# Grasshopper definition colors.gh (Grasshopper 1.0.8)
# Copyright: GNU Lesser General Public License Version 3
# plug-ins: ColorPlus

panel = Panel("""0
0.5
1""")
number_slider = Slider(11, range=0..15)
panel_2 = Panel("""#001117
#7B827D
#F7F3E3""")
col = Colour("#001117")
col_2 = Colour("#f7f3e3")
panel_3 = Panel("""0
0.33
0.66
1""")
panel_4 = Panel("""0
0.25
0.5
0.75
1""")
expression = Expression(x=number_slider, Expression="1/(x-1)")
panel_5 = Panel("""0
0.125
0.25
0.375
0.5
0.625
0.75
0.875
1""")
panel_6 = Panel("""#001117
#3E494A
#B9BAB0
#F7F3E3""")
panel_7 = Panel("""#001117
#243235
#7B827D
#D3D2C5
#F7F3E3""")
panel_8 = Panel("""#001117
#091A1F
#243235
#4C5756
#7B827D
#ABADA4
#D3D2C5
#EEEADB
#F7F3E3""")
series = Series(Start=0, Step=expression, Count=number_slider)
panel_10 = Panel("""0
0.16
0.33
0.5
0.66
0.83
1.0""")
panel_11 = Panel("""0
0.14
0.29
0.43
0.57
0.71
0.86
1.0""")
panel_12 = Panel("""0
0.2
0.4
0.6
0.8
1""")
panel_13 = Panel("""dark
0.1
0.2
0.3
0.4
grey
0.6
0.7
0.8
0.9
light""")
panel_15 = Panel("""#001117
#0C1C21
#2E3C3D
#606966
#979B94
#C9C8BD
#EBE8D9
#F7F3E3""")
panel_16 = Panel("""#001117
#18272A
#555F5D
#A2A59D
#DFDDD0
#F7F3E3""")
panel_17 = Panel("""#001117
#112025
#3E494A
#7B827D
#B9BAB0
#E6E4D5
#F7F3E3""")
gradient = Gradient(LowerLimit=0, UpperLimit=1, Parameter=series, stops=[0: RGB(0, 17, 23), 1: RGB(247, 243, 227)])
panel_18 = Panel("""0
0.11
0.22
0.33
0.44
0.55
0.66
0.77
0.88
1""")
panel_19 = Panel("""0
0.1
0.2
0.3
0.4
0.5
0.6
0.7
0.8
0.9
1.0""")
panel_20 = Panel("""#001117
#06171C
#18272A
#334041
#555F5D
#7B827D
#A2A59D
#C4C4B9
#DFDDD0
#F1EDDE
#F7F3E3""")
panel_21 = Panel("""#001117
#07181D
#1D2B2F
#3E494A
#666E6B
#91968F
#B9BBB0
#DAD9CB
#F0ECDD
#F7F3E3""")
col_3 = Colour(gradient)
tohex = ToHex(Color=col_3)
panel_23 = Panel(series)
txt = Text(tohex)
panel_24 = Panel(txt)
expression_2 = Expression(Expression="1/10")
expression_3 = Expression(Expression="1/7")
expression_4 = Expression(Expression="1/6")
expression_5 = Expression(Expression="1/9")
expression_6 = Expression(Expression="1/8")
panel_25 = Panel("""10
9
8
7
6""")
expression_7 = Expression(x=panel_25, Expression="x+1")
merge = Merge(Data1=expression_2, Data2=expression_5, Data3=expression_6, Data4=expression_3, Data5=expression_4)
panel_26 = Panel("1")
panel_27 = Panel(merge)
series_2 = Series(Start=0, Step=1, Count=expression_7)
series_3 = Series(Start=0, Step=merge, Count=expression_7)
concat = Concatenate(FragmentA=series_2, FragmentB="-", FragmentC=graft(panel_25))
trim = TrimTree(Tree=series_3, Depth=1)
concat_2 = Concatenate()
pt = ConstructPoint(XCoordinate=trim, YCoordinate=0, ZCoordinate=0)
trim_2 = TrimTree(Tree=concat, Depth=1)
cullpt = CullDuplicates(Points=pt, Tolerance="0.0001", CullMode=3)  # -> Points, Indices, Valence
panel_28 = Panel(concat)
item = ListItem(List=trim_2, Index=cullpt.Indices, Wrap=True)
pdecon = Deconstruct(Point=cullpt.Points)  # -> XComponent, YComponent, ZComponent
sort = SortList(Keys=pdecon.XComponent, ValuesA=item)  # -> Keys, ValuesA
num = Number()
panel_29 = Panel(sort.Keys)
panel_30 = Panel(sort.ValuesA)
panel_31 = Panel("""dark
dark-9-10
dark-8-9
dark-7-8
dark-6-7
dark-5-6
dark-4-5
dark-7-9
dark-grey
2-7
3-10
6-6
3-8
4-10
3-7
4-9
grey
5-9
4-7
6-10
5-8
6-6
7-10
5-7
light-grey
light-7-9
light-8-10
light-5-6
light-6-7
light-7-8
light-8-9
light-9-10
light""")
panel_33 = Panel("""dark-9-10
dark-8-9
dark-7-8
dark-6-7
dark-5-6
dark-4-5
2-9
2-8
2-7
3-10
6-6
3-8
4-10
3-7
4-9""")
