# Grasshopper definition nakagincapsuletower.gh (Grasshopper 1.0.7)
# plug-ins: semio, Swiftlet

number_slider = Slider(350, range=250..500)
number_slider_2 = Slider(250, range=250..500)
genes = GenePool(Decimals=0, Maximum=20, Minimum=0, Value=[2, 5, 8])
customize = BooleanToggle(False)
curdir = CurrentDirectory()  # -> D, P
# ---------- curdir: Python ----------
#Component Information
#--------------------------------------------------------------------------------------------
if ghenv.Component.RunCount<2:
    #General
    #--------------------------------------------------------------------------------------------
    __author__ = "Ueli Saluz"
    __version__ = "2023.09.29"
    
    ghenv.Component.Name = "CurrentDirectory"
    ghenv.Component.NickName = "CurDir"
    ghenv.Component.Description = "Current directory of the current grasshopper file."
    ghenv.Component.Message = "VER 1.0"
    ghenv.Component.Category = "Params"
    ghenv.Component.SubCategory = "Util"
    
    #Outputs
    #--------------------------------------------------------------------------------------------
    outputIndex=0
    
    ghenv.Component.Params.Output[outputIndex].Name = "Directory"
    ghenv.Component.Params.Output[outputIndex].NickName = "D"
    ghenv.Component.Params.Output[outputIndex].Description = "Directory of the current grasshopper file."
    outputIndex+=1
    
    ghenv.Component.Params.Output[outputIndex].Name = "Path"
    ghenv.Component.Params.Output[outputIndex].NickName = "P"
    ghenv.Component.Params.Output[outputIndex].Description = "Path of the current grasshopper file."
    outputIndex+=1


#Imports
#--------------------------------------------------------------------------------------------
from os.path import dirname

#Solver - Run with trees to enhance performance drastically
#--------------------------------------------------------------------------------------------
if __name__ == "__main__":
    P = ghenv.Component.OnPingDocument().FilePath
    D = dirname(P)
# ---------- end curdir ----------
toggle = BooleanToggle(False)
toggle_2 = BooleanToggle(True)
toggle_3 = BooleanToggle(True)
toggle_4 = BooleanToggle(False)
merge = Merge(
    Data1=toggle_2,
    Data2=toggle,
    Data3=toggle,
    Data4=toggle,
    Data5=toggle_2,
    Data6=toggle_2,
    Data7=toggle,
    Data8=toggle_2,
    Data9=toggle,
    Data10=toggle_2)
repeat = RepeatData(Data=Toggle(False), Length="9")
concat = Concatenate(FragmentA=curdir.D, FragmentB="\", FragmentC="base.gh")

# ---- group: base
sobject = ConstructSobject(Plan=concat)
link = ConstructLink(Ports="Primary")
link_2 = ConstructLink(Ports="Secondary")
connectable = ConstructConnectable(Sobject=sobject, Link=link)
connectable_2 = ConstructConnectable(Sobject=sobject, Link=link_2)

# ----
concat_2 = Concatenate(FragmentA=curdir.D, FragmentB="\", FragmentC="shaft.gh")
concat_3 = Concatenate(FragmentA=curdir.D, FragmentB="\", FragmentC="capital.gh")
concat_4 = Concatenate(FragmentA=curdir.D, FragmentB="\", FragmentC="capsule.gh")
concat_5 = Concatenate(FragmentA=curdir.D, FragmentB="\", FragmentC="bridge.gh")
repeat_2 = RepeatData(Data=Toggle(False), Length="11")
merge_2 = Merge(
    Data1=toggle_4,
    Data2=toggle_3,
    Data3=toggle_3,
    Data4=toggle_4,
    Data5=toggle_3,
    Data6=toggle_4,
    Data7=toggle_4,
    Data8=toggle_4,
    Data9=toggle_3)

# ---- group: base
sobject_2 = ConstructSobject(Plan=concat)
link_3 = ConstructLink(Ports="Primary")
link_4 = ConstructLink(Ports="Secondary")
connectable_3 = ConstructConnectable(Sobject=sobject_2, Link=link_3)
connectable_4 = ConstructConnectable(Sobject=sobject_2, Link=link_4)

# ----
trim = TrimTree(Tree=repeat, Depth=1)
bool = Boolean(invert(merge))
trim_2 = TrimTree(Tree=repeat_2, Depth=1)
bool_2 = Boolean(invert(trim))
merge_3 = Merge(
    Data1=toggle_4,
    Data2=toggle_4,
    Data3=toggle_4,
    Data4=toggle_4,
    Data5=toggle_4,
    Data6=toggle_4,
    Data7=toggle_4,
    Data8=toggle_3,
    Data9=toggle_3)
merge_4 = Merge(Data1=merge, Data2=toggle)
merge_5 = Merge(Data1=bool, Data2=toggle)
bool_3 = Boolean(invert(trim_2))
bool_4 = Boolean(invert(merge_2))
list = ValueList({"Front", "Right", "Bottom", "Left"}, selected="Bottom")
concat_6 = Concatenate(FragmentA=curdir.D, FragmentB="\", FragmentC="bouleenewtoncapsule.gh")
capsuletower = CapsuleTower(
    shafturi=concat_2,
    capsuleuri=concat_4,
    bridgeuri=concat_5,
    numberoffloors="11",
    bridge=list,
    bridgelevels=genes,
    largetower=Toggle(True),
    customize=customize,
    floorheight=number_slider,
    capsuleheight=number_slider_2,
    entrancepatternnorth1=merge_4,
    entrancepatternfront2=trim_2,
    entrancepatterneast1=bool_3,
    entrancepatterneast2=bool_3,
    entrancepatternsouth1=trim_2,
    entrancepatternsouth2=trim_2,
    entrancepatternwest1=bool_3,
    entrancepatternwest2=merge_5,
    windowpatternnorth1=trim_2,
    windowpatternfront2=trim_2,
    windowpatterneast1=trim_2,
    windowpatterneast2=trim_2,
    windowpatternsouth1=trim_2,
    windowpatternsouth2=trim_2,
    windowpatternwest1=bool_3,
    windowpatternwest2=trim_2)  # -> so_2, C_2
capsuletower_2 = CapsuleTower(
    shafturi=concat_2,
    capsuleuri=concat_4,
    numberoffloors="9",
    bridge=list,
    bridgelevels=genes,
    largetower=Toggle(False),
    customize=customize,
    floorheight=number_slider,
    capsuleheight=number_slider_2,
    entrancepatternnorth1=trim,
    entrancepatternfront2=merge_2,
    entrancepatterneast1=bool_4,
    entrancepatterneast2=trim,
    entrancepatternsouth1=bool_2,
    entrancepatternsouth2=trim,
    entrancepatternwest1=bool_2,
    entrancepatternwest2=bool_2,
    windowpatternnorth1=trim,
    windowpatternfront2=trim,
    windowpatterneast1=trim,
    windowpatterneast2=trim,
    windowpatternsouth1=merge_3,
    windowpatternsouth2=trim,
    windowpatternwest1=trim,
    windowpatternwest2=trim)  # -> so_2, C_2
capsuletower_3 = CapsuleTower(
    shafturi=concat_2,
    capsuleuri=concat_4,
    numberoffloors="11",
    bridge=list,
    customize=customize,
    floorheight=number_slider,
    capsuleheight=number_slider_2,
    entrancepatternnorth1=trim_2,
    entrancepatternfront2=trim_2,
    entrancepatterneast1=bool_3,
    entrancepatterneast2=bool_3,
    entrancepatternsouth1=trim_2,
    entrancepatternsouth2=trim_2,
    entrancepatternwest1=trim_2,
    entrancepatternwest2=trim_2,
    windowpatternnorth1=trim_2,
    windowpatternfront2=trim_2,
    windowpatterneast1=trim_2,
    windowpatterneast2=trim_2,
    windowpatternsouth1=trim_2,
    windowpatternsouth2=trim_2,
    windowpatternwest1=trim_2,
    windowpatternwest2=trim_2)  # -> so_2, C_2
capsuletower_4 = CapsuleTower(
    shafturi=concat_2,
    capsuleuri=concat_4,
    numberoffloors="9",
    bridge=list,
    customize=customize,
    floorheight=number_slider,
    capsuleheight=number_slider_2,
    entrancepatternnorth1=trim,
    entrancepatternfront2=trim,
    entrancepatterneast1=trim,
    entrancepatterneast2=trim,
    entrancepatternsouth1=trim,
    entrancepatternsouth2=trim,
    entrancepatternwest1=bool_2,
    entrancepatternwest2=bool_2,
    windowpatternnorth1=trim,
    windowpatternfront2=trim,
    windowpatterneast1=trim,
    windowpatterneast2=trim,
    windowpatternsouth1=trim,
    windowpatternsouth2=trim,
    windowpatternwest1=trim,
    windowpatternwest2=trim)  # -> so_2, C_2
capsuletower_5 = CapsuleTower(
    shafturi=concat_2,
    capsuleuri=concat_4,
    numberoffloors="11",
    bridge=list,
    customize=customize,
    floorheight=number_slider,
    capsuleheight=number_slider_2,
    entrancepatternnorth1=trim_2,
    entrancepatternfront2=trim_2,
    entrancepatterneast1=trim_2,
    entrancepatterneast2=trim_2,
    entrancepatternsouth1=trim_2,
    entrancepatternsouth2=trim_2,
    entrancepatternwest1=trim_2,
    entrancepatternwest2=trim_2,
    windowpatternnorth1=trim_2,
    windowpatternfront2=trim_2,
    windowpatterneast1=trim_2,
    windowpatterneast2=trim_2,
    windowpatternsouth1=trim_2,
    windowpatternsouth2=trim_2,
    windowpatternwest1=trim_2,
    windowpatternwest2=trim_2)  # -> so_2, C_2
list_2 = ValueList({"Small Tower": 0, "Tower Ensemble": 1, "Nakgin Capsule Tower": 2}, selected="Nakgin Capsule Tower")
item = ListItem(List=capsuletower.so_2, Index=0, Wrap=True)

# ---- group: primary shaft captial
xy = XYPlane(Origin=Point(0, 0, 0))
prot = RotatePlane(Plane=xy, Angle=degrees("-90"))
plan = ConstructPlan(Uri=concat_3)  # -> Plan, Hash
sobject_3 = ConstructSobject(Pose=prot, Plan=plan.Plan)

# ----
item_2 = ListItem(List=capsuletower_3.so_2, Index=0, Wrap=True)
item_3 = ListItem(List=capsuletower_2.so_2, Index=0, Wrap=True)

# ---- group: primary shaft captial
xy_2 = XYPlane(Origin=Point(0, 0, 0))
prot_2 = RotatePlane(Plane=xy_2, Angle=degrees("-90"))
plan_2 = ConstructPlan(Uri=concat_3)  # -> Plan, Hash
sobject_4 = ConstructSobject(Pose=prot_2, Plan=plan_2.Plan)

# ----
item_4 = ListItem(List=capsuletower_4.so_2, Index=0, Wrap=True)
run = Boolean(Toggle(True))
server = Text("http://localhost:2999")
clrcache = ClearCache(Run=Button())

# ---- group: primary shaft captial
xy_3 = XYPlane(Origin=Point(0, 0, 0))
prot_3 = RotatePlane(Plane=xy_3, Angle=degrees("-90"))
plan_3 = ConstructPlan(Uri=concat_3)  # -> Plan, Hash
sobject_5 = ConstructSobject(Pose=prot_3, Plan=plan_3.Plan)

# ----
link_5 = ConstructLink(Ports="Top")
link_6 = ConstructLink(Ports="Bottom")
link_7 = ConstructLink(Ports="Top")
link_8 = ConstructLink(Ports="Bottom")
link_9 = ConstructLink(Ports="Top")
item_5 = ListItem(List=capsuletower_5.so_2, Index=0, Wrap=True)
connectable_5 = ConstructConnectable(Sobject=item, Link=link_5)
connectable_6 = ConstructConnectable(Sobject=item, Link=link_6)
sobject_6 = ConstructSobject(Pose=prot, Plan=plan.Plan)
connectable_7 = ConstructConnectable(Sobject=item_3, Link=link_5)
connectable_8 = ConstructConnectable(Sobject=item_3, Link=link_6)
connectable_9 = ConstructConnectable(Sobject=item_2, Link=link_7)
connectable_10 = ConstructConnectable(Sobject=item_2, Link=link_8)
connectable_11 = ConstructConnectable(Sobject=item_5, Link=link_9)
connectable_12 = ConstructConnectable(Sobject=item_4, Link=link_7)
fjs = FormatJsonString(JSONString=item_5)
connectable_13 = ConstructConnectable(Sobject=item_4, Link=link_8)
sobject_7 = ConstructSobject(Pose=prot_3, Plan=plan_3.Plan)
connection = ConstructConnection(Connecting=connectable_6, Connected=connectable)
connection_2 = ConstructConnection(Connecting=sobject_3, Connected=connectable_5)
merge_6 = Merge(Data1=sobject_3, Data2=sobject_6)
connection_3 = ConstructConnection(Connecting=sobject_6, Connected=connectable_7)
connection_4 = ConstructConnection(Connecting=connectable_8, Connected=connectable_2)
connection_5 = ConstructConnection(Connecting=connectable_10, Connected=connectable_3)
connection_6 = ConstructConnection(Connecting=sobject_5, Connected=connectable_9)
connection_7 = ConstructConnection(Connecting=sobject_7, Connected=connectable_12)
connection_8 = ConstructConnection(Connecting=sobject_4, Connected=connectable_11)
connection_9 = ConstructConnection(Connecting=connectable_13, Connected=connectable_4)
so = Sobject(item_2)
merge_7 = Merge(Data1=sobject_5, Data2=sobject_7)
merge_8 = Merge(Data1=connection_8)
merge_9 = Merge(Data1=connection_2, Data2=connection_3)
merge_10 = Merge(Data1=connection, Data2=connection_4)
merge_11 = Merge(Data1=connection_6, Data2=connection_7)
merge_12 = Merge(Data1=connection_5, Data2=connection_9)
merge_13 = Merge(Data1=sobject, Data2=capsuletower.so_2, Data3=capsuletower_2.so_2, Data4=merge_6)
merge_14 = Merge(Data1=capsuletower_5.so_2, Data2=sobject_4)
merge_15 = Merge(Data1=capsuletower_5.C_2, Data2=merge_8)
merge_16 = Merge(Data1=merge_10, Data2=capsuletower.C_2, Data3=capsuletower_2.C_2, Data4=merge_9)
merge_17 = Merge(Data1=merge_12, Data2=capsuletower_3.C_2, Data3=capsuletower_4.C_2, Data4=merge_11)
merge_18 = Merge(Data1=sobject_2, Data2=capsuletower_3.so_2, Data3=capsuletower_4.so_2, Data4=merge_7)
filter = StreamFilter(Gate=list_2, Stream0=run)
layout = ConstructLayout(Sobjects=merge_14, Connections=merge_15, Assembly=item_5)
filter_2 = StreamFilter(Gate=list_2, Stream2=run)
layout_2 = ConstructLayout(Sobjects=merge_13, Connections=merge_16, Assembly=sobject)
layout_design = LayoutDesign(Url=server, Layout=layout, Run=filter)
filter_3 = StreamFilter(Gate=list_2, Stream1=run)
layout_3 = ConstructLayout(Sobjects=merge_18, Connections=merge_17, Assembly=sobject_2)
layout_design_2 = LayoutDesign(Url=server, Layout=layout_2, Run=filter_2)
layout_design_3 = LayoutDesign(Url=server, Layout=layout_3, Run=filter_3)
filter_4 = StreamFilter(Gate=list_2, Stream0=layout_design, Stream1=layout_design_3, Stream2=layout_design_2)
cluster = Cluster(D=filter_4)  # -> geo_2, planhash_2, centroid_2
wires = BrepWireframe(Brep=cluster.geo_2, Density=-1)
jagged = SettingsSpeed()
trim_3 = TrimTree(Tree=wires, Depth=1)
mesh = MeshBrep(Brep=flatten(cluster.geo_2), Settings=jagged)
panel = Panel("""30
31
33
36
37
167""")
preview = CustomPreview(Geometry=flatten(cluster.geo_2), Material=ColourSwatch(SwatchColor=RGB(255, 255, 255)))
preview_2 = CustomPreview(Geometry=flatten(trim_3), Material=ColourSwatch(SwatchColor=RGB(0, 0, 0)))
item_6 = ListItem(List=mesh, Index=panel, Wrap=True)
panel_2 = Panel(mesh)

# ==== cluster CapsuleTower
capsuleheight = ClusterInput()
entrancepatternsouth1 = ClusterInput()
entrancepatternsouth2 = ClusterInput()
entrancepatternnorth1 = ClusterInput()
entrancepatterneast2 = ClusterInput()
entrancepatternwest1 = ClusterInput()
entrancepatternwest2 = ClusterInput()
entrancepatternfront2 = ClusterInput()
entrancepatterneast1 = ClusterInput()
windowpatternnorth1 = ClusterInput()
windowpatternsouth1 = ClusterInput()
windowpatternsouth2 = ClusterInput()
windowpatternfront2 = ClusterInput()
windowpatternwest1 = ClusterInput()
windowpatterneast2 = ClusterInput()
windowpatterneast1 = ClusterInput()
windowpatternwest2 = ClusterInput()
capsuleheight_2 = Number(capsuleheight)
list = ValueList({"Round", "Rectangular"}, selected="Round")
entrancepatternnorth1_2 = Integer(entrancepatternnorth1)
entrancepatterneast2_2 = Integer(entrancepatterneast2)
entrancepatterneast1_2 = Integer(entrancepatterneast1)
entrancepatternsouth2_2 = Integer(entrancepatternsouth2)
entrancepatternfront2_2 = Integer(entrancepatternfront2)
entrancepatternsouth1_2 = Integer(entrancepatternsouth1)
entrancepatternwest1_2 = Integer(entrancepatternwest1)
entrancepatternwest2_2 = Integer(entrancepatternwest2)
windowpatternnorth1_2 = Integer(windowpatternnorth1)
windowpatterneast2_2 = Integer(windowpatterneast2)
windowpatterneast1_2 = Integer(windowpatterneast1)
windowpatternsouth2_2 = Integer(windowpatternsouth2)
windowpatternfront2_2 = Integer(windowpatternfront2)
windowpatternwest1_2 = Integer(windowpatternwest1)
windowpatternsouth1_2 = Integer(windowpatternsouth1)
windowpatternwest2_2 = Integer(windowpatternwest2)
parameter = ConstructParameter(Name="Height", Value=capsuleheight_2)
panel = Panel("""Back
Side""")
panel_2 = Panel("""Back
Side""")
list_2 = ValueList({"Front", "Side"}, selected="Front")
parameter_2 = ConstructParameter(Name="WindowShape", Value=list)
parameter_3 = ConstructParameter(Name="Length", Value=Slider(400, range=0..1000))
list_3 = ValueList({"Back", "Side"}, selected="Side")
parameter_4 = ConstructParameter(Name="Length", Value=Slider(420, range=0..1000))
parameter_5 = ConstructParameter(Name="Mirror", Value=Toggle(True))
item = ListItem(List=panel, Index=entrancepatternnorth1_2, Wrap=True)  # -> graft(Item)
item_2 = ListItem(List=panel, Index=entrancepatternfront2_2, Wrap=True)  # -> graft(Item)
item_3 = ListItem(List=panel, Index=entrancepatterneast1_2, Wrap=True)  # -> graft(Item)
item_4 = ListItem(List=panel, Index=entrancepatterneast2_2, Wrap=True)  # -> graft(Item)
item_5 = ListItem(List=panel, Index=entrancepatternsouth1_2, Wrap=True)  # -> graft(Item)
item_6 = ListItem(List=panel, Index=entrancepatternsouth2_2, Wrap=True)  # -> graft(Item)
item_7 = ListItem(List=panel, Index=entrancepatternwest1_2, Wrap=True)  # -> graft(Item)
item_8 = ListItem(List=panel, Index=entrancepatternwest2_2, Wrap=True)  # -> graft(Item)
parameter_6 = ConstructParameter(Name="Width", Value=Slider(270, range=0..1000))
item_9 = ListItem(List=panel_2, Index=windowpatternnorth1_2, Wrap=True)  # -> graft(Item)
item_10 = ListItem(List=panel_2, Index=windowpatternfront2_2, Wrap=True)  # -> graft(Item)
item_11 = ListItem(List=panel_2, Index=windowpatterneast1_2, Wrap=True)  # -> graft(Item)
item_12 = ListItem(List=panel_2, Index=windowpatterneast2_2, Wrap=True)  # -> graft(Item)
parameter_7 = ConstructParameter(Name="Height", Value=Slider(275, range=0..1000))
item_13 = ListItem(List=panel_2, Index=windowpatternsouth1_2, Wrap=True)  # -> graft(Item)
item_14 = ListItem(List=panel_2, Index=windowpatternsouth2_2, Wrap=True)  # -> graft(Item)
item_15 = ListItem(List=panel_2, Index=windowpatternwest1_2, Wrap=True)  # -> graft(Item)
item_16 = ListItem(List=panel_2, Index=windowpatternwest2_2, Wrap=True)  # -> graft(Item)
parameter_8 = ConstructParameter(Name="Entrance", Value=list_3)
parameter_9 = ConstructParameter(Name="Window", Value=list_2)
parameter_10 = ConstructParameter(Name="Entrance", Value=item)
parameter_11 = ConstructParameter(Name="Entrance", Value=item_2)
parameter_12 = ConstructParameter(Name="Entrance", Value=item_3)
parameter_13 = ConstructParameter(Name="Entrance", Value=item_4)
parameter_14 = ConstructParameter(Name="Entrance", Value=item_5)
parameter_15 = ConstructParameter(Name="Entrance", Value=item_6)
parameter_16 = ConstructParameter(Name="Entrance", Value=item_7)
parameter_17 = ConstructParameter(Name="Entrance", Value=item_8)
parameter_18 = ConstructParameter(Name="Window", Value=item_9)
parameter_19 = ConstructParameter(Name="Window", Value=item_10)
parameter_20 = ConstructParameter(Name="Window", Value=item_11)
parameter_21 = ConstructParameter(Name="Window", Value=item_12)
parameter_22 = ConstructParameter(Name="Window", Value=item_13)
parameter_23 = ConstructParameter(Name="Window", Value=item_14)
parameter_24 = ConstructParameter(Name="Window", Value=item_15)
parameter_25 = ConstructParameter(Name="Window", Value=item_16)
list_4 = ValueList({"Front", "Right", "Bottom", "Left"}, selected="Bottom")
numberoffloors = ClusterInput()
largetower = ClusterInput()
bridgelevels = ClusterInput()
customize = ClusterInput()
bridgeuri = ClusterInput()
capsuleuri = ClusterInput()
floorheight = ClusterInput()
shafturi = ClusterInput()
bridge = ClusterInput()
xy = XYPlane(Origin=Point(0, 0, 0))
shafturi_2 = Text(shafturi)
numberoffloors_2 = Integer(numberoffloors)
capsuleuri_2 = Text(capsuleuri)
bridgeuri_2 = Text(bridgeuri)
bridge_2 = Text(bridge)
largetower_2 = Boolean(largetower)
bridgelevels_2 = Integer(bridgelevels)
customize_2 = Boolean(customize)
filter = StreamFilter(Gate=customize_2, Stream1=parameter)
merge = Merge(Data2=parameter_2, Data3=parameter_3, Data4=filter)
commonmirror = Parameter([parameter_5, merge])
common = Parameter(merge)
dup = DuplicateData(Data=graft(common), Number=numberoffloors_2, Order=True)
dup_2 = DuplicateData(Data=graft(commonmirror), Number=numberoffloors_2, Order=True)
floorheight_2 = Number(floorheight)
trim = TrimTree(Tree=dup, Depth=1)
trim_2 = TrimTree(Tree=dup_2, Depth=1)
flip = FlipMatrix(Data=trim)
flip_2 = FlipMatrix(Data=trim_2)
series = Series(Start=0, Step=1, Count=numberoffloors_2)
link = ConstructLink(Ports="Door")
merge_2 = Merge(Data1=flip)
merge_3 = Merge(Data1=flip_2)
trim_3 = TrimTree(Tree=series, Depth=1)
parameter_26 = ConstructParameter(Name="Floor", Value=bridgelevels_2)  # -> graft(Parameter)
parameter_27 = ConstructParameter(Name="Floor", Value=trim_3)  # -> graft(Parameter)
link_2 = ConstructLink(Bias=parameter_27)
parameter_28 = ConstructParameter(Name="Floors", Value=numberoffloors_2)
parameter_29 = ConstructParameter(Name="SplitLevel", Value="1")
parameter_30 = ConstructParameter(Name="SplitLevel", Value="2")
parameter_31 = ConstructParameter(Name="SplitLevel", Value="1")
parameter_32 = ConstructParameter(Name="Door", Value="1")
parameter_33 = ConstructParameter(Name="Door", Value="2")
parameter_34 = ConstructParameter(Name="Door", Value="3")
expression = Expression(x=parameter_34, y=parameter_26, Expression="x")
link_3 = ConstructLink(Bias=[parameter_26, expression])
parameter_35 = ConstructParameter(Name="SecondDoor", Value="1")
parameter_36 = ConstructParameter(Name="Bridge", Value=bridge_2)
prot = RotatePlane(Plane=xy, Angle=degrees("180"))
parameter_37 = ConstructParameter(Name="FloorHeight", Value=floorheight_2)
prot_2 = RotatePlane(Plane=xy, Angle=degrees("90"))
prot_3 = RotatePlane(Plane=xy, Angle=degrees("-90"))
expression_2 = Expression(x=parameter_31, y=parameter_27, Expression="x")
expression_3 = Expression(x=parameter_32, y=parameter_27, Expression="x")
expression_4 = Expression(x=parameter_30, y=parameter_27, Expression="x")
expression_5 = Expression(x=parameter_29, y=parameter_27, Expression="x")
expression_6 = Expression(x=parameter_33, y=parameter_27, Expression="x")
filter_2 = StreamFilter(Gate=customize_2, Stream1=parameter_37)
merge_4 = Merge(Data1=parameter_35, Data2=parameter_36, Data3=parameter_28, Data4=filter_2)
expression_7 = Expression(x=parameter_34, y=parameter_27, Expression="x")
merge_5 = Merge(Data1=merge_3, Data2=parameter_10, Data3=parameter_18)
merge_6 = Merge(Data1=merge_3, Data2=parameter_14, Data3=parameter_22)
merge_7 = Merge(Data1=merge_2, Data2=parameter_11, Data3=parameter_19)
merge_8 = Merge(Data1=merge_3, Data2=parameter_16, Data3=parameter_24)
merge_9 = Merge(Data1=merge_2, Data2=parameter_13, Data3=parameter_21)
merge_10 = Merge(Data1=merge_3, Data2=parameter_12, Data3=parameter_20)
merge_11 = Merge(Data1=merge_2, Data2=parameter_17, Data3=parameter_25)
merge_12 = Merge(Data1=merge_2, Data2=parameter_15, Data3=parameter_23)
link_4 = ConstructLink(Bias=[parameter_27, expression_4])
plan = ConstructPlan(Uri=shafturi_2, Parameters=merge_4)  # -> Plan, Hash
link_5 = ConstructLink(Bias=[parameter_27, expression_5, expression_3])
link_6 = ConstructLink(Bias=[parameter_27, expression_6])
link_7 = ConstructLink(Bias=[parameter_27, expression_2])
link_8 = ConstructLink(Bias=[parameter_27, expression_7])
plan_2 = ConstructPlan(Uri=capsuleuri_2, Parameters=merge_5)  # -> Plan, Hash
link_9 = ConstructLink(Bias=[parameter_27, expression_6, expression_3])
link_10 = ConstructLink(Bias=parameter_27)
plan_3 = ConstructPlan(Uri=capsuleuri_2, Parameters=merge_7)  # -> Plan, Hash
plan_4 = ConstructPlan(Uri=capsuleuri_2, Parameters=merge_9)  # -> Plan, Hash
plan_5 = ConstructPlan(Uri=capsuleuri_2, Parameters=merge_12)  # -> Plan, Hash
plan_6 = ConstructPlan(Uri=capsuleuri_2, Parameters=merge_11)  # -> Plan, Hash
plan_7 = ConstructPlan(Uri=capsuleuri_2, Parameters=merge_10)  # -> Plan, Hash
plan_8 = ConstructPlan(Uri=capsuleuri_2, Parameters=merge_6)  # -> Plan, Hash
link_11 = ConstructLink(Bias=[parameter_27, expression_3, expression_4])
plan_9 = ConstructPlan(Uri=capsuleuri_2, Parameters=merge_8)  # -> Plan, Hash
sobject = ConstructSobject(Plan=plan.Plan)
connectable = ConstructConnectable(Sobject=sobject, Link=link_3)
trim_4 = TrimTree(Tree=connectable, Depth=1)
connectable_2 = ConstructConnectable(Sobject=sobject, Link=link_4)
sobject_2 = ConstructSobject(Plan=plan_2.Plan)
sobject_3 = ConstructSobject(Pose=prot_3, Plan=plan_4.Plan)
connectable_3 = ConstructConnectable(Sobject=sobject, Link=link_5)
sobject_4 = ConstructSobject(Plan=plan_3.Plan)
connectable_4 = ConstructConnectable(Sobject=sobject, Link=link_6)
connectable_5 = ConstructConnectable(Sobject=sobject, Link=link_7)
sobject_5 = ConstructSobject(Pose=prot, Plan=plan_8.Plan)
connectable_6 = ConstructConnectable(Sobject=sobject, Link=link_9)
connectable_7 = ConstructConnectable(Sobject=sobject, Link=link_8)
sobject_6 = ConstructSobject(Pose=prot_2, Plan=plan_6.Plan)
sobject_7 = ConstructSobject(Pose=prot, Plan=plan_5.Plan)
sobject_8 = ConstructSobject(Pose=prot_3, Plan=plan_7.Plan)
connectable_8 = ConstructConnectable(Sobject=sobject, Link=link_10)
sobject_9 = ConstructSobject(Pose=prot_2, Plan=plan_9.Plan)
connectable_9 = ConstructConnectable(Sobject=sobject, Link=link_11)
connectable_10 = ConstructConnectable(Sobject=sobject_2, Link=link)
connectable_11 = ConstructConnectable(Sobject=sobject_4, Link=link)
connection = ConstructConnection(Connecting=connectable_10, Connected=connectable_2)
connection_2 = ConstructConnection(Connecting=connectable_11, Connected=connectable_3)
connectable_12 = ConstructConnectable(Sobject=sobject_3, Link=link)
connectable_13 = ConstructConnectable(Sobject=sobject_8, Link=link)
connectable_14 = ConstructConnectable(Sobject=sobject_5, Link=link)
connection_3 = ConstructConnection(Connecting=connectable_14, Connected=connectable_4)
connection_4 = ConstructConnection(Connecting=connectable_13, Connected=connectable_5)
connectable_15 = ConstructConnectable(Sobject=sobject_7, Link=link)
connectable_16 = ConstructConnectable(Sobject=sobject_9, Link=link)
connectable_17 = ConstructConnectable(Sobject=sobject_6, Link=link)
connection_5 = ConstructConnection(Connecting=connectable_15, Connected=connectable_6)
connection_6 = ConstructConnection(Connecting=connectable_12, Connected=connectable_7)
connection_7 = ConstructConnection(Connecting=connectable_16, Connected=connectable_8)
connection_8 = ConstructConnection(Connecting=connectable_17, Connected=connectable_9)
trim_5 = TrimTree(Tree=sobject_8, Depth=1)
trim_6 = TrimTree(Tree=sobject_4, Depth=1)
trim_7 = TrimTree(Tree=sobject_5, Depth=1)
trim_8 = TrimTree(Tree=sobject_9, Depth=1)
trim_9 = TrimTree(Tree=sobject_2, Depth=1)
trim_10 = TrimTree(Tree=sobject_6, Depth=1)
trim_11 = TrimTree(Tree=sobject_7, Depth=1)
trim_12 = TrimTree(Tree=sobject_3, Depth=1)
trim_13 = TrimTree(Tree=connection, Depth=1)
trim_14 = TrimTree(Tree=connection_3, Depth=1)
trim_15 = TrimTree(Tree=connection_4, Depth=1)
trim_16 = TrimTree(Tree=connection_2, Depth=1)
trim_17 = TrimTree(Tree=connection_5, Depth=1)
trim_18 = TrimTree(Tree=connection_6, Depth=1)
trim_19 = TrimTree(Tree=connection_7, Depth=1)
trim_20 = TrimTree(Tree=connection_8, Depth=1)
lng = ListLength(List=bridgelevels_2)
panel_3 = Panel("""RightLength
LeftLength""")
cull_i = CullIndex(List=trim_8, Indices=bridgelevels_2, Wrap=True)
item_17 = ListItem(List=flatten(bridgelevels_2), Index=0, Wrap=True)
dup_3 = DuplicateData(Data=bridgeuri_2, Number=lng, Order=True)
trim_21 = TrimTree(Tree=cull_i, Depth=1)
cull_i_2 = CullIndex(List=trim_19, Indices=bridgelevels_2, Wrap=True)
null = NullItem(Item=item_17)  # -> NullFlags, InvalidFlags, Description
parameter_38 = ConstructParameter(Name=panel_3, Value=Slider(310, range=0..1000))
trim_22 = TrimTree(Tree=dup_3, Depth=1)
filter_3 = StreamFilter(Gate=largetower_2, Stream0=trim_21, Stream1=trim_8)
trim_23 = TrimTree(Tree=cull_i_2, Depth=1)
plan_10 = ConstructPlan(Uri=trim_22, Parameters=parameter_38)  # -> Plan, Hash
filter_4 = StreamFilter(Gate=largetower_2, Stream0=trim_23, Stream1=trim_19)
filter_5 = StreamFilter(Gate=null.NullFlags, Stream0=filter_3, Stream1=trim_8)
sobject_10 = ConstructSobject(Plan=plan_10.Plan)
replace = ReplaceItems(List=trim_12, Item=sobject_10, Indices=bridgelevels_2, Wrap=False)
trim_24 = TrimTree(Tree=replace, Depth=1)
filter_6 = StreamFilter(Gate=largetower_2, Stream0=trim_12, Stream1=trim_24)
filter_7 = StreamFilter(Gate=null.NullFlags, Stream0=filter_6, Stream1=trim_12)
merge_13 = Merge(Data1=trim_6, Data2=trim_10, Data3=trim_11, Data4=filter_7)
filter_8 = StreamFilter(Gate=null.NullFlags, Stream0=filter_4, Stream1=trim_19)
merge_14 = Merge(Data1=trim_9, Data2=trim_5, Data3=trim_7, Data4=filter_5)
connectable_18 = ConstructConnectable(Sobject=sobject_10)
connection_9 = ConstructConnection(Connecting=connectable_18, Connected=trim_4)
replace_2 = ReplaceItems(List=trim_18, Item=connection_9, Indices=bridgelevels_2, Wrap=False)
trim_25 = TrimTree(Tree=replace_2, Depth=1)
filter_9 = StreamFilter(Gate=largetower_2, Stream0=trim_18, Stream1=trim_25)
filter_10 = StreamFilter(Gate=null.NullFlags, Stream0=filter_9, Stream1=trim_18)
merge_15 = Merge(Data1=trim_13, Data2=filter_8, Data3=trim_14, Data4=trim_15)
merge_16 = Merge(Data1=trim_16, Data2=trim_20, Data3=trim_17, Data4=filter_10)
merge_17 = Merge(Data1=merge_14, Data2=merge_13)
merge_18 = Merge(Data1=merge_15, Data2=merge_16)
merge_19 = Merge(Data1=sobject, Data2=merge_17)
merge_20 = Merge(Data1=merge_18)
C = Connection(merge_20)
so = Sobject(merge_19)
layout = ConstructLayout(Sobjects=merge_19, Connections=merge_20, Assembly=sobject)
run = Boolean(Toggle(False))
server = Text("http://localhost:2999")
C_2 = ClusterOutput(C)
so_2 = ClusterOutput(so)
layout_design = LayoutDesign(Url=server, Layout=layout, Run=run)
design = ShowDesign(Design=layout_design, Concepts="All")
design_2 = ShowDesign(Design=layout_design, Concepts="Doors")
dedesign = DeconstructDesign(Design=layout_design)  # -> Prototypes, Elements

# ==== cluster Cluster
D = ClusterInput()
D_2 = Design(D)
dedesign = DeconstructDesign(Design=D_2)  # -> Prototypes, Elements
trim = TrimTree(Tree=dedesign.Elements, Depth=1)
trim_2 = TrimTree(Tree=dedesign.Prototypes, Depth=1)
viewer = ParamViewer(dedesign.Elements)
deelement = DeconstructElement(Element=trim)  # -> SobjectId, PlanHash, Pose
deprototype = DeconstructPrototype(Prototype=trim_2)  # -> PlanHash, Representations, Description
tstat = TreeStatistics(Tree=deprototype.Representations)  # -> Paths, Length, Count
hash = NAME(x=deprototype.PlanHash)  # -> h
# ---------- hash: Python ----------
#Component Information
#--------------------------------------------------------------------------------------------
if ghenv.Component.RunCount<2:
    #General
    #--------------------------------------------------------------------------------------------
    __author__ = "YOUR NAME"
    __version__ = "2000.00.00"
h = hash(x)
# ---------- end hash ----------
hash_2 = NAME(x=deelement.PlanHash)  # -> h; same code as hash
pln = Plane(deelement.Pose)
sort = SortList(Keys=hash, ValuesA=tstat.Paths)  # -> Keys, ValuesA
sort_2 = SortList(Keys=hash_2, ValuesA=pln, ValuesB=deelement.SobjectId)  # -> Keys, ValuesA, ValuesB
branch = TreeBranch(Tree=deprototype.Representations, Path=sort.ValuesA, MaintainPaths=False)
cset = CreateSet(List=sort_2.Keys)  # -> Set, Map
path = ConstructPath(Indices=graft(cset.Map))
item = ListItem(List=branch, Index=0, Wrap="False")  # -> Item, Item1
trim_3 = TrimTree(Tree=path, Depth=1)
relblbrch = RelabelBranches(TreeToMatch=graft(sort_2.ValuesA), ListOfPaths=trim_3)  # -> RelabeledTree; inputs TreeToMatch: tree, ListOfPaths: list; same code as relblbrch
imrepresentation = ImportRepresentation(Representation=item.Item)
trim_4 = TrimTree(Tree=imrepresentation, Depth=1)
pln_2 = Plane(relblbrch)
mtontreecopy = MtoNTreeCopy(tree=trim_4, targettree=pln_2)  # -> tree_4, targettree_4
pl2pl = MoveObjectPlaneToPlane(G=mtontreecopy.tree_4, S=PlaneXY(0, 0, 0), T=mtontreecopy.targettree_4)  # -> TG, T; inputs S: Plane, T: Plane
# ---------- pl2pl: Python ----------
#Component Information
#--------------------------------------------------------------------------------------------
if ghenv.Component.RunCount<2:
    #General
    #--------------------------------------------------------------------------------------------
    __author__ = "Ueli Saluz"
    __version__ = "2023.02.12"
    
    ghenv.Component.Name = "MoveObjectPlaneToPlane"
    ghenv.Component.NickName = "Pl2Pl"
    ghenv.Component.Description = "Moves abitrary geometry from a source plane to a target plane."
    ghenv.Component.Message = "VER 1.2"
    ghenv.Component.Category = "Transform"
    ghenv.Component.SubCategory = "Euclidean"
    
     #Inputs
    #--------------------------------------------------------------------------------------------
    inputIndex=0
    
    ghenv.Component.Params.Input[inputIndex].Name = "Geometry"
    ghenv.Component.Params.Input[inputIndex].NickName = "G"
    ghenv.Component.Params.Input[inputIndex].Description = "Geometry to move."
    ghenv.Component.Params.Input[inputIndex].Optional = False
    inputIndex+=1
    
    ghenv.Component.Params.Input[inputIndex].Name = "SourcePlane"
    ghenv.Component.Params.Input[inputIndex].NickName = "S"
    ghenv.Component.Params.Input[inputIndex].Description = "Source plane of object."
    ghenv.Component.Params.Input[inputIndex].Optional = False
    inputIndex+=1
    
    ghenv.Component.Params.Input[inputIndex].Name = "TargetPlane"
    ghenv.Component.Params.Input[inputIndex].NickName = "T"
    ghenv.Component.Params.Input[inputIndex].Description = "Target plane of object."
    ghenv.Component.Params.Input[inputIndex].Optional = False
    inputIndex+=1
    
    #Outputs
    #--------------------------------------------------------------------------------------------
    outputIndex=0
    
    ghenv.Component.Params.Output[outputIndex].Name = "TranslatedGeometry"
    ghenv.Component.Params.Output[outputIndex].NickName = "TG"
    ghenv.Component.Params.Output[outputIndex].Description = "Translated geometry in target plane."
    outputIndex+=1
    
    ghenv.Component.Params.Output[outputIndex].Name = "Trasnform"
    ghenv.Component.Params.Output[outputIndex].NickName = "T"
    ghenv.Component.Params.Output[outputIndex].Description = "Transform describing translation form source to target plane."
    outputIndex+=1


#Imports
#--------------------------------------------------------------------------------------------
import Rhino.Geometry.Transform as trsf

def MvObjPlnToPln (geo,plnObj,plnDest):
    transform = trsf.PlaneToPlane(plnObj,plnDest)
    geo.Transform(transform)
    return (geo,transform)

TG, T = MvObjPlnToPln(G,S,T)
# ---------- end pl2pl ----------
area = Area(Geometry=pl2pl.TG)  # -> Area, Centroid; disabled
avgp = AveragePoint(P=area.Centroid)  # -> AvP; inputs P: list of Point3d, M: list of Double; disabled
# ---------- avgp: C# usings ----------
using System.Linq;
# ---------- avgp: C# ----------
    //Author: Ueli Saluz
    //Last modified: 29.05.2020
    //Contact: usaluz@outlook.de

    if (Component.RunCount < 2)
    {
      Component.Name = "AveragePoint";
      Component.NickName = "AvgP";
      Component.Description = "Get the average point from a set of planes. Provide multiplier to weight some planes more.";
      Component.Params.Input[0].Name = "Points";
      Component.Params.Input[0].Description = "Points to take average from.";
      Component.Params.Input[1].Name = "Multipliers";
      Component.Params.Input[1].Description = "Multipliers act like weights towards a point.";

      Component.Params.Output[0].Name = "AveragePoint";
      Component.Params.Output[0].Description = "Resulting average point.";

      Component.Message = "VER 1.0";
    }
    if(P != null)
      AvP = GetAveragePoint(P.ToArray(), M.ToArray());
# ---------- avgp: C# additional code ----------
  public Point3d GetAveragePoint(Point3d[] points, double[] multipliers)
  {
    if (multipliers.Length < points.Length)
      multipliers = multipliers.Concat(Enumerable.Repeat(1d, points.Length - multipliers.Length)).ToArray();
    else if (multipliers.Length > points.Length)
      multipliers = multipliers.Take(points.Length).ToArray();

    if (multipliers.Sum() == 0)
      multipliers = Enumerable.Repeat(1d, points.Length).ToArray();

    var sum = multipliers.Sum();
    multipliers = multipliers.Select(x => x / sum).ToArray();

    for (int i = 0; i < points.Length; i++)
      points[i].Transform(new Transform(multipliers[i]));

    return points.Aggregate((a,b) => a + b);;
  }
# ---------- end avgp ----------
geo = Geometry(pl2pl.TG)
centroid = Point(avgp)
planhash = Text(sort_2.ValuesB)
geo_2 = ClusterOutput(geo)
centroid_2 = ClusterOutput(centroid)
planhash_2 = ClusterOutput(planhash)

# ==== cluster MtoNTreeCopy
targettree = ClusterInput()
tree = ClusterInput()
targettree_2 = Data(targettree)
tree_2 = Data(tree)
tstat = TreeStatistics(Tree=tree_2)  # -> Paths, Length, Count
tstat_2 = TreeStatistics(Tree=targettree_2)  # -> Paths, Length, Count
multiplication = Multiplication(A=tstat.Length, B=tstat_2.Length)
equals = Equality(FirstNumber=tstat.Length, SecondNumber=multiplication)  # -> Equality, Inequality
equals_2 = Equality(FirstNumber=tstat_2.Length, SecondNumber=multiplication)  # -> Equality, Inequality
lng = ListLength(List=tstat.Paths)
series = Series(Start=0, Step=1, Count=lng)
or = GateOr(A=equals.Equality, B=equals_2.Equality)
trim = TrimTree(Tree=series, Depth=1)
dispatch = Dispatch(List=tstat.Paths, DispatchPattern=or)  # -> ListA, ListB
dispatch_2 = Dispatch(List=trim, DispatchPattern=or)  # -> ListA, ListB
branch = TreeBranch(Tree=tree_2, Path=dispatch.ListB, MaintainPaths=True)
item = ListItem(List=tstat.Length, Index=dispatch_2.ListB, Wrap=True)
dpath = DeconstructPath(Branch=dispatch.ListA)
dup = DuplicateData(Data=graft(branch), Number=item, Order=True)
dpath_2 = DeconstructPath(Branch=dispatch.ListB)
series_2 = Series(Start=0, Step=1, Count=item)
expression = Expression(x="0", y=dpath, Expression="x")
trim_2 = TrimTree(Tree=dpath_2, Depth=1)
trim_3 = TrimTree(Tree=series_2, Depth=1)
trim_4 = TrimTree(Tree=dup, Depth=1)
merge = Merge(Data1=dpath, Data2=expression)
expression_2 = Expression(x=trim_2, y=trim_3, Expression="x")
flip = FlipMatrix(Data=trim_4)
branch_2 = TreeBranch(Tree=tree_2, Path=dispatch.ListA, MaintainPaths=True)
branch_3 = TreeBranch(Tree=targettree_2, Path=dispatch.ListA, MaintainPaths=True)
path = ConstructPath(Indices=merge)  # -> flatten(Branch)
merge_2 = Merge(Data1=graft(expression_2), Data2=graft(trim_3))
l2o = List2Object(L=branch_2)  # -> O; inputs L: tree
# ---------- l2o: Python ----------
#Component Information
#--------------------------------------------------------------------------------------------
if ghenv.Component.RunCount<2:
    #General
    #--------------------------------------------------------------------------------------------
    __author__ = "Ueli Saluz"
    __version__ = "2022.04.24"
    
    ghenv.Component.Name = "List2Object"
    ghenv.Component.NickName = "L2O"
    ghenv.Component.Description = "Wraps a list of objects into a list object."
    ghenv.Component.Message = "VER 1.0"
    ghenv.Component.Category = "Sets"
    ghenv.Component.SubCategory = "Tree"
    
     #Inputs
    #--------------------------------------------------------------------------------------------
    inputIndex=0
    
    ghenv.Component.Params.Input[inputIndex].Name = "List"
    ghenv.Component.Params.Input[inputIndex].NickName = "L"
    ghenv.Component.Params.Input[inputIndex].Description = "Tree with lists to wrap."
    ghenv.Component.Params.Input[inputIndex].Optional = False
    inputIndex+=1
    

    #Outputs
    #--------------------------------------------------------------------------------------------
    outputIndex=0
    
    ghenv.Component.Params.Output[outputIndex].Name =  "ListObject" 
    ghenv.Component.Params.Output[outputIndex].NickName = "O"
    ghenv.Component.Params.Output[outputIndex].Description = "Python list object as single item."
    outputIndex+=1


#Imports
#--------------------------------------------------------------------------------------------
from System import Object
from Grasshopper import DataTree

#Solver - Run with trees to enhance performance drastically
#--------------------------------------------------------------------------------------------
if __name__ == "__main__":
    
    #Initialize trees
    #--------------------------------------------------------------------------------------------
    TreeToWrap = DataTree[Object]()
    
    #Data matching
    #--------------------------------------------------------------------------------------------
    for path in L.Paths:
        listBranch = L.Branch(path)
        TreeToWrap.Add(listBranch,path)
    
     #Assign trees to output
    #--------------------------------------------------------------------------------------------
    O = TreeToWrap
# ---------- end l2o ----------
relblbrch = RelabelBranches(TreeToMatch=branch_2, ListOfPaths=flatten(path))  # -> RelabeledTree; inputs TreeToMatch: tree, ListOfPaths: list
# ---------- relblbrch: Python ----------
if ghenv.Component.RunCount<2:
    __author__ = "Your name"
    __version__ = "2000.00.00"
    
    ghenv.Component.Name = "RelabelBranches"
    ghenv.Component.NickName = "ReLblBrch"
    ghenv.Component.Description = "Relabel all the paths of the branches with a list of new paths. The amount of branches must match with the size of the list of pahts"
    ghenv.Component.Message = "VER 1.0"
    
    ghenv.Component.Params.Input[0].NickName = "TreeToMatch"
    ghenv.Component.Params.Input[1].NickName = "ListOfPaths"
    
    ghenv.Component.Params.Input[0].Description = "Tree that should be relabeled."
    ghenv.Component.Params.Input[1].Description = "List of paths to use for new branch paths."
    
    ghenv.Component.Params.Output[0].NickName = "RelabeledTree"
    ghenv.Component.Params.Output[0].Description = "Relabeled tree where all the paths of the branches have been replaced with new paths."

from System import Object
from Grasshopper import DataTree

def relabelBranchesWithLstOfPths (tree, paths):
    newTree = DataTree[Object]()
    for i,path in enumerate(tree.Paths):
        items = tree.Branch(path)
        for data in items:
            newTree.Add(data,paths[i])
    return newTree

if __name__ == "__main__":
    RelabeledTree = relabelBranchesWithLstOfPths(TreeToMatch,ListOfPaths)
# ---------- end relblbrch ----------
path_2 = ConstructPath(Indices=merge_2)
mtchanc = MatchAncestor(AT=l2o, CT=graft(branch_3))  # -> MAT; inputs AT: tree, CT: tree
# ---------- mtchanc: Python ----------
if ghenv.Component.RunCount<2:
    __author__ = "Ueli Saluz"
    __version__ = "2022.04.25"
    
    ghenv.Component.Name = "Match Ancestor"
    ghenv.Component.NickName = "MtchAnc"
    ghenv.Component.Description = "Duplicates all elements of an ancestor tree to match the amount of elements in the child tree."
    ghenv.Component.Message = "VER 1.1"
    
    ghenv.Component.Params.Input[0].Name = "AncestorTree"
    ghenv.Component.Params.Input[0].NickName = "AT"
    ghenv.Component.Params.Input[0].Description = "Ancestor tree that data will the duplicated until it matches the child tree"
    ghenv.Component.Params.Input[0].Optional = False
    
    ghenv.Component.Params.Input[1].Name = "ChildTree"
    ghenv.Component.Params.Input[1].NickName = "CT"
    ghenv.Component.Params.Input[1].Description = "Child tree that branches will the guide to duplicat the data of the ancestor tree"
    ghenv.Component.Params.Input[0].Optional = False
    
    ghenv.Component.Params.Output[0].Name = "MatchedAncestorTree"
    ghenv.Component.Params.Output[0].NickName = "MAT"
    ghenv.Component.Params.Output[0].Description = "Matched ancestor tree with the amount of items and the branch paths of the child tree"

from System import Object
from Grasshopper import DataTree

"""Returns a new tree with the ancestor data being duplicated along all child branches which where child paths of that ancestor.
    Inputs:
        ancestorTree: Ancestor tree that data will the duplicated until it matches the child tree
        childTree: Child tree that branches will the guide to duplicat the data of the ancestor tree
    Output:
        matchedAncestorTree: Matched ancestor tree with the amount of items and the branch paths of the child tree"""
def MatchAncestorTreeToChildTree (ancestorTree, childTree):
    
    matchedAncestorTree = DataTree[Object]()
    dummy = 0
    for i,pathAncestor in enumerate(ancestorTree.Paths):
        branch = ancestorTree.Branch(pathAncestor)
        if len(branch)!=1:
            raise Exception("Ancestor must be grafted and containing one item per branch")
        #The item to be duplicated
        item = branch[0]
        for j,pathChild in enumerate(childTree.Paths):
            #Returns a tuple and not like in the documentation described a bool with a pointer to the int to store the generations
            checkAncestor = pathChild.IsAncestor(pathAncestor,dummy)
            if(checkAncestor[0]):
                matchedAncestorTree.AddRange([item]*childTree.Branch(pathChild).Count,pathChild)
    return matchedAncestorTree

if __name__ == "__main__":
    MAT = MatchAncestorTreeToChildTree (AT,CT)
# ---------- end mtchanc ----------
relblbrch_2 = RelabelBranches(TreeToMatch=flip, ListOfPaths=flatten(path_2))  # -> RelabeledTree; inputs TreeToMatch: tree, ListOfPaths: list; same code as relblbrch
o2l = Object2List(O=mtchanc)  # -> L; inputs O: tree
# ---------- o2l: Python ----------
#Component Information
#--------------------------------------------------------------------------------------------
if ghenv.Component.RunCount<2:
    #General
    #--------------------------------------------------------------------------------------------
    __author__ = "Ueli Saluz"
    __version__ = "2022.04.24"
    
    ghenv.Component.Name = "Object2List"
    ghenv.Component.NickName = "O2L"
    ghenv.Component.Description = "Unwraps a list of objects into a list object."
    ghenv.Component.Message = "VER 1.0"
    ghenv.Component.Category = "Sets"
    ghenv.Component.SubCategory = "Tree"
    
     #Inputs
    #--------------------------------------------------------------------------------------------
    inputIndex=0
    
    ghenv.Component.Params.Input[inputIndex].Name = "ListObject"
    ghenv.Component.Params.Input[inputIndex].NickName = "O"
    ghenv.Component.Params.Input[inputIndex].Description = "A python list object that will be unwrapped into a Grasshopper list."
    ghenv.Component.Params.Input[inputIndex].Optional = False
    inputIndex+=1
    

    #Outputs
    #--------------------------------------------------------------------------------------------
    outputIndex=0
    
    ghenv.Component.Params.Output[outputIndex].Name =  "List"
    ghenv.Component.Params.Output[outputIndex].NickName = "L"
    ghenv.Component.Params.Output[outputIndex].Description = "The unwrapped list."
    outputIndex+=1


#Imports
#--------------------------------------------------------------------------------------------
from System import Object
from Grasshopper import DataTree

#Solver - Run with trees to enhance performance drastically
#--------------------------------------------------------------------------------------------
if __name__ == "__main__":
    
    #Initialize trees
    #--------------------------------------------------------------------------------------------
    OriginalTree = DataTree[Object]()
    
    #Data matching
    #--------------------------------------------------------------------------------------------
    for path in O.Paths:
        listBranch = O.Branch(path)
        for i,listItem in enumerate(listBranch):
            OriginalTree.AddRange(list(listItem),path.AppendElement(i))
    
     #Assign trees to output
    #--------------------------------------------------------------------------------------------
    L = OriginalTree
# ---------- end o2l ----------
trim_5 = TrimTree(Tree=o2l, Depth=1)
merge_3 = Merge(Data1=relblbrch_2, Data2=trim_5)
targettree_3 = Data(graft(targettree_2))
tree_3 = Data(merge_3)
tree_4 = ClusterOutput(tree_3)
targettree_4 = ClusterOutput(targettree_3)
