# Grasshopper definition base.gh (Grasshopper 1.0.7)
# plug-ins: semio, eleFront

north_not_properly_places = Vector(Vector(0.922262801, -0.3865634823, 0))
pt = ConstructPoint(XCoordinate=0, YCoordinate=0, ZCoordinate=0)
amp = Amplitude(Vector=north_not_properly_places, Amplitude=Slider(1000, range=0..1000))
# ^
#                  |
# Preview    ->
safe = Button()
vdisex = VectorDisplayEx(Point=pt, Vector=amp, Colour=RGB(0, 0, 0), Width=2)
# Parameters:
number_slider = Slider(400, range=0..1000)
number_slider_2 = Slider(350, range=0..1000)
floorgroundheight = GetNumber(number_slider, AtLeast=1, AtMost=1, Maximum=1.797693135e+308, Minimum=-1.797693135e+308, TreeAccess=False)
floorheight = GetNumber(number_slider_2, AtLeast=1, AtMost=1, Maximum=1.797693135e+308, Minimum=-1.797693135e+308, TreeAccess=False)
# External
#      |
#      v
# Model:
cores = GetInteger(AtLeast=1, AtMost=1, Maximum=2147483647, Minimum=-2147483648, TreeAccess=False)
# Local ->
number_slider_3 = Slider(495, range=0..1000)
number_slider_4 = Slider(550, range=0..1000)
coreprimarylength = Number(number_slider_4)
coressetbackdepth = Number(number_slider_3)
coressetbackwidth = Number(Slider(475, range=0..1000))
coreprimarywidth = Number(number_slider_4)
coresecondarylength = Number(number_slider_4)
coresecondarywidth = Number(number_slider_4)
plot = Curve(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)
entrancehallwidth = Number(Slider(560, range=0..1000))
sideshortsetbackdepth = Number(Slider(100, range=0..100))
nakagincapsuletowerbasefloorplan = NakaginCapsuleTowerBaseFloorplan(
    plotoutline=plot,
    coressetbackdepth=coressetbackdepth,
    coressetbackwidth=coressetbackwidth,
    coreprimarylength=coreprimarylength,
    coreprimarywidth=coreprimarywidth,
    coresecondarylength=coresecondarylength,
    coresecondarywidth=coresecondarywidth,
    entrancehallwidth=entrancehallwidth,
    sideshortsetbackdepth=sideshortsetbackdepth)  # -> sidebuilding_2, sideshort_2, sidemain_2, sidecorner_2, sidelong_2, coreprimary_2, coresecondary_2, sidemainfassadeside_2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
sidecorner = Curve(nakagincapsuletowerbasefloorplan.sidecorner_2)
sidebuilding = Curve(nakagincapsuletowerbasefloorplan.sidebuilding_2)
sideshort = Curve(nakagincapsuletowerbasefloorplan.sideshort_2)
sidemain = Curve(nakagincapsuletowerbasefloorplan.sidemain_2)
sidelong = Curve(nakagincapsuletowerbasefloorplan.sidelong_2)
coreprimary = Rectangle(nakagincapsuletowerbasefloorplan.coreprimary_2)
coresecondary = Rectangle(nakagincapsuletowerbasefloorplan.coresecondary_2)
sidemainfassadeside = Curve(nakagincapsuletowerbasefloorplan.sidemainfassadeside_2)
sidemainfassadeentrance = Curve(nakagincapsuletowerbasefloorplan.sidemainfassadeentrance_2)
sideshortfassade = Curve(nakagincapsuletowerbasefloorplan.sideshortfassade_2)
sidelongfassade = Curve(nakagincapsuletowerbasefloorplan.sidelongfassade_2)
basenoncore = Curve(nakagincapsuletowerbasefloorplan.basenoncore_2)
base = Curve(nakagincapsuletowerbasefloorplan.base_2)

Z = UnitZ(Factor=floorgroundheight)
base_2 = Curve(base)
Z_2 = UnitZ(Factor=floorheight)
move = Move(Geometry=plot, Motion=Z)  # -> Geometry, Transform
extr = Extrude(Base=base_2, Direction=Z)
extr_2 = Extrude(Base=move.Geometry, Direction=Z_2)
cap = CapHoles(Brep=extr)
cap_2 = CapHoles(Brep=extr_2)
floorgroundvolume1to500 = Brep(cap)
floorfirstvolume1to500 = Brep(cap_2)

columnssetbackdepth = Number(Slider(250, range=0..1000))
neg = Negative(Value=columnssetbackdepth)
offset = OffsetCurve(Curve=sidemain, Distance=neg, Corners=1)
offset_2 = OffsetCurve(Curve=sidelong, Distance=neg, Corners=1)
trim = TrimTree(Tree=offset, Depth=1)
trim_2 = TrimTree(Tree=offset_2, Depth=1)
columnswidth = Number(Slider(40, range=0..100))
columnssidelongsetbackwidth = Number(Slider(250, range=0..1000))
entrancesetback = Number(Slider(100, range=0..100))

eval = EvaluateCurve(Curve=reparameterize(sidemainfassadeentrance), Parameter="0.5")  # -> Point, Tangent, Angle
Z_3 = UnitZ(Factor=1)
xprod = CrossProduct(VectorA=eval.Tangent, VectorB=Z_3, Unitize=False)  # -> Vector, Length
neg_2 = Negative(Value=xprod.Vector)
amp_2 = Amplitude(Vector=neg_2, Amplitude=entrancesetback)
extr_3 = Extrude(Base=sidemainfassadeentrance, Direction=amp_2)
Z_4 = UnitZ(Factor=floorheight)
extr_4 = Extrude(Base=extr_3, Direction=Z_4)
cap_3 = CapHoles(Brep=extr_4)
sdiff = SolidDifference(BrepsA=floorgroundvolume1to500, BrepsB=cap_3)
groundfloorvolume1to200 = Brep(sdiff)

columnsmainaxis = Curve(trim)
columnssideaxis = Curve(trim_2)

expression = Expression(x=coreprimarylength, y=columnswidth, Expression="x-2*y")
expression_2 = Expression(x=coresecondarylength, y=columnswidth, Expression="x-2*y")
subtraction = Subtraction(A=coressetbackwidth, B=columnswidth)
merge = Merge(
    Data1=columnswidth,
    Data2=subtraction,
    Data3=columnswidth,
    Data4=expression,
    Data5=columnswidth,
    Data6=entrancehallwidth,
    Data7=columnswidth,
    Data8=expression_2,
    Data9=columnswidth)
ma = MassAddition(Input=merge)  # -> Result, PartialResults
eval_2 = EvaluateLength(Curve=columnsmainaxis, Length=ma.PartialResults, Normalized="False")  # -> Point, Tangent, Parameter
shatter = Shatter(Curve=columnsmainaxis, Parameters=eval_2.Parameter)
trim_3 = TrimTree(Tree=shatter, Depth=1)
Z_5 = UnitZ(Factor=floorgroundheight)
dispatch = Dispatch(List=trim_3, DispatchPattern=[True, False])  # -> ListA, ListB
extr_5 = Extrude(Base=dispatch.ListA, Direction=Z_5)
evalsrf = EvaluateSurface(Surface=reparameterize(extr_5), Point="0.5,0.5")  # -> Point, Normal, UDirection, VDirection, Frame
amp_3 = Amplitude(Vector=evalsrf.Normal, Amplitude=columnswidth)
extr_6 = Extrude(Base=extr_5, Direction=amp_3)
columnsmain = Brep(extr_6)

number_slider_5 = Slider(30, range=0..100)
fassadeedgesetback = Number(Slider(40, range=0..100))
windowparapetheight = Number(Slider(90, range=0..100))
windowheight = Number(Slider(150, range=0..1000))
atticheight = Number(number_slider_5)

neg_3 = Negative(Value=atticheight)
neg_4 = Negative(Value=atticheight)
ext = ExtendCurve(Curve=columnssideaxis, Type=0, Start=neg_3, End=neg_4)
divide = DivideCurve(Curve=ext, Count="2", Kinks=False)  # -> Points, Tangents, Parameters
trim_4 = TrimTree(Tree=divide.Parameters, Depth=1)
eval_3 = EvaluateCurve(Curve=columnssideaxis, Parameter=trim_4)  # -> Point, Tangent, Angle
pl = ConstructPlane(Origin=eval_3.Point, XAxis=eval_3.Tangent, YAxis=Vector(0, 1, 0))
_2d = _2D(x=columnswidth)
rectangle = Rectangle(Plane=pl, XSize=_2d, YSize=_2d, Radius=0)  # -> Rectangle, Length
Z_6 = UnitZ(Factor=floorgroundheight)
extr_7 = Extrude(Base=rectangle.Rectangle, Direction=Z_6)
cap_4 = CapHoles(Brep=extr_7)
columnsside = Brep(cap_4)

atticdepth = Number(number_slider_5)

sidemain_2 = Curve(sidemain)
sidecorner_2 = Curve(sidecorner)
sidelong_2 = Curve(sidelong)
sideshort_2 = Curve(sideshort)
merge_2 = Merge(Data1=sideshort_2, Data2=sidemain_2, Data3=sidecorner_2, Data4=sidelong_2)
join = JoinCurves(Curves=merge_2, Preserve=False)
trim_5 = TrimTree(Tree=join, Depth=1)
move_2 = Move(Geometry=trim_5, Motion=Z)  # -> Geometry, Transform
neg_5 = Negative(Value=fassadeedgesetback)
neg_6 = Negative(Value=fassadeedgesetback)
move_3 = Move(Geometry=move_2.Geometry, Motion=Z_2)  # -> Geometry, Transform
neg_7 = Negative(Value=fassadeedgesetback)
Z_7 = UnitZ(Factor=neg_6)
offset_3 = OffsetCurve(Curve=move_2.Geometry, Distance=neg_5, Corners=1)
Z_8 = UnitZ(Factor=fassadeedgesetback)
offset_4 = OffsetCurve(Curve=move_3.Geometry, Distance=neg_7, Corners=1)
move_4 = Move(Geometry=move_2.Geometry, Motion=Z_8)  # -> Geometry, Transform
trim_6 = TrimTree(Tree=offset_3, Depth=1)
crv = Curve(trim_6)
end = EndPoints(Curve=crv)  # -> Start, End
ln = Line(StartPoint=end.Start, EndPoint=end.End)
merge_3 = Merge(Data1=crv, Data2=ln)
move_5 = Move(Geometry=move_3.Geometry, Motion=Z_7)  # -> Geometry, Transform
trim_7 = TrimTree(Tree=offset_4, Depth=1)
# Outputs   ->
#                 |
#                 v
crv_2 = Curve(trim_7)
end_2 = EndPoints(Curve=crv_2)  # -> Start, End
ln_2 = Line(StartPoint=end_2.Start, EndPoint=end_2.End)
merge_4 = Merge(Data1=crv_2, Data2=ln_2)
join_2 = JoinCurves(Curves=merge_3, Preserve=False)
join_3 = JoinCurves(Curves=merge_4, Preserve=False)
rulesrf = RuledSurface(CurveA=trim_6, CurveB=move_4.Geometry)
rulesrf_2 = RuledSurface(CurveA=move_4.Geometry, CurveB=move_5.Geometry)
rulesrf_3 = RuledSurface(CurveA=trim_7, CurveB=move_5.Geometry)
trim_8 = TrimTree(Tree=join_2, Depth=1)
trim_9 = TrimTree(Tree=join_3, Depth=1)
neg_8 = Negative(Value=atticdepth)
merge_5 = Merge(Data1=rulesrf, Data2=rulesrf_2, Data3=rulesrf_3)
boundary = BoundarySurfaces(Edges=trim_8)
offset_5 = OffsetCurve(Curve=trim_9, Distance=neg_8, Corners=1)
boundary_2 = BoundarySurfaces(Edges=trim_9)
neg_9 = Negative(Value=atticheight)
Z_9 = UnitZ(Factor=neg_9)
trim_10 = TrimTree(Tree=offset_5, Depth=1)
fassadefirstfloor = Surface(merge_5)
rulesrf_4 = RuledSurface(CurveA=trim_9, CurveB=trim_10)
move_6 = Move(Geometry=trim_10, Motion=Z_9)  # -> Geometry, Transform
join_4 = BrepJoin(Breps=fassadefirstfloor)  # -> Breps, Closed
boundary_3 = BoundarySurfaces(Edges=move_6.Geometry)
rulesrf_5 = RuledSurface(CurveA=trim_10, CurveB=move_6.Geometry)
merge_6 = Merge(Data1=boundary, Data2=join_4.Breps, Data3=rulesrf_4, Data4=rulesrf_5, Data5=boundary_3)
move_7 = Move(Geometry=sidebuilding, Motion=Z)  # -> Geometry, Transform
Z_10 = UnitZ(Factor=floorheight)
join_5 = BrepJoin(Breps=merge_6)  # -> Breps, Closed
capex = CapHolesEx(Brep=join_5.Breps)  # -> Brep, Caps, Solid
floorfirstvolume1to200 = Brep(capex.Brep)

Z_11 = UnitZ(Factor=windowparapetheight)
move_8 = Move(Geometry=move_2.Geometry, Motion=Z_11)  # -> Geometry, Transform
Z_12 = UnitZ(Factor=windowheight)
move_9 = Move(Geometry=move_8.Geometry, Motion=Z_12)  # -> Geometry, Transform
rulesrf_6 = RuledSurface(CurveA=move_8.Geometry, CurveB=move_9.Geometry)
windowribbon = Surface(rulesrf_6)

addition = Addition(A=floorgroundheight, B=floorheight)
coresecondary_2 = Rectangle(coresecondary)
coreprimary_2 = Rectangle(coreprimary)
Z_13 = UnitZ(Factor=addition)
move_10 = Move(Geometry=coreprimary_2, Motion=Z_13)  # -> Geometry, Transform
move_11 = Move(Geometry=coresecondary_2, Motion=Z_13)  # -> Geometry, Transform
evalsrf_2 = EvaluateSurface(Surface=reparameterize(move_10.Geometry), Point="0.5,0.5")  # -> Point, Normal, UDirection, VDirection, Frame
evalsrf_3 = EvaluateSurface(Surface=reparameterize(move_11.Geometry), Point="0.5,0.5")  # -> Point, Normal, UDirection, VDirection, Frame
merge_7 = Merge(Data1=evalsrf_2.Point, Data2=evalsrf_3.Point)
panel = Panel("""0
1""")
spc = ModelSpecifier(Context="core", Group=panel)  # -> Specifier, Context, Group
por = ModelPort(Plane=graft(merge_7), Specifiers=graft(spc.Specifier))  # -> Port, Plane, Specifiers
trim_11 = TrimTree(Tree=por.Port, Depth=1)

variant = Integer(Slider(0, range=0..100))
curdir = CurrentDirectory()  # -> D, P, S
# ---------- curdir: Python ----------
#Component Information
#--------------------------------------------------------------------------------------------
if ghenv.Component.RunCount<2:
    #General
    #--------------------------------------------------------------------------------------------
    __author__ = "Ueli Saluz"
    __version__ = "2023.09.29"
    
    ghenv.Component.Name = "CurrentDirectory"
    ghenv.Component.NickName = "CurDir"
    ghenv.Component.Description = "Current directory of the current grasshopper file."
    ghenv.Component.Message = "VER 1.0"
    ghenv.Component.Category = "Params"
    ghenv.Component.SubCategory = "Util"
    
    #Outputs
    #--------------------------------------------------------------------------------------------
    outputIndex=0
    
    ghenv.Component.Params.Output[outputIndex].Name = "Directory"
    ghenv.Component.Params.Output[outputIndex].NickName = "D"
    ghenv.Component.Params.Output[outputIndex].Description = "Directory of the current grasshopper file."
    outputIndex+=1
    
    ghenv.Component.Params.Output[outputIndex].Name = "Path"
    ghenv.Component.Params.Output[outputIndex].NickName = "P"
    ghenv.Component.Params.Output[outputIndex].Description = "Path of the current grasshopper file."
    outputIndex+=1
    
    ghenv.Component.Params.Output[outputIndex].Name = "Separator"
    ghenv.Component.Params.Output[outputIndex].NickName = "S"
    ghenv.Component.Params.Output[outputIndex].Description = "Separator of the current system."
    outputIndex+=1

#Imports
#--------------------------------------------------------------------------------------------
from os.path import dirname
from os import sep

#Solver - Run with trees to enhance performance drastically
#--------------------------------------------------------------------------------------------
if __name__ == "__main__":
    P = ghenv.Component.OnPingDocument().FilePath
    D = dirname(P)
    S = sep
# ---------- end curdir ----------
expression_3 = Expression(x=variant, Expression="x+1")
concat = Concatenate(FragmentC="representations", FragmentD=curdir.S, FragmentA="base", FragmentB="_", FragmentE=expression_3, FragmentF="_")
concat_2 = Concatenate(FragmentA=concat, FragmentE="1to500", FragmentG="_", FragmentF="volume")
concat_3 = Concatenate(FragmentA=concat, FragmentE="1to200", FragmentG="_", FragmentF="volume")
concat_4 = Concatenate(FragmentA=concat_2, FragmentB=".3dm")
concat_5 = Concatenate(FragmentA=concat_3, FragmentB=".3dm")
rep = ModelRepresentation(Url=concat_4, LevelOfDetail="1to500", Tags="volume")  # -> Representation, Url, LevelOfDetail, Tags
rep_2 = ModelRepresentation(Url=concat_5, LevelOfDetail="1to200", Tags="volume")  # -> Representation, Url, LevelOfDetail, Tags

concat_6 = Concatenate(FragmentA="first floor", FragmentB="::", FragmentC="windows")
concat_7 = Concatenate(FragmentA="ground floor", FragmentB="::", FragmentC="columns")
concat_8 = Concatenate(FragmentA="first floor", FragmentB="::", FragmentC="volume")
concat_9 = Concatenate(FragmentA="ground floor", FragmentB="::", FragmentC="building")
floorgroundvolume1to500_2 = Brep(floorgroundvolume1to500)
floorfirstvolume1to500_2 = Brep(floorfirstvolume1to500)
groundfloorvolume1to200_2 = Brep(groundfloorvolume1to200)
floorfirstvolume1to200_2 = Brep(floorfirstvolume1to200)
concat_10 = Concatenate(FragmentA=concat_7, FragmentB="::", FragmentC="main")
concat_11 = Concatenate(FragmentA=concat_7, FragmentB="::", FragmentC="side")
windowribbon_2 = Surface(windowribbon)
columnsmain_2 = Brep(columnsmain)
columnsside_2 = Brep(columnsside)
expression_4 = Expression(x=concat_11, y=columnsside_2, Expression="x")
expression_5 = Expression(x=concat_10, y=columnsmain_2, Expression="x")
expression_6 = Expression(x=concat_8, y=floorfirstvolume1to500_2, Expression="x")
expression_7 = Expression(x=concat_6, y=windowribbon_2, Expression="x")
expression_8 = Expression(x=concat_10, y=columnsmain_2, Expression="x")
expression_9 = Expression(x=concat_9, y=floorgroundvolume1to500_2, Expression="x")
merge_8 = Merge(Data1=expression_9, Data2=expression_5, Data3=expression_4, Data4=expression_6, Data5=expression_7)
merge_9 = Merge(
    Data1=floorgroundvolume1to500_2,
    Data2=columnsmain_2,
    Data3=columnsside_2,
    Data4=floorfirstvolume1to500_2,
    Data5=windowribbon_2)
merge_10 = Merge(
    Data1=groundfloorvolume1to200_2,
    Data2=columnsmain_2,
    Data3=columnsside_2,
    Data4=floorfirstvolume1to200_2,
    Data5=windowribbon_2)
ef_layer = EleFrontLayer(FullPath=merge_8)  # -> Layer, FullPath, Hidden, Locked, DisplayColour, MaterialName, Linetype, PrintColour, PrintWidth
ef_att = EleFrontAttributes(Layer=ef_layer.Layer)  # -> Attributes, Keys, Values, Name, Layer, ColourSource, DisplayColour, MaterialSource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
baketofile = BakeObjectsToFile(
    FilePath=concat_4,
    Geometry=merge_9,
    Attributes=ef_att.Attributes,
    Bake=safe,
    networkMode=False,
    ValueTable_networkMode=True,
    overwriteMode="Overwrite",
    preset="Safest")
baketofile_2 = BakeObjectsToFile(
    FilePath=rep_2.Url,
    Geometry=merge_10,
    Attributes=ef_att.Attributes,
    Bake=safe,
    networkMode=False,
    ValueTable_networkMode=True,
    overwriteMode="Overwrite",
    preset="Safest")

merge_11 = Merge(Data1="2", Data2=number_slider_2, Data3=number_slider, Data4="2")
panel_2 = Panel("""storeys
floor height
ground floor height
cores
core length
core width""")
panel_3 = Panel(merge_11)
panel_4 = Panel("""cm
cm

cm
cm""")
qlt = ModelQuality(Name=panel_2, Value=panel_3, Unit=panel_4)  # -> Quality, Name, Value, Unit

merge_12 = Merge(Data1=columnsmain, Data2=columnsside)
columns = Brep(merge_12)

previewplane = PreviewPlane(plane=merge_7, axis_length=Slider(100, range=0..100))

panel_5 = Panel("A two storey office building with a setback and a colonade on the groundfloor towards the street.")
merge_13 = Merge(Data1=rep.Representation, Data2=rep_2.Representation)
typ = ModelType(Name="base", Explanation=panel_5, Representations=merge_13, Ports=trim_11, Qualities=qlt.Quality)  # -> Type, Name, Explanation, Icon, Representations, Ports, Qualities
typ_2 = RemoveType(TypeName=typ.Name, TypeQualities=typ.Qualities, Run=safe)
or = GateOr(A=safe, B=typ_2)
typ_3 = AddType(Type=typ.Type, Run=or)

typ_4 = SerializeType(Type=typ.Type)
type = Text(typ_4)
context_bake = ContextBake(Geometry=type)

# ==== cluster NakaginCapsuleTowerBaseFloorplan
sideshortsetbackdepth = ClusterInput()
plotoutline = ClusterInput()
coressetbackdepth = ClusterInput()
coressetbackwidth = ClusterInput()
coreprimarylength = ClusterInput()
coreprimarywidth = ClusterInput()
coresecondarylength = ClusterInput()
coresecondarywidth = ClusterInput()
entrancehallwidth = ClusterInput()
coressetbackdepth_2 = Number(coressetbackdepth)
coreprimarylength_2 = Number(coreprimarylength)
coreprimarywidth_2 = Number(coreprimarywidth)
coresecondarylength_2 = Number(coresecondarylength)
coressetbackwidth_2 = Number(coressetbackwidth)
plotoutline_2 = Curve(plotoutline)
coresecondarywidth_2 = Number(coresecondarywidth)
entrancehallwidth_2 = Number(entrancehallwidth)
sideshortsetbackdepth_2 = Number(sideshortsetbackdepth)
xy = XYPlane(Origin=Point(0, 0, 0))
merge = Merge(Data1=coressetbackwidth_2, Data2=coreprimarylength_2, Data3=entrancehallwidth_2, Data4=coresecondarylength_2)
neg = Negative(Value=coressetbackdepth_2)
ma = MassAddition(Input=merge)  # -> Result, PartialResults
explode = Explode(Curve=plotoutline_2, Recursive=True)  # -> Segments, Vertices
Y = UnitY(Factor=neg)
neg_2 = Negative(Value=ma.PartialResults)
trim = TrimTree(Tree=explode.Segments, Depth=1)
X = UnitX(Factor=neg_2)
move = Move(Geometry=xy, Motion=Y)  # -> Geometry, Transform
item = ListItem(List=trim, Index=0, Wrap=True)  # -> Item, Item1, Item2, Item3, Item4
move_2 = Move(Geometry=move.Geometry, Motion=X)  # -> Geometry, Transform
sidemain = Curve(item.Item2)
sidecorner = Curve(item.Item3)
sidelong = Curve(item.Item4)
sidebuilding = Curve(item.Item)
sideshort = Curve(item.Item1)
item_2 = ListItem(List=move_2.Geometry, Index=0, Wrap=True)  # -> Item, Item1, Item2, Item3
neg_3 = Negative(Value=coresecondarywidth_2)
neg_4 = Negative(Value=coreprimarywidth_2)
neg_5 = Negative(Value=entrancehallwidth_2)
sidebuilding_2 = ClusterOutput(sidebuilding)
sideshort_2 = ClusterOutput(sideshort)
sidemain_2 = ClusterOutput(sidemain)
sidecorner_2 = ClusterOutput(sidecorner)
sidelong_2 = ClusterOutput(sidelong)
rectangle = Rectangle(Plane=item_2.Item2, XSize=entrancehallwidth_2, YSize=neg_5, Radius=0)  # -> Rectangle, Length
rectangle_2 = Rectangle(Plane=item_2.Item1, XSize=coreprimarylength_2, YSize=neg_3, Radius=0)  # -> Rectangle, Length
rectangle_3 = Rectangle(Plane=item_2.Item3, XSize=coresecondarylength_2, YSize=neg_4, Radius=0)  # -> Rectangle, Length
coresecondary = Rectangle(rectangle_2.Rectangle)
coreprimary = Rectangle(rectangle_3.Rectangle)
explode_2 = Explode(Curve=rectangle.Rectangle, Recursive=True)  # -> Segments, Vertices
explode_3 = Explode(Curve=coreprimary, Recursive=True)  # -> Segments, Vertices
coreprimary_2 = ClusterOutput(coreprimary)
coresecondary_2 = ClusterOutput(coresecondary)
trim_2 = TrimTree(Tree=explode_2.Segments, Depth=1)
trim_3 = TrimTree(Tree=explode_3.Vertices, Depth=1)
item_3 = ListItem(List=trim_2, Index=0, Wrap=True)  # -> Item, Item1, Item2, Item3
item_4 = ListItem(List=trim_3, Index=0, Wrap=True)  # -> Item, Item1, Item2, Item3
neg_6 = Negative(Value=sideshortsetbackdepth_2)
offset = OffsetCurve(Curve=sideshort, Distance=neg_6, Corners=1)
trim_4 = TrimTree(Tree=offset, Depth=1)

X_2 = UnitX(Factor=1)
line = LineSDL(Start=move.Geometry, Direction=X_2, Length=1)
rotax = RotateAxis(Geometry=move.Geometry, Angle=degrees("90"), Axis=line)  # -> Geometry, Transform
pcx = CurvePlane(Curve=trim_4, Plane=rotax.Geometry)  # -> Points, ParamsC, ParamsP
trim_5 = TrimTree(Tree=pcx.Points, Depth=1)
crv_cp = CurveClosestPoint(Point=trim_5, Curve=trim_4)  # -> Point, Parameter, Distance
shatter = Shatter(Curve=trim_4, Parameters=crv_cp.Parameter)
trim_6 = TrimTree(Tree=shatter, Depth=1)
item_5 = ListItem(List=trim_6, Index=0, Wrap=True)

explode_4 = Explode(Curve=coresecondary, Recursive=True)  # -> Segments, Vertices
trim_7 = TrimTree(Tree=explode_4.Segments, Depth=1)
shift = ShiftList(List=trim_7, Shift="-2", Wrap=True)
panel = Panel("-1")
trim_8 = TrimTree(Tree=shift, Depth=1)
lito3p = ListInto3Parts(ListToSlice=trim_8, StartIndex="1")  # -> FilteredList, ItemsBefore, ItemsAfter; inputs ListToSlice: tree, StartIndex: tree of Int32, EndIndex: tree of Int32
# ---------- lito3p: Python ----------
if ghenv.Component.RunCount<2:
    __author__ = "Ueli Saluz"
    __version__ = "2020.05.28"
    
    ghenv.Component.Name = "ListInto3Parts"
    ghenv.Component.NickName = "LiTo3P"
    ghenv.Component.Description = "Slice list into 3 parts. All lists are sliced with the same indices. End index = 0 = length(list)."
    ghenv.Component.Message = "VER 1.6"

from System import Object
from Grasshopper import DataTree

def filterList(listToFilter,startIndex,endIndex):
    # Return: FilteredList, Before, After
    if (((startIndex == 0) or (startIndex is None)) and ((endIndex == 0) or (endIndex is None))) or (endIndex <= startIndex and endIndex > 0):
        return (listToFilter,None,None)
    elif (startIndex == 0) or (startIndex is None):
        return (listToFilter[:endIndex],None,listToFilter[endIndex:])
    elif (endIndex == 0) or (endIndex is None):
        print 1
        return (listToFilter[:startIndex],listToFilter[startIndex:],None)
    else:
        return (listToFilter[startIndex:endIndex],listToFilter[:startIndex],listToFilter[endIndex:])

if __name__ == "__main__":
    FilteredList = DataTree[Object]()
    ItemsBefore = DataTree[Object]()
    ItemsAfter = DataTree[Object]()
    
    for path in ListToSlice.Paths:
        listBranch = ListToSlice.Branch(path)
        pyList = list(listBranch)   #Convert .Net List to Python
        try: #terrible way of writing code but if I set the list to list access the performance decreases massivly due to many calls
            startIndex = StartIndex.Branch(path)
            startIndex = startIndex[0]
        except Exception:
            try:
                startIndex = StartIndex.Branch(0)
                startIndex = startIndex[0]
            except Exception:
                startIndex = 0
        try:
            endIndex = EndIndex.Branch(path)
            endIndex = endIndex[0]
        except Exception:
            try:
                endIndex = EndIndex.Branch(0)
                endIndex = endIndex[0]
            except Exception:
                endIndex = len(pyList)
        filtList=filterList(pyList,startIndex,endIndex)
        if filtList[0]:
            FilteredList.AddRange(filtList[0],path)
        if filtList[1]:
            ItemsBefore.AddRange(filtList[1],path)
        if filtList[2]:
            ItemsAfter.AddRange(filtList[2],path)
# ---------- end lito3p ----------

panel_2 = Panel(trim_5)
ln = Line(StartPoint=crv_cp.Point, EndPoint=item_2.Item)
ln_2 = Line(StartPoint=item_2.Item1, EndPoint=item_2.Item2)
ln_3 = Line(StartPoint=crv_cp.Point, EndPoint=item_4.Item3)
ln_4 = Line(StartPoint=item_4.Item3, EndPoint=item_4.Item)
ln_5 = Line(StartPoint=item_4.Item, EndPoint=item_4.Item1)
sidemainfassadeside = Curve(ln)
sideshortfassade = Curve(item_5)
sidemainfassadeentrance = Curve(ln_2)
sidemainfassadeentrance_2 = ClusterOutput(sidemainfassadeentrance)
sidemainfassadeside_2 = ClusterOutput(sidemainfassadeside)
sideshortfassade_2 = ClusterOutput(sideshortfassade)

xy_2 = XYPlane(Origin=Point(0, 0, 0))
rotate = Rotate(Geometry=xy_2, Angle=degrees("180"), Plane=PlaneXY(0, 0, 0))  # -> Geometry, Transform
brec = BoundingRectangle(geometry=plotoutline_2, plane=graft(rotate.Geometry))  # -> boundingrectangle_2, length_2
end = EndPoints(Curve=trim_4)  # -> Start, End
crv_cp_2 = CurveClosestPoint(Point=end.Start, Curve=sidebuilding)  # -> Point, Parameter, Distance

rec = Rectangle(brec.boundingrectangle_2)

trim_9 = TrimTree(Tree=rec, Depth=1)
drec = DeconstuctRectangle(Rectangle=trim_9)  # -> BasePlane, XInterval, YInterval
domprop = DomainProperties(I=drec.YInterval, In=True)  # -> L, M, T0, T1; inputs I: tree, In: tree of Boolean
# ---------- domprop: Python ----------
#Component Information
#--------------------------------------------------------------------------------------------
if ghenv.Component.RunCount<2:
    #General
    #--------------------------------------------------------------------------------------------
    __author__ = "Ueli Saluz"
    __version__ = "2021.11.22"
    
    ghenv.Component.Name = "DomainProperties"
    ghenv.Component.NickName = "DomProp"
    ghenv.Component.Description = "Returns some properties of a domain"
    ghenv.Component.Message = "VER 1.0"
    ghenv.Component.Category = "Maths"
    ghenv.Component.SubCategory = "Domain"
    
     #Inputs
    #--------------------------------------------------------------------------------------------
    inputIndex=0
    
    ghenv.Component.Params.Input[inputIndex].Name = "Domain"
    ghenv.Component.Params.Input[inputIndex].NickName = "I"
    ghenv.Component.Params.Input[inputIndex].Description = "Domain to evaluate"
    ghenv.Component.Params.Input[inputIndex].Optional = False
    inputIndex+=1
    
    ghenv.Component.Params.Input[inputIndex].Name = "MakeIncreasing"
    ghenv.Component.Params.Input[inputIndex].NickName = "In"
    ghenv.Component.Params.Input[inputIndex].Description = "Makes sure that the domain is increasing. If not it gets swapped."
    ghenv.Component.Params.Input[inputIndex].Optional = False
    inputIndex+=1
    
    #Outputs
    #--------------------------------------------------------------------------------------------
    outputIndex=0
    
    ghenv.Component.Params.Output[outputIndex].Name = "Length"
    ghenv.Component.Params.Output[outputIndex].NickName = "L"
    ghenv.Component.Params.Output[outputIndex].Description = "Length of the domain"
    outputIndex+=1
    
    ghenv.Component.Params.Output[outputIndex].Name = "Mid"
    ghenv.Component.Params.Output[outputIndex].NickName = "M"
    ghenv.Component.Params.Output[outputIndex].Description = "Middle of the of the domain"
    outputIndex+=1
    
    ghenv.Component.Params.Output[outputIndex].Name = "DomainStartParameter"
    ghenv.Component.Params.Output[outputIndex].NickName = "T0"
    ghenv.Component.Params.Output[outputIndex].Description = "Start parameter. Doens't have to be smaller than the end parameter."
    outputIndex+=1
    
    ghenv.Component.Params.Output[outputIndex].Name = "DomainEndParameter"
    ghenv.Component.Params.Output[outputIndex].NickName = "T1"
    ghenv.Component.Params.Output[outputIndex].Description = "End parameter. Doens't have to be bigger than the start parameter."
    outputIndex+=1
    


#Imports
#--------------------------------------------------------------------------------------------
from System import Object
from Grasshopper import DataTree

#Solver - Run with trees to enhance performance drastically
#--------------------------------------------------------------------------------------------
if __name__ == "__main__":
    
    #Initialize trees
    #--------------------------------------------------------------------------------------------
    LengthTree = DataTree[Object]()
    MidTree = DataTree[Object]()
    DomainStartParameterTree = DataTree[Object]()
    DomainEndParameterTree = DataTree[Object]()
    LengthTree = DataTree[Object]()
    
    #Data matching
    #--------------------------------------------------------------------------------------------
    for path in I.Paths:
        domainBranch = I.Branch(path)
        for i,domain in enumerate(domainBranch):
            if In==True:
                domain.MakeIncreasing()
            LengthTree.Add(domain.Length, path)
            MidTree.Add(domain.Mid, path)
            DomainStartParameterTree.Add(domain.T0, path)
            DomainEndParameterTree.Add(domain.T1, path)
    
     #Assign trees to output
    #--------------------------------------------------------------------------------------------
    L = LengthTree
    M = MidTree
    T0 = DomainStartParameterTree
    T1 = DomainEndParameterTree
# ---------- end domprop ----------
ext = ExtendCurve(Curve=item_3.Item3, Type=0, Start="0", End=domprop.L)
ccx = CurveCurve(CurveA=ext, CurveB=sidebuilding)  # -> Points, ParamsA, ParamsB
trim_10 = TrimTree(Tree=ccx.Points, Depth=1)
trim_11 = TrimTree(Tree=ccx.ParamsB, Depth=1)
merge_2 = Merge(Data1=trim_11, Data2=crv_cp_2.Parameter)
trim_12 = TrimTree(Tree=ccx.ParamsA, Depth=1)
shatter_2 = Shatter(Curve=sidebuilding, Parameters=merge_2)
shatter_3 = Shatter(Curve=ext, Parameters=trim_12)
trim_13 = TrimTree(Tree=shatter_2, Depth=1)
trim_14 = TrimTree(Tree=shatter_3, Depth=1)

item_6 = ListItem(List=trim_13, Index=0, Wrap=True)  # -> Item, Item1
item_7 = ListItem(List=trim_14, Index=0, Wrap=True)  # -> Item, Item1
ln_6 = Line(StartPoint=item_4.Item1, EndPoint=trim_10)
merge_3 = Merge(Data1=ln, Data2=lito3p.FilteredList, Data3=ln_2, Data4=item_7.Item, Data5=item_6.Item1, Data6=item_5)
merge_4 = Merge(Data1=ln_3, Data2=ln_4, Data3=ln_5, Data4=ln_6, Data5=item_6.Item1, Data6=item_5)
join = JoinCurves(Curves=merge_3, Preserve=False)
sidelongfassade = Curve(ln_6)
join_2 = JoinCurves(Curves=merge_4, Preserve=False)
trim_15 = TrimTree(Tree=join, Depth=1)
trim_16 = TrimTree(Tree=join_2, Depth=1)
end_2 = EndPoints(Curve=trim_15)  # -> Start, End
end_3 = EndPoints(Curve=trim_16)  # -> Start, End
ln_7 = Line(StartPoint=end_2.Start, EndPoint=end_2.End)
ln_8 = Line(StartPoint=end_3.Start, EndPoint=end_3.End)
merge_5 = Merge(Data1=ln_7, Data2=trim_15)
merge_6 = Merge(Data1=ln_8, Data2=trim_16)
sidelongfassade_2 = ClusterOutput(sidelongfassade)
join_3 = JoinCurves(Curves=merge_5, Preserve=False)
join_4 = JoinCurves(Curves=merge_6, Preserve=False)
trim_17 = TrimTree(Tree=join_3, Depth=1)
trim_18 = TrimTree(Tree=join_4, Depth=1)
simplify = SimplifyCurve(Curve=trim_17)  # -> Curve, Simplified
simplify_2 = SimplifyCurve(Curve=trim_18)  # -> Curve, Simplified
crv_cp_3 = CurveClosestPoint(Point=move.Geometry, Curve=simplify.Curve)  # -> Point, Parameter, Distance
crv_cp_4 = CurveClosestPoint(Point=move.Geometry, Curve=simplify_2.Curve)  # -> Point, Parameter, Distance
seam = Seam(Curve=simplify.Curve, Seam=crv_cp_3.Parameter)
seam_2 = Seam(Curve=simplify_2.Curve, Seam=crv_cp_4.Parameter)
crv_cp_5 = CurveClosestPoint(Point=crv_cp.Point, Curve=seam)  # -> Point, Parameter, Distance
crv_cp_6 = CurveClosestPoint(Point=crv_cp.Point, Curve=seam_2)  # -> Point, Parameter, Distance
seam_3 = Seam(Curve=seam, Seam=crv_cp_5.Parameter)
seam_4 = Seam(Curve=seam, Seam=crv_cp_6.Parameter)
flip = FlipCurve(Curve=seam_3, Guide=plotoutline_2)  # -> Curve, Flag
flip_2 = FlipCurve(Curve=seam_4, Guide=plotoutline_2)  # -> Curve, Flag
basenoncore = Curve(flip.Curve)
basenoncore_2 = ClusterOutput(basenoncore)
base = Curve(flip_2.Curve)
base_2 = ClusterOutput(base)

# ==== cluster _2D
x = ClusterInput()
expression = Expression(x=x, Expression="x/2")
neg = Negative(Value=expression)
dom = ConstructDomain(DomainStart=neg, DomainEnd=expression)
I = ClusterOutput(dom)

# ==== cluster PreviewPlane: Preview a plane with axis colors and naming.
axis_length = ClusterInput()
plane = ClusterInput()
axis_length_2 = Number(axis_length)
plane_2 = Plane(plane)
deplane = DeconstructPlane(Plane=plane_2)  # -> Origin, XAxis, YAxis, ZAxis
line = LineSDL(Start=deplane.Origin, Direction=deplane.YAxis, Length=axis_length_2)
line_2 = LineSDL(Start=deplane.Origin, Direction=deplane.XAxis, Length=axis_length_2)
line_3 = LineSDL(Start=deplane.Origin, Direction=deplane.ZAxis, Length=axis_length_2)
swatch = ColourSwatch(SwatchColor=RGB(235, 52, 79))
swatch_2 = ColourSwatch(SwatchColor=RGB(0, 166, 157))
swatch_3 = ColourSwatch(SwatchColor=RGB(240, 117, 24))
end = EndPoints(Curve=line_2)  # -> Start, End
end_2 = EndPoints(Curve=line)  # -> Start, End
end_3 = EndPoints(Curve=line_3)  # -> Start, End
tag = TextTag(Location=end.End, Text="X", Colour=swatch)
tag_2 = TextTag(Location=end_2.End, Text="Y", Colour=swatch_2)
tag_3 = TextTag(Location=end_3.End, Text="Z", Colour=swatch_3)
preview = CustomPreview(Geometry=line_2, Material=swatch)
preview_2 = CustomPreview(Geometry=line, Material=swatch_2)
preview_3 = CustomPreview(Geometry=line_3, Material=swatch_3)

# ==== cluster BoundingRectangle: Get a bounding rectangle on a plane of individual geometry.
geometry = ClusterInput()
plane = ClusterInput()
plane_2 = Plane(plane)
geometry_2 = Geometry(geometry)
bbox = BoundingBox(Content=geometry_2, Plane=plane_2)  # -> Box, Box_2
trim = TrimTree(Tree=bbox.Box, Depth=1)
debox = DeconstructBox(Box=trim)  # -> Plane, X, Y, Z
rectangle = Rectangle(Plane=debox.Plane, XSize=debox.X, YSize=debox.Y, Radius=0)  # -> Rectangle, Length
boundingrectangle = Rectangle(rectangle.Rectangle)
length = Number(rectangle.Length)
length_2 = ClusterOutput(length)
boundingrectangle_2 = ClusterOutput(boundingrectangle)
