# Grasshopper definition capsule.gh (Grasshopper 1.0.7)
# plug-ins: Semio.Grasshopper, eleFront

merge = Merge(Data1="back", Data2="back", Data3="back", Data4="back", Data5="side", Data6="side", Data7="side", Data8="side")
variant = Slider(0, range=0..7)
series = Series(Start=0, Step=1, Count="8")
safe = Button()
trim = TrimTree(Tree=series, Depth=1)
merge_2 = Merge(Data1="front", Data2="front", Data3="side", Data4="side", Data5="front", Data6="front", Data7="side", Data8="side")
filter = StreamFilter(Gate="0", Stream0=variant, Stream1=trim)
item = ListItem(List=merge, Index=filter, Wrap=True)
item_2 = ListItem(List=merge_2, Index=filter, Wrap=True)
merge_3 = Merge(Data1="F", Data2="T", Data3="F", Data4="T", Data5="F", Data6="T", Data7="F", Data8="T")
# ^
#                  |
# Preview    ->
# Parameters:
item_3 = ListItem(List=merge_3, Index=filter, Wrap=True)
toggle = BooleanToggle(False)
list = ValueList({"Front", "Side"}, selected="Front")
list_2 = ValueList({"Back": "back", "Side": "side"}, selected="Back")
# External
#      |
#      v
entrance = GetString(item, AtLeast=0, AtMost=1, TreeAccess=False)
view = GetString(item_2, AtLeast=0, AtMost=1, TreeAccess=False)
mirror = GetBoolean(item_3, AtLeast=0, AtMost=1, FalseValue="False", TreeAccess=False, TrueValue="True")
panel = Panel("""round
rectangular""")
panel_2 = Panel("""front
side""")
panel_3 = Panel("""back
side""")
itemindex = ItemIndex(L=panel_3, I=entrance)  # -> i; inputs L: list
# ---------- itemindex: Python ----------
#Component Information
#--------------------------------------------------------------------------------------------
if ghenv.Component.RunCount<2:
    #General
    #--------------------------------------------------------------------------------------------
    __author__ = "Ueli Saluz"
    __version__ = "2022.11.18"
    
    ghenv.Component.Name = "ItemIndex"
    ghenv.Component.NickName = "ItemIndex"
    ghenv.Component.Description = "A better IdemIndex"
    ghenv.Component.Message = "VER 1.0"
    ghenv.Component.Category = "Set"
    ghenv.Component.SubCategory = "List"
    
     #Inputs
    #--------------------------------------------------------------------------------------------
    inputIndex=0
    
    ghenv.Component.Params.Input[inputIndex].Name = "List"
    ghenv.Component.Params.Input[inputIndex].NickName = "L"
    ghenv.Component.Params.Input[inputIndex].Description = "Input1 is..."
    ghenv.Component.Params.Input[inputIndex].Optional = False
    inputIndex+=1
    
    ghenv.Component.Params.Input[inputIndex].Name = "Item"
    ghenv.Component.Params.Input[inputIndex].NickName = "I"
    ghenv.Component.Params.Input[inputIndex].Description = "Input2 is..."
    ghenv.Component.Params.Input[inputIndex].Optional = False
    inputIndex+=1
    
    #Outputs
    #--------------------------------------------------------------------------------------------
    outputIndex=0
    
    ghenv.Component.Params.Output[outputIndex].Name = "Index"
    ghenv.Component.Params.Output[outputIndex].NickName = "i"
    ghenv.Component.Params.Output[outputIndex].Description = "Output1 is..."
    outputIndex+=1

i = L.index(I)
# ---------- end itemindex ----------
itemindex_2 = ItemIndex(L=panel_2, I=view)  # -> i; inputs L: list; same code as itemindex
valueor0 = ValueOr0(value=itemindex)
valueor0_2 = ValueOr0(value=itemindex_2)
entrance_2 = Integer(valueor0)
view_2 = Integer(valueor0_2)
view_3 = Integer(view_2)
multiplication = Multiplication(A=view_3, B="2")
length = Number(Slider(420, range=0..1000))
# Local ->
_2d = _2D(x=length)
width = Number(Slider(260, range=0..1000))
_2d_2 = _2D(x=width)
height = Number(Slider(250, range=0..1000))
bool = Boolean(invert(mirror))
filter_2 = StreamFilter(Gate=entrance_2, Stream0=mirror, Stream1=bool)
mirror_2 = Boolean(filter_2)
mirrored = Boolean(mirror_2)
filletradius = Number(Slider(25, range=0..100))
shellthickness = Number(Slider(20, range=0..100))
subtraction = Subtraction(A=height, B=shellthickness)
neg = Negative(Value=shellthickness)
dom = ConstructDomain(DomainStart=neg, DomainEnd=subtraction)
box = DomainBox(Base=PlaneXY(0, 0, 0), X=_2d_2, Y=_2d, Z=dom)
volume1to500 = Box(box)
debrep = DeconstructBrep(Brep=volume1to500)  # -> Faces, Edges, Vertices
trim_2 = TrimTree(Tree=debrep.Edges, Depth=1)
trim_3 = TrimTree(Tree=debrep.Faces, Depth=1)
item_4 = ListItem(List=trim_3, Index=0, Wrap=True)  # -> Item, Item1, Item2, Item3, Item4, Item5
entrance_3 = Integer(entrance_2)
entrance_4 = Integer(entrance_3)
multiplication_2 = Multiplication(A=entrance_4, B="4")
addition = Addition(A=multiplication_2, B=multiplication, C=mirrored)
variant_2 = Integer(addition)

variant_3 = Integer(variant_2)
curdir = CurrentDirectory()  # -> D, P, S
# ---------- curdir: Python ----------
#Component Information
#--------------------------------------------------------------------------------------------
if ghenv.Component.RunCount<2:
    #General
    #--------------------------------------------------------------------------------------------
    __author__ = "Ueli Saluz"
    __version__ = "2023.09.29"
    
    ghenv.Component.Name = "CurrentDirectory"
    ghenv.Component.NickName = "CurDir"
    ghenv.Component.Description = "Current directory of the current grasshopper file."
    ghenv.Component.Message = "VER 1.0"
    ghenv.Component.Category = "Params"
    ghenv.Component.SubCategory = "Util"
    
    #Outputs
    #--------------------------------------------------------------------------------------------
    outputIndex=0
    
    ghenv.Component.Params.Output[outputIndex].Name = "Directory"
    ghenv.Component.Params.Output[outputIndex].NickName = "D"
    ghenv.Component.Params.Output[outputIndex].Description = "Directory of the current grasshopper file."
    outputIndex+=1
    
    ghenv.Component.Params.Output[outputIndex].Name = "Path"
    ghenv.Component.Params.Output[outputIndex].NickName = "P"
    ghenv.Component.Params.Output[outputIndex].Description = "Path of the current grasshopper file."
    outputIndex+=1
    
    ghenv.Component.Params.Output[outputIndex].Name = "Separator"
    ghenv.Component.Params.Output[outputIndex].NickName = "S"
    ghenv.Component.Params.Output[outputIndex].Description = "Separator of the current system."
    outputIndex+=1

#Imports
#--------------------------------------------------------------------------------------------
from os.path import dirname
from os import sep

#Solver - Run with trees to enhance performance drastically
#--------------------------------------------------------------------------------------------
if __name__ == "__main__":
    P = ghenv.Component.OnPingDocument().FilePath
    D = dirname(P)
    S = sep
# ---------- end curdir ----------
expression = Expression(x=variant_3, Expression="x+1")
concat = Concatenate(FragmentC="representations", FragmentD=curdir.S, FragmentA="capsule", FragmentB="_", FragmentE=expression, FragmentF="_")
concat_2 = Concatenate(FragmentA=concat, FragmentE="1to500", FragmentG="_", FragmentF="volume")
concat_3 = Concatenate(FragmentA=concat, FragmentE="1to200", FragmentG="_", FragmentF="volume")
concat_4 = Concatenate(FragmentA=concat_2, FragmentB=".3dm")
concat_5 = Concatenate(FragmentA=concat_3, FragmentB=".3dm")
rep = ModelRepresentation(Url=concat_4, LevelOfDetail="1to500", Tags="volume")  # -> Representation, Url, LevelOfDetail, Tags
rep_2 = ModelRepresentation(Url=concat_5, LevelOfDetail="1to200", Tags="volume")  # -> Representation, Url, LevelOfDetail, Tags

lng = ListLength(List=debrep.Edges)
series_2 = Series(Start=0, Step=1, Count=lng)
trim_4 = TrimTree(Tree=series_2, Depth=1)
filedge = FilletEdge(Shape=volume1to500, Blend=0, Metric=0, Edges=trim_4, Radii=filletradius)

list_3 = ValueList({"Round": "round", "Rectangular": "rectangular"}, selected="Round")
windowcircleradius = Number(Slider(65, range=0..100))
window_offset_wall = Number(Slider(30, range=0..100))
windowshape = Text(list_3)
itemindex_3 = ItemIndex(L=panel, I=windowshape)  # -> i; inputs L: list; same code as itemindex
valueor0_3 = ValueOr0(value=itemindex_3)

# ----
# Outputs   ->
#                 |
#                 v
case = TextCase(Text=mirror, Culture=127)  # -> UpperCase, LowerCase
merge_4 = Merge(Data1=entrance, Data2=view, Data3=case.LowerCase, Data4=length, Data5=width, Data6=height, Data7=windowshape)
panel_4 = Panel("""entrance
view
mirrored
length
width
heigth
window shape""")
panel_5 = Panel(merge_4)
panel_6 = Panel("""cm
cm
cm""")
qlt = ModelQuality(Name=panel_4, Value=panel_5, Unit=panel_6)  # -> Quality, Name, Value, Unit

windowshape_2 = Integer(valueor0_3)
door_offset_wall = Number(Slider(25, range=0..100))
door_width = Number(Slider(80, range=0..100))
door_height = Number(Slider(200, range=0..1000))

item_5 = ListItem(List=trim_2, Index=0, Wrap=True)  # -> Item, Item1, Item2, Item3
flip = FlipCurve(Curve=item_5.Item)  # -> Curve, Flag
filter_3 = StreamFilter(Gate=mirror_2, Stream0=flip.Curve, Stream1=item_5.Item)
filter_4 = StreamFilter(Gate=mirror_2, Stream0=item_4.Item1, Stream1=item_4.Item3)
filter_5 = StreamFilter(Gate=entrance_3, Stream0=filter_3, Stream1=item_5.Item1)
filter_6 = StreamFilter(Gate=entrance_3, Stream0=item_4.Item, Stream1=filter_4)
addition_2 = Addition(A=door_offset_wall, B=shellthickness)
eval = EvaluateLength(Curve=filter_5, Length=addition_2, Normalized=False)  # -> Point, Tangent, Parameter
srf_cp = SurfaceClosestPoint(Point=eval.Point, Surface=filter_6)  # -> Point, UVPoint, Distance
evalsrf = EvaluateSurface(Surface=filter_6, Point=srf_cp.UVPoint)  # -> Point, Normal, UDirection, VDirection, Frame
neg_2 = Negative(Value=door_width)
filter_7 = StreamFilter(Gate=entrance_3, Stream0=neg_2, Stream1=door_width)
filter_8 = StreamFilter(Gate=mirror_2, Stream0=filter_7, Stream1=door_width)
and = GateAnd(A=entrance_3, B=mirror_2)
filter_9 = StreamFilter(Gate=and, Stream0=filter_8, Stream1=neg_2)
rectangle = Rectangle(Plane=evalsrf.Frame, XSize=filter_9, YSize=door_height, Radius=0)  # -> Rectangle, Length
Z = UnitZ(Factor=shellthickness)
move = Move(Geometry=rectangle.Rectangle, Motion=Z)  # -> Geometry, Transform
door = Rectangle(move.Geometry)

flip_2 = FlipCurve(Curve=item_5.Item1)  # -> Curve, Flag
expression_2 = Expression(x=height, Expression="x/2")
filter_10 = StreamFilter(Gate=mirror_2, Stream0=item_5.Item3, Stream1=flip_2.Curve)
addition_3 = Addition(A=windowcircleradius, B=window_offset_wall, C=shellthickness)
Z_2 = UnitZ(Factor=expression_2)
filter_11 = StreamFilter(Gate=mirror_2, Stream0=item_4.Item3, Stream1=item_4.Item1)
eval_2 = EvaluateLength(Curve=filter_10, Length=addition_3, Normalized=False)  # -> Point, Tangent, Parameter
evalsrf_2 = EvaluateSurface(Surface=reparameterize(filter_11), Point="0.5,0.5")  # -> Point, Normal, UDirection, VDirection, Frame
move_2 = Move(Geometry=eval_2.Point, Motion=Z_2)  # -> Geometry, Transform
evalsrf_3 = EvaluateSurface(Surface=reparameterize(item_4.Item2), Point="0.5,0.5")  # -> Point, Normal, UDirection, VDirection, Frame
pl_origin = PlaneOrigin(Base=evalsrf_2.Frame, Origin=move_2.Geometry)
expression_3 = Expression(x=windowcircleradius, Expression="x*2")
filter_12 = StreamFilter(Gate=view_2, Stream0=evalsrf_3.Frame, Stream1=pl_origin)
_2d_3 = _2D(x=expression_3)
rectangle_2 = Rectangle(Plane=filter_12, XSize=_2d_3, YSize=_2d_3, Radius=0)  # -> Rectangle, Length
cir = Circle(Plane=filter_12, Radius=windowcircleradius)
filter_13 = StreamFilter(Gate=windowshape_2, Stream0=cir, Stream1=rectangle_2.Rectangle)
windowplane = Plane(filter_12)
window = Geometry(filter_13)

windowplane_2 = Plane(windowplane)
deplane = DeconstructPlane(Plane=windowplane_2)  # -> Origin, XAxis, YAxis, ZAxis
expression_4 = Expression(x=shellthickness, Expression="x/3")
neg_3 = Negative(Value=deplane.ZAxis)
amp = Amplitude(Vector=neg_3, Amplitude=expression_4)
extr = Extrude(Base=window, Direction=amp)
cap = CapHoles(Brep=extr)

srf = Surface(item_4.Item)
srf_2 = Surface(item_4.Item3)
srf_3 = Surface(item_4.Item2)
srf_4 = Surface(item_4.Item4)
srf_5 = Surface(item_4.Item1)
srf_6 = Surface(item_4.Item5)
mirrored_2 = Boolean(mirror_2)
mirrored_3 = Boolean(mirror_2)
filter_14 = StreamFilter(Gate=mirrored_2, Stream0=srf_5, Stream1=srf_2)
filter_15 = StreamFilter(Gate=mirrored_3, Stream0=srf_2, Stream1=srf_5)
merge_5 = Merge(Data1=srf_5, Data2=srf_2)
merge_6 = Merge(Data1=srf_5, Data2=srf)
merge_7 = Merge(Data1=srf, Data2=srf_3)
merge_8 = Merge(Data1=srf_5, Data2=srf_3)
merge_9 = Merge(Data1=srf_2, Data2=srf_3)
merge_10 = Merge(Data1=srf, Data2=srf_2)
entrance_5 = Integer(entrance_3)
window_2 = Integer(view_2)
filter_16 = StreamFilter(Gate=entrance_5, Stream0=srf, Stream1=filter_14)
filter_17 = StreamFilter(Gate=window_2, Stream0=srf_3, Stream1=filter_15)
filter_18 = StreamFilter(
    Gate=variant_2,
    Stream0=merge_5,
    Stream1=merge_5,
    Stream2=merge_8,
    Stream3=merge_9,
    Stream4=merge_10,
    Stream5=merge_6,
    Stream6=merge_7,
    Stream7=merge_7)

door_2 = Rectangle(door)
explode = Explode(Curve=door, Recursive=True)  # -> Segments, Vertices
trim_5 = TrimTree(Tree=explode.Segments, Depth=1)
item_6 = ListItem(List=trim_5, Index=0, Wrap=True)  # -> Item, Item1, Item2, Item3
eval_3 = EvaluateCurve(Curve=reparameterize(item_6.Item), Parameter="0.5")  # -> Point, Tangent, Angle
rev = Reverse(Vector=eval_3.Tangent)
Z_3 = UnitZ(Factor=1)
xprod = CrossProduct(VectorA=rev, VectorB=Z_3, Unitize=False)  # -> Vector, Length
pl = ConstructPlane(Origin=eval_3.Point, XAxis=eval_3.Tangent, YAxis=xprod.Vector)
doorentranceplane = Plane(pl)

pln = Plane(doorentranceplane)
spc = Specifier(Context="doors", Group="front")  # -> Specifier, Context, Group
por = Port(Plane=pln, Specifiers=spc.Specifier)  # -> Port, Plane, Specifiers

doorentranceplane_2 = Plane(doorentranceplane)
deplane_2 = DeconstructPlane(Plane=doorentranceplane_2)  # -> Origin, XAxis, YAxis, ZAxis
amp_2 = Amplitude(Vector=deplane_2.YAxis, Amplitude=shellthickness)
extr_2 = Extrude(Base=door, Direction=amp_2)
cap_2 = CapHoles(Brep=extr_2)

merge_11 = Merge(Data1=rep.Representation, Data2=rep_2.Representation)
typ = ModelType(
    Name="capsule",
    Explanation="A living capsule for one person.",
    Icon="📦",
    Representations=merge_11,
    Ports=por.Port,
    Qualities=qlt.Quality)  # -> Type, Name, Explanation, Icon, Representations, Ports, Qualities
typ_2 = RemoveType(TypeName=typ.Name, TypeQualities=typ.Qualities, Run=safe)
or = GateOr(A=safe, B=typ_2)
typ_3 = AddType(Type=typ.Type, Run=or)

merge_12 = Merge(Data1=cap_2, Data2=cap)
sdiff = SolidDifference(BrepsA=filedge, BrepsB=merge_12)
typ_4 = SerializeType(Type=typ.Type)
volume1to200 = Brep(sdiff)

volume1to200_2 = Brep(volume1to200)
expression_5 = Expression(x="volume", y=volume1to200_2, Expression="x")
ef_layer = EleFrontLayer(FullPath=expression_5)  # -> Layer, FullPath, Hidden, Locked, DisplayColour, MaterialName, Linetype, PrintColour, PrintWidth
ef_att = EleFrontAttributes(Layer=ef_layer.Layer)  # -> Attributes, Keys, Values, Name, Layer, ColourSource, DisplayColour, MaterialSource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
baketofile = BakeObjectsToFile(
    FilePath=concat_5,
    Geometry=volume1to200_2,
    Attributes=ef_att.Attributes,
    Bake=safe,
    networkMode=False,
    ValueTable_networkMode=True,
    overwriteMode="Overwrite",
    preset="Safest")

type = Text(typ_4)
context_bake = ContextBake(Geometry=type)
merge_13 = Merge(Data1=door, Data2=window)
merge_14 = Merge(Data1=filter_16, Data2=filter_17)
sdiff_2 = SolidDifference(BrepsA=merge_14, BrepsB=merge_13)
merge_15 = Merge(Data1=srf_4, Data2=filter_18, Data3=sdiff_2, Data4=srf_6)
shell = Surface(merge_15)
previewplane = PreviewPlane(plane=doorentranceplane, axis_length=Slider(100, range=0..100))

shell_2 = Surface(shell)
door_3 = Surface(door)
expression_6 = Expression(x="shell", y=shell_2, Expression="x")
window_3 = Surface(window)
ef_layer_2 = EleFrontLayer(FullPath=expression_6)  # -> Layer, FullPath, Hidden, Locked, DisplayColour, MaterialName, Linetype, PrintColour, PrintWidth
ef_layer_3 = EleFrontLayer(FullPath="window")  # -> Layer, FullPath, Hidden, Locked, DisplayColour, MaterialName, Linetype, PrintColour, PrintWidth
ef_layer_4 = EleFrontLayer(FullPath="door")  # -> Layer, FullPath, Hidden, Locked, DisplayColour, MaterialName, Linetype, PrintColour, PrintWidth
ef_att_2 = EleFrontAttributes(Layer=ef_layer_2.Layer)  # -> Attributes, Keys, Values, Name, Layer, ColourSource, DisplayColour, MaterialSource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
ef_att_3 = EleFrontAttributes(Layer=ef_layer_3.Layer)  # -> Attributes, Keys, Values, Name, Layer, ColourSource, DisplayColour, MaterialSource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
ef_att_4 = EleFrontAttributes(Layer=ef_layer_4.Layer)  # -> Attributes, Keys, Values, Name, Layer, ColourSource, DisplayColour, MaterialSource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

merge_16 = Merge(Data1=shell_2, Data2=window_3, Data3=door_3)
merge_17 = Merge(Data1=ef_att_2.Attributes, Data2=ef_att_3.Attributes, Data3=ef_att_4.Attributes)

baketofile_2 = BakeObjectsToFile(
    FilePath=concat_4,
    Geometry=merge_16,
    Attributes=merge_17,
    Bake=safe,
    networkMode=False,
    ValueTable_networkMode=True,
    overwriteMode="Overwrite",
    preset="Safest")

# ==== cluster _2D
x = ClusterInput()
expression = Expression(x=x, Expression="x/2")
neg = Negative(Value=expression)
dom = ConstructDomain(DomainStart=neg, DomainEnd=expression)
I = ClusterOutput(dom)

# ==== cluster ValueOr0
value = ClusterInput()
value_2 = Number(value)
null = NullItem(Item=value_2)  # -> NullFlags, InvalidFlags, Description
filter = StreamFilter(Gate=null.NullFlags, Stream0=value_2, Stream1="0")
valueor0 = Number(filter)
valueor0_2 = ClusterOutput(valueor0)

# ==== cluster PreviewPlane: Preview a plane with axis colors and naming.
axis_length = ClusterInput()
plane = ClusterInput()
axis_length_2 = Number(axis_length)
plane_2 = Plane(plane)
deplane = DeconstructPlane(Plane=plane_2)  # -> Origin, XAxis, YAxis, ZAxis
line = LineSDL(Start=deplane.Origin, Direction=deplane.YAxis, Length=axis_length_2)
line_2 = LineSDL(Start=deplane.Origin, Direction=deplane.XAxis, Length=axis_length_2)
line_3 = LineSDL(Start=deplane.Origin, Direction=deplane.ZAxis, Length=axis_length_2)
swatch = ColourSwatch(SwatchColor=RGB(235, 52, 79))
swatch_2 = ColourSwatch(SwatchColor=RGB(0, 166, 157))
swatch_3 = ColourSwatch(SwatchColor=RGB(240, 117, 24))
end = EndPoints(Curve=line_2)  # -> Start, End
end_2 = EndPoints(Curve=line)  # -> Start, End
end_3 = EndPoints(Curve=line_3)  # -> Start, End
tag = TextTag(Location=end.End, Text="X", Colour=swatch)
tag_2 = TextTag(Location=end_2.End, Text="Y", Colour=swatch_2)
tag_3 = TextTag(Location=end_3.End, Text="Z", Colour=swatch_3)
preview = CustomPreview(Geometry=line_2, Material=swatch)
preview_2 = CustomPreview(Geometry=line, Material=swatch_2)
preview_3 = CustomPreview(Geometry=line_3, Material=swatch_3)
