# Grasshopper definition nakagin-capsule-tower-speckle.gh (Grasshopper 1.0.8)
# plug-ins: Speckle 2, semio

# ---- group: Read representations from speckle
list = ValueList({"1to500", "1to200"}, selected="1to200")
run = BooleanToggle(True)

# ---- group: Upload representations to speckle NOTE: It can take quite long depending on the delay.
panel = Panel("Last Storey")
panel_2 = Panel("*")
panel_3 = Panel("Cylindric Tambour")
upload_delay_s = Slider(4, range=0..10)
variant = Slider(11, range=0..11)
export = BooleanToggle(False)
reset = Button()
run_2 = BooleanToggle(True)

# ----
curdir = CurrentDirectory()  # -> PD, D, P, S
# ---------- curdir: Python ----------
# Component Information
# --------------------------------------------------------------------------------------------
if ghenv.Component.RunCount < 2:
    # General
    # --------------------------------------------------------------------------------------------
    __author__ = "Ueli Saluz"
    __version__ = "2024.07.26"

    ghenv.Component.Name = "CurrentDirectory"
    ghenv.Component.NickName = "CurDir"
    ghenv.Component.Description = "Current directory of the current grasshopper file."
    ghenv.Component.Message = "VER 1.1"
    ghenv.Component.Category = "Params"
    ghenv.Component.SubCategory = "Util"

    # Outputs
    # --------------------------------------------------------------------------------------------
    outputIndex = 0

    ghenv.Component.Params.Output[outputIndex].Name = "ParentDirectory"
    ghenv.Component.Params.Output[outputIndex].NickName = "PD"
    ghenv.Component.Params.Output[outputIndex].Description = "Parent directory of the current directory."
    outputIndex += 1

    ghenv.Component.Params.Output[outputIndex].Name = "Directory"
    ghenv.Component.Params.Output[outputIndex].NickName = "D"
    ghenv.Component.Params.Output[outputIndex].Description = "Directory of the current grasshopper file."
    outputIndex += 1

    ghenv.Component.Params.Output[outputIndex].Name = "Path"
    ghenv.Component.Params.Output[outputIndex].NickName = "P"
    ghenv.Component.Params.Output[outputIndex].Description = "Path of the current grasshopper file."
    outputIndex += 1

    ghenv.Component.Params.Output[outputIndex].Name = "Separator"
    ghenv.Component.Params.Output[outputIndex].NickName = "S"
    ghenv.Component.Params.Output[outputIndex].Description = "Separator of the current system."
    outputIndex += 1

# Imports
# --------------------------------------------------------------------------------------------
from os.path import dirname, abspath
from os import sep

# Solver - Run with trees to enhance performance drastically
# --------------------------------------------------------------------------------------------
if __name__ == "__main__":
    P = ghenv.Component.OnPingDocument().FilePath
    D = dirname(P)
    PD = dirname(D)
    S = sep
# ---------- end curdir ----------
kit = LoadKit(Directory=curdir.D, Run=run_2)  # -> Name, Description, Icon, Url, Homepage, Types, Formations
trim = TrimTree(Tree=kit.Types, Depth=1)
typ = ModelType(Type=trim)  # -> Type, Name, Description, Icon, Variant, Unit, Representations, Ports, Qualities
tmatch = MatchText(Text=typ.Name, Pattern=panel_3, Case=True)
tmatch_2 = MatchText(Text=typ.Variant, Pattern=panel_2, Case=True)
and = GateAnd(A=tmatch, B=tmatch_2)
cull = CullPattern(List=trim, CullPattern=and)  # -> graft(List)

trim_2 = TrimTree(Tree=kit.Formations, Depth=1)
for = ModelFormation(Formation=trim_2)  # -> Formation, Name, Description, Icon, Variant, Unit, Pieces, Connections, Qualities
expression = Expression(x=for.Variant, y="Futuristic", Expression="x=y")
expression_2 = Expression(x=for.Name, y="Nakagin Capsule Tower", Expression="x=y")
expression_3 = Expression(x=for.Variant, Expression="x=y")
and_2 = GateAnd(A=expression_2, B=expression_3)
and_3 = GateAnd(A=expression_2, B=expression)
cull_2 = CullPattern(List=trim_2, CullPattern=and_2)
cull_3 = CullPattern(List=trim_2, CullPattern=and_3)
mime = Mime({".stl": "model/stl", ".obj": "model/obj", ".glb": "model/gltf-binary", ".gltf": "model/gltf+json", ".3dm": "model/vnd.3dm", ".speckle": "model/vnd.speckle+json", ".png": "image/png", ".jpg": "image/jpeg", ".jpeg": "image/jpeg", ".svg": "image/svg+xml", ".pdf": "application/pdf", ".zip": "application/zip", ".json": "application/json", ".csv": "text/csv", ".txt": "text/plain"}, selected=".speckle")
for_2 = ModelFormation(Formation=cull_2)  # -> Formation, Name, Description, Icon, Variant, Unit, Pieces, Connections, Qualities
scn = GetScene(FormationName=for_2.Name, FormationVariant=for_2.Variant, Run=run)
scn_2 = FilterScene(Scene=scn, LevelOfDetails=list, Tags="volume", Mimes=mime)  # -> Representations, Planes, PiecesIds, ParentsPiecesIds
trim_3 = TrimTree(Tree=scn_2.Planes, Depth=1)
trim_4 = TrimTree(Tree=scn_2.Representations, Depth=1)
rep = ModelRepresentation(Representation=trim_4)  # -> Representation, Url, LevelOfDetail, Tags, Tags_2
# https://app.speckle.systems/explorer
# 
# {
#   project(id:"e7de1a2f8f"){
#     models(limit:100, filter:{
#       search:"cylindric tambour"
#     }){
#       totalCount
#       items{
#         id
#         name
#       }
#     }
#   }
# }
# 
# mutation DeleteModel($input: DeleteModelInput!) {
#   modelMutations {
#     delete(input: $input)
#   }
# }
# 
# {
#   "input": {
#     "projectId": "e7de1a2f8f",
#     "id": ""
#   }
# }
cset = CreateSet(List=rep.Url)  # -> Set, Map

item = ListItem(List=cset.Set, Index=0, Wrap=True)  # -> Item, Item1, Item2, Item3, Item4, Item5, Item6, Item7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
receive = Receive(
    Stream=item.Item,
    AutoReceive=False,
    CurrentComponentState="expired",
    ExpandOutput=True,
    LastInfoMessage="Ueli Saluz @ 08/11/2024 13:02:54: Pushed 3 elements from Grasshopper. (id:e9d980e0f1)",
    ReceiveOnOpen=False,
    ReceivedCommitId="e9d980e0f1",
    StreamWrapper="https://app.speckle.systems/projects/e7de1a2f8f/models/b394acfd5c",
    selectedKitName="Objects")  # -> Info, Representation
receive_2 = Receive(
    Stream=item.Item1,
    AutoReceive=False,
    CurrentComponentState="expired",
    ExpandOutput=True,
    LastInfoMessage="Ueli Saluz @ 08/13/2024 14:09:45: Pushed 3 elements from Grasshopper. (id:153466ee93)",
    ReceiveOnOpen=False,
    ReceivedCommitId="153466ee93",
    StreamWrapper="https://app.speckle.systems/projects/e7de1a2f8f/models/tambour/first storey/1to200/volume",
    selectedKitName="Objects")  # -> Info, Representation
receive_3 = Receive(
    Stream=item.Item3,
    AutoReceive=False,
    CurrentComponentState="expired",
    ExpandOutput=True,
    LastInfoMessage="Ueli Saluz @ 08/13/2024 14:10:25: Pushed 3 elements from Grasshopper. (id:393b32e8b0)",
    ReceiveOnOpen=False,
    ReceivedCommitId="393b32e8b0",
    StreamWrapper="https://app.speckle.systems/projects/e7de1a2f8f/models/345fa2173d",
    selectedKitName="Objects")  # -> Info, Representation
receive_4 = Receive(
    Stream=item.Item5,
    AutoReceive=False,
    CurrentComponentState="expired",
    ExpandOutput=True,
    LastInfoMessage="Ueli Saluz @ 08/08/2024 19:18:12: Pushed 1 elements from Grasshopper. (id:cf0329dbd8)",
    ReceiveOnOpen=False,
    ReceivedCommitId="cf0329dbd8",
    StreamWrapper="https://app.speckle.systems/projects/e7de1a2f8f/models/45ab357369",
    selectedKitName="Objects")  # -> Info, Data
receive_5 = Receive(
    Stream=item.Item2,
    AutoReceive=False,
    CurrentComponentState="expired",
    ExpandOutput=True,
    LastInfoMessage="Ueli Saluz @ 08/13/2024 13:59:38: Pushed 3 elements from Grasshopper. (id:c481402a45)",
    ReceiveOnOpen=False,
    ReceivedCommitId="c481402a45",
    StreamWrapper="https://app.speckle.systems/projects/e7de1a2f8f/models/b27c179b7d",
    selectedKitName="Objects")  # -> Info, Representation
receive_6 = Receive(
    Stream=item.Item4,
    AutoReceive=False,
    CurrentComponentState="expired",
    ExpandOutput=True,
    LastInfoMessage="Ueli Saluz @ 08/11/2024 12:16:15: Pushed 3 elements from Grasshopper. (id:a4497b467a)",
    ReceiveOnOpen=False,
    ReceivedCommitId="a4497b467a",
    StreamWrapper="https://app.speckle.systems/projects/e7de1a2f8f/models/90435c0046",
    selectedKitName="Objects")  # -> Info, Representation
receive_7 = Receive(
    Stream=item.Item6,
    AutoReceive=False,
    CurrentComponentState="expired",
    ExpandOutput=True,
    LastInfoMessage="Ueli Saluz @ 08/08/2024 19:20:08: Pushed 1 elements from Grasshopper. (id:405e10e597)",
    ReceiveOnOpen=False,
    ReceivedCommitId="405e10e597",
    StreamWrapper="https://app.speckle.systems/projects/e7de1a2f8f/models/a6e1f7d736",
    selectedKitName="Objects")  # -> Info, Data
receive_8 = Receive(
    Stream=item.Item10,
    AutoReceive=False,
    CurrentComponentState="expired",
    ExpandOutput=True,
    LastInfoMessage="Ueli Saluz @ 08/08/2024 19:20:07: Pushed 1 elements from Grasshopper. (id:edd125a722)",
    ReceiveOnOpen=False,
    ReceivedCommitId="edd125a722",
    StreamWrapper="https://app.speckle.systems/projects/e7de1a2f8f/models/5004160f7d",
    selectedKitName="Objects")  # -> Info, Data
receive_9 = Receive(
    Stream=item.Item7,
    AutoReceive=False,
    CurrentComponentState="expired",
    ExpandOutput=True,
    LastInfoMessage="Ueli Saluz @ 08/09/2024 09:24:26: Pushed 1 elements from Grasshopper. (id:7bf618c472)",
    ReceiveOnOpen=False,
    ReceivedCommitId="7bf618c472",
    StreamWrapper="https://app.speckle.systems/projects/e7de1a2f8f/models/f16baa9eba",
    selectedKitName="Objects")  # -> Info, Data
receive_10 = Receive(
    Stream=item.Item11,
    AutoReceive=False,
    CurrentComponentState="expired",
    ExpandOutput=True,
    LastInfoMessage="Ueli Saluz @ 08/08/2024 19:19:27: Pushed 1 elements from Grasshopper. (id:e363f58d78)",
    ReceiveOnOpen=False,
    ReceivedCommitId="e363f58d78",
    StreamWrapper="https://app.speckle.systems/projects/e7de1a2f8f/models/ff37b776dd",
    selectedKitName="Objects")  # -> Info, Data
receive_11 = Receive(
    Stream=item.Item8,
    AutoReceive=False,
    CurrentComponentState="expired",
    ExpandOutput=True,
    LastInfoMessage="Ueli Saluz @ 08/08/2024 19:20:36: Pushed 1 elements from Grasshopper. (id:7d9e5c3ba3)",
    ReceiveOnOpen=False,
    ReceivedCommitId="7d9e5c3ba3",
    StreamWrapper="https://app.speckle.systems/projects/e7de1a2f8f/models/capsule/7/1to200/volume",
    selectedKitName="Objects")  # -> Info, Data
receive_12 = Receive(
    Stream=item.Item9,
    AutoReceive=False,
    CurrentComponentState="expired",
    ExpandOutput=True,
    LastInfoMessage="Ueli Saluz @ 08/12/2024 09:41:10: Pushed 3 elements from Grasshopper. (id:8372373b76)",
    ReceiveOnOpen=False,
    ReceivedCommitId="8372373b76",
    StreamWrapper="https://app.speckle.systems/projects/e7de1a2f8f/models/bridge/1to200/volume",
    selectedKitName="Objects")  # -> Info, Representation
sok = SpeckleObjectKeys(SpeckleObject=receive.Representation, perObject=True)
sok_2 = SpeckleObjectKeys(SpeckleObject=receive_2.Representation, perObject=True)
sok_3 = SpeckleObjectKeys(SpeckleObject=receive_3.Representation, perObject=True)
sok_4 = SpeckleObjectKeys(SpeckleObject=receive_4.Data, perObject=True)
sok_5 = SpeckleObjectKeys(SpeckleObject=receive_5.Representation, perObject=True)
sok_6 = SpeckleObjectKeys(SpeckleObject=receive_6.Representation, perObject=True)
sok_7 = SpeckleObjectKeys(SpeckleObject=receive_7.Data, perObject=True)
sok_8 = SpeckleObjectKeys(SpeckleObject=receive_8.Data, perObject=True)
sok_9 = SpeckleObjectKeys(SpeckleObject=receive_9.Data, perObject=True)
sok_10 = SpeckleObjectKeys(SpeckleObject=receive_10.Data, perObject=True)
sok_11 = SpeckleObjectKeys(SpeckleObject=receive_11.Data, perObject=True)
sok_12 = SpeckleObjectKeys(SpeckleObject=receive_12.Representation, perObject=True)
trim_5 = TrimTree(Tree=sok, Depth=1)
trim_6 = TrimTree(Tree=sok_2, Depth=1)
trim_7 = TrimTree(Tree=sok_3, Depth=1)
trim_8 = TrimTree(Tree=sok_4, Depth=1)
trim_9 = TrimTree(Tree=sok_5, Depth=1)
trim_10 = TrimTree(Tree=sok_6, Depth=1)
trim_11 = TrimTree(Tree=sok_7, Depth=1)
trim_12 = TrimTree(Tree=sok_8, Depth=1)
trim_13 = TrimTree(Tree=sok_9, Depth=1)
trim_14 = TrimTree(Tree=sok_10, Depth=1)
trim_15 = TrimTree(Tree=sok_11, Depth=1)
trim_16 = TrimTree(Tree=sok_12, Depth=1)
sovk = SpeckleObjectValueByKey(Object=receive.Representation, Key=trim_5, selectedKitName="Objects")
sovk_2 = SpeckleObjectValueByKey(Object=receive_2.Representation, Key=trim_6, selectedKitName="Objects")  # -> flatten(Value)
sovk_3 = SpeckleObjectValueByKey(Object=receive_3.Representation, Key=trim_7, selectedKitName="Objects")  # -> flatten(Value)
sovk_4 = SpeckleObjectValueByKey(Object=receive_4.Data, Key=trim_8, selectedKitName="Objects")  # -> flatten(Value)
sovk_5 = SpeckleObjectValueByKey(Object=receive_5.Representation, Key=trim_9, selectedKitName="Objects")  # -> flatten(Value)
sovk_6 = SpeckleObjectValueByKey(Object=receive_6.Representation, Key=trim_10, selectedKitName="Objects")  # -> flatten(Value)
sovk_7 = SpeckleObjectValueByKey(Object=receive_7.Data, Key=trim_11, selectedKitName="Objects")  # -> flatten(Value)
sovk_8 = SpeckleObjectValueByKey(Object=receive_8.Data, Key=trim_12, selectedKitName="Objects")  # -> flatten(Value)
sovk_9 = SpeckleObjectValueByKey(Object=receive_9.Data, Key=trim_13, selectedKitName="Objects")  # -> flatten(Value)
sovk_10 = SpeckleObjectValueByKey(Object=receive_10.Data, Key=trim_14, selectedKitName="Objects")  # -> flatten(Value)
sovk_11 = SpeckleObjectValueByKey(Object=receive_11.Data, Key=trim_15, selectedKitName="Objects")  # -> flatten(Value)
sovk_12 = SpeckleObjectValueByKey(Object=receive_12.Representation, Key=trim_16, selectedKitName="Objects")  # -> flatten(Value)
mrg_a = MergeSeperatlyAppend(
    x=sovk,
    y=sovk_2,
    z=sovk_5,
    u=sovk_3,
    v=sovk_6,
    w=sovk_4,
    s=sovk_7,
    t=sovk_9,
    xx=sovk_11,
    xy=sovk_12,
    xz=sovk_8,
    xu=sovk_10)  # -> Mrgd; inputs x: tree, y: tree, z: tree, u: tree, v: tree, w: tree, s: tree, t: tree, xx: tree, xy: tree, xz: tree, xu: tree
# ---------- mrg_a: Python ----------
if ghenv.Component.RunCount<2:
    __author__ = "Ueli Saluz"
    __version__ = "2020.05.28"
    
    ghenv.Component.Name = "MergeSeperatly(Append)"
    ghenv.Component.NickName = "Mrg(A)"
    ghenv.Component.Description = "Merge inputs seperatly on a new path. Append index of input parameter for distincting."
    ghenv.Component.Message = "VER 1.0"

from System import Object
from Grasshopper import DataTree
from Grasshopper.Kernel import GH_ParamAccess as Access

if __name__ == "__main__":
    Mrgd = DataTree[Object]()
    access = Access()
    
    for input in ghenv.Component.Params.Input:  #set all Inputaccess to Tree Access
        input.Access = access.tree
    
    for i,input in enumerate(ghenv.Component.Params.Input):
        for j,source in enumerate(input.Sources):
            for path in source.VolatileData.Paths:
                Mrgd.AddRange(source.VolatileData[path],path.AppendElement(i))
# ---------- end mrg_a ----------
tstat = TreeStatistics(Tree=mrg_a)  # -> Paths, Length, Count
item_2 = ListItem(List=tstat.Paths, Index=cset.Map, Wrap=True)
branch = TreeBranch(Tree=mrg_a, Path=item_2, MaintainPaths=False)
pl2pl = MoveObjectPlaneToPlane(G=branch, S=PlaneXY(0, 0, 0), T=graft(trim_3))  # -> TG, T; inputs S: Plane, T: Plane
# ---------- pl2pl: Python ----------
#Component Information
#--------------------------------------------------------------------------------------------
if ghenv.Component.RunCount<2:
    #General
    #--------------------------------------------------------------------------------------------
    __author__ = "Ueli Saluz"
    __version__ = "2023.02.12"
    
    ghenv.Component.Name = "MoveObjectPlaneToPlane"
    ghenv.Component.NickName = "Pl2Pl"
    ghenv.Component.Description = "Moves abitrary geometry from a source plane to a target plane."
    ghenv.Component.Message = "VER 1.2"
    ghenv.Component.Category = "Transform"
    ghenv.Component.SubCategory = "Euclidean"
    
     #Inputs
    #--------------------------------------------------------------------------------------------
    inputIndex=0
    
    ghenv.Component.Params.Input[inputIndex].Name = "Geometry"
    ghenv.Component.Params.Input[inputIndex].NickName = "G"
    ghenv.Component.Params.Input[inputIndex].Description = "Geometry to move."
    ghenv.Component.Params.Input[inputIndex].Optional = False
    inputIndex+=1
    
    ghenv.Component.Params.Input[inputIndex].Name = "SourcePlane"
    ghenv.Component.Params.Input[inputIndex].NickName = "S"
    ghenv.Component.Params.Input[inputIndex].Description = "Source plane of object."
    ghenv.Component.Params.Input[inputIndex].Optional = False
    inputIndex+=1
    
    ghenv.Component.Params.Input[inputIndex].Name = "TargetPlane"
    ghenv.Component.Params.Input[inputIndex].NickName = "T"
    ghenv.Component.Params.Input[inputIndex].Description = "Target plane of object."
    ghenv.Component.Params.Input[inputIndex].Optional = False
    inputIndex+=1
    
    #Outputs
    #--------------------------------------------------------------------------------------------
    outputIndex=0
    
    ghenv.Component.Params.Output[outputIndex].Name = "TranslatedGeometry"
    ghenv.Component.Params.Output[outputIndex].NickName = "TG"
    ghenv.Component.Params.Output[outputIndex].Description = "Translated geometry in target plane."
    outputIndex+=1
    
    ghenv.Component.Params.Output[outputIndex].Name = "Trasnform"
    ghenv.Component.Params.Output[outputIndex].NickName = "T"
    ghenv.Component.Params.Output[outputIndex].Description = "Transform describing translation form source to target plane."
    outputIndex+=1


#Imports
#--------------------------------------------------------------------------------------------
import Rhino.Geometry.Transform as trsf

def MvObjPlnToPln (geo,plnObj,plnDest):
    transform = trsf.PlaneToPlane(plnObj,plnDest)
    geo.Transform(transform)
    return (geo,transform)

TG, T = MvObjPlnToPln(G,S,T)
# ---------- end pl2pl ----------

typ_2 = ModelType(Type=cull)  # -> Type, Name, Description, Icon, Variant, Unit, Representations, Ports, Qualities
mime_2 = Mime({".stl": "model/stl", ".obj": "model/obj", ".glb": "model/gltf-binary", ".gltf": "model/gltf+json", ".3dm": "model/vnd.3dm", ".speckle": "model/vnd.speckle+json", ".png": "image/png", ".jpg": "image/jpeg", ".jpeg": "image/jpeg", ".svg": "image/svg+xml", ".pdf": "application/pdf", ".zip": "application/zip", ".json": "application/json", ".csv": "text/csv", ".txt": "text/plain"}, selected=".3dm")
mime_3 = Mime({".stl": "model/stl", ".obj": "model/obj", ".glb": "model/gltf-binary", ".gltf": "model/gltf+json", ".3dm": "model/vnd.3dm", ".speckle": "model/vnd.speckle+json", ".png": "image/png", ".jpg": "image/jpeg", ".jpeg": "image/jpeg", ".svg": "image/svg+xml", ".pdf": "application/pdf", ".zip": "application/zip", ".json": "application/json", ".csv": "text/csv", ".txt": "text/plain"}, selected=".speckle")
trim_17 = TrimTree(Tree=typ_2.Representations, Depth=1)
rep_2 = ModelRepresentation(Representation=trim_17)  # -> Representation, Url, Mime, LoD, Tags
expression_4 = Expression(x=rep_2.Mime, y=mime_2, Expression="x=y")
expression_5 = Expression(x=rep_2.Mime, y=mime_3, Expression="x=y")
cull_4 = CullPattern(List=rep_2.Representation, CullPattern=expression_5)
cull_5 = CullPattern(List=rep_2.Representation, CullPattern=expression_4)
rep_3 = ModelRepresentation(Representation=cull_4)  # -> Representation, Url, Mime, LoD, Tags
rep_4 = ModelRepresentation(Representation=cull_5)  # -> Representation, Url, Mime, LoD, Tags
tsort = SortText(Keys=rep_4.LoD, Values=rep_4.Url, Culture=127)  # -> Keys, Values
tsort_2 = SortText(Keys=rep_3.LoD, Values=rep_3.Url, Culture=127)  # -> Keys, Values
trim_18 = TrimTree(Tree=tsort_2.Values, Depth=1)
trim_19 = TrimTree(Tree=tsort.Values, Depth=1)  # -> graft(Tree)
concat = Concatenate(FragmentA=curdir.D, FragmentB=curdir.S, FragmentC=trim_19)

lng = ListLength(List=flatten(rep_4.Url))
expression_6 = Expression(x=lng, Expression="x-1")
panel_4 = Panel(expression_6)
panel_5 = Panel(trim_19)
# TODO: Include layer nesting. Layer name doesn't include partents.
panel_6 = Panel(trim_18)
semio_preview = SemioPreview(geo=pl2pl.TG)

item_3 = ListItem(List=flatten(trim_19), Index=variant, Wrap=True)
import = ImportContent(FilePath=concat, Import=run_2)  # -> ModelTransform, Objects, Layers, Linetypes, HatchPatterns, AnnotationStyles, Materials, BlockDefinitions
trim_20 = TrimTree(Tree=import.Objects, Depth=1)
trim_21 = TrimTree(Tree=import.Layers, Depth=1)
object = ModelObject(Object=trim_20)  # -> Object, Geometry, Name, Layer, Visibility, Display, Drafting, Render
tstat_2 = TreeStatistics(Tree=object.Geometry)  # -> Paths, Length, Count
item_4 = ListItem(List=flatten(tstat_2.Paths), Index=variant, Wrap=True)
layer = ModelLayer(Layer=object.Layer)  # -> Layer, Name, Hidden, Locked, DisplayColour, Material, Linetype
branch_2 = TreeBranch(Tree=object.Geometry, Path=item_4, MaintainPaths=True)
csokv = CreateSpeckleObjectByKeyValue(Keys=layer.Name, Values=object.Object, selectedKitName="Objects")
loop_slider = PythonScript(
    SliderToModify=variant,
    Min="0",
    Max=Slider(11, range=0..100),
    stepSize="1",
    Delay=upload_delay_s,
    Run=export,
    Reset=reset)  # inputs Run: Boolean, Reset: Boolean
# ---------- loop_slider: Python ----------
import time

def updateSliderInput(inputName,min,max,value,decimalPlace=2):
    for input in ghenv.Component.Params.Input:
        for source in input.Sources:
            if input.Name == str(inputName):
                source.Slider.DecimalPlaces = decimalPlace
                source.Slider.Minimum = min
                source.Slider.Maximum = max
                source.Slider.Value = value
                source.ExpireSolution(True)

def countDecimal(number):
    string= str(number)
    return string[::-1].find('.')

if Run == True:
    if SliderToModify < Max:
        time.sleep(Delay)
        updateSliderInput("SliderToModify",Min,Max,SliderToModify+stepSize,countDecimal(stepSize))
if Reset == True:
    updateSliderInput("SliderToModify",Min,Max,Min)
# ---------- end loop_slider ----------
item_5 = ListItem(List=flatten(csokv), Index=variant, Wrap=True)
item_6 = ListItem(List=flatten(trim_18), Index=variant, Wrap=True)

geo = Geometry(branch_2)
panel_7 = Panel(item_6)
panel_8 = Panel(item_3)

# ---- group: Upload representations to speckle NOTE: It can take quite long depending on the delay. (continued)
send = Send(
    Stream=item_6,
    Representation=item_5,
    AutoSend=False,
    BaseId="8aab74125e505f92a95d7aa77a7c5d25",
    CurrentComponentState="expired",
    KitName="Objects",
    OutputWrappers="https://app.speckle.systems\te7de1a2f8f\t30af7d2fe1",
    UseDefaultCache=True,
    selectedKitName="Objects")

# ----
txt = Text(trim_21)
fragment = TextFragment(Text=txt, Start="14")
panel_9 = Panel(fragment)

# ==== cluster SemioPreview
geo = ClusterInput()

geo_2 = Geometry(geo)
swatch = ColourSwatch(SwatchColor=RGB(0, 0, 0))
filtertype = FilterByType(ObjectType="Curve", Geometry=flatten(geo_2), invertFilter=False, returnNulls=False)  # -> ExcludedGeometry, IncludedGeometry
filtertype_2 = FilterByType(ObjectType="Brep", Geometry=flatten(geo_2), invertFilter=False, returnNulls=False)  # -> ExcludedGeometry, IncludedGeometry
debrep = DeconstructBrep(Brep=filtertype_2.IncludedGeometry)  # -> Faces, Edges, Vertices
preview = CustomPreview(Geometry=flatten(filtertype.IncludedGeometry), Material=swatch)
preview_2 = CustomPreview(Geometry=flatten(filtertype_2.IncludedGeometry), Material=ColourSwatch(SwatchColor=RGB(255, 255, 255)))
preview_3 = CustomPreview(Geometry=flatten(debrep.Edges), Material=swatch)
