# Grasshopper definition nakagin-capsule-tower.gh (Grasshopper 1.0.7)
# plug-ins: semio, Speckle 2

list = Accounts(
    {"No account selected": , "Account (ueli.saluz@iek.uni-hannover.de | https://app.speckle.systems)": "https://app.speckle.systems/?id=9168be9d22"}, selected="Account (ueli.saluz@iek.uni-hannover.de | https://app.speckle.systems)",
    FirstSelectedItem="https://app.speckle.systems/?id=9168be9d22")
accdet = AccountDetails(SpeckleAccount=list)  # -> IsDefault, ServerName, ServerCompany, ServerURL, UserID, UserName, UserCompany, UserEmail
slist = StreamList(SpeckleAccount=list, Limit=10)
sdet = StreamDetails(Stream=slist)  # -> StreamID, Name, Description, CreatedAt, UpdatedAt, Public, Collaborators, Branches
item = ListItem(List=sdet.StreamID, Index=0, Wrap=True)
panel = Panel(sdet.Name)
txt = Text("e7de1a2f8f")
curdir = CurrentDirectory()  # -> D, P, S
# ---------- curdir: Python ----------
#Component Information
#--------------------------------------------------------------------------------------------
if ghenv.Component.RunCount<2:
    #General
    #--------------------------------------------------------------------------------------------
    __author__ = "Ueli Saluz"
    __version__ = "2023.09.29"
    
    ghenv.Component.Name = "CurrentDirectory"
    ghenv.Component.NickName = "CurDir"
    ghenv.Component.Description = "Current directory of the current grasshopper file."
    ghenv.Component.Message = "VER 1.0"
    ghenv.Component.Category = "Params"
    ghenv.Component.SubCategory = "Util"
    
    #Outputs
    #--------------------------------------------------------------------------------------------
    outputIndex=0
    
    ghenv.Component.Params.Output[outputIndex].Name = "Directory"
    ghenv.Component.Params.Output[outputIndex].NickName = "D"
    ghenv.Component.Params.Output[outputIndex].Description = "Directory of the current grasshopper file."
    outputIndex+=1
    
    ghenv.Component.Params.Output[outputIndex].Name = "Path"
    ghenv.Component.Params.Output[outputIndex].NickName = "P"
    ghenv.Component.Params.Output[outputIndex].Description = "Path of the current grasshopper file."
    outputIndex+=1
    
    ghenv.Component.Params.Output[outputIndex].Name = "Separator"
    ghenv.Component.Params.Output[outputIndex].NickName = "S"
    ghenv.Component.Params.Output[outputIndex].Description = "Separator of the current system."
    outputIndex+=1

#Imports
#--------------------------------------------------------------------------------------------
from os.path import dirname
from os import sep

#Solver - Run with trees to enhance performance drastically
#--------------------------------------------------------------------------------------------
if __name__ == "__main__":
    P = ghenv.Component.OnPingDocument().FilePath
    D = dirname(P)
    S = sep
# ---------- end curdir ----------
panel_2 = Panel("https://github.com/usalu/semio/releases/download/r24.08-2/examples.zip")

# ----
# Everything for metabolistic architecture.
panel_3 = Panel("https://github.com/usalu/semio/tree/r24.08-2/examples/metabolism")
remove_formations = BooleanToggle(False)
remove_types = BooleanToggle(False)
read_kit = BooleanToggle(True)
kit = DeleteKit(Run=Toggle(False))
kit_2 = LoadKit(Run=read_kit)  # -> Name, Description, Icon, Url, Homepage, Types, Formations
panel_4 = Panel("Cylindric Shaft")
panel_5 = Panel("Cylindric Capital")
panel_6 = Panel("Capsule")
panel_7 = Panel("Base")
panel_8 = Panel("Capital")
panel_9 = Panel("Shaft")
typ = ModelType(Type=kit_2.Types)  # -> Type, Name, Description, Icon, Variant, Unit, Representations, Ports, Qualities
panel_10 = Panel(typ.Type)
for = ModelFormation(Formation=kit_2.Formations)  # -> Formation, Name, Description, Icon, Variant, Unit, Pieces, Attractions, Qualities
for_2 = RemoveFormation(FormationName=for.Name, FormationVariant=for.Variant, Run=remove_formations)
tmatch = MatchText(Text=typ.Name, Pattern="*", Case=True)
trim = TrimTree(Tree=kit_2.Types, Depth=1)
cull = CullPattern(List=kit_2.Types, CullPattern=tmatch)
typ_2 = ModelType(Type=cull)  # -> Type, Name, Description, Icon, Variant, Unit, Representations, Ports, Qualities
panel_11 = Panel(typ_2.Type)
typ_3 = RemoveType(TypeName=typ_2.Name, TypeVariant=typ_2.Variant, Run=remove_types)

panel_12 = Panel("r24.08-2")
kit_3 = CreateKit(Name="Metabolism", Icon="🫀", Url=panel_2, Homepage=panel_3, Run=Toggle(True))
ty = Type([null x29])
fo = Formation([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])
panel_13 = Panel("The second tower (eleven storey) of the Nakagin Capule Tower.")
panel_14 = Panel("11")
panel_15 = Panel("2")
genes = GenePool(Decimals=0, Maximum=10, Minimum=0, Value=[3, 6, 9])

energy_global_warming_potential_kgco2e_k = ValueList({"Natural Gas": 0.201, "Heating Oil": 0.216, "Electricity Non-Renewable": 0.5, "Electricity Renewable": 0}, selected="Natural Gas")  # "Energy Global Warming Potential [kgCO2e/kWh]"
energy_global_warming_potential_kgco2e_k_2 = ValueList({"Natural Gas": 0.201, "Heating Oil": 0.216, "Electricity Non-Renewable": 0.5, "Electricity Renewable": 0}, selected="Electricity Non-Renewable")  # "Energy Global Warming Potential [kgCO2e/kWh]"
energy_price_kwh = ValueList({"Natural Gas": 0.095, "Heating Oil": 0.10, "Electricity Non-Renewable": 0.25, "Electrictiy Renewable": 0.35}, selected="Natural Gas")
energy_price_kwh_2 = ValueList({"Natural Gas": 0.095, "Heating Oil": 0.10, "Electricity Non-Renewable": 0.25, "Electrictiy Renewable": 0.35}, selected="Electricity Non-Renewable")
list_2 = ValueList({"Full": 0, "First Tower": 1, "Second Tower": 2}, selected="Full")
futuristic = BooleanToggle(False)
list_3 = ValueList({"1to500", "1to200"}, selected="1to500")
run = BooleanToggle(True)

heating_energy_price_kwh = Number(energy_price_kwh)
heating_efficiency_factor = Number(Slider(0.9, range=0.5..4))
electrictiy_global_warming_potential_kgc = Number(energy_global_warming_potential_kgco2e_k_2)  # "Electrictiy Global Warming Potential [kgCO2e/kWh]"
heating_global_warming_potential_kgco2e = Number(energy_global_warming_potential_kgco2e_k)  # "Heating Global Warming Potential [kgCO2e/kWh]"
cooling_energy_price_kwh = Number(energy_price_kwh_2)
cooling_efficiency_factor = Number(Slider(0.9, range=0.5..4))
cooling_global_warming_potential_kgco2e = Number(energy_global_warming_potential_kgco2e_k_2)  # "Cooling Global Warming Potential [kgCO2e/kWh]"
electrictiy_energy_price_cent_kwh = Number(energy_price_kwh_2)

# ---- group: No impact on design. Only on drawing of diagram.
diagram_piece_diameter = Panel("40")
expression = Expression(x=diagram_piece_diameter, Expression="x/2")
addition = Addition(A=diagram_piece_diameter, B=Slider(10, range=0..10))
multiplication = Multiplication(A=diagram_piece_diameter, B=Slider(2, range=0..10))
neg = Negative(Value=multiplication)
neg_2 = Negative(Value=addition)
neg_3 = Negative(Value=addition)
model_screen_point = ModelScreenPoint(X=addition, Y=neg)  # -> ScreenPoint, X, Y
addition_2 = Addition(A=model_screen_point.Y, B=neg)
addition_3 = Addition(A=model_screen_point.Y, B=neg)
model_screen_point_2 = ModelScreenPoint(X=model_screen_point.X, Y=addition_2)  # -> ScreenPoint, X, Y
addition_4 = Addition(A=model_screen_point_2.X, B=multiplication)
series = Series(Start=addition_4, Step=addition, Count="8")
trim_2 = TrimTree(Tree=series, Depth=1)
model_screen_point_3 = ModelScreenPoint(X=neg_2, Y=neg)  # -> ScreenPoint, X, Y
model_screen_point_4 = ModelScreenPoint(X=model_screen_point_3.X, Y=addition_3)  # -> ScreenPoint, X, Y
subtraction = Subtraction(A=model_screen_point_4.X, B=multiplication)
series_2 = Series(Start=subtraction, Step=neg_2, Count="8")
trim_3 = TrimTree(Tree=series_2, Depth=1)

# ----
xy = XYPlane(Origin=Point(0, 0, 0))
concat = Concatenate(FragmentD="b", FragmentC="_", FragmentA="s", FragmentB="2")
concat_2 = Concatenate(FragmentD="b", FragmentC="_", FragmentA="s", FragmentB="1")
concat_3 = Concatenate(FragmentD=concat_2, FragmentC="_", FragmentA="ci")
concat_4 = Concatenate(FragmentD=concat, FragmentC="_", FragmentA="ci")
pce = ModelPiece(Id=concat_3, TypeName="Capital", DiagramScreenPoint=model_screen_point_2.ScreenPoint)  # -> Piece, Id, TypeName, TypeVariant, RootPlane, DiagramScreenPoint
pce_2 = ModelPiece(Id="b", TypeName="Base", RootPlane=xy)  # -> Piece, Id, TypeName, TypeVariant, RootPlane, DiagramScreenPoint
pce_3 = ModelPiece(Id=concat_2, TypeName="Shaft", TypeVariant="1", DiagramScreenPoint=model_screen_point.ScreenPoint)  # -> Piece, Id, TypeName, TypeVariant, RootPlane, DiagramScreenPoint
pce_4 = ModelPiece(Id=concat, TypeName="Shaft", TypeVariant="2", DiagramScreenPoint=model_screen_point_3.ScreenPoint)  # -> Piece, Id, TypeName, TypeVariant, RootPlane, DiagramScreenPoint
pce_5 = ModelPiece(Id=concat_4, TypeName="Capital", DiagramScreenPoint=model_screen_point_4.ScreenPoint)  # -> Piece, Id, TypeName, TypeVariant, RootPlane, DiagramScreenPoint
core = Panel("c")
concat_5 = Concatenate(FragmentA=core, FragmentB="-", FragmentC="0")
top = Panel("t")
concat_6 = Concatenate(FragmentA=core, FragmentB="-", FragmentC="1")
bottom = Panel("b")
sde = ModelSide(PieceId=pce_3.Id, PieceTypePortId=top)  # -> Side, PieceId, PieceTypePortId
sde_2 = ModelSide(PieceId=pce_4.Id, PieceTypePortId=top)  # -> Side, PieceId, PieceTypePortId
sde_3 = ModelSide(PieceId=pce_2.Id, PieceTypePortId=concat_6)  # -> Side, PieceId, PieceTypePortId
sde_4 = ModelSide(PieceId=pce_4.Id, PieceTypePortId=bottom)  # -> Side, PieceId, PieceTypePortId
sde_5 = ModelSide(PieceId=pce_2.Id, PieceTypePortId=concat_5)  # -> Side, PieceId, PieceTypePortId
sde_6 = ModelSide(PieceId=pce_3.Id, PieceTypePortId=bottom)  # -> Side, PieceId, PieceTypePortId
filter = StreamFilter(Gate=futuristic, Stream1=Slider(-9, range=-360..360))
con = ModelConnection(ConnectedSide=sde.Side, ConnectingSide=pce.Id)  # -> Connection, ConnectedSide, ConnectingSide, Offset, Rotation
con_2 = ModelConnection(ConnectedSide=sde_3.Side, ConnectingSide=sde_4.Side)  # -> Connection, ConnectedSide, ConnectingSide, Offset, Rotation
con_3 = ModelConnection(ConnectedSide=sde_2.Side, ConnectingSide=pce_5.Id)  # -> Connection, ConnectedSide, ConnectingSide, Offset, Rotation
con_4 = ModelConnection(ConnectedSide=sde_5.Side, ConnectingSide=sde_6.Side, Rotation=filter)  # -> Connection, ConnectedSide, ConnectingSide, Offset, Rotation

merge = Merge(Data1=con_2.Connection, Data2=con_4.Connection, Data3=con.Connection, Data4=con_3.Connection)
merge_2 = Merge(Data1=pce_2.Piece, Data2=pce_4.Piece, Data3=pce_3.Piece, Data4=pce_5.Piece, Data5=pce.Piece)

genes_2 = GenePool(Decimals=0, Maximum=8, Minimum=0, Value=[0, 0, 0, 0, 0, 0, 0, 0, 0])
genes_3 = GenePool(Decimals=0, Maximum=8, Minimum=0, Value=[6, 6, 6, 6, 6, 6, 6, 6, 6])
genes_4 = GenePool(Decimals=0, Maximum=8, Minimum=0, Value=[6, 0, 0, 6, 6, 3, 3, 6, 0])
genes_5 = GenePool(Decimals=0, Maximum=8, Minimum=0, Value=[0, 1, 2, 3, 4, 5, 6, 7, 8])

# ---- group: No impact on design. Only on drawing of diagram. (continued)
expression_2 = Expression(x="9", Expression="x/2")
multiplication_2 = Multiplication(A=expression_2, B=neg_2)
addition_5 = Addition(A=model_screen_point_3.Y, B=multiplication_2, C=expression)
model_screen_point_5 = ModelScreenPoint(X=trim_2, Y=addition_5)  # -> ScreenPoint, X, Y

# ----
tower = Tower(
    number_of_floors="9",
    shaftpieceid=pce_3.Id,
    capsulepatternnortheast=genes_2,
    capsulepatternsoutheast=genes_3,
    capsulepatternsouthwest=genes_4,
    capsulepatternnorthwest=genes_5,
    diagramstarts=model_screen_point_5.ScreenPoint,
    diagramverticaldirection=addition)  # -> pc_2, co_2

merge_3 = Merge(Data1=con.Connection, Data2=tower.co_2)
merge_4 = Merge(Data1=pce_3.Piece, Data2=pce.Piece, Data3=tower.pc_2)
for_3 = ModelFormation(
    Name="Capsule Tower",
    Description="The first tower (nine storey) of the Nakagin Capule Tower.",
    Icon="9",
    Variant="1",
    Pieces=merge_4,
    Connections=merge_3)  # -> Formation, Name, Description, Icon, Variant, Unit, Pieces, Connections, Qualities

genes_6 = GenePool(Decimals=0, Maximum=8, Minimum=0, Value=[0, 0, 0, 0, 0, 0, 0, 0, 0, 0, 0])
genes_7 = GenePool(Decimals=0, Maximum=8, Minimum=0, Value=[6, 0, 0, 0, 6, 6, 0, 6, 0, 6, 3])
genes_8 = GenePool(Decimals=0, Maximum=8, Minimum=0, Value=[6, 6, 6, 6, 6, 6, 6, 6, 6, 6, 6])
genes_9 = GenePool(Decimals=0, Maximum=8, Minimum=0, Value=[8, 8, 8, 8, 8, 8, 8, 8, 8, 8, 8])

# ---- group: No impact on design. Only on drawing of diagram. (continued)
expression_3 = Expression(x="11", Expression="x/2")
multiplication_3 = Multiplication(A=expression_3, B=neg_2)
addition_6 = Addition(A=model_screen_point.Y, B=multiplication_3, C=expression)
model_screen_point_6 = ModelScreenPoint(X=trim_3, Y=addition_6)  # -> ScreenPoint, X, Y

# ----
tower_2 = Tower(
    number_of_floors="11",
    shaftpieceid=pce_4.Id,
    capsulepatternnortheast=genes_6,
    capsulepatternsoutheast=genes_8,
    capsulepatternsouthwest=genes_9,
    capsulepatternnorthwest=genes_7,
    diagramstarts=model_screen_point_6.ScreenPoint,
    diagramverticaldirection=addition)  # -> pc_2, co_2

merge_5 = Merge(Data1=tower_2.pc_2, Data2=tower.pc_2)
merge_6 = Merge(Data1=tower_2.co_2, Data2=tower.co_2)
merge_7 = Merge(Data1=con_3.Connection, Data2=tower_2.co_2)
merge_8 = Merge(Data1=pce_4.Piece, Data2=pce_5.Piece, Data3=tower_2.pc_2)
merge_9 = Merge(Data1=merge_2, Data2=merge_5)
merge_10 = Merge(Data1=merge, Data2=merge_6)
for_4 = ModelFormation(Name="Capsule Tower", Description=panel_13, Pieces=merge_8, Connections=merge_7)  # -> Formation, Name, Description, Icon, Variant, Unit, Pieces, Connections, Qualities
for_5 = ModelFormation(
    Name="Nakagin Capsule Tower",
    Description="The former Nakagin Capsule Tower from Tokyio.",
    Icon="🏯",
    Pieces=merge_9,
    Connections=merge_10)  # -> Formation, Name, Description, Icon, Variant, Unit, Pieces, Connections, Qualities
add_bridges = AddBridges(fo=for_5.Formation, levels=genes)
filter_2 = StreamFilter(Gate=list_2, Stream0=add_bridges, Stream1=for_3.Formation, Stream2=for_4.Formation)

replacetypevariantinformation = ReplaceTypeVariantInFormation(fo=filter_2, type_name="Base", new_variant_name="Blob")
replacetypeinformation = TypInFor(fo=replacetypevariantinformation, old_type_name="Capsule", new_type_name="Ellipsoid Capsule")
replacetypeinformation_2 = TypInFor(fo=replacetypeinformation, old_type_name="Shaft", new_type_name="Cylindric Shaft")
replacetypeinformation_3 = TypInFor(fo=replacetypeinformation_2, old_type_name="Capital", new_type_name="Cylindric Capital")
panel_16 = Panel("A futuristic version of the former Nakagin Capsule Tower from Tokyio.")
for_6 = ModelFormation(Formation=replacetypeinformation_3, Description=panel_16, Variant="Futuristic")  # -> Formation, Name, Description, Icon, Variant, Unit, Pieces, Connections, Qualities
filter_3 = StreamFilter(Gate=futuristic, Stream0=filter_2, Stream1=for_6.Formation)

performance_assessment = PerformanceAssessment(
    fo=filter_3,
    ty=trim,
    heating_energy_price_cent_kwh=heating_energy_price_kwh,
    heating_efficiency_factor=heating_efficiency_factor,
    heating_global_warming_potential_kgco2e=heating_global_warming_potential_kgco2e,
    cooling_energy_price_cent_kwh=cooling_energy_price_kwh,
    cooling_efficiency_factor=cooling_efficiency_factor,
    cooling_global_warming_potential_kgco2e=cooling_global_warming_potential_kgco2e,
    electrictiy_energy_price_cent_kwh=electrictiy_energy_price_cent_kwh,
    electrictiy_global_warming_potential_kgc=electrictiy_global_warming_potential_kgc)  # -> fo_4, effective_floor_area_m²_2, specific_operational_global_warming_pote_2, construction_cost_2, return_a_2, construction_global_warming_potential_kg_2, operational_cost_a_2, operational_global_warming_potential_kgc_2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

for_7 = ModelFormation(Formation=performance_assessment.fo_4)  # -> Formation, Name, Description, Icon, Variant, Unit, Pieces, Connections, Qualities
for_8 = RemoveFormation(FormationName=for_7.Name, FormationVariant=for_7.Variant, Run=run)
or = GateOr(A=run, B=for_8)
for_9 = AddFormation(Formation=for_7.Formation, Run=or)
scn = GetScene(FormationName=for_7.Name, FormationVariant=for_7.Variant, Run=for_9)
scn_2 = FilterScene(Scene=scn, LevelOfDetails=list_3, Tags="volume", Formats=".3dm")  # -> Representations, Planes, PiecesIds, ParentsPiecesIds
trim_4 = TrimTree(Tree=scn_2.Representations, Depth=1)
trim_5 = TrimTree(Tree=scn_2.Planes, Depth=1)
rep = ModelRepresentation(Representation=trim_4)  # -> Representation, Url, LevelOfDetail, Tags
concat_7 = Concatenate(FragmentA=curdir.D, FragmentB=curdir.S, FragmentC=rep.Url)
load_geometry = LoadGeometry(path=concat_7, pln=trim_5)

previewplane = PreviewPlane(plane=trim_5, axis_length=Slider(2, range=0..10))
semio_preview = SemioPreview(geo=load_geometry)
expression_4 = Expression(x=performance_assessment.construction_cost_2, Expression="x/1000000")
expression_5 = Expression(x=performance_assessment.operational_cost_a_2, Expression="x/1000000")
expression_6 = Expression(x=performance_assessment.maintenance_expenses_a_2, Expression="x/1000000")
expression_7 = Expression(x=performance_assessment.income_2, Expression="x/1000000")
expression_8 = Expression(x=performance_assessment.return_a_2, Expression="x/1000000")
expression_9 = Expression(x=performance_assessment.operational_energy_cost_a_2, Expression="x/1000000")
expression_10 = Expression(x=performance_assessment.construction_global_warming_potential_kg_2, Expression="x/1000")
expression_11 = Expression(x=performance_assessment.operational_global_warming_potential_kgc_2, Expression="x/1000")
expression_12 = Expression(x=performance_assessment.heating_energy_demand_kwh_a_2, Expression="x/1000")
expression_13 = Expression(x=performance_assessment.cooling_energy_demand_kwh_a_2, Expression="x/1000")
expression_14 = Expression(x=performance_assessment.technical_equipment_energy_demand_kwh_a_2, Expression="x/1000")
roundmult = RoundToMultiple(N=expression_7, M="0.05")  # -> R; inputs N: tree, M: tree
# ---------- roundmult: Python ----------
#Component Information
#--------------------------------------------------------------------------------------------
if ghenv.Component.RunCount<2:
    #General
    #--------------------------------------------------------------------------------------------
    __author__ = "YOUR NAME"
    __version__ = "2000.00.00"
    
    ghenv.Component.Name = "Round to Multiple"
    ghenv.Component.NickName = "RoundMult"
    ghenv.Component.Description = "Rounds a number to the nearest specified multiple."
    ghenv.Component.Message = "VER 1.0"
    ghenv.Component.Category = "Math"
    ghenv.Component.SubCategory = "Arithmetic"
    
     #Inputs
    #--------------------------------------------------------------------------------------------
    inputIndex=0
    
    ghenv.Component.Params.Input[inputIndex].Name = "Number"
    ghenv.Component.Params.Input[inputIndex].NickName = "N"
    ghenv.Component.Params.Input[inputIndex].Description = "Number to round."
    ghenv.Component.Params.Input[inputIndex].Optional = False
    inputIndex+=1
    
    ghenv.Component.Params.Input[inputIndex].Name = "Multiple"
    ghenv.Component.Params.Input[inputIndex].NickName = "M"
    ghenv.Component.Params.Input[inputIndex].Description = "Multiple to round to."
    ghenv.Component.Params.Input[inputIndex].Optional = False
    inputIndex+=1
    
    #Outputs
    #--------------------------------------------------------------------------------------------
    outputIndex=0
    
    ghenv.Component.Params.Output[outputIndex].Name = "Rounded"
    ghenv.Component.Params.Output[outputIndex].NickName = "R"
    ghenv.Component.Params.Output[outputIndex].Description = "Number rounded to the nearest specified multiple."
    outputIndex+=1


#Imports
#--------------------------------------------------------------------------------------------
from System import Object
from Grasshopper import DataTree
import math


#The Component function - Business logic only (e.g. working without trees)
#--------------------------------------------------------------------------------------------
"""Function that this component is computing.
    Inputs:
        number: The number to round.
        multiple: The multiple to round to.
    Output:
        rounded: The number rounded to the nearest specified multiple."""
def RoundToMultiple(number, multiple):
    rounded = math.ceil(number / multiple) * multiple
    return rounded

#Solver - Run with trees to enhance performance drastically
#--------------------------------------------------------------------------------------------
if __name__ == "__main__":
    
    #Initialize trees
    #--------------------------------------------------------------------------------------------
    RoundedTree = DataTree[Object]()
    
    #Data matching
    #--------------------------------------------------------------------------------------------
    for path in N.Paths:
        numberBranch = N.Branch(path)
        for i, number in enumerate(numberBranch):
            multiple = M.Branch(path)[i]
            rounded = RoundToMultiple(number, multiple)
            RoundedTree.Add(rounded, path)
    
     #Assign trees to output
    #--------------------------------------------------------------------------------------------
    R = RoundedTree
# ---------- end roundmult ----------
roundmult_2 = RoundToMultiple(N=expression_6, M="0.05")  # -> R; inputs N: tree, M: tree; same code as roundmult
roundmult_3 = RoundToMultiple(N=performance_assessment.specific_energy_demand_kwh_m²a_2, M="2.5")  # -> R; inputs N: tree, M: tree; same code as roundmult
roundmult_4 = RoundToMultiple(N=expression_9, M="0.05")  # -> R; inputs N: tree, M: tree; same code as roundmult
roundmult_5 = RoundToMultiple(N=expression_12, M=1)  # -> R; inputs N: tree, M: tree; same code as roundmult
roundmult_6 = RoundToMultiple(N=expression_13, M=1)  # -> R; inputs N: tree, M: tree; same code as roundmult
roundmult_7 = RoundToMultiple(N=expression_14, M=1)  # -> R; inputs N: tree, M: tree; same code as roundmult
roundmult_8 = RoundToMultiple(N=performance_assessment.effective_floor_area_m²_2, M="25")  # -> R; inputs N: tree, M: tree; same code as roundmult
roundmult_9 = RoundToMultiple(N=performance_assessment.specific_operational_global_warming_pote_2, M=1)  # -> R; inputs N: tree, M: tree; same code as roundmult
roundmult_10 = RoundToMultiple(N=expression_4, M="0.05")  # -> R; inputs N: tree, M: tree; same code as roundmult
roundmult_11 = RoundToMultiple(N=expression_8, M="0.05")  # -> R; inputs N: tree, M: tree; same code as roundmult
roundmult_12 = RoundToMultiple(N=expression_10, M="25")  # -> R; inputs N: tree, M: tree; same code as roundmult
roundmult_13 = RoundToMultiple(N=expression_5, M="0.05")  # -> R; inputs N: tree, M: tree; same code as roundmult
roundmult_14 = RoundToMultiple(N=expression_11, M="5")  # -> R; inputs N: tree, M: tree; same code as roundmult
effective_floor_area_m² = Number(roundmult_8)
specific_operational_global_warming_pote = Number(roundmult_9)  # "Specific Operational Global Warming Potential [kgCO2e/m²a]"
construction_cost_mio = Number(roundmult_10)
return_a = Number(roundmult_11)
construction_global_warming_potential_tc = Number(roundmult_12)  # "Construction Global Warming Potential [tCO2e]"
operational_cost_mio_a = Number(roundmult_13)
operational_global_warming_potential_tco = Number(roundmult_14)  # "Operational Global Warming Potential [tCO2e/a]"
income_mio_a = Number(roundmult)
maintenance_expenses_mio_a = Number(roundmult_2)
operational_energy_cost_a = Number(roundmult_4)
cooling_energy_demand_mwh_a = Number(roundmult_6)
technical_equipment_energy_demand_mwh_a = Number(roundmult_7)
specific_energy_demand_kwh_m²a = Number(roundmult_3)
heating_energy_demand_mwh_a = Number(roundmult_5)

return_a_2 = Panel(return_a)
operational_cost_mio_a_2 = Panel(operational_cost_mio_a)
effective_floor_area_m²_2 = Panel(effective_floor_area_m²)
construction_cost_mio_2 = Panel(construction_cost_mio)
income_mio_a_2 = Panel(income_mio_a)
operational_energy_cost_a_2 = Panel(operational_energy_cost_a)
maintenance_expenses_mio_a_2 = Panel(maintenance_expenses_mio_a)
specific_operational_global_warming_pote_2 = Panel(specific_operational_global_warming_pote)  # "Specific Operational Global Warming Potential [kgCO2e/m²a]"
construction_global_warming_potential_tc_2 = Panel(construction_global_warming_potential_tc)  # "Construction Global Warming Potential [tCO2e]"
operational_global_warming_potential_tco_2 = Panel(operational_global_warming_potential_tco)  # "Operational Global Warming Potential [tCO2e/a]"
specific_energy_demand_kwh_m²a_2 = Panel(specific_energy_demand_kwh_m²a)
heating_energy_demand_mwh_a_2 = Panel(heating_energy_demand_mwh_a)
cooling_energy_demand_mwh_a_2 = Panel(cooling_energy_demand_mwh_a)
technical_equipment_energy_demand_mwh_a_2 = Panel(technical_equipment_energy_demand_mwh_a)

# ==== cluster PreviewPlane: Preview a plane with axis colors and naming.
axis_length = ClusterInput()
plane = ClusterInput()
axis_length_2 = Number(axis_length)
plane_2 = Plane(plane)
deplane = DeconstructPlane(Plane=plane_2)  # -> Origin, XAxis, YAxis, ZAxis
line = LineSDL(Start=deplane.Origin, Direction=deplane.YAxis, Length=axis_length_2)
line_2 = LineSDL(Start=deplane.Origin, Direction=deplane.XAxis, Length=axis_length_2)
line_3 = LineSDL(Start=deplane.Origin, Direction=deplane.ZAxis, Length=axis_length_2)
swatch = ColourSwatch(SwatchColor=RGB(235, 52, 79))
swatch_2 = ColourSwatch(SwatchColor=RGB(0, 166, 157))
swatch_3 = ColourSwatch(SwatchColor=RGB(240, 117, 24))
end = EndPoints(Curve=line_2)  # -> Start, End
end_2 = EndPoints(Curve=line)  # -> Start, End
end_3 = EndPoints(Curve=line_3)  # -> Start, End
tag = TextTag(Location=end.End, Text="X", Colour=swatch)
tag_2 = TextTag(Location=end_2.End, Text="Y", Colour=swatch_2)
tag_3 = TextTag(Location=end_3.End, Text="Z", Colour=swatch_3)
preview = CustomPreview(Geometry=line_2, Material=swatch)
preview_2 = CustomPreview(Geometry=line, Material=swatch_2)
preview_3 = CustomPreview(Geometry=line_3, Material=swatch_3)

# ==== cluster Tower
diagramverticaldirection = ClusterInput()
number_of_floors = ClusterInput()
shaftpieceid = ClusterInput()
capsulepatternnortheast = ClusterInput()
capsulepatternsoutheast = ClusterInput()
capsulepatternsouthwest = ClusterInput()
capsulepatternnorthwest = ClusterInput()
diagramstarts = ClusterInput()
diagramverticaldirection_2 = Integer(diagramverticaldirection)
capsulepatternnorthwest_2 = Integer(capsulepatternnorthwest)
capsulepatternsoutheast_2 = Integer(capsulepatternsoutheast)
number_of_floors_2 = Integer(number_of_floors)
shaftpieceid_2 = Text(shaftpieceid)
capsulepatternsouthwest_2 = Integer(capsulepatternsouthwest)
diagramstarts_2 = ScreenPoint(diagramstarts)
item = ListItem(List=diagramstarts_2, Index=0, Wrap=True)  # -> Item, Item1, Item2, Item3, Item4, Item5, Item6, Item7
model_screen_point = ModelScreenPoint(ScreenPoint=item.Item)  # -> ScreenPoint, X, Y
model_screen_point_2 = ModelScreenPoint(ScreenPoint=item.Item2)  # -> ScreenPoint, X, Y
model_screen_point_3 = ModelScreenPoint(ScreenPoint=item.Item4)  # -> ScreenPoint, X, Y
model_screen_point_4 = ModelScreenPoint(ScreenPoint=item.Item1)  # -> ScreenPoint, X, Y
model_screen_point_5 = ModelScreenPoint(ScreenPoint=item.Item6)  # -> ScreenPoint, X, Y
model_screen_point_6 = ModelScreenPoint(ScreenPoint=item.Item3)  # -> ScreenPoint, X, Y
model_screen_point_7 = ModelScreenPoint(ScreenPoint=item.Item5)  # -> ScreenPoint, X, Y
model_screen_point_8 = ModelScreenPoint(ScreenPoint=item.Item7)  # -> ScreenPoint, X, Y
series = Series(Start=model_screen_point.Y, Step=diagramverticaldirection_2, Count=number_of_floors_2)
series_2 = Series(Start=model_screen_point_2.Y, Step=diagramverticaldirection_2, Count=number_of_floors_2)
series_3 = Series(Start=model_screen_point_3.Y, Step=diagramverticaldirection_2, Count=number_of_floors_2)
series_4 = Series(Start=model_screen_point_4.Y, Step=diagramverticaldirection_2, Count=number_of_floors_2)
series_5 = Series(Start=model_screen_point_5.Y, Step=diagramverticaldirection_2, Count=number_of_floors_2)
series_6 = Series(Start=model_screen_point_6.Y, Step=diagramverticaldirection_2, Count=number_of_floors_2)
series_7 = Series(Start=model_screen_point_7.Y, Step=diagramverticaldirection_2, Count=number_of_floors_2)
series_8 = Series(Start=model_screen_point_8.Y, Step=diagramverticaldirection_2, Count=number_of_floors_2)
trim = TrimTree(Tree=series, Depth=1)
trim_2 = TrimTree(Tree=series_2, Depth=1)
trim_3 = TrimTree(Tree=series_3, Depth=1)
trim_4 = TrimTree(Tree=series_4, Depth=1)
trim_5 = TrimTree(Tree=series_5, Depth=1)
trim_6 = TrimTree(Tree=series_6, Depth=1)
trim_7 = TrimTree(Tree=series_7, Depth=1)
trim_8 = TrimTree(Tree=series_8, Depth=1)
rev = ReverseList(List=trim)
rev_2 = ReverseList(List=trim_2)
rev_3 = ReverseList(List=trim_3)
rev_4 = ReverseList(List=trim_4)
rev_5 = ReverseList(List=trim_6)
rev_6 = ReverseList(List=trim_5)
rev_7 = ReverseList(List=trim_7)
rev_8 = ReverseList(List=trim_8)
model_screen_point_9 = ModelScreenPoint(ScreenPoint=model_screen_point.ScreenPoint, Y=rev)  # -> graft(ScreenPoint), X, Y
model_screen_point_10 = ModelScreenPoint(ScreenPoint=model_screen_point_2.ScreenPoint, Y=rev_2)  # -> graft(ScreenPoint), X, Y
model_screen_point_11 = ModelScreenPoint(ScreenPoint=model_screen_point_3.ScreenPoint, Y=rev_3)  # -> graft(ScreenPoint), X, Y
model_screen_point_12 = ModelScreenPoint(ScreenPoint=model_screen_point_4.ScreenPoint, Y=rev_4)  # -> graft(ScreenPoint), X, Y
model_screen_point_13 = ModelScreenPoint(ScreenPoint=model_screen_point_5.ScreenPoint, Y=rev_6)  # -> graft(ScreenPoint), X, Y
model_screen_point_14 = ModelScreenPoint(ScreenPoint=model_screen_point_6.ScreenPoint, Y=rev_5)  # -> graft(ScreenPoint), X, Y
model_screen_point_15 = ModelScreenPoint(ScreenPoint=model_screen_point_7.ScreenPoint, Y=rev_7)  # -> graft(ScreenPoint), X, Y
model_screen_point_16 = ModelScreenPoint(ScreenPoint=model_screen_point_8.ScreenPoint, Y=rev_8)  # -> graft(ScreenPoint), X, Y
capsulepatternnortheast_2 = Integer(capsulepatternnortheast)
panel = Panel("""0
0
1
0
1
0
2
3
3""")
merge = Merge(Data1="1", Data2="3", Data3="5", Data4="7")
merge_2 = Merge(Data1="2", Data2="4", Data3="6", Data4="8")
panel_2 = Panel("""2
3
3
0
0
1
0
0
1""")

item_2 = ListItem(List=panel_2, Index=capsulepatternnortheast_2, Wrap=True)
capsuletypeeastleft = Integer(item_2)

item_3 = ListItem(List=panel, Index=capsulepatternnortheast_2, Wrap=True)
capsuletypenorthright = Integer(item_3)

item_4 = ListItem(List=panel, Index=capsulepatternsoutheast_2, Wrap=True)
capsuletypeeastright = Integer(item_4)

item_5 = ListItem(List=panel, Index=capsulepatternsouthwest_2, Wrap=True)
capsuletypewestleft = Integer(item_5)
item_6 = ListItem(List=merge, Index=capsuletypewestleft, Wrap=True)  # -> graft(Item)

series_9 = Series(Start=0, Step=1, Count=number_of_floors_2)
trim_9 = TrimTree(Tree=series_9, Depth=1)  # -> graft(Tree)
door = Panel("d")
split_level = Panel("sl")
floor = Panel("f")
concat = Concatenate(FragmentA=floor, FragmentC="-", FragmentB=trim_9)

expression = Expression(x="2", y=trim_9, Expression="x")
concat_2 = Concatenate(FragmentA=door, FragmentC="-", FragmentB=expression)

item_7 = ListItem(List=panel_2, Index=capsulepatternsoutheast_2, Wrap=True)
capsuletypesouthleft = Integer(item_7)
item_8 = ListItem(List=merge, Index=capsuletypesouthleft, Wrap=True)  # -> graft(Item)

expression_2 = Expression(x="1", y=trim_9, Expression="x")
concat_3 = Concatenate(FragmentA=split_level, FragmentC="-", FragmentB=expression_2)

expression_3 = Expression(x="0", y=trim_9, Expression="x")
expression_4 = Expression(x="0", y=trim_9, Expression="x")

expression_5 = Expression(x="2", y=trim_9, Expression="x")
concat_4 = Concatenate(FragmentA=split_level, FragmentC="-", FragmentB=expression_5)

item_9 = ListItem(List=panel, Index=capsulepatternnorthwest_2, Wrap=True)
capsuletypenorthleft = Integer(item_9)
item_10 = ListItem(List=merge, Index=capsuletypenorthleft, Wrap=True)  # -> graft(Item)

item_11 = ListItem(List=merge, Index=capsuletypeeastleft, Wrap=True)  # -> graft(Item)

concat_5 = Concatenate(FragmentA=split_level, FragmentC="-", FragmentB=expression_3)
concat_6 = Concatenate(FragmentA=door, FragmentC="-", FragmentB=expression_4)
concat_7 = Concatenate(FragmentA=concat, FragmentD="#", FragmentB=concat_5, FragmentC="#", FragmentE=concat_6)
sde = ModelSide(PieceId=shaftpieceid_2, PieceTypePortId=concat_7)  # -> Side, PieceId, PieceTypePortId
concat_8 = Concatenate(FragmentA=shaftpieceid_2, FragmentB="_", FragmentD="c", FragmentE="#", FragmentC=concat_7)

pce = ModelPiece(Id=concat_8, TypeName="Capsule", TypeVariant=item_8, DiagramScreenPoint=model_screen_point_9.ScreenPoint)  # -> Piece, Id, TypeName, TypeVariant, RootPlane, DiagramScreenPoint
trim_10 = TrimTree(Tree=pce.Piece, Depth=1)
trim_11 = TrimTree(Tree=pce.Id, Depth=1)

trim_12 = TrimTree(Tree=sde.Side, Depth=1)

con = ModelConnection(ConnectedSide=trim_12, ConnectingSide=trim_11)  # -> Connection, ConnectedSide, ConnectingSide, Offset, Rotation

concat_9 = Concatenate(FragmentA=concat, FragmentD="#", FragmentB=concat_3, FragmentC="#", FragmentE=concat_6)
sde_2 = ModelSide(PieceId=shaftpieceid_2, PieceTypePortId=concat_9)  # -> Side, PieceId, PieceTypePortId
trim_13 = TrimTree(Tree=sde_2.Side, Depth=1)

concat_10 = Concatenate(FragmentA=shaftpieceid_2, FragmentB="_", FragmentD="c", FragmentE="#", FragmentC=concat_9)
pce_2 = ModelPiece(Id=concat_10, TypeName="Capsule", TypeVariant=item_10, DiagramScreenPoint=model_screen_point_11.ScreenPoint)  # -> Piece, Id, TypeName, TypeVariant, RootPlane, DiagramScreenPoint
trim_14 = TrimTree(Tree=pce_2.Id, Depth=1)
trim_15 = TrimTree(Tree=pce_2.Piece, Depth=1)

con_2 = ModelConnection(ConnectedSide=trim_13, ConnectingSide=trim_14)  # -> Connection, ConnectedSide, ConnectingSide, Offset, Rotation

concat_11 = Concatenate(FragmentA=concat, FragmentD="#", FragmentB=concat_4, FragmentC="#", FragmentE=concat_6)
sde_3 = ModelSide(PieceId=shaftpieceid_2, PieceTypePortId=concat_11)  # -> Side, PieceId, PieceTypePortId
trim_16 = TrimTree(Tree=sde_3.Side, Depth=1)

concat_12 = Concatenate(FragmentA=shaftpieceid_2, FragmentB="_", FragmentD="c", FragmentE="#", FragmentC=concat_11)
pce_3 = ModelPiece(Id=concat_12, TypeName="Capsule", TypeVariant=item_6, DiagramScreenPoint=model_screen_point_13.ScreenPoint)  # -> Piece, Id, TypeName, TypeVariant, RootPlane, DiagramScreenPoint
trim_17 = TrimTree(Tree=pce_3.Id, Depth=1)
trim_18 = TrimTree(Tree=pce_3.Piece, Depth=1)

con_3 = ModelConnection(ConnectedSide=trim_16, ConnectingSide=trim_17)  # -> Connection, ConnectedSide, ConnectingSide, Offset, Rotation

concat_13 = Concatenate(FragmentA=concat, FragmentD="#", FragmentB=concat_5, FragmentE="#", FragmentC=concat_2)
sde_4 = ModelSide(PieceId=shaftpieceid_2, PieceTypePortId=concat_13)  # -> Side, PieceId, PieceTypePortId
trim_19 = TrimTree(Tree=sde_4.Side, Depth=1)

concat_14 = Concatenate(FragmentA=shaftpieceid_2, FragmentB="_", FragmentD="c", FragmentE="#", FragmentC=concat_13)
pce_4 = ModelPiece(Id=concat_14, TypeName="Capsule", TypeVariant=item_11, DiagramScreenPoint=model_screen_point_10.ScreenPoint)  # -> Piece, Id, TypeName, TypeVariant, RootPlane, DiagramScreenPoint
trim_20 = TrimTree(Tree=pce_4.Piece, Depth=1)
trim_21 = TrimTree(Tree=pce_4.Id, Depth=1)

con_4 = ModelConnection(ConnectedSide=trim_19, ConnectingSide=trim_21)  # -> Connection, ConnectedSide, ConnectingSide, Offset, Rotation

item_12 = ListItem(List=panel_2, Index=capsulepatternnorthwest_2, Wrap=True)
capsuletypewestright = Integer(item_12)
item_13 = ListItem(List=merge_2, Index=capsuletypewestright, Wrap=True)  # -> graft(Item)

item_14 = ListItem(List=panel_2, Index=capsulepatternsouthwest_2, Wrap=True)
capsuletypesouthrigh = Integer(item_14)
item_15 = ListItem(List=merge_2, Index=capsuletypesouthrigh, Wrap=True)  # -> graft(Item)

expression_6 = Expression(x="3", y=trim_9, Expression="x")
concat_15 = Concatenate(FragmentA=door, FragmentC="-", FragmentB=expression_6)
concat_16 = Concatenate(FragmentA=concat, FragmentD="#", FragmentB=concat_5, FragmentC="#", FragmentE=concat_15)
sde_5 = ModelSide(PieceId=shaftpieceid_2, PieceTypePortId=concat_16)  # -> Side, PieceId, PieceTypePortId
trim_22 = TrimTree(Tree=sde_5.Side, Depth=1)

item_16 = ListItem(List=merge_2, Index=capsuletypenorthright, Wrap=True)  # -> graft(Item)
concat_17 = Concatenate(FragmentA=shaftpieceid_2, FragmentB="_", FragmentD="c", FragmentE="#", FragmentC=concat_16)
pce_5 = ModelPiece(Id=concat_17, TypeName="Capsule", TypeVariant=item_16, DiagramScreenPoint=model_screen_point_14.ScreenPoint)  # -> Piece, Id, TypeName, TypeVariant, RootPlane, DiagramScreenPoint
trim_23 = TrimTree(Tree=pce_5.Id, Depth=1)
trim_24 = TrimTree(Tree=pce_5.Piece, Depth=1)

con_5 = ModelConnection(ConnectedSide=trim_22, ConnectingSide=trim_23)  # -> Connection, ConnectedSide, ConnectingSide, Offset, Rotation

expression_7 = Expression(x="1", y=trim_9, Expression="x")
concat_18 = Concatenate(FragmentA=door, FragmentC="-", FragmentB=expression_7)
concat_19 = Concatenate(FragmentA=concat, FragmentD="#", FragmentB=concat_5, FragmentC="#", FragmentE=concat_18)
sde_6 = ModelSide(PieceId=shaftpieceid_2, PieceTypePortId=concat_19)  # -> Side, PieceId, PieceTypePortId
trim_25 = TrimTree(Tree=sde_6.Side, Depth=1)

item_17 = ListItem(List=merge_2, Index=capsuletypeeastright, Wrap=True)  # -> graft(Item)
concat_20 = Concatenate(FragmentA=shaftpieceid_2, FragmentB="_", FragmentD="c", FragmentE="#", FragmentC=concat_19)
pce_6 = ModelPiece(Id=concat_20, TypeName="Capsule", TypeVariant=item_17, DiagramScreenPoint=model_screen_point_12.ScreenPoint)  # -> Piece, Id, TypeName, TypeVariant, RootPlane, DiagramScreenPoint
trim_26 = TrimTree(Tree=pce_6.Id, Depth=1)
trim_27 = TrimTree(Tree=pce_6.Piece, Depth=1)

con_6 = ModelConnection(ConnectedSide=trim_25, ConnectingSide=trim_26)  # -> Connection, ConnectedSide, ConnectingSide, Offset, Rotation

concat_21 = Concatenate(FragmentA=concat, FragmentD="#", FragmentB=concat_3, FragmentC="#", FragmentE=concat_18)
sde_7 = ModelSide(PieceId=shaftpieceid_2, PieceTypePortId=concat_21)  # -> Side, PieceId, PieceTypePortId
trim_28 = TrimTree(Tree=sde_7.Side, Depth=1)

concat_22 = Concatenate(FragmentA=shaftpieceid_2, FragmentB="_", FragmentD="c", FragmentE="#", FragmentC=concat_21)
pce_7 = ModelPiece(Id=concat_22, TypeName="Capsule", TypeVariant=item_13, DiagramScreenPoint=model_screen_point_15.ScreenPoint)  # -> Piece, Id, TypeName, TypeVariant, RootPlane, DiagramScreenPoint
trim_29 = TrimTree(Tree=pce_7.Id, Depth=1)
trim_30 = TrimTree(Tree=pce_7.Piece, Depth=1)

con_7 = ModelConnection(ConnectedSide=trim_28, ConnectingSide=trim_29)  # -> Connection, ConnectedSide, ConnectingSide, Offset, Rotation

concat_23 = Concatenate(FragmentA=concat, FragmentD="#", FragmentB=concat_4, FragmentC="#", FragmentE=concat_18)
sde_8 = ModelSide(PieceId=shaftpieceid_2, PieceTypePortId=concat_23)  # -> Side, PieceId, PieceTypePortId
trim_31 = TrimTree(Tree=sde_8.Side, Depth=1)

concat_24 = Concatenate(FragmentA=shaftpieceid_2, FragmentB="_", FragmentD="c", FragmentE="#", FragmentC=concat_23)
pce_8 = ModelPiece(Id=concat_24, TypeName="Capsule", TypeVariant=item_15, DiagramScreenPoint=model_screen_point_16.ScreenPoint)  # -> Piece, Id, TypeName, TypeVariant, RootPlane, DiagramScreenPoint
trim_32 = TrimTree(Tree=pce_8.Id, Depth=1)
trim_33 = TrimTree(Tree=pce_8.Piece, Depth=1)

con_8 = ModelConnection(ConnectedSide=trim_31, ConnectingSide=trim_32)  # -> Connection, ConnectedSide, ConnectingSide, Offset, Rotation

merge_3 = Merge(Data1=trim_10, Data2=trim_27, Data3=trim_20, Data4=trim_24, Data5=trim_15, Data6=trim_30, Data7=trim_18, Data8=trim_33)
merge_4 = Merge(
    Data1=con.Connection,
    Data2=con_6.Connection,
    Data3=con_4.Connection,
    Data4=con_5.Connection,
    Data5=con_2.Connection,
    Data6=con_7.Connection,
    Data7=con_3.Connection,
    Data8=con_8.Connection)
co = Connection(merge_4)
pc = Piece(merge_3)
co_2 = ClusterOutput(co)
pc_2 = ClusterOutput(pc)

# ==== cluster AddBridges
fo = ClusterInput()
levels = ClusterInput()
fo_2 = Formation(fo)
levels_2 = Integer(levels)
expression = Expression(x=levels_2, Expression="x-1")
concat = Concatenate(FragmentA="b_s1_c#f-", FragmentB=expression, FragmentC="#sl-0#d-2")
concat_2 = Concatenate(FragmentA="b_s2_c#f-", FragmentB=expression, FragmentC="#sl-0#d-1")
merge = Merge(Data1=concat, Data2=concat_2)
remove_pieces = Pc(fo=fo_2, ids=merge)  # -> fo_4, removed_pieces_2, removed_attractions_2
lng = ListLength(List=levels_2)
for = ModelFormation(Formation=remove_pieces.fo_4)  # -> Formation, Name, Description, Icon, Variant, Unit, Pieces, Connections, Qualities
trim = TrimTree(Tree=for.Pieces, Depth=1)
trim_2 = TrimTree(Tree=for.Connections, Depth=1)
split = SplitList(List=remove_pieces.removed_attractions_2, Index=lng)  # -> ListA, ListB
split_2 = SplitList(List=remove_pieces.removed_pieces_2, Index=lng)  # -> ListA, ListB
trim_3 = TrimTree(Tree=split_2.ListB, Depth=1)
trim_4 = TrimTree(Tree=split.ListB, Depth=1)
pce = ModelPiece(Piece=trim_3, TypeName="Bridge")  # -> Piece, Id, TypeName, TypeVariant, RootPlane, DiagramScreenPoint
con = ModelConnection(Connection=trim_4)  # -> Connection, ConnectedSide, ConnectingSide, Offset, Rotation
sde = ModelSide(Side=con.ConnectingSide, PieceId=pce.Id, PieceTypePortId="e")  # -> Side, PieceId, PieceTypePortId
con_2 = ModelConnection(Connection=con.Connection, ConnectingSide=sde.Side)  # -> Connection, ConnectedSide, ConnectingSide, Offset, Rotation
merge_2 = Merge(Data1=trim, Data2=pce.Piece)
merge_3 = Merge(Data1=trim_2, Data2=con_2.Connection)
for_2 = ModelFormation(Formation=for.Formation, Pieces=merge_2, Connections=merge_3)  # -> Formation, Name, Description, Icon, Variant, Unit, Pieces, Connections, Qualities
fo_3 = Formation(for_2.Formation)
fo_4 = ClusterOutput(fo_3)

# ==== cluster SemioPreview
geo = ClusterInput()

geo_2 = Geometry(geo)
swatch = ColourSwatch(SwatchColor=RGB(0, 0, 0))
filtertype = FilterByType(ObjectType="Curve", Geometry=flatten(geo_2), invertFilter=False, returnNulls=False)  # -> ExcludedGeometry, IncludedGeometry
filtertype_2 = FilterByType(ObjectType="Brep", Geometry=flatten(geo_2), invertFilter=False, returnNulls=False)  # -> ExcludedGeometry, IncludedGeometry
debrep = DeconstructBrep(Brep=filtertype_2.IncludedGeometry)  # -> Faces, Edges, Vertices
preview = CustomPreview(Geometry=flatten(filtertype.IncludedGeometry), Material=swatch)
preview_2 = CustomPreview(Geometry=flatten(filtertype_2.IncludedGeometry), Material=ColourSwatch(SwatchColor=RGB(255, 255, 255)))
preview_3 = CustomPreview(Geometry=flatten(debrep.Edges), Material=swatch)

# ==== cluster PerformanceAssessment
fo = ClusterInput()
ty = ClusterInput()
heating_energy_price_cent_kwh = ClusterInput()
heating_efficiency_factor = ClusterInput()
heating_global_warming_potential_kgco2e = ClusterInput()  # "Heating Global Warming Potential [kgCO2e/kWh]"
cooling_energy_price_cent_kwh = ClusterInput()
cooling_efficiency_factor = ClusterInput()
cooling_global_warming_potential_kgco2e = ClusterInput()  # "Cooling Global Warming Potential [kgCO2e/kWh]"
electrictiy_energy_price_cent_kwh = ClusterInput()
electrictiy_global_warming_potential_kgc = ClusterInput()  # "Electrictiy Global Warming Potential [kgCO2e/kWh]"
heating_energy_price_cent_kwh_2 = Number(heating_energy_price_cent_kwh)
heating_efficiency_factor_2 = Number(heating_efficiency_factor)
heating_global_warming_potential_kgco2e_2 = Number(heating_global_warming_potential_kgco2e)  # "Heating Global Warming Potential [kgCO2e/kWh]"
cooling_energy_price_cent_kwh_2 = Number(cooling_energy_price_cent_kwh)
cooling_efficiency_factor_2 = Number(cooling_efficiency_factor)
cooling_global_warming_potential_kgco2e_2 = Number(cooling_global_warming_potential_kgco2e)  # "Cooling Global Warming Potential [kgCO2e/kWh]"
electrictiy_energy_price_cent_kwh_2 = Number(electrictiy_energy_price_cent_kwh)
electrictiy_global_warming_potential_kgc_2 = Number(electrictiy_global_warming_potential_kgc)  # "Electrictiy Global Warming Potential [kgCO2e/kWh]"
ty_2 = Type(ty)
fo_2 = Formation(fo)
sum_qualities = SumQal(fo=fo_2, ty=ty_2, name="effective floor area")  # -> num_2, ql_2
sum_qualities_2 = SumQal(fo=fo_2, ty=ty_2, name="construction cost")  # -> num_2, ql_2
sum_qualities_3 = SumQal(fo=fo_2, ty=ty_2, name=graft("heating energy demand"))  # -> num_2, ql_2
sum_qualities_4 = SumQal(fo=fo_2, ty=ty_2, name=graft("cooling energy demand"))  # -> num_2, ql_2
sum_qualities_5 = SumQal(fo=fo_2, ty=ty_2, name="maintenance expenses")  # -> num_2, ql_2
sum_qualities_6 = SumQal(fo=fo_2, ty=ty_2, name=graft("technical equipment energy demand"))  # -> num_2, ql_2
sum_qualities_7 = SumQal(fo=fo_2, ty=ty_2, name="income")  # -> num_2, ql_2
expression = Expression(x=sum_qualities_3.num_2, y=heating_efficiency_factor_2, Expression="x*(1/y)")
expression_2 = Expression(x=sum_qualities_4.num_2, y=cooling_efficiency_factor_2, Expression="x*(1/y)")
addition = Addition(A=expression, B=expression_2, C=sum_qualities_6.num_2)
multiplication = Multiplication(A=heating_energy_price_cent_kwh_2, B=expression)
multiplication_2 = Multiplication(A=heating_global_warming_potential_kgco2e_2, B=expression)
multiplication_3 = Multiplication(A=cooling_energy_price_cent_kwh_2, B=expression_2)
multiplication_4 = Multiplication(A=cooling_global_warming_potential_kgco2e_2, B=expression_2)
multiplication_5 = Multiplication(A=sum_qualities_6.num_2, B=electrictiy_energy_price_cent_kwh_2)
multiplication_6 = Multiplication(A=electrictiy_global_warming_potential_kgc_2, B=electrictiy_global_warming_potential_kgc_2)
sum_qualities_8 = SumQal(fo=fo_2, ty=ty_2, name="construction global warming potential")  # -> num_2, ql_2
division = Division(A=addition, B=sum_qualities.num_2)
addition_2 = Addition(A=multiplication, B=multiplication_3, C=multiplication_5)
addition_3 = Addition(A=multiplication_2, B=multiplication_4, C=multiplication_6)
division_2 = Division(A=addition_3, B=sum_qualities.num_2)
addition_4 = Addition(A=sum_qualities_5.num_2, B=addition_2)
subtraction = Subtraction(A=sum_qualities_7.num_2, B=addition_4)
panel = Panel("""https://identifier.buildingsmart.org/uri/buildingsmart/ifc/4.3/prop/NetFloorArea
https://identifier.buildingsmart.org/uri/etim/etim/9.0/prop/EF016979
construction cost
return
https://identifier.buildingsmart.org/uri/etim/etim/9.0/prop/EF016979
operational cost
https://identifier.buildingsmart.org/uri/etim/etim/9.0/prop/EF016979
income
maintenance expenses
https://identifier.buildingsmart.org/uri/buildingsmart/ifc/4.3/prop/EnergyConsumption
operational energy cost
https://identifier.buildingsmart.org/uri/buildingsmart/ifc/4.3/prop/EnergyConsumption
https://identifier.buildingsmart.org/uri/buildingsmart/ifc/4.3/prop/EnergyConsumption
https://identifier.buildingsmart.org/uri/buildingsmart/ifc/4.3/prop/EnergyConsumption""")
panel_2 = Panel("""effective floor area
specific operational global warming potential
construction cost
return
construction global warming potential
operational cost
operational global warming potential
income
maintenance expenses
specific energy demand
operational energy cost
heating energy demand
cooling energy demand
technical equipment energy demand""")
effective_floor_area_m² = Number(sum_qualities.num_2)
specific_operational_global_warming_pote = Number(division_2)  # "Specific Operational Global Warming Potential [kgCO2e/m²a]"
construction_cost = Number(sum_qualities_2.num_2)
return_a = Number(subtraction)
construction_global_warming_potential_kg = Number(sum_qualities_8.num_2)  # "Construction Global Warming Potential [kgCO2e]"
operational_cost_a = Number(addition_4)
operational_global_warming_potential_kgc = Number(addition_3)  # "Operational Global Warming Potential [kgCO2e/a]"
income = Number(sum_qualities_7.num_2)
maintenance_expenses_a = Number(sum_qualities_5.num_2)
specific_energy_demand_kwh_m²a = Number(division)
operational_energy_cost_a = Number(addition_2)
heating_energy_demand_kwh_a = Number(sum_qualities_3.num_2)
cooling_energy_demand_kwh_a = Number(sum_qualities_4.num_2)
technical_equipment_energy_demand_kwh_a = Number(sum_qualities_6.num_2)
merge = Merge(
    Data1=effective_floor_area_m²,
    Data2=specific_operational_global_warming_pote,
    Data3=construction_cost,
    Data4=return_a,
    Data5=construction_global_warming_potential_kg,
    Data6=operational_cost_a,
    Data7=operational_global_warming_potential_kgc,
    Data8=income,
    Data9=maintenance_expenses_a,
    Data10=specific_energy_demand_kwh_m²a,
    Data11=operational_energy_cost_a,
    Data12=heating_energy_demand_kwh_a,
    Data13=cooling_energy_demand_kwh_a,
    Data14=technical_equipment_energy_demand_kwh_a)
panel_3 = Panel("""m²
kgCO2e/m²a
€
€/a
kgCO2e
€/a
kgCO2e/a
€
€/a
kWh/m²a
€/a
kWh/a
kWh/a
kWh/a""")
for = ModelFormation(Formation=fo_2)  # -> Formation, Name, Description, Icon, Variant, Unit, Pieces, Connections, Qualities
trim = TrimTree(Tree=for.Qualities, Depth=1)
qlt = ModelQuality(Name=panel_2, Value=merge, Unit=panel_3, Definition=panel)  # -> Quality, Name, Value, Unit, Definition
merge_2 = Merge(Data1=trim, Data2=qlt.Quality)
for_2 = ModelFormation(Formation=for.Formation, Qualities=merge_2)  # -> Formation, Name, Description, Icon, Variant, Unit, Pieces, Connections, Qualities
fo_3 = Formation(for_2.Formation)
effective_floor_area_m²_2 = ClusterOutput(effective_floor_area_m²)
specific_operational_global_warming_pote_2 = ClusterOutput(specific_operational_global_warming_pote)  # "Specific Operational Global Warming Potential [kgCO2e/m²a]"
construction_cost_2 = ClusterOutput(construction_cost)
return_a_2 = ClusterOutput(return_a)
construction_global_warming_potential_kg_2 = ClusterOutput(construction_global_warming_potential_kg)  # "Construction Global Warming Potential [kgCO2e]"
operational_cost_a_2 = ClusterOutput(operational_cost_a)
operational_global_warming_potential_kgc_2 = ClusterOutput(operational_global_warming_potential_kgc)  # "Operational Global Warming Potential [kgCO2e/a]"
income_2 = ClusterOutput(income)
maintenance_expenses_a_2 = ClusterOutput(maintenance_expenses_a)
specific_energy_demand_kwh_m²a_2 = ClusterOutput(specific_energy_demand_kwh_m²a)
operational_energy_cost_a_2 = ClusterOutput(operational_energy_cost_a)
heating_energy_demand_kwh_a_2 = ClusterOutput(heating_energy_demand_kwh_a)
cooling_energy_demand_kwh_a_2 = ClusterOutput(cooling_energy_demand_kwh_a)
technical_equipment_energy_demand_kwh_a_2 = ClusterOutput(technical_equipment_energy_demand_kwh_a)
fo_4 = ClusterOutput(fo_3)

# ==== cluster LoadGeometry
path = ClusterInput()
pln = ClusterInput()
path_2 = FilePath(path)

pln_2 = Plane(graft(pln))
cset = CreateSet(List=path_2)  # -> Set, Map
refbake = ReferenceByBakeName(FilePath=graft(cset.Set), BakeName="*", Key="*", Val="*", lightweight=False, DisableAutoUpdate=True)
lng = ListLength(List=cset.Set)
expression = Expression(x=lng, Expression="x>1")
trim = TrimTree(Tree=refbake, Depth=1)
filter = StreamFilter(Gate=expression, Stream0=refbake, Stream1=trim)
filtertype = FilterByType(ObjectType="Brep", Geometry=filter, invertFilter=False, returnNulls=False)  # -> ExcludedGeometry, IncludedGeometry
filtertype_2 = FilterByType(ObjectType="Curve", Geometry=filter, invertFilter=False, returnNulls=False)  # -> ExcludedGeometry, IncludedGeometry
filtertype_3 = FilterByType(ObjectType="Point", Geometry=filter, invertFilter=False, returnNulls=False)  # -> ExcludedGeometry, IncludedGeometry
trim_2 = TrimTree(Tree=filtertype.IncludedGeometry, Depth=1)
trim_3 = TrimTree(Tree=filtertype_2.IncludedGeometry, Depth=1)
trim_4 = TrimTree(Tree=filtertype_3.IncludedGeometry, Depth=1)
brep = Brep(trim_2)
crv = Curve(trim_3)
pt = Point(trim_4)

filtertype_4 = FilterByType(ObjectType="Mesh", Geometry=filter, invertFilter=False, returnNulls=False)  # -> ExcludedGeometry, IncludedGeometry
trim_5 = TrimTree(Tree=filtertype_4.IncludedGeometry, Depth=1)
mesh = Mesh(trim_5)

merge = Merge(Data1=mesh, Data2=brep, Data3=crv, Data4=pt)
tstat = TreeStatistics(Tree=merge)  # -> Paths, Length, Count
item = ListItem(List=tstat.Paths, Index=cset.Map, Wrap=True)
branch = TreeBranch(Tree=merge, Path=item, MaintainPaths=False)
match = MatchTree(Tree=branch, Guide=pln_2)
mtchanc = MatchAncestor(AT=pln_2, CT=graft(match))  # -> MAT; inputs AT: tree, CT: tree
# ---------- mtchanc: Python ----------
if ghenv.Component.RunCount<2:
    __author__ = "Ueli Saluz"
    __version__ = "2022.04.25"
    
    ghenv.Component.Name = "Match Ancestor"
    ghenv.Component.NickName = "MtchAnc"
    ghenv.Component.Description = "Duplicates all elements of an ancestor tree to match the amount of elements in the child tree."
    ghenv.Component.Message = "VER 1.1"
    
    ghenv.Component.Params.Input[0].Name = "AncestorTree"
    ghenv.Component.Params.Input[0].NickName = "AT"
    ghenv.Component.Params.Input[0].Description = "Ancestor tree that data will the duplicated until it matches the child tree"
    ghenv.Component.Params.Input[0].Optional = False
    
    ghenv.Component.Params.Input[1].Name = "ChildTree"
    ghenv.Component.Params.Input[1].NickName = "CT"
    ghenv.Component.Params.Input[1].Description = "Child tree that branches will the guide to duplicat the data of the ancestor tree"
    ghenv.Component.Params.Input[0].Optional = False
    
    ghenv.Component.Params.Output[0].Name = "MatchedAncestorTree"
    ghenv.Component.Params.Output[0].NickName = "MAT"
    ghenv.Component.Params.Output[0].Description = "Matched ancestor tree with the amount of items and the branch paths of the child tree"

from System import Object
from Grasshopper import DataTree

"""Returns a new tree with the ancestor data being duplicated along all child branches which where child paths of that ancestor.
    Inputs:
        ancestorTree: Ancestor tree that data will the duplicated until it matches the child tree
        childTree: Child tree that branches will the guide to duplicat the data of the ancestor tree
    Output:
        matchedAncestorTree: Matched ancestor tree with the amount of items and the branch paths of the child tree"""
def MatchAncestorTreeToChildTree (ancestorTree, childTree):
    
    matchedAncestorTree = DataTree[Object]()
    dummy = 0
    for i,pathAncestor in enumerate(ancestorTree.Paths):
        branch = ancestorTree.Branch(pathAncestor)
        if len(branch)!=1:
            raise Exception("Ancestor must be grafted and containing one item per branch")
        #The item to be duplicated
        item = branch[0]
        for j,pathChild in enumerate(childTree.Paths):
            #Returns a tuple and not like in the documentation described a bool with a pointer to the int to store the generations
            checkAncestor = pathChild.IsAncestor(pathAncestor,dummy)
            if(checkAncestor[0]):
                matchedAncestorTree.AddRange([item]*childTree.Branch(pathChild).Count,pathChild)
    return matchedAncestorTree

if __name__ == "__main__":
    MAT = MatchAncestorTreeToChildTree (AT,CT)
# ---------- end mtchanc ----------
trim_6 = TrimTree(Tree=mtchanc, Depth=1)
pl2pl = MoveObjectPlaneToPlane(G=match, S=PlaneXY(0, 0, 0), T=trim_6)  # -> TG, T; inputs S: Plane, T: Plane
# ---------- pl2pl: Python ----------
#Component Information
#--------------------------------------------------------------------------------------------
if ghenv.Component.RunCount<2:
    #General
    #--------------------------------------------------------------------------------------------
    __author__ = "Ueli Saluz"
    __version__ = "2023.02.12"
    
    ghenv.Component.Name = "MoveObjectPlaneToPlane"
    ghenv.Component.NickName = "Pl2Pl"
    ghenv.Component.Description = "Moves abitrary geometry from a source plane to a target plane."
    ghenv.Component.Message = "VER 1.2"
    ghenv.Component.Category = "Transform"
    ghenv.Component.SubCategory = "Euclidean"
    
     #Inputs
    #--------------------------------------------------------------------------------------------
    inputIndex=0
    
    ghenv.Component.Params.Input[inputIndex].Name = "Geometry"
    ghenv.Component.Params.Input[inputIndex].NickName = "G"
    ghenv.Component.Params.Input[inputIndex].Description = "Geometry to move."
    ghenv.Component.Params.Input[inputIndex].Optional = False
    inputIndex+=1
    
    ghenv.Component.Params.Input[inputIndex].Name = "SourcePlane"
    ghenv.Component.Params.Input[inputIndex].NickName = "S"
    ghenv.Component.Params.Input[inputIndex].Description = "Source plane of object."
    ghenv.Component.Params.Input[inputIndex].Optional = False
    inputIndex+=1
    
    ghenv.Component.Params.Input[inputIndex].Name = "TargetPlane"
    ghenv.Component.Params.Input[inputIndex].NickName = "T"
    ghenv.Component.Params.Input[inputIndex].Description = "Target plane of object."
    ghenv.Component.Params.Input[inputIndex].Optional = False
    inputIndex+=1
    
    #Outputs
    #--------------------------------------------------------------------------------------------
    outputIndex=0
    
    ghenv.Component.Params.Output[outputIndex].Name = "TranslatedGeometry"
    ghenv.Component.Params.Output[outputIndex].NickName = "TG"
    ghenv.Component.Params.Output[outputIndex].Description = "Translated geometry in target plane."
    outputIndex+=1
    
    ghenv.Component.Params.Output[outputIndex].Name = "Trasnform"
    ghenv.Component.Params.Output[outputIndex].NickName = "T"
    ghenv.Component.Params.Output[outputIndex].Description = "Transform describing translation form source to target plane."
    outputIndex+=1


#Imports
#--------------------------------------------------------------------------------------------
import Rhino.Geometry.Transform as trsf

def MvObjPlnToPln (geo,plnObj,plnDest):
    transform = trsf.PlaneToPlane(plnObj,plnDest)
    geo.Transform(transform)
    return (geo,transform)

TG, T = MvObjPlnToPln(G,S,T)
# ---------- end pl2pl ----------
geo = Geometry(pl2pl.TG)

geo_2 = ClusterOutput(geo)

# ==== cluster ReplaceTypeVariantInFormation
old_variant_name = ClusterInput()
type_name = ClusterInput()
new_variant_name = ClusterInput()
fo = ClusterInput()
fo_2 = Formation(fo)
type_name_2 = Text(type_name)
old_variant_name_2 = Text(old_variant_name)
new_variant_name_2 = Text(new_variant_name)
for = ModelFormation(Formation=fo_2)  # -> Formation, Name, Description, Icon, Variant, Unit, Pieces, Connections, Qualities
trim = TrimTree(Tree=for.Pieces, Depth=1)
pce = ModelPiece(Piece=trim)  # -> Piece, Id, TypeName, TypeVariant, RootPlane, DiagramScreenPoint
lng = ListLength(List=trim)
series = Series(Start=0, Step=1, Count=lng)
expression = Expression(x=pce.TypeVariant, y=old_variant_name_2, Expression="x=y")
expression_2 = Expression(x=pce.TypeName, y=type_name_2, Expression="x=y")
trim_2 = TrimTree(Tree=series, Depth=1)
and = GateAnd(A=expression_2, B=expression)
dispatch = Dispatch(List=trim_2, DispatchPattern=and)  # -> ListA, ListB
dispatch_2 = Dispatch(List=pce.Piece, DispatchPattern=and)  # -> ListA, ListB
pce_2 = ModelPiece(Piece=dispatch_2.ListA, TypeVariant=new_variant_name_2)  # -> Piece, Id, TypeName, TypeVariant, RootPlane, DiagramScreenPoint
replace = ReplaceItems(List=trim, Item=pce_2.Piece, Indices=dispatch.ListA, Wrap=False)
trim_3 = TrimTree(Tree=replace, Depth=1)
for_2 = ModelFormation(Formation=for.Formation, Pieces=trim_3)  # -> Formation, Name, Description, Icon, Variant, Unit, Pieces, Connections, Qualities
fo_3 = Formation(for_2.Formation)
fo_4 = ClusterOutput(fo_3)

# ==== cluster TypInFor: Replace a type in a formation. All variants stay the same and must exist in the new type.
old_type_name = ClusterInput()
new_type_name = ClusterInput()
fo = ClusterInput()
old_type_name_2 = Text(old_type_name)
new_type_name_2 = Text(new_type_name)
fo_2 = Formation(fo)
for = ModelFormation(Formation=fo_2)  # -> Formation, Name, Description, Icon, Variant, Unit, Pieces, Connections, Qualities
trim = TrimTree(Tree=for.Pieces, Depth=1)
lng = ListLength(List=trim)
pce = ModelPiece(Piece=trim)  # -> Piece, Id, TypeName, TypeVariant, RootPlane, DiagramScreenPoint
series = Series(Start=0, Step=1, Count=lng)
expression = Expression(x=pce.TypeName, y=old_type_name_2, Expression="x=y")
trim_2 = TrimTree(Tree=series, Depth=1)
dispatch = Dispatch(List=pce.Piece, DispatchPattern=expression)  # -> ListA, ListB
dispatch_2 = Dispatch(List=trim_2, DispatchPattern=expression)  # -> ListA, ListB
pce_2 = ModelPiece(Piece=dispatch.ListA, TypeName=new_type_name_2)  # -> Piece, Id, TypeName, TypeVariant, RootPlane, DiagramScreenPoint
replace = ReplaceItems(List=trim, Item=pce_2.Piece, Indices=dispatch_2.ListA, Wrap=False)
trim_3 = TrimTree(Tree=replace, Depth=1)
for_2 = ModelFormation(Formation=fo_2, Pieces=trim_3)  # -> Formation, Name, Description, Icon, Variant, Unit, Pieces, Connections, Qualities
fo_3 = Formation(for_2.Formation)
fo_4 = ClusterOutput(fo_3)

# ==== cluster Pc: Remove pieces and all attractions with these pieces from a formation.
fo = ClusterInput()
ids = ClusterInput()
fo_2 = Formation(fo)
ids_2 = Text(ids)
for = ModelFormation(Formation=fo_2)  # -> Formation, Name, Description, Icon, Variant, Unit, Pieces, Attractions, Qualities

trim = TrimTree(Tree=for.Attractions, Depth=1)
con = ModelConnection(Connection=trim)  # -> Connection, ConnectedSide, ConnectingSide, Offset, Rotation
sde = ModelSide(Side=con.ConnectedSide)  # -> Side, PieceId, PieceTypePortId
sde_2 = ModelSide(Side=con.ConnectingSide)  # -> Side, PieceId, PieceTypePortId
expression = Expression(x=graft(sde_2.PieceId), y=ids_2, Expression="x=y")
expression_2 = Expression(x=graft(sde.PieceId), y=ids_2, Expression="x=y")
ma = MassAddition(Input=expression_2)  # -> Result, PartialResults
ma_2 = MassAddition(Input=expression)  # -> Result, PartialResults
or = GateOr(A=ma.Result, B=ma_2.Result)
trim_2 = TrimTree(Tree=or, Depth=1)
dispatch = Dispatch(List=trim, DispatchPattern=trim_2)  # -> ListA, ListB

trim_3 = TrimTree(Tree=for.Pieces, Depth=1)
pce = ModelPiece(Piece=trim_3)  # -> Piece, Id, TypeName, TypeVariant, RootPlane, DiagramScreenPoint
expression_3 = Expression(x=graft(pce.Id), y=ids_2, Expression="x=y")
ma_3 = MassAddition(Input=expression_3)  # -> Result, PartialResults
trim_4 = TrimTree(Tree=ma_3.Result, Depth=1)
dispatch_2 = Dispatch(List=trim_3, DispatchPattern=trim_4)  # -> ListA, ListB

for_2 = ModelFormation(Formation=for.Formation, Pieces=dispatch_2.ListB, Attractions=dispatch.ListB)  # -> Formation, Name, Description, Icon, Variant, Unit, Pieces, Attractions, Qualities
fo_3 = Formation(for_2.Formation)
removed_pieces = Piece(dispatch_2.ListA)
removed_attractions = Attraction(dispatch.ListA)
fo_4 = ClusterOutput(fo_3)
removed_pieces_2 = ClusterOutput(removed_pieces)
removed_attractions_2 = ClusterOutput(removed_attractions)

# ==== cluster SumQal: A sum of the value of the quality of the pieces of the formation. NOTE: No unit conversion is performed.
fo = ClusterInput()
ty = ClusterInput()
name = ClusterInput()
fo_2 = Formation(fo)
ty_2 = Type(ty)
name_2 = Text(name)
for = ModelFormation(Formation=fo_2)  # -> Formation, Name, Description, Icon, Variant, Unit, Pieces, Attractions, Qualities
typ = ModelType(Type=ty_2)  # -> Type, Name, Description, Icon, Variant, Unit, Representations, Ports, Qualities
lng = ListLength(List=ty_2)
series = Series(Start=0, Step=1, Count=lng)
trim = TrimTree(Tree=for.Pieces, Depth=1)
qlt = ModelQuality(Quality=typ.Qualities)  # -> Quality, Name, Value, Unit, Definition
trim_2 = TrimTree(Tree=series, Depth=1)
pce = ModelPiece(Piece=trim)  # -> Piece, Id, TypeName, TypeVariant, RootPlane, DiagramScreenPoint
expression = Expression(x=name_2, y=qlt.Name, Expression="x=y")
expression_2 = Expression(x=graft(pce.TypeName), y=typ.Name, Expression="x=y")
expression_3 = Expression(x=graft(pce.TypeVariant), y=typ.Variant, Expression="x=y")
cull = CullPattern(List=typ.Qualities, CullPattern=expression)
qlt_2 = ModelQuality(Quality=cull)  # -> Quality, Name, flatten(Value), Unit, Definition
and = GateAnd(A=expression_2, B=expression_3)
cull_2 = CullPattern(List=ty_2, CullPattern=and)
txt = Text(ty_2)
txt_2 = Text(cull_2)
expression_4 = Expression(x=txt_2, y=txt, Expression="x=y")
ql = Quality(qlt_2.Quality)
cull_3 = CullPattern(List=trim_2, CullPattern=expression_4)
trim_3 = TrimTree(Tree=cull_3, Depth=1)
item = ListItem(List=qlt_2.Value, Index=trim_3, Wrap=True)
clean = CleanTree(RemoveNulls=True, RemoveInvalid=True, RemoveEmpty=False, Tree=item)
ma = MassAddition(Input=clean)  # -> Result, PartialResults
num = Number(ma.Result)
num_2 = ClusterOutput(num)
ql_2 = ClusterOutput(ql)
