# Grasshopper definition nakagincapsuletower.gh (Grasshopper 1.0.7)
# plug-ins: semio, eleFront

pln = Plane(Plane(origin=(-30.53932401, 10.97645736, 0), x=(0, -1, 0), y=(-0.3410194715, 0, 0.9400562324)))
pln_2 = Plane(Plane(origin=(58.97947904, 9.453789068, 0), x=(0, 1, 0), y=(-0.2528976811, 0, -0.9674930299)))

ids = RandomIds(Count=1, Seed=0, UniqueComponent=True)
ids_2 = RandomIds(Count=1, Seed=0, UniqueComponent=True)
ids_3 = RandomIds(Count=1, Seed=0, UniqueComponent=True)
ids_4 = RandomIds(Count=1, Seed=0, UniqueComponent=True)
ids_5 = RandomIds(Count=1, Seed=0, UniqueComponent=True)
trim = TrimTree(Tree=ids, Depth=1)
trim_2 = TrimTree(Tree=ids_2, Depth=1)
trim_3 = TrimTree(Tree=ids_3, Depth=1)
trim_4 = TrimTree(Tree=ids_4, Depth=1)
trim_5 = TrimTree(Tree=ids_5, Depth=1)
pce = ModelPiece(Id=trim, TypeName="Base")  # -> Piece, Id, TypeName, TypeVariant, RootPlane, DiagramScreenPoint
pce_2 = ModelPiece(Id=trim_2, TypeName="Shaft", TypeVariant="1")  # -> Piece, Id, TypeName, TypeVariant, RootPlane, DiagramScreenPoint
pce_3 = ModelPiece(Id=trim_3, TypeName="Shaft", TypeVariant="2")  # -> Piece, Id, TypeName, TypeVariant, RootPlane, DiagramScreenPoint
pce_4 = ModelPiece(Id=trim_4, TypeName="Capital")  # -> Piece, Id, TypeName, TypeVariant, RootPlane, DiagramScreenPoint
pce_5 = ModelPiece(Id=trim_5, TypeName="Capital")  # -> Piece, Id, TypeName, TypeVariant, RootPlane, DiagramScreenPoint
spc = ModelSpecifier(Context="core", Group="0")  # -> Specifier, Context, Group
spc_2 = ModelSpecifier(Context="bottom")  # -> Specifier, Context, Group
spc_3 = ModelSpecifier(Context="core", Group="1")  # -> Specifier, Context, Group
sde = ModelSide(PieceId=pce.Id, PieceTypePortSpecifiers=spc.Specifier)  # -> Side, PieceId, PieceTypePortSpecifiers
sde_2 = ModelSide(PieceId=pce_3.Id, PieceTypePortSpecifiers=spc_2.Specifier)  # -> Side, PieceId, PieceTypePortSpecifiers
sde_3 = ModelSide(PieceId=pce.Id, PieceTypePortSpecifiers=spc_3.Specifier)  # -> Side, PieceId, PieceTypePortSpecifiers
sde_4 = ModelSide(PieceId=pce_2.Id, PieceTypePortSpecifiers=spc_2.Specifier)  # -> Side, PieceId, PieceTypePortSpecifiers
sde_5 = ModelSide(PieceId=pce_3.Id, PieceTypePortSpecifiers="top")  # -> Side, PieceId, PieceTypePortSpecifiers
sde_6 = ModelSide(PieceId=pce_4.Id, PieceTypePortSpecifiers="bottom")  # -> Side, PieceId, PieceTypePortSpecifiers
sde_7 = ModelSide(PieceId=pce_2.Id, PieceTypePortSpecifiers="top")  # -> Side, PieceId, PieceTypePortSpecifiers
sde_8 = ModelSide(PieceId=pce_5.Id, PieceTypePortSpecifiers="bottom")  # -> Side, PieceId, PieceTypePortSpecifiers
atr = ModelAttraction(AttractingSide=sde.Side, AttractedSide=sde_2.Side)  # -> Attraction, AttractingSide, AttractedSide
atr_2 = ModelAttraction(AttractingSide=sde_3.Side, AttractedSide=sde_4.Side)  # -> Attraction, AttractingSide, AttractedSide
atr_3 = ModelAttraction(AttractingSide=sde_5.Side, AttractedSide=sde_6.Side)  # -> Attraction, AttractingSide, AttractedSide
atr_4 = ModelAttraction(AttractingSide=sde_7.Side, AttractedSide=sde_8.Side)  # -> Attraction, AttractingSide, AttractedSide

genes = GenePool(Decimals=0, Maximum=8, Minimum=0, Value=[0, 0, 0, 0, 0, 0, 0, 0, 0])
genes_2 = GenePool(Decimals=0, Maximum=8, Minimum=0, Value=[6, 6, 6, 6, 6, 6, 6, 6, 6])
genes_3 = GenePool(Decimals=0, Maximum=8, Minimum=0, Value=[6, 0, 0, 6, 6, 3, 3, 6, 0])
genes_4 = GenePool(Decimals=0, Maximum=8, Minimum=0, Value=[0, 1, 2, 3, 4, 5, 6, 7, 8])
tower = Tower(
    number_of_floors="9",
    shaftpieceid=pce_2.Id,
    capsulepatternnortheast=genes,
    capsulepatternsoutheast=genes_2,
    capsulepatternsouthwest=genes_3,
    capsulepatternnorthwest=genes_4,
    id="1")  # -> pc_2, at_2

genes_5 = GenePool(Decimals=0, Maximum=8, Minimum=0, Value=[0, 0, 0, 0, 0, 0, 0, 0, 0, 0, 0])
genes_6 = GenePool(Decimals=0, Maximum=8, Minimum=0, Value=[6, 0, 0, 0, 6, 6, 0, 6, 0, 6, 3])
genes_7 = GenePool(Decimals=0, Maximum=8, Minimum=0, Value=[6, 6, 6, 6, 6, 6, 6, 6, 6, 6, 6])
genes_8 = GenePool(Decimals=0, Maximum=8, Minimum=0, Value=[8, 8, 8, 8, 8, 8, 8, 8, 8, 8, 8])
tower_2 = Tower(
    number_of_floors="11",
    shaftpieceid=pce_3.Id,
    capsulepatternnortheast=genes_5,
    capsulepatternsoutheast=genes_7,
    capsulepatternsouthwest=genes_8,
    capsulepatternnorthwest=genes_6,
    id="0")  # -> pc_2, at_2

ids_6 = RandomIds(Count=1, Seed=0, UniqueComponent=True)
ids_7 = RandomIds(Count=1, Seed=0, UniqueComponent=True)
ids_8 = RandomIds(Count=1, Seed=0, UniqueComponent=True)
ids_9 = RandomIds(Count=1, Seed=0, UniqueComponent=True)
trim_6 = TrimTree(Tree=ids_6, Depth=1)
trim_7 = TrimTree(Tree=ids_7, Depth=1)
trim_8 = TrimTree(Tree=ids_8, Depth=1)
trim_9 = TrimTree(Tree=ids_9, Depth=1)
pce_6 = ModelPiece(Id=trim_6, TypeName="Shaft", TypeVariant="1", RootPlane=pln)  # -> Piece, Id, TypeName, TypeVariant, RootPlane, DiagramScreenPoint
pce_7 = ModelPiece(Id=trim_7, TypeName="Shaft", TypeVariant="2", RootPlane=pln_2)  # -> Piece, Id, TypeName, TypeVariant, RootPlane, DiagramScreenPoint
pce_8 = ModelPiece(Id=trim_8, TypeName="Capital")  # -> Piece, Id, TypeName, TypeVariant, RootPlane, DiagramScreenPoint
pce_9 = ModelPiece(Id=trim_9, TypeName="Capital")  # -> Piece, Id, TypeName, TypeVariant, RootPlane, DiagramScreenPoint
sde_9 = ModelSide(PieceId=pce_7.Id, PieceTypePortSpecifiers="top")  # -> Side, PieceId, PieceTypePortSpecifiers
sde_10 = ModelSide(PieceId=pce_8.Id, PieceTypePortSpecifiers="bottom")  # -> Side, PieceId, PieceTypePortSpecifiers
sde_11 = ModelSide(PieceId=pce_6.Id, PieceTypePortSpecifiers="top")  # -> Side, PieceId, PieceTypePortSpecifiers
sde_12 = ModelSide(PieceId=pce_9.Id, PieceTypePortSpecifiers="bottom")  # -> Side, PieceId, PieceTypePortSpecifiers
atr_5 = ModelAttraction(AttractingSide=sde_9.Side, AttractedSide=sde_10.Side)  # -> Attraction, AttractingSide, AttractedSide
atr_6 = ModelAttraction(AttractingSide=sde_11.Side, AttractedSide=sde_12.Side)  # -> Attraction, AttractingSide, AttractedSide

genes_9 = GenePool(Decimals=0, Maximum=8, Minimum=0, Value=[0, 0, 0, 0, 0, 0, 0, 0, 0])
genes_10 = GenePool(Decimals=0, Maximum=8, Minimum=0, Value=[6, 6, 6, 6, 6, 6, 6, 6, 6])
genes_11 = GenePool(Decimals=0, Maximum=8, Minimum=0, Value=[6, 0, 0, 6, 6, 3, 3, 6, 0])
genes_12 = GenePool(Decimals=0, Maximum=8, Minimum=0, Value=[0, 1, 2, 3, 4, 5, 6, 7, 8])
tower_3 = Tower(
    number_of_floors="9",
    shaftpieceid=pce_6.Id,
    capsulepatternnortheast=genes_9,
    capsulepatternsoutheast=genes_10,
    capsulepatternsouthwest=genes_11,
    capsulepatternnorthwest=genes_12,
    id="1")  # -> pc_2, at_2

genes_13 = GenePool(Decimals=0, Maximum=8, Minimum=0, Value=[0, 0, 0, 0, 0, 0, 0, 0, 0, 0, 0])
genes_14 = GenePool(Decimals=0, Maximum=8, Minimum=0, Value=[6, 0, 0, 0, 6, 6, 0, 6, 0, 6, 3])
genes_15 = GenePool(Decimals=0, Maximum=8, Minimum=0, Value=[6, 6, 6, 6, 6, 6, 6, 6, 6, 6, 6])
genes_16 = GenePool(Decimals=0, Maximum=8, Minimum=0, Value=[8, 8, 8, 8, 8, 8, 8, 8, 8, 8, 8])
tower_4 = Tower(
    number_of_floors="11",
    shaftpieceid=pce_7.Id,
    capsulepatternnortheast=genes_13,
    capsulepatternsoutheast=genes_15,
    capsulepatternsouthwest=genes_16,
    capsulepatternnorthwest=genes_14,
    id="0")  # -> pc_2, at_2

ty = Type([null x12])
kit = CreateKit(
    Name="Metabolism",
    Explanation="Everything for metabolistic architecture.",
    Icon="🫀",
    Url="https://github.com/usalu/semio/examples/metabolism",
    Types=ty,
    Run=Toggle(False))
kit_2 = DeleteKit(Run=Toggle(False))
remove_types = BooleanToggle(False)
read_kit = BooleanToggle(True)
panel = Panel("Cylindric Shaft")
panel_2 = Panel("Cylindric Capital")
panel_3 = Panel("capsule")
panel_4 = Panel("Capital")
panel_5 = Panel("Shaft")
merge = Merge(Data3=atr_5.Attraction, Data4=atr_6.Attraction)
merge_2 = Merge(Data2=pce_7.Piece, Data3=pce_6.Piece, Data4=pce_8.Piece, Data5=pce_9.Piece)
kit_3 = LoadKit(Run=read_kit)  # -> Name, Description, Icon, Url, Types, Formations
merge_3 = Merge(Data1=atr.Attraction, Data2=atr_2.Attraction, Data3=atr_3.Attraction, Data4=atr_4.Attraction)
merge_4 = Merge(Data1=pce.Piece, Data2=pce_3.Piece, Data3=pce_2.Piece, Data4=pce_4.Piece, Data5=pce_5.Piece)
merge_5 = Merge(Data1=merge, Data3=tower_4.at_2, Data4=tower_3.at_2)
merge_6 = Merge(Data1=merge_2, Data2=tower_4.pc_2, Data3=tower_3.pc_2)
typ = ModelType(Type=kit_3.Types)  # -> Type, Name, Description, Icon, Variant, Unit, Representations, Ports, Qualities
for = ModelFormation(Formation=kit_3.Formations)  # -> Formation, Name, Description, Icon, Variant, Unit, Pieces, Attractions, Qualities
merge_7 = Merge(Data1=merge_3, Data3=tower_2.at_2, Data4=tower.at_2)
merge_8 = Merge(Data1=merge_4, Data2=tower_2.pc_2, Data3=tower.pc_2)
panel_6 = Panel(typ.Type)
for_2 = ModelFormation(
    Name="Nakagin Capsule Tower",
    Description="The former Nakagin Capsule Tower from Tokyio.",
    Icon="🏯2",
    Variant="2",
    Pieces=merge_6,
    Attractions=merge_5)  # -> Formation, Name, Description, Icon, Variant, Unit, Pieces, Attractions, Qualities
tmatch = MatchText(Text=typ.Description, Pattern="Base", Case=True)
for_3 = ModelFormation(
    Name="Nakagin Capsule Tower",
    Description="The former Nakagin Capsule Tower from Tokyio.",
    Icon="🏯",
    Pieces=merge_8,
    Attractions=merge_7)  # -> Formation, Name, Description, Icon, Variant, Unit, Pieces, Attractions, Qualities
for_4 = SerializeFormation(Formation=for_3.Formation)
txt = DecodeText(EncodedText=for_4)
cull = CullPattern(List=kit_3.Types, CullPattern=tmatch)
for_5 = RemoveFormation(Run=remove_types)
replacetypeinformation = ReplaceTypeInFormation(fo=for_3.Formation, old_type_name="Capsule", new_type_name="Futuristic Capsule")
typ_2 = ModelType(Type=cull)  # -> Type, Name, Description, Icon, Variant, Unit, Representations, Ports, Qualities

_1_to_500_or_200 = BooleanToggle(True)
cylindric = BooleanToggle(False)
futuristic = BooleanToggle(False)
run = BooleanToggle(True)

multiple_roots = BooleanToggle(False)
or = GateOr(A=for_5, B=remove_types)
panel_7 = Panel(typ_2.Type)
typ_3 = RemoveType(TypeName=typ_2.Name, TypeVariant=typ_2.Variant, Run=or)
filter = StreamFilter(Gate=futuristic, Stream0=for_3.Formation, Stream1=replacetypeinformation)
replacetypeinformation_2 = ReplaceTypeInFormation(fo=filter, old_type_name="Shaft", new_type_name="Cylindric Shaft")
filter_2 = StreamFilter(Gate=cylindric, Stream0=filter, Stream1=replacetypeinformation_2)
replacetypeinformation_3 = ReplaceTypeInFormation(fo=filter_2, old_type_name="Capital", new_type_name="Cylindric Capital")
filter_3 = StreamFilter(Gate=cylindric, Stream0=filter_2, Stream1=replacetypeinformation_3)
filter_4 = StreamFilter(Gate=multiple_roots, Stream0=filter_3, Stream1=for_2.Formation)
for_6 = ModelFormation(Formation=filter_4)  # -> Formation, Name, Description, Icon, Variant, Unit, Pieces, Attractions, Qualities
for_7 = RemoveFormation(FormationName=for_6.Name, FormationVariant=for_6.Variant, Run=run)
or_2 = GateOr(A=run, B=for_7)
run_2 = BooleanToggle(True)
for_8 = AddFormation(Formation=for_6.Formation, Run=or_2)
scn = GetScene(FormationName=for_6.Name, Run=for_8)  # disabled
filter_5 = StreamFilter(Gate=_1_to_500_or_200, Stream0="1to500", Stream1="1to200")
scn_2 = GetScene(FormationName=for_6.Name, FormationVariant=for_6.Variant, Run=run_2)
scn_3 = FilterScene(Scene=scn_2, LevelOfDetails=filter_5, Tags="volume", Formats=".3dm")  # -> Representations, Planes, PiecesIds, ParentsPiecesIds

rp = Representation(scn_3.Representations)
pln_3 = Plane(scn_3.Planes)
trim_10 = TrimTree(Tree=pln_3, Depth=1)  # -> graft(Tree)
trim_11 = TrimTree(Tree=rp, Depth=1)
rep = ModelRepresentation(Representation=trim_11)  # -> Representation, Url, LevelOfDetail, Tags
box = DomainBox(Base=PlaneXY(0, 0, 0), X=Domain(-2, 2), Y=Domain(-0.5, 0.5), Z=Domain(0, 0.25))
pl2pl = MoveObjectPlaneToPlane(G=box, S=PlaneXY(0, 0, 0), T=trim_10)  # -> TG, T; inputs S: Plane, T: Plane
# ---------- pl2pl: Python ----------
#Component Information
#--------------------------------------------------------------------------------------------
if ghenv.Component.RunCount<2:
    #General
    #--------------------------------------------------------------------------------------------
    __author__ = "Ueli Saluz"
    __version__ = "2023.02.12"
    
    ghenv.Component.Name = "MoveObjectPlaneToPlane"
    ghenv.Component.NickName = "Pl2Pl"
    ghenv.Component.Description = "Moves abitrary geometry from a source plane to a target plane."
    ghenv.Component.Message = "VER 1.2"
    ghenv.Component.Category = "Transform"
    ghenv.Component.SubCategory = "Euclidean"
    
     #Inputs
    #--------------------------------------------------------------------------------------------
    inputIndex=0
    
    ghenv.Component.Params.Input[inputIndex].Name = "Geometry"
    ghenv.Component.Params.Input[inputIndex].NickName = "G"
    ghenv.Component.Params.Input[inputIndex].Description = "Geometry to move."
    ghenv.Component.Params.Input[inputIndex].Optional = False
    inputIndex+=1
    
    ghenv.Component.Params.Input[inputIndex].Name = "SourcePlane"
    ghenv.Component.Params.Input[inputIndex].NickName = "S"
    ghenv.Component.Params.Input[inputIndex].Description = "Source plane of object."
    ghenv.Component.Params.Input[inputIndex].Optional = False
    inputIndex+=1
    
    ghenv.Component.Params.Input[inputIndex].Name = "TargetPlane"
    ghenv.Component.Params.Input[inputIndex].NickName = "T"
    ghenv.Component.Params.Input[inputIndex].Description = "Target plane of object."
    ghenv.Component.Params.Input[inputIndex].Optional = False
    inputIndex+=1
    
    #Outputs
    #--------------------------------------------------------------------------------------------
    outputIndex=0
    
    ghenv.Component.Params.Output[outputIndex].Name = "TranslatedGeometry"
    ghenv.Component.Params.Output[outputIndex].NickName = "TG"
    ghenv.Component.Params.Output[outputIndex].Description = "Translated geometry in target plane."
    outputIndex+=1
    
    ghenv.Component.Params.Output[outputIndex].Name = "Trasnform"
    ghenv.Component.Params.Output[outputIndex].NickName = "T"
    ghenv.Component.Params.Output[outputIndex].Description = "Transform describing translation form source to target plane."
    outputIndex+=1


#Imports
#--------------------------------------------------------------------------------------------
import Rhino.Geometry.Transform as trsf

def MvObjPlnToPln (geo,plnObj,plnDest):
    transform = trsf.PlaneToPlane(plnObj,plnDest)
    geo.Transform(transform)
    return (geo,transform)

TG, T = MvObjPlnToPln(G,S,T)
# ---------- end pl2pl ----------
curdir = CurrentDirectory()  # -> D, P, S
# ---------- curdir: Python ----------
#Component Information
#--------------------------------------------------------------------------------------------
if ghenv.Component.RunCount<2:
    #General
    #--------------------------------------------------------------------------------------------
    __author__ = "Ueli Saluz"
    __version__ = "2023.09.29"
    
    ghenv.Component.Name = "CurrentDirectory"
    ghenv.Component.NickName = "CurDir"
    ghenv.Component.Description = "Current directory of the current grasshopper file."
    ghenv.Component.Message = "VER 1.0"
    ghenv.Component.Category = "Params"
    ghenv.Component.SubCategory = "Util"
    
    #Outputs
    #--------------------------------------------------------------------------------------------
    outputIndex=0
    
    ghenv.Component.Params.Output[outputIndex].Name = "Directory"
    ghenv.Component.Params.Output[outputIndex].NickName = "D"
    ghenv.Component.Params.Output[outputIndex].Description = "Directory of the current grasshopper file."
    outputIndex+=1
    
    ghenv.Component.Params.Output[outputIndex].Name = "Path"
    ghenv.Component.Params.Output[outputIndex].NickName = "P"
    ghenv.Component.Params.Output[outputIndex].Description = "Path of the current grasshopper file."
    outputIndex+=1
    
    ghenv.Component.Params.Output[outputIndex].Name = "Separator"
    ghenv.Component.Params.Output[outputIndex].NickName = "S"
    ghenv.Component.Params.Output[outputIndex].Description = "Separator of the current system."
    outputIndex+=1

#Imports
#--------------------------------------------------------------------------------------------
from os.path import dirname
from os import sep

#Solver - Run with trees to enhance performance drastically
#--------------------------------------------------------------------------------------------
if __name__ == "__main__":
    P = ghenv.Component.OnPingDocument().FilePath
    D = dirname(P)
    S = sep
# ---------- end curdir ----------
concat = Concatenate(FragmentA=curdir.D, FragmentB=curdir.S, FragmentC=rep.Url)
refbake = ReferenceByBakeName(FilePath=graft(concat), BakeName="*", Key="*", Val="*", lightweight=False)
trim_12 = TrimTree(Tree=refbake, Depth=1)  # -> graft(Tree)
mtchanc = MatchAncestor(AT=pl2pl.T, CT=trim_12)  # -> MAT; inputs AT: tree, CT: tree
# ---------- mtchanc: Python ----------
if ghenv.Component.RunCount<2:
    __author__ = "Ueli Saluz"
    __version__ = "2022.04.25"
    
    ghenv.Component.Name = "Match Ancestor"
    ghenv.Component.NickName = "MtchAnc"
    ghenv.Component.Description = "Duplicates all elements of an ancestor tree to match the amount of elements in the child tree."
    ghenv.Component.Message = "VER 1.1"
    
    ghenv.Component.Params.Input[0].Name = "AncestorTree"
    ghenv.Component.Params.Input[0].NickName = "AT"
    ghenv.Component.Params.Input[0].Description = "Ancestor tree that data will the duplicated until it matches the child tree"
    ghenv.Component.Params.Input[0].Optional = False
    
    ghenv.Component.Params.Input[1].Name = "ChildTree"
    ghenv.Component.Params.Input[1].NickName = "CT"
    ghenv.Component.Params.Input[1].Description = "Child tree that branches will the guide to duplicat the data of the ancestor tree"
    ghenv.Component.Params.Input[0].Optional = False
    
    ghenv.Component.Params.Output[0].Name = "MatchedAncestorTree"
    ghenv.Component.Params.Output[0].NickName = "MAT"
    ghenv.Component.Params.Output[0].Description = "Matched ancestor tree with the amount of items and the branch paths of the child tree"

from System import Object
from Grasshopper import DataTree

"""Returns a new tree with the ancestor data being duplicated along all child branches which where child paths of that ancestor.
    Inputs:
        ancestorTree: Ancestor tree that data will the duplicated until it matches the child tree
        childTree: Child tree that branches will the guide to duplicat the data of the ancestor tree
    Output:
        matchedAncestorTree: Matched ancestor tree with the amount of items and the branch paths of the child tree"""
def MatchAncestorTreeToChildTree (ancestorTree, childTree):
    
    matchedAncestorTree = DataTree[Object]()
    dummy = 0
    for i,pathAncestor in enumerate(ancestorTree.Paths):
        branch = ancestorTree.Branch(pathAncestor)
        if len(branch)!=1:
            raise Exception("Ancestor must be grafted and containing one item per branch")
        #The item to be duplicated
        item = branch[0]
        for j,pathChild in enumerate(childTree.Paths):
            #Returns a tuple and not like in the documentation described a bool with a pointer to the int to store the generations
            checkAncestor = pathChild.IsAncestor(pathAncestor,dummy)
            if(checkAncestor[0]):
                matchedAncestorTree.AddRange([item]*childTree.Branch(pathChild).Count,pathChild)
    return matchedAncestorTree

if __name__ == "__main__":
    MAT = MatchAncestorTreeToChildTree (AT,CT)
# ---------- end mtchanc ----------
trim_13 = TrimTree(Tree=mtchanc, Depth=1)
transform = Transform(Geometry=refbake, Transform=trim_13)
geo = Geometry(transform)

previewplane = PreviewPlane(plane=pln_3, axis_length=Slider(200, range=0..1000))
toggle = BooleanToggle(False)  # disabled
filtertype = FilterByType(ObjectType="Brep", Geometry=flatten(geo), invertFilter=False, returnNulls=False)  # -> ExcludedGeometry, IncludedGeometry
swatch = ColourSwatch(SwatchColor=RGB(0, 0, 0))
filtertype_2 = FilterByType(ObjectType="Curve", Geometry=flatten(geo), invertFilter=False, returnNulls=False)  # -> ExcludedGeometry, IncludedGeometry
debrep = DeconstructBrep(Brep=geo)  # -> Faces, Edges, Vertices
preview = CustomPreview(Geometry=flatten(filtertype.IncludedGeometry), Material=ColourSwatch(SwatchColor=RGB(255, 255, 255)))
preview_2 = CustomPreview(Geometry=flatten(filtertype_2.IncludedGeometry), Material=swatch)
preview_3 = CustomPreview(Geometry=flatten(debrep.Edges), Material=swatch)

# ==== cluster PreviewPlane: Preview a plane with axis colors and naming.
axis_length = ClusterInput()
plane = ClusterInput()
axis_length_2 = Number(axis_length)
plane_2 = Plane(plane)
deplane = DeconstructPlane(Plane=plane_2)  # -> Origin, XAxis, YAxis, ZAxis
line = LineSDL(Start=deplane.Origin, Direction=deplane.YAxis, Length=axis_length_2)
line_2 = LineSDL(Start=deplane.Origin, Direction=deplane.XAxis, Length=axis_length_2)
line_3 = LineSDL(Start=deplane.Origin, Direction=deplane.ZAxis, Length=axis_length_2)
swatch = ColourSwatch(SwatchColor=RGB(235, 52, 79))
swatch_2 = ColourSwatch(SwatchColor=RGB(0, 166, 157))
swatch_3 = ColourSwatch(SwatchColor=RGB(240, 117, 24))
end = EndPoints(Curve=line_2)  # -> Start, End
end_2 = EndPoints(Curve=line)  # -> Start, End
end_3 = EndPoints(Curve=line_3)  # -> Start, End
tag = TextTag(Location=end.End, Text="X", Colour=swatch)
tag_2 = TextTag(Location=end_2.End, Text="Y", Colour=swatch_2)
tag_3 = TextTag(Location=end_3.End, Text="Z", Colour=swatch_3)
preview = CustomPreview(Geometry=line_2, Material=swatch)
preview_2 = CustomPreview(Geometry=line, Material=swatch_2)
preview_3 = CustomPreview(Geometry=line_3, Material=swatch_3)

# ==== cluster Tower
number_of_floors = ClusterInput()
shaftpieceid = ClusterInput()
capsulepatternnortheast = ClusterInput()
capsulepatternsoutheast = ClusterInput()
capsulepatternsouthwest = ClusterInput()
capsulepatternnorthwest = ClusterInput()
id = ClusterInput()
panel = Panel("""0
0
1
0
1
0
2
3
3""")
capsulepatternnorthwest_2 = Integer(capsulepatternnorthwest)
capsulepatternsoutheast_2 = Integer(capsulepatternsoutheast)
number_of_floors_2 = Integer(number_of_floors)
shaftpieceid_2 = Text(shaftpieceid)
capsulepatternsouthwest_2 = Integer(capsulepatternsouthwest)
id_2 = Integer(id)
capsulepatternnortheast_2 = Integer(capsulepatternnortheast)
merge = Merge(Data1="1", Data2="3", Data3="5", Data4="7")
merge_2 = Merge(Data1="2", Data2="4", Data3="6", Data4="8")
panel_2 = Panel("""2
3
3
0
0
1
0
0
1""")

item = ListItem(List=panel_2, Index=capsulepatternsoutheast_2, Wrap=True)
capsuletypesouthleft = Integer(item)
ids = RandomIds(Count=number_of_floors_2, Seed=id_2, UniqueComponent=True)
item_2 = ListItem(List=merge, Index=capsuletypesouthleft, Wrap=True)  # -> graft(Item)
trim = TrimTree(Tree=ids, Depth=1)  # -> graft(Tree)
pce = ModelPiece(Id=trim, TypeName="Capsule", TypeVariant=item_2)  # -> Piece, Id, TypeName, TypeVariant, RootPlane, DiagramScreenPoint
trim_2 = TrimTree(Tree=pce.Piece, Depth=1)
trim_3 = TrimTree(Tree=pce.Id, Depth=1)

item_3 = ListItem(List=panel, Index=capsulepatternnortheast_2, Wrap=True)
capsuletypenorthright = Integer(item_3)

item_4 = ListItem(List=panel, Index=capsulepatternsouthwest_2, Wrap=True)
capsuletypewestleft = Integer(item_4)
ids_2 = RandomIds(Count=number_of_floors_2, Seed=id_2, UniqueComponent=True)
trim_4 = TrimTree(Tree=ids_2, Depth=1)  # -> graft(Tree)
item_5 = ListItem(List=merge, Index=capsuletypewestleft, Wrap=True)  # -> graft(Item)
pce_2 = ModelPiece(Id=trim_4, TypeName="Capsule", TypeVariant=item_5)  # -> Piece, Id, TypeName, TypeVariant, RootPlane, DiagramScreenPoint
trim_5 = TrimTree(Tree=pce_2.Id, Depth=1)
trim_6 = TrimTree(Tree=pce_2.Piece, Depth=1)

item_6 = ListItem(List=panel, Index=capsulepatternsoutheast_2, Wrap=True)
capsuletypeeastright = Integer(item_6)

item_7 = ListItem(List=panel, Index=capsulepatternnorthwest_2, Wrap=True)
capsuletypenorthleft = Integer(item_7)
ids_3 = RandomIds(Count=number_of_floors_2, Seed=id_2, UniqueComponent=True)
trim_7 = TrimTree(Tree=ids_3, Depth=1)  # -> graft(Tree)
item_8 = ListItem(List=merge, Index=capsuletypenorthleft, Wrap=True)  # -> graft(Item)
pce_3 = ModelPiece(Id=trim_7, TypeName="Capsule", TypeVariant=item_8)  # -> Piece, Id, TypeName, TypeVariant, RootPlane, DiagramScreenPoint
trim_8 = TrimTree(Tree=pce_3.Id, Depth=1)
trim_9 = TrimTree(Tree=pce_3.Piece, Depth=1)

item_9 = ListItem(List=panel_2, Index=capsulepatternnortheast_2, Wrap=True)
capsuletypeeastleft = Integer(item_9)

ids_4 = RandomIds(Count=number_of_floors_2, Seed=id_2, UniqueComponent=True)
trim_10 = TrimTree(Tree=ids_4, Depth=1)  # -> graft(Tree)
item_10 = ListItem(List=merge_2, Index=capsuletypenorthright, Wrap=True)  # -> graft(Item)
pce_4 = ModelPiece(Id=trim_10, TypeName="Capsule", TypeVariant=item_10)  # -> Piece, Id, TypeName, TypeVariant, RootPlane, DiagramScreenPoint
trim_11 = TrimTree(Tree=pce_4.Id, Depth=1)
trim_12 = TrimTree(Tree=pce_4.Piece, Depth=1)

ids_5 = RandomIds(Count=number_of_floors_2, Seed=id_2, UniqueComponent=True)
trim_13 = TrimTree(Tree=ids_5, Depth=1)  # -> graft(Tree)
item_11 = ListItem(List=merge_2, Index=capsuletypeeastright, Wrap=True)  # -> graft(Item)
pce_5 = ModelPiece(Id=trim_13, TypeName="Capsule", TypeVariant=item_11)  # -> Piece, Id, TypeName, TypeVariant, RootPlane, DiagramScreenPoint
trim_14 = TrimTree(Tree=pce_5.Id, Depth=1)
trim_15 = TrimTree(Tree=pce_5.Piece, Depth=1)

ids_6 = RandomIds(Count=number_of_floors_2, Seed=id_2, UniqueComponent=True)
item_12 = ListItem(List=merge, Index=capsuletypeeastleft, Wrap=True)  # -> graft(Item)
trim_16 = TrimTree(Tree=ids_6, Depth=1)  # -> graft(Tree)
pce_6 = ModelPiece(Id=trim_16, TypeName="Capsule", TypeVariant=item_12)  # -> Piece, Id, TypeName, TypeVariant, RootPlane, DiagramScreenPoint
trim_17 = TrimTree(Tree=pce_6.Id, Depth=1)
trim_18 = TrimTree(Tree=pce_6.Piece, Depth=1)

item_13 = ListItem(List=panel_2, Index=capsulepatternsouthwest_2, Wrap=True)
capsuletypesouthrigh = Integer(item_13)
ids_7 = RandomIds(Count=number_of_floors_2, Seed=id_2, UniqueComponent=True)
trim_19 = TrimTree(Tree=ids_7, Depth=1)  # -> graft(Tree)
item_14 = ListItem(List=merge_2, Index=capsuletypesouthrigh, Wrap=True)  # -> graft(Item)
pce_7 = ModelPiece(Id=trim_19, TypeName="Capsule", TypeVariant=item_14)  # -> Piece, Id, TypeName, TypeVariant, RootPlane, DiagramScreenPoint
trim_20 = TrimTree(Tree=pce_7.Id, Depth=1)
trim_21 = TrimTree(Tree=pce_7.Piece, Depth=1)

item_15 = ListItem(List=panel_2, Index=capsulepatternnorthwest_2, Wrap=True)
capsuletypewestright = Integer(item_15)
ids_8 = RandomIds(Count=number_of_floors_2, Seed=id_2, UniqueComponent=True)
trim_22 = TrimTree(Tree=ids_8, Depth=1)  # -> graft(Tree)
item_16 = ListItem(List=merge_2, Index=capsuletypewestright, Wrap=True)  # -> graft(Item)
pce_8 = ModelPiece(Id=trim_22, TypeName="Capsule", TypeVariant=item_16)  # -> Piece, Id, TypeName, TypeVariant, RootPlane, DiagramScreenPoint
trim_23 = TrimTree(Tree=pce_8.Id, Depth=1)
trim_24 = TrimTree(Tree=pce_8.Piece, Depth=1)

series = Series(Start=0, Step=1, Count=number_of_floors_2)
trim_25 = TrimTree(Tree=series, Depth=1)  # -> graft(Tree)
expression = Expression(x="0", y=trim_25, Expression="x")
expression_2 = Expression(x="0", y=trim_25, Expression="x")
spc = ModelSpecifier(Context="floor", Group=trim_25)  # -> Specifier, Context, Group
spc_2 = ModelSpecifier(Context="split level", Group=expression)  # -> Specifier, Context, Group
spc_3 = ModelSpecifier(Context="door", Group=expression_2)  # -> Specifier, Context, Group
merge_3 = Merge(Data1=spc.Specifier, Data2=spc_2.Specifier, Data3=spc_3.Specifier)
sde = ModelSide(PieceId=shaftpieceid_2, PieceTypePortSpecifiers=merge_3)  # -> Side, PieceId, PieceTypePortSpecifiers
sde_2 = ModelSide(PieceId=trim_3, PieceTypePortSpecifiers="door")  # -> Side, PieceId, PieceTypePortSpecifiers
trim_26 = TrimTree(Tree=sde.Side, Depth=1)
atr = ModelAttraction(AttractingSide=trim_26, AttractedSide=sde_2.Side)  # -> Attraction, AttractingSide, AttractedSide

expression_3 = Expression(x="2", y=trim_25, Expression="x")
spc_4 = ModelSpecifier(Context="split level", Group=expression_3)  # -> Specifier, Context, Group
merge_4 = Merge(Data1=spc.Specifier, Data2=spc_4.Specifier, Data3=spc_3.Specifier)
sde_3 = ModelSide(PieceId=shaftpieceid_2, PieceTypePortSpecifiers=merge_4)  # -> Side, PieceId, PieceTypePortSpecifiers
sde_4 = ModelSide(PieceId=trim_5, PieceTypePortSpecifiers="door")  # -> Side, PieceId, PieceTypePortSpecifiers
trim_27 = TrimTree(Tree=sde_3.Side, Depth=1)
atr_2 = ModelAttraction(AttractingSide=trim_27, AttractedSide=sde_4.Side)  # -> Attraction, AttractingSide, AttractedSide

expression_4 = Expression(x="3", y=trim_25, Expression="x")
spc_5 = ModelSpecifier(Context="door", Group=expression_4)  # -> Specifier, Context, Group
merge_5 = Merge(Data1=spc.Specifier, Data2=spc_2.Specifier, Data3=spc_5.Specifier)
sde_5 = ModelSide(PieceId=shaftpieceid_2, PieceTypePortSpecifiers=merge_5)  # -> Side, PieceId, PieceTypePortSpecifiers
sde_6 = ModelSide(PieceId=trim_11, PieceTypePortSpecifiers="door")  # -> Side, PieceId, PieceTypePortSpecifiers
trim_28 = TrimTree(Tree=sde_5.Side, Depth=1)
atr_3 = ModelAttraction(AttractingSide=trim_28, AttractedSide=sde_6.Side)  # -> Attraction, AttractingSide, AttractedSide

expression_5 = Expression(x="1", y=trim_25, Expression="x")
spc_6 = ModelSpecifier(Context="door", Group=expression_5)  # -> Specifier, Context, Group
merge_6 = Merge(Data1=spc.Specifier, Data2=spc_2.Specifier, Data3=spc_6.Specifier)
sde_7 = ModelSide(PieceId=shaftpieceid_2, PieceTypePortSpecifiers=merge_6)  # -> Side, PieceId, PieceTypePortSpecifiers
sde_8 = ModelSide(PieceId=trim_14, PieceTypePortSpecifiers="door")  # -> Side, PieceId, PieceTypePortSpecifiers
trim_29 = TrimTree(Tree=sde_7.Side, Depth=1)
atr_4 = ModelAttraction(AttractingSide=trim_29, AttractedSide=sde_8.Side)  # -> Attraction, AttractingSide, AttractedSide

expression_6 = Expression(x="1", y=trim_25, Expression="x")
spc_7 = ModelSpecifier(Context="split level", Group=expression_6)  # -> Specifier, Context, Group
merge_7 = Merge(Data1=spc.Specifier, Data2=spc_7.Specifier, Data3=spc_3.Specifier)
sde_9 = ModelSide(PieceId=shaftpieceid_2, PieceTypePortSpecifiers=merge_7)  # -> Side, PieceId, PieceTypePortSpecifiers
sde_10 = ModelSide(PieceId=trim_8, PieceTypePortSpecifiers="door")  # -> Side, PieceId, PieceTypePortSpecifiers
trim_30 = TrimTree(Tree=sde_9.Side, Depth=1)
atr_5 = ModelAttraction(AttractingSide=trim_30, AttractedSide=sde_10.Side)  # -> Attraction, AttractingSide, AttractedSide

expression_7 = Expression(x="2", y=trim_25, Expression="x")
spc_8 = ModelSpecifier(Context="door", Group=expression_7)  # -> Specifier, Context, Group
merge_8 = Merge(Data1=spc.Specifier, Data2=spc_2.Specifier, Data3=spc_8.Specifier)
sde_11 = ModelSide(PieceId=shaftpieceid_2, PieceTypePortSpecifiers=merge_8)  # -> Side, PieceId, PieceTypePortSpecifiers
sde_12 = ModelSide(PieceId=trim_17, PieceTypePortSpecifiers="door")  # -> Side, PieceId, PieceTypePortSpecifiers
trim_31 = TrimTree(Tree=sde_11.Side, Depth=1)
atr_6 = ModelAttraction(AttractingSide=trim_31, AttractedSide=sde_12.Side)  # -> Attraction, AttractingSide, AttractedSide

merge_9 = Merge(Data1=spc.Specifier, Data2=spc_4.Specifier, Data3=spc_6.Specifier)
sde_13 = ModelSide(PieceId=shaftpieceid_2, PieceTypePortSpecifiers=merge_9)  # -> Side, PieceId, PieceTypePortSpecifiers
sde_14 = ModelSide(PieceId=trim_20, PieceTypePortSpecifiers="door")  # -> Side, PieceId, PieceTypePortSpecifiers
trim_32 = TrimTree(Tree=sde_13.Side, Depth=1)
atr_7 = ModelAttraction(AttractingSide=trim_32, AttractedSide=sde_14.Side)  # -> Attraction, AttractingSide, AttractedSide

merge_10 = Merge(Data1=spc.Specifier, Data2=spc_7.Specifier, Data3=spc_6.Specifier)
sde_15 = ModelSide(PieceId=shaftpieceid_2, PieceTypePortSpecifiers=merge_10)  # -> Side, PieceId, PieceTypePortSpecifiers
sde_16 = ModelSide(PieceId=trim_23, PieceTypePortSpecifiers="door")  # -> Side, PieceId, PieceTypePortSpecifiers
trim_33 = TrimTree(Tree=sde_15.Side, Depth=1)
atr_8 = ModelAttraction(AttractingSide=trim_33, AttractedSide=sde_16.Side)  # -> Attraction, AttractingSide, AttractedSide

data = Data(flatten(spc_2.Specifier))
panel_3 = Panel(data)
merge_11 = Merge(Data1=trim_2, Data2=trim_15, Data3=trim_18, Data4=trim_12, Data5=trim_9, Data6=trim_24, Data7=trim_6, Data8=trim_21)
merge_12 = Merge(
    Data1=atr.Attraction,
    Data2=atr_4.Attraction,
    Data3=atr_6.Attraction,
    Data4=atr_3.Attraction,
    Data5=atr_5.Attraction,
    Data6=atr_8.Attraction,
    Data7=atr_2.Attraction,
    Data8=atr_7.Attraction)
pc = Piece(merge_11)
at = Attraction(merge_12)
at_2 = ClusterOutput(at)
pc_2 = ClusterOutput(pc)

# ==== cluster ReplaceTypeInFormation
fo = ClusterInput()
old_type_name = ClusterInput()
new_type_name = ClusterInput()
fo_2 = Formation(fo)
old_type_name_2 = Text(old_type_name)
new_type_name_2 = Text(new_type_name)
for = ModelFormation(Formation=fo_2)  # -> Formation, Name, Description, Icon, Variant, Unit, Pieces, Attractions, Qualities
pce = ModelPiece(Piece=for.Pieces)  # -> Piece, Id, TypeName, TypeVariant, RootPlane, DiagramScreenPoint
tmatch = MatchText(Text=pce.TypeName, Pattern=old_type_name_2, Case=True)
dispatch = Dispatch(List=pce.Piece, DispatchPattern=tmatch)  # -> ListA, ListB
pce_2 = ModelPiece(Piece=dispatch.ListA, TypeName=new_type_name_2)  # -> Piece, Id, TypeName, TypeVariant, RootPlane, DiagramScreenPoint
merge = Merge(Data1=pce_2.Piece, Data2=dispatch.ListB)
for_2 = ModelFormation(Formation=fo_2, Pieces=merge)  # -> Formation, Name, Description, Icon, Variant, Unit, Pieces, Attractions, Qualities
fo_3 = Formation(for_2.Formation)
fo_4 = ClusterOutput(fo_3)
