# Grasshopper definition capsule-speckle.gh (Grasshopper 1.0.7)
# plug-ins: Speckle 2, semio

save_representation = BooleanToggle(False)
icon_export = BooleanToggle(False)
variant = Slider(0, range=0..7)
save = BooleanToggle(False)
loop_slider = PythonScript(SliderToModify=variant, Min="0", Max="7", stepSize="1", Delay=Slider(0, range=0..1), Run=Toggle(False), Reset=Button())  # inputs Run: Boolean, Reset: Boolean
# ---------- loop_slider: Python ----------
import time

def updateSliderInput(inputName,min,max,value,decimalPlace=2):
    for input in ghenv.Component.Params.Input:
        for source in input.Sources:
            if input.Name == str(inputName):
                source.Slider.DecimalPlaces = decimalPlace
                source.Slider.Minimum = min
                source.Slider.Maximum = max
                source.Slider.Value = value
                source.ExpireSolution(True)

def countDecimal(number):
    string= str(number)
    return string[::-1].find('.')

if Run == True:
    if SliderToModify < Max:
        time.sleep(Delay)
        updateSliderInput("SliderToModify",Min,Max,SliderToModify+stepSize,countDecimal(stepSize))
if Reset == True:
    updateSliderInput("SliderToModify",Min,Max,Min)
# ---------- end loop_slider ----------
and = GateAnd(A=save, B=save_representation)
and_2 = GateAnd(A=save, B=icon_export)
curdir = CurrentDirectory()  # -> PD, D, P, S
# ---------- curdir: Python ----------
# Component Information
# --------------------------------------------------------------------------------------------
if ghenv.Component.RunCount < 2:
    # General
    # --------------------------------------------------------------------------------------------
    __author__ = "Ueli Saluz"
    __version__ = "2024.07.26"

    ghenv.Component.Name = "CurrentDirectory"
    ghenv.Component.NickName = "CurDir"
    ghenv.Component.Description = "Current directory of the current grasshopper file."
    ghenv.Component.Message = "VER 1.1"
    ghenv.Component.Category = "Params"
    ghenv.Component.SubCategory = "Util"

    # Outputs
    # --------------------------------------------------------------------------------------------
    outputIndex = 0

    ghenv.Component.Params.Output[outputIndex].Name = "ParentDirectory"
    ghenv.Component.Params.Output[outputIndex].NickName = "PD"
    ghenv.Component.Params.Output[outputIndex].Description = "Parent directory of the current directory."
    outputIndex += 1

    ghenv.Component.Params.Output[outputIndex].Name = "Directory"
    ghenv.Component.Params.Output[outputIndex].NickName = "D"
    ghenv.Component.Params.Output[outputIndex].Description = "Directory of the current grasshopper file."
    outputIndex += 1

    ghenv.Component.Params.Output[outputIndex].Name = "Path"
    ghenv.Component.Params.Output[outputIndex].NickName = "P"
    ghenv.Component.Params.Output[outputIndex].Description = "Path of the current grasshopper file."
    outputIndex += 1

    ghenv.Component.Params.Output[outputIndex].Name = "Separator"
    ghenv.Component.Params.Output[outputIndex].NickName = "S"
    ghenv.Component.Params.Output[outputIndex].Description = "Separator of the current system."
    outputIndex += 1

# Imports
# --------------------------------------------------------------------------------------------
from os.path import dirname, abspath
from os import sep

# Solver - Run with trees to enhance performance drastically
# --------------------------------------------------------------------------------------------
if __name__ == "__main__":
    P = ghenv.Component.OnPingDocument().FilePath
    D = dirname(P)
    PD = dirname(D)
    S = sep
# ---------- end curdir ----------
kit = LoadKit(Directory=curdir.PD, Run=Toggle(True))  # -> Name, Description, Icon, Url, Homepage, Types, Formations
_3dm = Import3DM(Layer="*", Name="*")
cso = CreateSpeckleObject(selectedKitName="Objects")
cso_2 = CreateSpeckleObject(selectedKitName="Objects")
panel = Panel("https://app.speckle.systems/projects/e7de1a2f8f/models/b665508e8d")
panel_2 = Panel("https://app.speckle.systems/projects/e7de1a2f8f/models/571abc7332")
panel_3 = Panel("https://app.speckle.systems/projects/e7de1a2f8f/models/64b4da837a")
# Outputs   ->
#                 |
#                 v
list = Accounts(
    {"No account selected": , "Account (ueli.saluz@iek.uni-hannover.de | https://app.speckle.systems)": "https://app.speckle.systems/?id=9168be9d22"}, selected="Account (ueli.saluz@iek.uni-hannover.de | https://app.speckle.systems)",
    FirstSelectedItem="https://app.speckle.systems/?id=9168be9d22")
send = Send(
    Stream=panel,
    Data=cso,
    AutoSend=False,
    BaseId="12c2159a7ecdff295e2160d152e1d5ab",
    CurrentComponentState="up_to_date",
    KitName="Objects",
    OutputWrappers="https://app.speckle.systems\te7de1a2f8f\t6129697a34",
    UseDefaultCache=True,
    selectedKitName="Objects")
send_2 = Send(
    Stream=panel_3,
    Data=cso,
    AutoSend=False,
    BaseId="12c2159a7ecdff295e2160d152e1d5ab",
    CurrentComponentState="up_to_date",
    KitName="Objects",
    OutputWrappers="https://app.speckle.systems\te7de1a2f8f\t9091ff1b81",
    UseDefaultCache=True,
    selectedKitName="Objects")
item = ListItem(List=panel_2, Index=0, Wrap=True)
send_3 = Send(
    Stream=panel_2,
    Data=cso_2,
    AutoSend=False,
    BaseId="41c591f12f7a131e5620599344118ced",
    CurrentComponentState="up_to_date",
    KitName="Objects",
    OutputWrappers="https://app.speckle.systems\te7de1a2f8f\tcaf3d101c4",
    UseDefaultCache=True,
    selectedKitName="Objects")
