# Grasshopper definition shaft.gh (Grasshopper 1.0.7)
# plug-ins: Semio.Grasshopper, eleFront

number_slider = Slider(200, range=0..1000)
number_slider_2 = Slider(10, range=0..100)
number_slider_3 = Slider(80, range=0..200)
list = ValueList({"Front", "Right", "Bottom", "Left"}, selected="Right")
# ^
#                  |
# Preview    ->
# Parameters:
safe = Button()
# External
#       |
#       v
width = GetNumber(Slider(550, range=0..1000), AtLeast=1, AtMost=1, Maximum=1.797693135e+308, Minimum=-1.797693135e+308, TreeAccess=False)
floorheight = GetNumber(Slider(275, range=0..1000), AtLeast=1, AtMost=1, Maximum=1.797693135e+308, Minimum=-1.797693135e+308, TreeAccess=False)
platform = GetString(list, AtLeast=1, AtMost=1, TreeAccess=False)
wallthickness = GetNumber(Slider(30, range=0..100), AtLeast=1, AtMost=1, Maximum=1.797693135e+308, Minimum=-1.797693135e+308, TreeAccess=False)
doorwidth = GetNumber(number_slider_3, AtLeast=1, AtMost=1, Maximum=1.797693135e+308, Minimum=-1.797693135e+308, TreeAccess=False)
dooroffset = GetNumber(number_slider_2, AtLeast=1, AtMost=1, Maximum=1.797693135e+308, Minimum=-1.797693135e+308, TreeAccess=False)
doorheight = GetNumber(number_slider, AtLeast=1, AtMost=1, Maximum=1.797693135e+308, Minimum=-1.797693135e+308, TreeAccess=False)
floors = GetNumber(Slider(10, range=0..20), AtLeast=1, AtMost=1, Maximum=1.797693135e+308, Minimum=-1.797693135e+308, TreeAccess=False)

series = Series(Start="1", Step=1, Count="2")
dup = DuplicateData(Data="0", Number="4", Order=True)
trim = TrimTree(Tree=series, Depth=1)  # -> graft(Tree)
trim_2 = TrimTree(Tree=dup, Depth=1)
dup_2 = DuplicateData(Data=trim, Number="2", Order=True)  # -> flatten(Data)
merge = Merge(Data1=trim_2, Data2=dup_2)
dup_3 = DuplicateData(Data=merge, Number=floors, Order=True)
trim_3 = TrimTree(Tree=dup_3, Depth=1)
spc = ModelSpecifier(Context="split level", Group=trim_3)  # -> Specifier, Context, Group

# ----
# Local ->
expression = Expression(x=floors, Expression="x+1")
panel = Panel("""Front
Right
Bottom
Left""")
itemindex = ItemIndex(L=panel, I=platform)  # -> i; inputs L: list
# ---------- itemindex: Python ----------
#Component Information
#--------------------------------------------------------------------------------------------
if ghenv.Component.RunCount<2:
    #General
    #--------------------------------------------------------------------------------------------
    __author__ = "Ueli Saluz"
    __version__ = "2022.11.18"
    
    ghenv.Component.Name = "ItemIndex"
    ghenv.Component.NickName = "ItemIndex"
    ghenv.Component.Description = "A better IdemIndex"
    ghenv.Component.Message = "VER 1.0"
    ghenv.Component.Category = "Set"
    ghenv.Component.SubCategory = "List"
    
     #Inputs
    #--------------------------------------------------------------------------------------------
    inputIndex=0
    
    ghenv.Component.Params.Input[inputIndex].Name = "List"
    ghenv.Component.Params.Input[inputIndex].NickName = "L"
    ghenv.Component.Params.Input[inputIndex].Description = "Input1 is..."
    ghenv.Component.Params.Input[inputIndex].Optional = False
    inputIndex+=1
    
    ghenv.Component.Params.Input[inputIndex].Name = "Item"
    ghenv.Component.Params.Input[inputIndex].NickName = "I"
    ghenv.Component.Params.Input[inputIndex].Description = "Input2 is..."
    ghenv.Component.Params.Input[inputIndex].Optional = False
    inputIndex+=1
    
    #Outputs
    #--------------------------------------------------------------------------------------------
    outputIndex=0
    
    ghenv.Component.Params.Output[outputIndex].Name = "Index"
    ghenv.Component.Params.Output[outputIndex].NickName = "i"
    ghenv.Component.Params.Output[outputIndex].Description = "Output1 is..."
    outputIndex+=1

i = L.index(I)
# ---------- end itemindex ----------
int = Integer(expression)
multiplication = Multiplication(A=int, B=floorheight)
valueor0 = ValueOr0(value=itemindex)
coreheight = Number(multiplication)
expression_2 = Expression(x=valueor0, Expression="-((x+2)*90)%360")
dom = ConstructDomain(DomainStart=0, DomainEnd=coreheight)
_2d = _2D(x=width)
box = DomainBox(Base=PlaneXY(0, 0, 0), X=_2d, Y=_2d, Z=dom)
corevolume = Box(box)
debrep = DeconstructBrep(Brep=corevolume)  # -> Faces, Edges, Vertices
trim_4 = TrimTree(Tree=debrep.Faces, Depth=1)
item = ListItem(List=trim_4, Index=0, Wrap=True)  # -> Item, Item1, Item2, Item3, Item4
base = Surface(item.Item4)
explode = Explode(Curve=base, Recursive=True)  # -> Segments, Vertices
trim_5 = TrimTree(Tree=explode.Segments, Depth=1)
join = JoinCurves(Curves=explode.Segments, Preserve=False)
expression_3 = Expression(x=width, Expression="x/2")
expression_4 = Expression(x=doorwidth, Expression="x/2")
trim_6 = TrimTree(Tree=join, Depth=1)
curvepoint = PointOnCurve(trim_5, parameter=0.5)
subtraction = Subtraction(A=expression_3, B=expression_4, C=dooroffset, D=wallthickness)
crv_cp = CurveClosestPoint(Point=curvepoint, Curve=trim_5)  # -> Point, Parameter, Distance
addition = Addition(A=crv_cp.Parameter, B=subtraction)
subtraction_2 = Subtraction(A=crv_cp.Parameter, B=subtraction)
eval = EvaluateCurve(Curve=trim_5, Parameter=addition)  # -> Point, Tangent, Angle
eval_2 = EvaluateCurve(Curve=trim_5, Parameter=subtraction_2)  # -> Point, Tangent, Angle
shift = ShiftList(List=eval_2.Point, Shift=1, Wrap=True)
trim_7 = TrimTree(Tree=shift, Depth=1)
merge_2 = Merge(Data1=graft(eval.Point), Data2=graft(trim_7))

expression_5 = Expression(x=floorheight, Expression="x/3")
lng = ListLength(List=trim_5)
dup_4 = DuplicateData(Data=expression_5, Number=lng, Order=True)
trim_8 = TrimTree(Tree=dup_4, Depth=1)
expression_6 = Expression(x=int, Expression="(x-1)*4")
replace = ReplaceItems(List=trim_8, Item="0", Indices="1", Wrap=False)
repeat = RepeatData(Data=replace, Length=expression_6)
trim_9 = TrimTree(Tree=repeat, Depth=1)
ma = MassAddition(Input=trim_9)  # -> Result, PartialResults
flip = FlipMatrix(Data=ma.PartialResults)
doorheights = Number(flip)
Z = UnitZ(Factor=doorheights)
trim_10 = TrimTree(Tree=Z, Depth=1)
cset = CreateSet(List=trim_10)  # -> Set, graft(Map)
path = ConstructPath(Indices=cset.Map)
trim_11 = TrimTree(Tree=path, Depth=1)

l2o = List2Object(L=merge_2)  # -> O; inputs L: tree
# ---------- l2o: Python ----------
#Component Information
#--------------------------------------------------------------------------------------------
if ghenv.Component.RunCount<2:
    #General
    #--------------------------------------------------------------------------------------------
    __author__ = "Ueli Saluz"
    __version__ = "2022.04.24"
    
    ghenv.Component.Name = "List2Object"
    ghenv.Component.NickName = "L2O"
    ghenv.Component.Description = "Wraps a list of objects into a list object."
    ghenv.Component.Message = "VER 1.0"
    ghenv.Component.Category = "Sets"
    ghenv.Component.SubCategory = "Tree"
    
     #Inputs
    #--------------------------------------------------------------------------------------------
    inputIndex=0
    
    ghenv.Component.Params.Input[inputIndex].Name = "List"
    ghenv.Component.Params.Input[inputIndex].NickName = "L"
    ghenv.Component.Params.Input[inputIndex].Description = "Tree with lists to wrap."
    ghenv.Component.Params.Input[inputIndex].Optional = False
    inputIndex+=1
    

    #Outputs
    #--------------------------------------------------------------------------------------------
    outputIndex=0
    
    ghenv.Component.Params.Output[outputIndex].Name =  "ListObject" 
    ghenv.Component.Params.Output[outputIndex].NickName = "O"
    ghenv.Component.Params.Output[outputIndex].Description = "Python list object as single item."
    outputIndex+=1


#Imports
#--------------------------------------------------------------------------------------------
from System import Object
from Grasshopper import DataTree

#Solver - Run with trees to enhance performance drastically
#--------------------------------------------------------------------------------------------
if __name__ == "__main__":
    
    #Initialize trees
    #--------------------------------------------------------------------------------------------
    TreeToWrap = DataTree[Object]()
    
    #Data matching
    #--------------------------------------------------------------------------------------------
    for path in L.Paths:
        listBranch = L.Branch(path)
        TreeToWrap.Add(listBranch,path)
    
     #Assign trees to output
    #--------------------------------------------------------------------------------------------
    O = TreeToWrap
# ---------- end l2o ----------
trim_12 = TrimTree(Tree=l2o, Depth=1)
repeat_2 = RepeatData(Data=trim_12, Length=expression_6)
trim_13 = TrimTree(Tree=repeat_2, Depth=1)
o2l = Object2List(O=trim_13)  # -> L; inputs O: tree
# ---------- o2l: Python ----------
#Component Information
#--------------------------------------------------------------------------------------------
if ghenv.Component.RunCount<2:
    #General
    #--------------------------------------------------------------------------------------------
    __author__ = "Ueli Saluz"
    __version__ = "2022.04.24"
    
    ghenv.Component.Name = "Object2List"
    ghenv.Component.NickName = "O2L"
    ghenv.Component.Description = "Unwraps a list of objects into a list object."
    ghenv.Component.Message = "VER 1.0"
    ghenv.Component.Category = "Sets"
    ghenv.Component.SubCategory = "Tree"
    
     #Inputs
    #--------------------------------------------------------------------------------------------
    inputIndex=0
    
    ghenv.Component.Params.Input[inputIndex].Name = "ListObject"
    ghenv.Component.Params.Input[inputIndex].NickName = "O"
    ghenv.Component.Params.Input[inputIndex].Description = "A python list object that will be unwrapped into a Grasshopper list."
    ghenv.Component.Params.Input[inputIndex].Optional = False
    inputIndex+=1
    

    #Outputs
    #--------------------------------------------------------------------------------------------
    outputIndex=0
    
    ghenv.Component.Params.Output[outputIndex].Name =  "List"
    ghenv.Component.Params.Output[outputIndex].NickName = "L"
    ghenv.Component.Params.Output[outputIndex].Description = "The unwrapped list."
    outputIndex+=1


#Imports
#--------------------------------------------------------------------------------------------
from System import Object
from Grasshopper import DataTree

#Solver - Run with trees to enhance performance drastically
#--------------------------------------------------------------------------------------------
if __name__ == "__main__":
    
    #Initialize trees
    #--------------------------------------------------------------------------------------------
    OriginalTree = DataTree[Object]()
    
    #Data matching
    #--------------------------------------------------------------------------------------------
    for path in O.Paths:
        listBranch = O.Branch(path)
        for i,listItem in enumerate(listBranch):
            OriginalTree.AddRange(list(listItem),path.AppendElement(i))
    
     #Assign trees to output
    #--------------------------------------------------------------------------------------------
    L = OriginalTree
# ---------- end o2l ----------
match = MatchTree(Tree=Z, Guide=o2l)
move = Move(Geometry=o2l, Motion=match)  # -> Geometry, Transform
crv_cp_2 = CurveClosestPoint(Point=move.Geometry, Curve=trim_6)  # -> Point, Parameter, Distance
eval_3 = EvaluateCurve(Curve=trim_6, Parameter=crv_cp_2.Parameter)  # -> Point, Tangent, Angle
rev = Reverse(Vector=eval_3.Tangent)
line = LineSDL(Start=eval_3.Point, Direction=Vector(0, 0, 1), Length=1)
vrot = Rotate(Vector=rev, Axis=line, Angle=degrees("90"))
pl = ConstructPlane(Origin=eval_3.Point, XAxis=rev, YAxis=vrot)
move_2 = Move(Geometry=pl, Motion=Z)  # -> Geometry, Transform
rotate = Rotate(Geometry=move_2.Geometry, Angle=degrees(expression_2), Plane=PlaneXY(0, 0, 0))  # -> Geometry, Transform
neg = Negative(Value=expression_5)
relblbrch = RelabelBranches(TreeToMatch=rotate.Geometry, ListOfPaths=trim_11)  # -> RelabeledTree; inputs TreeToMatch: tree, ListOfPaths: list
# ---------- relblbrch: Python ----------
if ghenv.Component.RunCount<2:
    __author__ = "Your name"
    __version__ = "2000.00.00"
    
    ghenv.Component.Name = "RelabelBranches"
    ghenv.Component.NickName = "ReLblBrch"
    ghenv.Component.Description = "Relabel all the paths of the branches with a list of new paths. The amount of branches must match with the size of the list of pahts"
    ghenv.Component.Message = "VER 1.0"
    
    ghenv.Component.Params.Input[0].NickName = "TreeToMatch"
    ghenv.Component.Params.Input[1].NickName = "ListOfPaths"
    
    ghenv.Component.Params.Input[0].Description = "Tree that should be relabeled."
    ghenv.Component.Params.Input[1].Description = "List of paths to use for new branch paths."
    
    ghenv.Component.Params.Output[0].NickName = "RelabeledTree"
    ghenv.Component.Params.Output[0].Description = "Relabeled tree where all the paths of the branches have been replaced with new paths."

from System import Object
from Grasshopper import DataTree

def relabelBranchesWithLstOfPths (tree, paths):
    newTree = DataTree[Object]()
    for i,path in enumerate(tree.Paths):
        items = tree.Branch(path)
        for data in items:
            newTree.Add(data,paths[i])
    return newTree

if __name__ == "__main__":
    RelabeledTree = relabelBranchesWithLstOfPths(TreeToMatch,ListOfPaths)
# ---------- end relblbrch ----------
addition_2 = Addition(A=neg)
Z_2 = UnitZ(Factor=addition_2)
move_3 = Move(Geometry=relblbrch, Motion=Z_2)  # -> Geometry, Transform
entranceplanes = Plane(move_3.Geometry)

# ----
# Outputs   ->
#                 |
#                 v
panel_2 = Panel("2")
series_2 = Series(Start=0, Step=1, Count="4")
series_3 = Series(Start=0, Step=1, Count=panel_2)
trim_14 = TrimTree(Tree=series_2, Depth=1)
trim_15 = TrimTree(Tree=series_3, Depth=1)
lng_2 = ListLength(List=flatten(entranceplanes))
merge_3 = Merge(Data1=trim_14, Data2=trim_15, Data3=trim_15)
repeat_3 = RepeatData(Data=merge_3, Length=lng_2)
trim_16 = TrimTree(Tree=repeat_3, Depth=1)
spc_2 = ModelSpecifier(Context="door", Group=trim_16)  # -> Specifier, Context, Group

series_4 = Series(Start=0, Step=1, Count=floors)
trim_17 = TrimTree(Tree=series_4, Depth=1)
dup_5 = DuplicateData(Data=graft(trim_17), Number="8", Order=True)
trim_18 = TrimTree(Tree=dup_5, Depth=1)
trim_19 = TrimTree(Tree=trim_18, Depth=1)
spc_3 = ModelSpecifier(Context="floor", Group=trim_19)  # -> Specifier, Context, Group

variant = Integer(Slider(0, range=0..10))
curdir = CurrentDirectory()  # -> D, P, S
# ---------- curdir: Python ----------
#Component Information
#--------------------------------------------------------------------------------------------
if ghenv.Component.RunCount<2:
    #General
    #--------------------------------------------------------------------------------------------
    __author__ = "Ueli Saluz"
    __version__ = "2023.09.29"
    
    ghenv.Component.Name = "CurrentDirectory"
    ghenv.Component.NickName = "CurDir"
    ghenv.Component.Description = "Current directory of the current grasshopper file."
    ghenv.Component.Message = "VER 1.0"
    ghenv.Component.Category = "Params"
    ghenv.Component.SubCategory = "Util"
    
    #Outputs
    #--------------------------------------------------------------------------------------------
    outputIndex=0
    
    ghenv.Component.Params.Output[outputIndex].Name = "Directory"
    ghenv.Component.Params.Output[outputIndex].NickName = "D"
    ghenv.Component.Params.Output[outputIndex].Description = "Directory of the current grasshopper file."
    outputIndex+=1
    
    ghenv.Component.Params.Output[outputIndex].Name = "Path"
    ghenv.Component.Params.Output[outputIndex].NickName = "P"
    ghenv.Component.Params.Output[outputIndex].Description = "Path of the current grasshopper file."
    outputIndex+=1
    
    ghenv.Component.Params.Output[outputIndex].Name = "Separator"
    ghenv.Component.Params.Output[outputIndex].NickName = "S"
    ghenv.Component.Params.Output[outputIndex].Description = "Separator of the current system."
    outputIndex+=1

#Imports
#--------------------------------------------------------------------------------------------
from os.path import dirname
from os import sep

#Solver - Run with trees to enhance performance drastically
#--------------------------------------------------------------------------------------------
if __name__ == "__main__":
    P = ghenv.Component.OnPingDocument().FilePath
    D = dirname(P)
    S = sep
# ---------- end curdir ----------
expression_7 = Expression(x=variant, Expression="x+1")
concat = Concatenate(FragmentC="representations", FragmentD=curdir.S, FragmentA="shaft", FragmentB="_", FragmentE=expression_7, FragmentF="_")
concat_2 = Concatenate(FragmentA=concat, FragmentE="1to500", FragmentG="_", FragmentF="volume")
concat_3 = Concatenate(FragmentA=concat, FragmentE="1to200", FragmentG="_", FragmentF="volume")
concat_4 = Concatenate(FragmentA=concat_2, FragmentB=".3dm")
concat_5 = Concatenate(FragmentA=concat_3, FragmentB=".3dm")
rep = ModelRepresentation(Url=concat_4, LevelOfDetail="1to500", Tags="volume")  # -> Representation, Url, LevelOfDetail, Tags
rep_2 = ModelRepresentation(Url=concat_5, LevelOfDetail="1to200", Tags="volume")  # -> Representation, Url, LevelOfDetail, Tags

merge_4 = Merge(
    Data1=width,
    Data2=floors,
    Data3=floorheight,
    Data4=platform,
    Data5=number_slider_3,
    Data6=number_slider,
    Data7=number_slider_2)
panel_3 = Panel("""width
floors
floor height
platform
door width
door height
door offset""")
panel_4 = Panel(merge_4)
panel_5 = Panel("""cm

cm
cm
cm
cm
cm""")
qlt = ModelQuality(Name=panel_3, Value=panel_4, Unit=panel_5)  # -> Quality, Name, Value, Unit

xy = XYPlane(Origin=Point(0, 0, 0))
Z_3 = UnitZ(Factor=coreheight)
move_4 = Move(Geometry=xy, Motion=Z_3)  # -> Geometry, Transform
spc_4 = ModelSpecifier(Context="bottom", Group="true")  # -> Specifier, Context, Group
spc_5 = ModelSpecifier(Context="top", Group="true")  # -> Specifier, Context, Group
por = ModelPort(Plane=xy, Specifiers=spc_4.Specifier)  # -> Port, Plane, Specifiers
por_2 = ModelPort(Plane=move_4.Geometry, Specifiers=spc_5.Specifier)  # -> Port, Plane, Specifiers

entranceplanes_2 = Plane(flatten(entranceplanes))
merge_5 = Merge(Data1=graft(spc_3.Specifier), Data2=graft(spc.Specifier), Data3=graft(spc_2.Specifier))
por_3 = ModelPort(Plane=graft(entranceplanes_2), Specifiers=merge_5)  # -> flatten(Port), Plane, Specifiers

merge_6 = Merge(Data1=rep.Representation, Data2=rep_2.Representation)
merge_7 = Merge(Data1=por.Port, Data2=por_2.Port, Data3=por_3.Port)
typ = ModelType(
    Name="shaft",
    Explanation="An efficient core with many doors.",
    Icon="🛗",
    Representations=merge_6,
    Ports=merge_7,
    Qualities=qlt.Quality)  # -> Type, Name, Explanation, Icon, Representations, Ports, Qualities
typ_2 = RemoveType(TypeName=typ.Name, TypeQualities=typ.Qualities, Run=safe)
or = GateOr(A=safe, B=typ_2)
typ_3 = AddType(Type=typ.Type, Run=or)

typ_4 = SerializeType(Type=typ.Type)
type = Text(typ_4)
context_bake = ContextBake(Geometry=type)
previewplane = PreviewPlane(plane=graft(entranceplanes), axis_length=Slider(50, range=0..100))  # -> X_2, Y_2, Z_2

deplane = DeconstructPlane(Plane=entranceplanes)  # -> Origin, XAxis, YAxis, ZAxis
pl_2 = ConstructPlane(Origin=deplane.Origin, XAxis=deplane.XAxis, YAxis=deplane.ZAxis)
_2d_2 = _2D(x=doorwidth)
rectangle = Rectangle(Plane=pl_2, XSize=_2d_2, YSize=doorheight, Radius=0)  # -> Rectangle, Length
doors = Rectangle(rectangle.Rectangle)

doors_2 = Rectangle(flatten(doors))
corevolume_2 = Box(corevolume)
expression_8 = Expression(x="doors", y=doors_2, Expression="x")
expression_9 = Expression(x="volume", y=corevolume_2, Expression="x")
ef_layer = EleFrontLayer(FullPath=expression_9)  # -> Layer, FullPath, Hidden, Locked, DisplayColour, MaterialName, Linetype, PrintColour, PrintWidth
ef_layer_2 = EleFrontLayer(FullPath=expression_8)  # -> Layer, FullPath, Hidden, Locked, DisplayColour, MaterialName, Linetype, PrintColour, PrintWidth
ef_att = EleFrontAttributes(Layer=ef_layer.Layer)  # -> Attributes, Keys, Values, Name, Layer, ColourSource, DisplayColour, MaterialSource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
ef_att_2 = EleFrontAttributes(Layer=ef_layer_2.Layer)  # -> Attributes, Keys, Values, Name, Layer, ColourSource, DisplayColour, MaterialSource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
merge_8 = Merge(Data1=corevolume_2)
merge_9 = Merge(Data1=ef_att.Attributes)
merge_10 = Merge(Data1=doors_2)
merge_11 = Merge(Data1=ef_att_2.Attributes)
baketofile = BakeObjectsToFile(
    FilePath=rep.Url,
    Geometry=merge_8,
    Attributes=merge_9,
    Bake=safe,
    networkMode=False,
    ValueTable_networkMode=True,
    overwriteMode="Overwrite",
    preset="Safest")
baketofile_2 = BakeObjectsToFile(
    FilePath=rep_2.Url,
    Geometry=merge_10,
    Attributes=merge_11,
    Bake=safe,
    networkMode=False,
    ValueTable_networkMode=True,
    overwriteMode="Overwrite",
    preset="Safest")

merge_12 = Merge(Data1=previewplane.X_2, Data2=previewplane.Y_2, Data3=previewplane.Z_2)

# ==== cluster _2D
x = ClusterInput()
expression = Expression(x=x, Expression="x/2")
neg = Negative(Value=expression)
dom = ConstructDomain(DomainStart=neg, DomainEnd=expression)
I = ClusterOutput(dom)

# ==== cluster ValueOr0
value = ClusterInput()
value_2 = Number(value)
null = NullItem(Item=value_2)  # -> NullFlags, InvalidFlags, Description
filter = StreamFilter(Gate=null.NullFlags, Stream0=value_2, Stream1="0")
valueor0 = Number(filter)
valueor0_2 = ClusterOutput(valueor0)

# ==== cluster PreviewPlane: Preview a plane with axis colors and naming.
axis_length = ClusterInput()
plane = ClusterInput()
axis_length_2 = Number(axis_length)
plane_2 = Plane(plane)
deplane = DeconstructPlane(Plane=plane_2)  # -> Origin, XAxis, YAxis, ZAxis
line = LineSDL(Start=deplane.Origin, Direction=deplane.YAxis, Length=axis_length_2)
line_2 = LineSDL(Start=deplane.Origin, Direction=deplane.XAxis, Length=axis_length_2)
line_3 = LineSDL(Start=deplane.Origin, Direction=deplane.ZAxis, Length=axis_length_2)
swatch = ColourSwatch(SwatchColor=RGB(235, 52, 79))
swatch_2 = ColourSwatch(SwatchColor=RGB(0, 166, 157))
swatch_3 = ColourSwatch(SwatchColor=RGB(240, 117, 24))
end = EndPoints(Curve=line_2)  # -> Start, End
end_2 = EndPoints(Curve=line)  # -> Start, End
end_3 = EndPoints(Curve=line_3)  # -> Start, End
tag = TextTag(Location=end.End, Text="X", Colour=swatch)
tag_2 = TextTag(Location=end_2.End, Text="Y", Colour=swatch_2)
tag_3 = TextTag(Location=end_3.End, Text="Z", Colour=swatch_3)
preview = CustomPreview(Geometry=line_2, Material=swatch)
preview_2 = CustomPreview(Geometry=line, Material=swatch_2)
preview_3 = CustomPreview(Geometry=line_3, Material=swatch_3)
X = Line(line_2)
Y = Line(line)
Z = Line(line_3)
X_2 = ClusterOutput(X)
Y_2 = ClusterOutput(Y)
Z_2 = ClusterOutput(Z)
