# Grasshopper definition test.gh (Grasshopper 1.0.7)
# plug-ins: Semio.Grasshopper, LunchBox

number_slider = Slider(37, range=0..1000)
curdir = CurrentDirectory()  # -> D, P, S
# ---------- curdir: Python ----------
#Component Information
#--------------------------------------------------------------------------------------------
if ghenv.Component.RunCount<2:
    #General
    #--------------------------------------------------------------------------------------------
    __author__ = "Ueli Saluz"
    __version__ = "2023.09.29"
    
    ghenv.Component.Name = "CurrentDirectory"
    ghenv.Component.NickName = "CurDir"
    ghenv.Component.Description = "Current directory of the current grasshopper file."
    ghenv.Component.Message = "VER 1.0"
    ghenv.Component.Category = "Params"
    ghenv.Component.SubCategory = "Util"
    
    #Outputs
    #--------------------------------------------------------------------------------------------
    outputIndex=0
    
    ghenv.Component.Params.Output[outputIndex].Name = "Directory"
    ghenv.Component.Params.Output[outputIndex].NickName = "D"
    ghenv.Component.Params.Output[outputIndex].Description = "Directory of the current grasshopper file."
    outputIndex+=1
    
    ghenv.Component.Params.Output[outputIndex].Name = "Path"
    ghenv.Component.Params.Output[outputIndex].NickName = "P"
    ghenv.Component.Params.Output[outputIndex].Description = "Path of the current grasshopper file."
    outputIndex+=1
    
    ghenv.Component.Params.Output[outputIndex].Name = "Separator"
    ghenv.Component.Params.Output[outputIndex].NickName = "S"
    ghenv.Component.Params.Output[outputIndex].Description = "Separator of the current system."
    outputIndex+=1

#Imports
#--------------------------------------------------------------------------------------------
from os.path import dirname
from os import sep

#Solver - Run with trees to enhance performance drastically
#--------------------------------------------------------------------------------------------
if __name__ == "__main__":
    P = ghenv.Component.OnPingDocument().FilePath
    D = dirname(P)
    S = sep
# ---------- end curdir ----------
platotetra = PlatonicTetrahedron(Plane=PlaneXY(0, 0, 0), Radius=10, Truncation=0)
box = DomainBox(Base=PlaneXY(0, 0, 0), X=number_slider, Y=number_slider, Z=number_slider)
filter = StreamFilter(Gate=Toggle(False), Stream0=box, Stream1=platotetra)
debrep = DeconstructBrep(Brep=filter)  # -> Faces, Edges, Vertices
trim = TrimTree(Tree=debrep.Faces, Depth=1)
join = BrepJoin(Breps=trim)  # -> Breps, Closed
scale = Scale(Geometry=join.Breps, Center=Point(0, 0, 0), Factor=number_slider)  # -> Geometry, Transform
debrep_2 = DeconstructBrep(Brep=scale.Geometry)  # -> Faces, Edges, Vertices
trim_2 = TrimTree(Tree=debrep_2.Faces, Depth=1)
evalsrf = EvaluateSurface(Surface=reparameterize(trim_2), Point="0.5,0.5")  # -> Point, Normal, UDirection, VDirection, Frame
subset = SubList(List=evalsrf.Frame, Domain="3", Wrap=True)  # -> List, Index
pln = Plane(subset.List)
geo = Geometry(scale.Geometry)
panel = Panel("""q
r
s
t""")
pce = ModelPiece(Id="1", TypeName="tetrahedron")  # -> Piece, Id, TypeName, TypeQualities
pce_2 = ModelPiece(Id="1a", TypeName="tetrahedron")  # -> Piece, Id, TypeName, TypeQualities
pce_3 = ModelPiece(Id="a", TypeName="tetrahedron")  # -> Piece, Id, TypeName, TypeQualities
pce_4 = ModelPiece(Id="1a1", TypeName="tetrahedron")  # -> Piece, Id, TypeName, TypeQualities
pce_5 = ModelPiece(Id="1ab", TypeName="tetrahedron")  # -> Piece, Id, TypeName, TypeQualities
pce_6 = ModelPiece(Id="1b", TypeName="tetrahedron")  # -> Piece, Id, TypeName, TypeQualities
pce_7 = ModelPiece(Id="b", TypeName="tetrahedron")  # -> Piece, Id, TypeName, TypeQualities
pce_8 = ModelPiece(Id="1b1", TypeName="tetrahedron")  # -> Piece, Id, TypeName, TypeQualities
spc = ModelSpecifier(Context="side", Group=panel)  # -> Specifier, Context, Group
dir = Directory(D="..\..\examples\metabolism")  # -> AP, Pa
# ---------- dir: Python ----------
#Component Information
#--------------------------------------------------------------------------------------------
if ghenv.Component.RunCount<2:
    #General
    #--------------------------------------------------------------------------------------------
    __author__ = "Ueli Saluz"
    __version__ = "2024.01.30"
    
    ghenv.Component.Name = "Directory"
    ghenv.Component.NickName = "Dir"
    ghenv.Component.Description = "Attributes of a directory."
    ghenv.Component.Message = "VER 1.0"
    ghenv.Component.Category = "Params"
    ghenv.Component.SubCategory = "Util"
    
    #Inputs
    #--------------------------------------------------------------------------------------------
    inputIndex=0
    
    ghenv.Component.Params.Input[inputIndex].Name = "Directory"
    ghenv.Component.Params.Input[inputIndex].NickName = "D"
    ghenv.Component.Params.Input[inputIndex].Description = "Path for a directory"
    inputIndex+=1
    
    #Outputs
    #--------------------------------------------------------------------------------------------
    outputIndex=0
    
    ghenv.Component.Params.Output[outputIndex].Name = "AbsolutePath"
    ghenv.Component.Params.Output[outputIndex].NickName = "AP"
    ghenv.Component.Params.Output[outputIndex].Description = "Absolute path."
    outputIndex+=1
    
    ghenv.Component.Params.Output[outputIndex].Name = "Parent"
    ghenv.Component.Params.Output[outputIndex].NickName = "Pa"
    ghenv.Component.Params.Output[outputIndex].Description = "Parent"
    outputIndex+=1

#Imports
#--------------------------------------------------------------------------------------------
from os.path import dirname, abspath, join
from os import sep, pardir

#Solver - Run with trees to enhance performance drastically
#--------------------------------------------------------------------------------------------
if __name__ == "__main__":
    AP = abspath(D)
    Pa = abspath(join(D, pardir))
# ---------- end dir ----------
item = ListItem(List=spc.Specifier, Index=0, Wrap=True)  # -> Item, Item1, Item2, Item3
sde = ModelSide(PieceId=pce_2.Id, PieceTypePortSpecifiers=item.Item)  # -> Side, PieceId, PieceTypePortSpecifiers
sde_2 = ModelSide(PieceId=pce_5.Id, PieceTypePortSpecifiers=item.Item1)  # -> Side, PieceId, PieceTypePortSpecifiers
sde_3 = ModelSide(PieceId=pce_4.Id, PieceTypePortSpecifiers=item.Item)  # -> Side, PieceId, PieceTypePortSpecifiers
sde_4 = ModelSide(PieceId=pce_3.Id, PieceTypePortSpecifiers=item.Item1)  # -> Side, PieceId, PieceTypePortSpecifiers
sde_5 = ModelSide(PieceId=pce_5.Id, PieceTypePortSpecifiers=item.Item)  # -> Side, PieceId, PieceTypePortSpecifiers
sde_6 = ModelSide(PieceId=pce_3.Id, PieceTypePortSpecifiers=item.Item1)  # -> Side, PieceId, PieceTypePortSpecifiers
atr = ModelAttraction(AttractingSide=sde.Side, AttractedSide=sde_2.Side)  # -> Attraction, AttractingSide, AttractedSide
atr_2 = ModelAttraction(AttractingSide=sde_3.Side, AttractedSide=sde_4.Side)  # -> Attraction, AttractingSide, AttractedSide
atr_3 = ModelAttraction(AttractingSide=sde_5.Side, AttractedSide=sde_6.Side)  # -> Attraction, AttractingSide, AttractedSide
sde_7 = ModelSide(PieceId=pce.Id, PieceTypePortSpecifiers=item.Item)  # -> Side, PieceId, PieceTypePortSpecifiers
sde_8 = ModelSide(PieceId=pce_2.Id, PieceTypePortSpecifiers=item.Item1)  # -> Side, PieceId, PieceTypePortSpecifiers
sde_9 = ModelSide(PieceId=pce.Id, PieceTypePortSpecifiers=item.Item)  # -> Side, PieceId, PieceTypePortSpecifiers
sde_10 = ModelSide(PieceId=pce_6.Id, PieceTypePortSpecifiers=item.Item1)  # -> Side, PieceId, PieceTypePortSpecifiers
sde_11 = ModelSide(PieceId=pce_5.Id, PieceTypePortSpecifiers=item.Item)  # -> Side, PieceId, PieceTypePortSpecifiers
sde_12 = ModelSide(PieceId=pce_7.Id, PieceTypePortSpecifiers=item.Item1)  # -> Side, PieceId, PieceTypePortSpecifiers
sde_13 = ModelSide(PieceId=pce_2.Id, PieceTypePortSpecifiers=item.Item)  # -> Side, PieceId, PieceTypePortSpecifiers
sde_14 = ModelSide(PieceId=pce_4.Id, PieceTypePortSpecifiers=item.Item1)  # -> Side, PieceId, PieceTypePortSpecifiers
sde_15 = ModelSide(PieceId=pce_6.Id, PieceTypePortSpecifiers=item.Item)  # -> Side, PieceId, PieceTypePortSpecifiers
sde_16 = ModelSide(PieceId=pce_5.Id, PieceTypePortSpecifiers=item.Item1)  # -> Side, PieceId, PieceTypePortSpecifiers
por = ModelPort(Plane=graft(pln), Specifiers=graft(spc.Specifier))  # -> Port, Plane, Specifiers
kit = LoadKit(Directory="../../examples/metabolism", Run=Toggle(True))  # -> Name, Explanation, Icon, Url, Types, Formations
concat = Concatenate(FragmentA="tetrahedron", FragmentB=curdir.S, FragmentC="geometry.3dm")
atr_4 = ModelAttraction(AttractingSide=sde_7.Side, AttractedSide=sde_8.Side)  # -> Attraction, AttractingSide, AttractedSide
atr_5 = ModelAttraction(AttractingSide=sde_9.Side, AttractedSide=sde_10.Side)  # -> Attraction, AttractingSide, AttractedSide
atr_6 = ModelAttraction(AttractingSide=sde_11.Side, AttractedSide=sde_12.Side)  # -> Attraction, AttractingSide, AttractedSide
atr_7 = ModelAttraction(AttractingSide=sde_13.Side, AttractedSide=sde_14.Side)  # -> Attraction, AttractingSide, AttractedSide
atr_8 = ModelAttraction(AttractingSide=sde_15.Side, AttractedSide=sde_16.Side)  # -> Attraction, AttractingSide, AttractedSide
rep = ModelRepresentation(Url=concat)  # -> Representation, Url, LevelOfDetail, Tags
trim_3 = TrimTree(Tree=kit.Types, Depth=1)
trim_4 = TrimTree(Tree=kit.Formations, Depth=1)
item_2 = ListItem(List=trim_4, Index=0, Wrap=True)
trim_5 = TrimTree(Tree=por.Port, Depth=1)
typ = Type(Type=trim_3)  # -> Type, Name, Explanation, Icon, Representations, Ports, Qualities
for = Formation(Formation=item_2)  # -> Formation, Name, Explanation, Icon, Pieces, Attractions, Qualities
panel_2 = Panel(kit.Name)
merge = Merge(
    Data1=pce.Piece,
    Data2=pce_2.Piece,
    Data3=pce_6.Piece,
    Data4=pce_4.Piece,
    Data5=pce_8.Piece,
    Data6=pce_3.Piece,
    Data7=pce_7.Piece,
    Data8=pce_5.Piece)
panel_3 = Panel(kit.Url)
panel_4 = Panel(kit.Explanation)
merge_2 = Merge(
    Data1=atr_4.Attraction,
    Data2=atr.Attraction,
    Data3=atr_2.Attraction,
    Data4=atr_3.Attraction,
    Data5=atr_5.Attraction,
    Data6=atr_7.Attraction,
    Data7=atr_6.Attraction,
    Data8=atr_8.Attraction)
panel_5 = Panel("../../examples/metabolism2")
typ_2 = ModelType(Name="tetrahedron", Representations=rep.Representation, Ports=trim_5)  # -> Type, Name, Explanation, Icon, Representations, Ports, Qualities
typ_3 = Type(Type=trim_3)  # -> Type, Name, Explanation, Icon, Representations, Ports, Qualities
for_2 = Formation(Formation=trim_4)  # -> Formation, Name, Explanation, Icon, Pieces, Attractions, Qualities
for_3 = ModelFormation(Name="formation1", Pieces=merge, Attractions=merge_2)  # -> Formation, Name, Explanation, Icon, Pieces, Attractions, Qualities
rp = Representation(flatten(Tree({0;0}: ["""{
  "url": "shaft/geometry.3dm",
  "lod": "1to100",
  "tags": [
    "simple"
  ]
}"""], {0;1}: ["""{
  "url": "capsules/standard/geometry.3dm",
  "lod": "1to100",
  "tags": [
    "simple"
  ]
}"""], {0;2}: ["""{
  "url": "capsules/mirrored/geometry.3dm",
  "lod": "1to100",
  "tags": [
    "simple"
  ]
}"""])))
F = Formation([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])
ty = Type([null x3])
panel_6 = Panel(for_2.Explanation)
atr_9 = Attraction(Attraction=for_2.Attractions)  # -> Attraction, AttractingSide, AttractedSide
panel_7 = Panel(for_2.Name)
rep_2 = Representation(Representation=typ_3.Representations)  # -> Representation, Url, LevelOfDetail, Tags
por_2 = Port(Port=typ_3.Ports)  # -> Port, Plane, Specifiers
qlt = Quality(Quality=typ_3.Qualities)  # -> Quality, Name, Value, Unit
pce_9 = Piece(Piece=for_2.Pieces)  # -> Piece, Id, TypeName, TypeQualities
panel_8 = Panel(typ_3.Name)
panel_9 = Panel(typ_3.Explanation)
typ_4 = RemoveType(TypeName=graft(typ.Name), TypeQualities=typ.Qualities, Directory=panel_5, Run=Toggle(False))
kit_2 = CreateKit(Name="metabolism2", Directory=panel_5, Run=Toggle(False))
kit_3 = DeleteKit(Directory=panel_5, Run=Toggle(False))
typ_5 = AddType(Type=trim_3, Directory=panel_5, Run=Toggle(False))
concat_2 = Concatenate(FragmentA="../../examples/", FragmentB="kit1")
panel_10 = Panel(rep_2.Url)
spc_2 = Specifier(Specifier=por_2.Specifiers)  # -> Specifier, Context, Group
panel_11 = Panel(pce_9.Id)
qlt_2 = Quality(Quality=pce_9.TypeQualities)  # -> Quality, Name, Value, Unit
sde_17 = Side(Side=atr_9.AttractingSide)  # -> Side, PieceId, PieceTypePortSpecifiers
sde_18 = Side(Side=atr_9.AttractedSide)  # -> Side, PieceId, PieceTypePortSpecifiers
panel_12 = Panel(qlt.Name)
panel_13 = Panel(kit_3)
panel_14 = Panel(typ_5)
panel_15 = Panel(typ_4)
for_4 = RemoveFormation(FormationName=for_3.Name, Directory=concat_2, Run=Toggle(True))
kit_4 = CreateKit(Name="kit1", Types=typ_2.Type, Formations=for_3.Formation, Directory=concat_2, Run=Toggle(False))
scn = GetScene(FormationName="formation1", Directory=concat_2, Run=Toggle(True))
panel_16 = Panel(spc_2.Context)
panel_17 = Panel(pce_9.TypeName)
panel_18 = Panel(qlt_2.Name)
for_5 = AddFormation(Formation=item_2, Directory=panel_5, Run=Toggle(False))
panel_19 = Panel(qlt.Value)
for_6 = RemoveFormation(FormationName=for.Name, FormationQualities=for.Qualities, Directory=panel_5, Run=Toggle(False))
kit_5 = LoadKit(Directory=panel_5, Run=Button(ExpressionNormal="True", ExpressionPressed="False"))  # -> Name, Explanation, Icon, Url, Types, Formations
spc_3 = Specifier(Specifier=sde_17.PieceTypePortSpecifiers)  # -> Specifier, Context, Group
typ_6 = RemoveType(TypeName=typ_2.Name, Directory=concat_2, Run=for_4)
panel_20 = Panel(spc_2.Group)
spc_4 = Specifier(Specifier=sde_18.PieceTypePortSpecifiers)  # -> Specifier, Context, Group
scn_2 = FilterScene(Scene=scn)  # -> Representations, Planes, PiecesIds, ParentsPiecesIds
panel_21 = Panel(for_5)
panel_22 = Panel(qlt.Unit)
panel_23 = Panel(kit_5.Types)
panel_24 = Panel(kit_5.Formations)
panel_25 = Panel(qlt_2.Value)
panel_26 = Panel(for_6)
panel_27 = Panel(spc_3.Context)
typ_7 = AddType(Type=typ_2.Type, Directory=concat_2, Run=typ_6)
panel_28 = Panel(por_2.Plane)
panel_29 = Panel(rep_2.LevelOfDetail)
panel_30 = Panel(spc_4.Context)
kit_6 = LoadKit(Directory=concat_2, Run=Toggle(True))  # -> Name, Explanation, Icon, Url, Types, Formations
pl2pl = MoveObjectPlaneToPlane(G=geo, S=PlaneXY(0, 0, 0), T=scn_2.Planes)  # -> TG, T; inputs S: Plane, T: Plane
# ---------- pl2pl: Python ----------
#Component Information
#--------------------------------------------------------------------------------------------
if ghenv.Component.RunCount<2:
    #General
    #--------------------------------------------------------------------------------------------
    __author__ = "Ueli Saluz"
    __version__ = "2023.02.12"
    
    ghenv.Component.Name = "MoveObjectPlaneToPlane"
    ghenv.Component.NickName = "Pl2Pl"
    ghenv.Component.Description = "Moves abitrary geometry from a source plane to a target plane."
    ghenv.Component.Message = "VER 1.2"
    ghenv.Component.Category = "Transform"
    ghenv.Component.SubCategory = "Euclidean"
    
     #Inputs
    #--------------------------------------------------------------------------------------------
    inputIndex=0
    
    ghenv.Component.Params.Input[inputIndex].Name = "Geometry"
    ghenv.Component.Params.Input[inputIndex].NickName = "G"
    ghenv.Component.Params.Input[inputIndex].Description = "Geometry to move."
    ghenv.Component.Params.Input[inputIndex].Optional = False
    inputIndex+=1
    
    ghenv.Component.Params.Input[inputIndex].Name = "SourcePlane"
    ghenv.Component.Params.Input[inputIndex].NickName = "S"
    ghenv.Component.Params.Input[inputIndex].Description = "Source plane of object."
    ghenv.Component.Params.Input[inputIndex].Optional = False
    inputIndex+=1
    
    ghenv.Component.Params.Input[inputIndex].Name = "TargetPlane"
    ghenv.Component.Params.Input[inputIndex].NickName = "T"
    ghenv.Component.Params.Input[inputIndex].Description = "Target plane of object."
    ghenv.Component.Params.Input[inputIndex].Optional = False
    inputIndex+=1
    
    #Outputs
    #--------------------------------------------------------------------------------------------
    outputIndex=0
    
    ghenv.Component.Params.Output[outputIndex].Name = "TranslatedGeometry"
    ghenv.Component.Params.Output[outputIndex].NickName = "TG"
    ghenv.Component.Params.Output[outputIndex].Description = "Translated geometry in target plane."
    outputIndex+=1
    
    ghenv.Component.Params.Output[outputIndex].Name = "Trasnform"
    ghenv.Component.Params.Output[outputIndex].NickName = "T"
    ghenv.Component.Params.Output[outputIndex].Description = "Transform describing translation form source to target plane."
    outputIndex+=1


#Imports
#--------------------------------------------------------------------------------------------
import Rhino.Geometry.Transform as trsf

def MvObjPlnToPln (geo,plnObj,plnDest):
    transform = trsf.PlaneToPlane(plnObj,plnDest)
    geo.Transform(transform)
    return (geo,transform)

TG, T = MvObjPlnToPln(G,S,T)
# ---------- end pl2pl ----------
for_7 = AddFormation(Formation=for_3.Formation, Directory=concat_2, Run=typ_7)
panel_31 = Panel(spc_3.Group)
panel_32 = Panel(spc_4.Group)
panel_33 = Panel(rep_2.Tags)
panel_34 = Panel(qlt_2.Unit)
panel_35 = Panel(sde_17.PieceId)
panel_36 = Panel(sde_18.PieceId)
toggle = BooleanToggle(True)
toggle_2 = BooleanToggle(True)
toggle_3 = BooleanToggle(True)
item_3 = ListItem(List=flatten(qlt_2.Quality), Index=0, Wrap=True)
item_4 = ListItem(List=trim_3, Index=0, Wrap=True)
typ_8 = SerializeType(Type=item_4, Run=toggle_2)
qlt_3 = SerializeQuality(Quality=item_3, Run=toggle)
for_8 = SerializeFormation(Formation=trim_4, Run=toggle_3)
typ_9 = DeserializeType(Text=typ_8, Run=toggle_2)
qlt_4 = DeserializeQuality(Text=qlt_3, Run=toggle)
for_9 = DeserializeFormation(Text=for_8, Run=toggle_3)
for_10 = ModelFormation(Formation=for_9)  # -> Formation, Name, Explanation, Icon, Pieces, Attractions, Qualities
typ_10 = SerializeType(Type=typ_9, Run=toggle_2)
qlt_5 = SerializeQuality(Quality=qlt_4, Run=toggle)
pce_10 = ModelPiece(Piece=for_10.Pieces)  # -> Piece, Id, TypeName, TypeQualities
for_11 = SerializeFormation(Formation=for_9, Run=toggle_3)
eq = NAME(t1=qlt_3, t2=qlt_5)  # -> r
# ---------- eq: Python ----------
r = t1==t2
# ---------- end eq ----------
eq_2 = NAME(t1=typ_8, t2=typ_10)  # -> r; same code as eq
eq_3 = NAME(t1=for_8, t2=for_11)  # -> r; same code as eq
panel_37 = Panel(pce_10.TypeQualities)
panel_38 = Panel(eq_2)
panel_39 = Panel(eq)
panel_40 = Panel(eq_3)
