# Grasshopper definition assess-perfomance.gh (Grasshopper 1.0.8)
# Copyright: GNU Lesser General Public License Version 3
# plug-ins: semio

kt = Kit("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")
kit = ModelKit(Kit=kt)  # -> Kit, Valid, Name, Description, Icon, Image, Preview, Version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
typ = ModelType(Type=kit.Types)  # -> Type, Valid, Name, Description, Icon, Image, Variant, Stock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
dsn = ModelDesign(Design=kit.Designs)  # -> Design, Valid, Name, Description, Icon, Image, Variant, View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
con = ModelConnection(Connection=dsn.Connections)  # -> Connection, Valid, ConnectedPieceId, ConnectedPieceTypePortId, ConnectingPieceId, ConnectingPieceTypePortId, Description, Gap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
item = ListItem(List=kit.Designs, Index=0, Wrap=True)  # -> Item, Item1
por = ModelPort(Port=typ.Ports)  # -> Port, Valid, Id, Description, Mandatory, Family, CompatibleFamilies, Point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
rep = ModelRepresentation(Representation=typ.Representations)  # -> Representation, Valid, Url, Description, Tags, Qualities
pce = ModelPiece(Piece=dsn.Pieces)  # -> Piece, Valid, Id, Description, TypeName, TypeVariant, Plane, Center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
panel = Panel(dsn.Pieces)
merge = Merge(Data1=item.Item, Data2=item.Item)
dn = Design(flatten(merge))
ty = Type(flatten(kit.Types))
prf = AssessPerformance(dn=dn, ty=ty)  # -> dn_3, interest_2, area_efficiency_eff_m²_m²_2, area_comfort_m²_person_2, income_a_3, expenses_a_3, energy_expenses_a_3, effective_floor_area_m²_12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

# ==== cluster AssessPerformance: Simple performance assement based on the following qualities of the types (No unit conversion is applied for now, so make sure that all your types have the values with the same unit.): floor area, effective floor area, residents, workspaces, construction cost, maintenance expenses, income, transmission heat loss, ventilation heat loss, cooling energy demand, technical equipment energy demand,construction global warming potential, heating load, cooling load, ventilation air flow volume
dn = ClusterInput()
ty = ClusterInput()
technical_equipment_cost = ClusterInput()
technical_equipment_gwp_kgco2e = ClusterInput()
ventilation_heat_recovery_factor = ClusterInput()
heating_efficiency_factor = ClusterInput()
heating_primary_energy_factor = ClusterInput()
heating_energy_price_kwh = ClusterInput()
heating_global_warming_potential_kgco2e = ClusterInput()  # "Heating Global Warming Potential [kgCO2e/kWh]"
cooling_efficiency_factor = ClusterInput()
cooling_primary_energy_factor = ClusterInput()
cooling_global_warming_potential_kgco2e = ClusterInput()  # "Cooling Global Warming Potential [kgCO2e/kWh]"
cooling_energy_price_kwh = ClusterInput()
electrictiy_primary_energy_factor = ClusterInput()
electrictiy_global_warming_potential_kgc = ClusterInput()  # "Electrictiy Global Warming Potential [kgCO2e/kWh]"
electrictiy_energy_price_kwh = ClusterInput()
co2_price_tco2e = ClusterInput()
life_cycle_a = ClusterInput()
dn_2 = Design(graft(dn))
electrictiy_energy_price_kwh_2 = Number(electrictiy_energy_price_kwh)
heating_primary_energy_factor_2 = Number(heating_primary_energy_factor)
heating_energy_price_kwh_2 = Number(heating_energy_price_kwh)
heating_global_warming_potential_kgco2e_2 = Number(heating_global_warming_potential_kgco2e)  # "Heating Global Warming Potential [kgCO2e/kWh]"
cooling_energy_price_kwh_2 = Number(cooling_energy_price_kwh)
electrictiy_primary_energy_factor_2 = Number(electrictiy_primary_energy_factor)
ventilation_heat_recovery_factor_2 = Number(ventilation_heat_recovery_factor)
heating_efficiency_factor_2 = Number(heating_efficiency_factor)
cooling_efficiency_factor_2 = Number(cooling_efficiency_factor)
cooling_primary_energy_factor_2 = Number(cooling_primary_energy_factor)
cooling_global_warming_potential_kgco2e_2 = Number(cooling_global_warming_potential_kgco2e)  # "Cooling Global Warming Potential [kgCO2e/kWh]"
electrictiy_global_warming_potential_kgc_2 = Number(electrictiy_global_warming_potential_kgc)  # "Electrictiy Global Warming Potential [kgCO2e/kWh]"
co2_price_tco2e_2 = Number(co2_price_tco2e)
life_cycle_a_2 = Number(life_cycle_a)
ty_2 = Type(ty)
technical_equipment_cost_2 = Number(technical_equipment_cost)
technical_equipment_gwp_kgco2e_2 = Number(technical_equipment_gwp_kgco2e)
expression = Expression(x=co2_price_tco2e_2, Expression="x/1000")
co2_price_kgco2e = Number(expression)
qal = SumQualities(dn=dn_2, ty=ty_2, na="floor area")  # -> num_2, ql_2; disabled
qal_2 = SumQualities(dn=dn_2, ty=ty_2, na="effective floor area")  # -> num_2, ql_2; disabled
qal_3 = SumQualities(dn=dn_2, ty=ty_2, na="construction cost")  # -> num_2, ql_2; disabled
qal_4 = SumQualities(dn=dn_2, ty=ty_2, na="maintenance expenses")  # -> num_2, ql_2; disabled
qal_5 = SumQualities(dn=dn_2, ty=ty_2, na="income")  # -> num_2, ql_2; disabled
qal_6 = SumQualities(dn=dn_2, ty=ty_2, na="transmission heat demand")  # -> num_2, ql_2; disabled
qal_7 = SumQualities(dn=dn_2, ty=ty_2, na="ventilation heat demand")  # -> num_2, ql_2; disabled
qal_8 = SumQualities(dn=dn_2, ty=ty_2, na="cooling energy demand")  # -> num_2, ql_2; disabled
qal_9 = SumQualities(dn=dn_2, ty=ty_2, na="technical equipment energy demand")  # -> num_2, ql_2; disabled
qal_10 = SumQualities(dn=dn_2, ty=ty_2, na="construction global warming potential")  # -> num_2, ql_2; disabled
qal_11 = SumQualities(dn=dn_2, ty=ty_2, na="heating load")  # -> num_2, ql_2; disabled
qal_12 = SumQualities(dn=dn_2, ty=ty_2, na="cooling load")  # -> num_2, ql_2; disabled
qal_13 = SumQualities(dn=dn_2, ty=ty_2, na="ventilation air flow volume")  # -> num_2, ql_2; disabled
ventilation_heat_recovery_factor_3 = Number(ventilation_heat_recovery_factor_2)  # disabled
ventiation_heat_loss_kwh_a = Number(qal_7.num_2)  # disabled
transmission_heat_loss_kwh_a = Number(qal_6.num_2)  # disabled
expression_2 = Expression(x=ventilation_heat_recovery_factor_3, Expression="1-x")  # disabled
# Beispiel
# NullToBranch nur bei unterster Kategorie
nulltobranch = AddNullToEmptyBranch()  # -> R; inputs D: tree; same code as nulltobranch
multiplication = Multiplication(A=ventiation_heat_loss_kwh_a, B=expression_2)  # disabled
heating_global_warming_potential_kgco2e_3 = Number(heating_global_warming_potential_kgco2e_2)  # "Heating Global Warming Potential [kgCO2e/kWh]"; disabled
electrictiy_global_warming_potential_kgc_3 = Number(electrictiy_global_warming_potential_kgc_2)  # "Electrictiy Global Warming Potential [kgCO2e/kWh]"; disabled
cooling_global_warming_potential_kgco2e_3 = Number(cooling_global_warming_potential_kgco2e_2)  # "Cooling Global Warming Potential [kgCO2e/kWh]"; disabled
addition = Addition(A=transmission_heat_loss_kwh_a, B=multiplication)  # disabled
nullrep = ReplaceNulls(Items=nulltobranch, Replacements="0")  # -> Items, Count
panel = Panel(nulltobranch)
heating_energy_demand_kwh_a = Number(addition)  # disabled
cooling_energy_demand_kwh_a = Number(qal_8.num_2)  # disabled
heating_efficiency_factor_3 = Number(heating_efficiency_factor_2)  # disabled
cooling_efficiency_factor_3 = Number(cooling_efficiency_factor_2)  # disabled
technical_equipment_energy_demand_kwh_a = Number(qal_9.num_2)  # disabled
electricity_energy_demand_kwh_a = Number(technical_equipment_energy_demand_kwh_a)  # disabled

dsn = ModelDesign(Design=dn_2)  # -> Design, Valid, Name, Description, Icon, Image, Variant, View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
trim = TrimTree(Tree=dsn.Pieces, Depth=1)
typ = SelectTypeByPiece(ty=ty_2, pc=trim)  # -> ty_4, i_2
typ_2 = ModelType(Type=typ.ty_4)  # -> Type, Valid, Name, Description, Icon, Image, Variant, Stock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

multiplication_2 = Multiplication(A=electricity_energy_demand_kwh_a, B=electrictiy_global_warming_potential_kgc_3)  # disabled
multiplication_3 = Multiplication(A=heating_energy_demand_kwh_a, B=heating_efficiency_factor_3)  # disabled
final_heating_energy_demand_kwh_a = Number(multiplication_3)  # disabled
multiplication_4 = Multiplication(A=final_heating_energy_demand_kwh_a, B=heating_global_warming_potential_kgco2e_3)  # disabled
multiplication_5 = Multiplication(A=cooling_energy_demand_kwh_a, B=cooling_efficiency_factor_3)  # disabled
final_cooling_energy_demand_kwh_a = Number(multiplication_5)  # disabled
multiplication_6 = Multiplication(A=final_cooling_energy_demand_kwh_a, B=cooling_global_warming_potential_kgco2e_3)  # disabled
heating_global_warming_potential_kgco2e_4 = Number(multiplication_4)  # "Heating Global Warming Potential [kgCO2e/a]"; disabled
cooling_global_warming_potential_kgco2e_4 = Number(multiplication_6)  # "Cooling Global Warming Potential [kgCO2e/a]"; disabled
electricity_global_warming_potential_kgc = Number(multiplication_2)  # "Electricity Global Warming Potential [kgCO2e/a]"; disabled
final_cooling_energy_demand_kwh_a_2 = Number(multiplication_5)  # disabled
final_heating_energy_demand_kwh_a_2 = Number(multiplication_3)  # disabled
electricity_energy_demand_kwh_a_2 = Number(technical_equipment_energy_demand_kwh_a)  # disabled
electrictiy_energy_price_kwh_3 = Number(electrictiy_energy_price_kwh_2)  # disabled
heating_energy_price_kwh_3 = Number(heating_energy_price_kwh_2)  # disabled
cooling_energy_price_kwh_3 = Number(cooling_energy_price_kwh_2)  # disabled
ventilation_heat_recovery_factor_4 = Number(ventilation_heat_recovery_factor_2)
co2_price_kgco2e_2 = Number(co2_price_kgco2e)  # disabled
co2_price_kgco2e_3 = Number(co2_price_kgco2e)  # disabled
co2_price_kgco2e_4 = Number(co2_price_kgco2e)  # disabled
genes = GenePool(Decimals=1, Maximum=2, Minimum=0, Value=[0.3, 1.3])
genes_2 = GenePool(Decimals=1, Maximum=2, Minimum=0, Value=[0.9, 2])
ql = Quality(typ_2.Qualities)

qal_14 = SelectQuality(ql=ql, na="transmission heat demand")  # -> graft(ql_4)
qal_15 = SelectQuality_2(ql=ql, na="heating energy demand")  # -> graft(ql_4)
qal_16 = SelectQuality(ql=ql, na="ventilation heat demand")  # -> graft(ql_4)
qal_17 = ModelQuality(Quality=qal_15)  # -> Quality, Valid, Name, Value, Unit, Definition
qal_18 = ModelQuality(Quality=qal_14)  # -> Quality, Valid, Name, Value, Unit, Definition
qal_19 = ModelQuality(Quality=qal_16)  # -> Quality, Valid, Name, Value, Unit, Definition
transmission_heat_loss_kwh_a_2 = Number(qal_18.Value)
ventilation_heat_recovery_factor_5 = Number(ventilation_heat_recovery_factor_2)
ventiation_heat_loss_kwh_a_2 = Number(qal_19.Value)
null = NullItem(Item=qal_15)  # -> NullFlags, InvalidFlags, Description
expression_3 = Expression(x=ventilation_heat_recovery_factor_5, Expression="1-x")
multiplication_7 = Multiplication(A=ventiation_heat_loss_kwh_a_2, B=expression_3)
addition_2 = Addition(A=transmission_heat_loss_kwh_a_2, B=multiplication_7)
nulltobranch_2 = AddNullToEmptyBranch(D=addition_2)  # -> R; inputs D: tree; same code as nulltobranch
nullrep_2 = ReplaceNulls(Items=nulltobranch_2, Replacements="0")  # -> Items, Count
merge = Merge(Data1=qal_17.Value, Data2=nullrep_2.Items)
item = ListItem(List=merge, Index=null.NullFlags, Wrap=invert(True))
trim_2 = TrimTree(Tree=item, Depth=1)
num = Number(trim_2)

panel_2 = Panel(ql)
multiplication_8 = Multiplication(A=final_heating_energy_demand_kwh_a_2, B=heating_energy_price_kwh_3)  # disabled
multiplication_9 = Multiplication(A=electricity_energy_demand_kwh_a_2, B=electrictiy_energy_price_kwh_3)  # disabled
multiplication_10 = Multiplication(A=final_cooling_energy_demand_kwh_a_2, B=cooling_energy_price_kwh_3)  # disabled
multiplication_11 = Multiplication(A=heating_global_warming_potential_kgco2e_4, B=co2_price_kgco2e_2)  # disabled
multiplication_12 = Multiplication(A=cooling_global_warming_potential_kgco2e_4, B=co2_price_kgco2e_3)  # disabled
multiplication_13 = Multiplication(A=electricity_global_warming_potential_kgc, B=co2_price_kgco2e_4)  # disabled
electricity_global_warming_potential_kgc_2 = Number(electricity_global_warming_potential_kgc)  # "Electricity Global Warming Potential [kgCO2e/a]"; disabled
heating_global_warming_potential_kgco2e_5 = Number(heating_global_warming_potential_kgco2e_4)  # "Heating Global Warming Potential [kgCO2e/a]"; disabled
cooling_global_warming_potential_kgco2e_5 = Number(cooling_global_warming_potential_kgco2e_4)  # "Cooling Global Warming Potential [kgCO2e/a]"; disabled
expression_4 = Expression(x=ventilation_heat_recovery_factor_4, Expression="1-x")
heating_energy_price_a = Number(multiplication_8)  # disabled
cooling_energy_price_a = Number(multiplication_9)  # disabled
heating_co2_price_a = Number(multiplication_11)  # disabled
cooling_co2_price_a = Number(multiplication_12)  # disabled
cooling_energy_price_a_2 = Number(multiplication_10)  # disabled
electricity_co2_price_a = Number(multiplication_13)  # disabled
final_heating_energy_demand_kwh_a_3 = Number(final_heating_energy_demand_kwh_a_2)  # disabled
final_cooling_energy_demand_kwh_a_3 = Number(final_cooling_energy_demand_kwh_a_2)  # disabled
electricity_energy_demand_kwh_a_3 = Number(electricity_energy_demand_kwh_a_2)  # disabled
electricity_energy_demand_kwh_a_4 = Number(electricity_energy_demand_kwh_a_2)  # disabled
electrictiy_primary_energy_factor_3 = Number(electrictiy_primary_energy_factor_2)  # disabled
heating_primary_energy_factor_3 = Number(heating_primary_energy_factor_2)  # disabled
final_cooling_energy_demand_kwh_a_4 = Number(final_cooling_energy_demand_kwh_a_2)  # disabled
cooling_primary_energy_factor_3 = Number(cooling_primary_energy_factor_2)  # disabled
final_heating_energy_demand_kwh_a_4 = Number(final_heating_energy_demand_kwh_a_2)  # disabled
panel_3 = Panel("""residents
workspace""")
panel_4 = Panel("""length
width""")
panel_5 = Panel(typ.ty_4)
merge_2 = Merge(Data1="transmission heat demand", Data2="ventilation heat demand")
merge_3 = Merge(Data1="1", Data2=expression_4)
building_construction_gwp_kgco2e = Number(qal_10.num_2)  # disabled
technical_equipment_gwp_kgco2e_3 = Number(technical_equipment_gwp_kgco2e_2)  # disabled
qal_20 = SumQualitiesByHierachy(ql=ql, na="users", cna=panel_3, value="0", cfa=genes)  # -> value_4, pa_2, ch_2
qal_21 = SumQualitiesByHierachy(ql=ql, na="users", cna=panel_4, value="0", cfa=genes_2)  # -> value_4, pa_2, ch_2
addition_3 = Addition(A=cooling_energy_price_a_2, B=cooling_co2_price_a)  # disabled
addition_4 = Addition(A=heating_energy_price_a, B=heating_co2_price_a)  # disabled
addition_5 = Addition(A=cooling_energy_price_a, B=electricity_co2_price_a)  # disabled
addition_6 = Addition(
    A=heating_global_warming_potential_kgco2e_5,
    B=cooling_global_warming_potential_kgco2e_5,
    C=electricity_global_warming_potential_kgc_2)  # disabled
addition_7 = Addition(A=final_heating_energy_demand_kwh_a_3, B=final_cooling_energy_demand_kwh_a_3, C=electricity_energy_demand_kwh_a_4)  # disabled
qal_22 = SumQualitiesByHierachy(ql=ql, na="heating energy demand", cna=merge_2, value="0", cfa=merge_3)  # -> value_4, pa_2, ch_2
multiplication_14 = Multiplication(A=electricity_energy_demand_kwh_a_3, B=electrictiy_primary_energy_factor_3)  # disabled
multiplication_15 = Multiplication(A=final_heating_energy_demand_kwh_a_4, B=heating_primary_energy_factor_3)  # disabled
multiplication_16 = Multiplication(A=final_cooling_energy_demand_kwh_a_4, B=cooling_primary_energy_factor_3)  # disabled
electricity_expenses_a = Number(addition_5)  # disabled
heating_expenses_a = Number(addition_4)  # disabled
cooling_expenses_a = Number(addition_3)  # disabled
energy_global_warming_potential_kgco2e_a = Number(addition_6)  # disabled
final_energy_demand_kwh_a = Number(addition_7)  # disabled
primary_heating_energy_demand_kwh_a = Number(multiplication_15)  # disabled
primary_cooling_energy_demand_kwh_a = Number(multiplication_16)  # disabled
primary_electricity_energy_demand_kwh_a = Number(multiplication_14)  # disabled
users_person = Number(qal_20.value_4)  # disabled
panel_6 = Panel(num)
addition_8 = Addition(A=building_construction_gwp_kgco2e, B=technical_equipment_gwp_kgco2e_3)  # disabled
addition_9 = Addition(A=heating_expenses_a, B=cooling_expenses_a, C=electricity_expenses_a)  # disabled

heating_energy_demand_kwh_a_2 = Number(num)
heating_efficiency_factor_4 = Number(heating_efficiency_factor_2)
null_2 = NullItem(Item=heating_efficiency_factor_4)  # -> NullFlags, InvalidFlags, Description
filter = StreamFilter(Gate=null_2.NullFlags, Stream0=heating_efficiency_factor_4, Stream1="0")
multiplication_17 = Multiplication(A=heating_energy_demand_kwh_a_2, B=filter)
cluster = Cluster(ql=ql, na="Final Heating Energy Demand", cna=multiplication_17)

panel_7 = Panel(qal_22.value_4)
life_cycle_a_3 = Number(life_cycle_a_2)  # disabled
construction_gwp_kgco2e = Number(addition_8)  # disabled
panel_8 = Panel(qal_21.value_4)
maintenance_expenses_a = Number(qal_4.num_2)  # disabled
energy_expenses_a = Number(addition_9)  # disabled
multiplication_18 = Multiplication(A=energy_global_warming_potential_kgco2e_a, B=life_cycle_a_3)  # disabled
addition_10 = Addition(A=primary_heating_energy_demand_kwh_a, B=primary_cooling_energy_demand_kwh_a, C=primary_electricity_energy_demand_kwh_a)  # disabled
addition_11 = Addition(A=multiplication_18, B=construction_gwp_kgco2e)  # disabled
addition_12 = Addition(A=maintenance_expenses_a, B=energy_expenses_a)  # disabled
building_construction_cost = Number(qal_3.num_2)  # disabled
technical_equipment_cost_3 = Number(technical_equipment_cost_2)  # disabled
primary_energy_demand_kwh_a = Number(addition_10)  # disabled
life_cycle_gwp_kgco2e = Number(addition_11)  # disabled
expenses_a = Number(addition_12)  # disabled
life_cycle_a_4 = Number(life_cycle_a_2)  # disabled
multiplication_19 = Multiplication(A=expenses_a, B=life_cycle_a_4)  # disabled
addition_13 = Addition(A=building_construction_cost, B=technical_equipment_cost_3)  # disabled

final_heating_energy_demand_kwh_a_5 = Number(cluster)
heating_energy_price_kwh_4 = Number(heating_energy_price_kwh_2)
null_3 = NullItem(Item=heating_energy_price_kwh_4)  # -> NullFlags, InvalidFlags, Description
filter_2 = StreamFilter(Gate=null_3.NullFlags, Stream0=heating_energy_price_kwh_4, Stream1="0")
multiplication_20 = Multiplication(A=final_heating_energy_demand_kwh_a_5, B=filter_2)
cluster_2 = Cluster(ql=ql, na="Heating Energy Price", cna=multiplication_20)

heating_global_warming_potential_kgco2e_6 = Number(heating_global_warming_potential_kgco2e_2)  # "Heating Global Warming Potential [kgCO2e/kWh]"
life_cycle_expenses = Number(multiplication_19)  # disabled
construction_cost = Number(addition_13)  # disabled
final_heating_energy_demand_kwh_a_6 = Number(cluster)
income_a = Number(qal_5.num_2)  # disabled
life_cycle_a_5 = Number(life_cycle_a_2)  # disabled

# ----
# Berechnung Oberkategorie aus Unterkategorien
transmission_heat_loss_kwh_a_3 = Number(qal_6.num_2)
addition_14 = Addition(A=transmission_heat_loss_kwh_a_3, B=multiplication)
heating_energy_demand_kwh_a_3 = Number(addition_14)

addition_15 = Addition(A=construction_cost, B=life_cycle_expenses)  # disabled
multiplication_21 = Multiplication(A=income_a, B=life_cycle_a_5)  # disabled
cooling_energy_demand_kwh_a_2 = Number(cooling_energy_demand_kwh_a)  # disabled
heating_energy_demand_kwh_a_4 = Number(heating_energy_demand_kwh_a)  # disabled
heating_energy_demand_kwh_a_5 = Number(heating_energy_demand_kwh_a)  # disabled
cooling_energy_demand_kwh_a_3 = Number(cooling_energy_demand_kwh_a)  # disabled
primary_energy_demand_kwh_a_2 = Number(primary_energy_demand_kwh_a)  # disabled
primary_energy_demand_kwh_a_3 = Number(primary_energy_demand_kwh_a)  # disabled
null_4 = NullItem(Item=heating_global_warming_potential_kgco2e_6)  # -> NullFlags, InvalidFlags, Description
final_energy_demand_kwh_a_2 = Number(final_energy_demand_kwh_a)  # disabled
final_energy_demand_kwh_a_3 = Number(final_energy_demand_kwh_a)  # disabled
construction_gwp_kgco2e_2 = Number(construction_gwp_kgco2e)  # disabled
construction_gwp_kgco2e_3 = Number(construction_gwp_kgco2e)  # disabled
life_cycle_gwp_kgco2e_2 = Number(life_cycle_gwp_kgco2e)  # disabled
life_cycle_gwp_kgco2e_3 = Number(life_cycle_gwp_kgco2e)  # disabled
effective_floor_area_m² = Number(qal_2.num_2)  # disabled
effective_floor_area_m²_2 = Number(qal_2.num_2)  # disabled
effective_floor_area_m²_3 = Number(qal_2.num_2)  # disabled
effective_floor_area_m²_4 = Number(qal_2.num_2)  # disabled
effective_floor_area_m²_5 = Number(qal_2.num_2)  # disabled
effective_floor_area_m²_6 = Number(qal_2.num_2)  # disabled
effective_floor_area_m²_7 = Number(qal_2.num_2)  # disabled
effective_floor_area_m²_8 = Number(qal_2.num_2)  # disabled
effective_floor_area_m²_9 = Number(qal_2.num_2)  # disabled
effective_floor_area_m²_10 = Number(qal_2.num_2)  # disabled
construction_cost_2 = Number(addition_13)  # disabled
life_cycle_income = Number(multiplication_21)  # disabled
construction_cost_3 = Number(addition_13)  # disabled
heating_energy_price_a_2 = Number(cluster_2)
life_cycle_cost = Number(addition_15)  # disabled
life_cycle_cost_2 = Number(addition_15)  # disabled
life_cycle_cost_3 = Number(addition_15)  # disabled
floor_area_m² = Number(qal.num_2)  # disabled
users_person_2 = Number(users_person)  # disabled
users_person_3 = Number(users_person)  # disabled
users_person_4 = Number(users_person)  # disabled
users_person_5 = Number(users_person)  # disabled
users_person_6 = Number(users_person)  # disabled
users_person_7 = Number(users_person)  # disabled
users_person_8 = Number(users_person)  # disabled
users_person_9 = Number(users_person)  # disabled
users_person_10 = Number(users_person)  # disabled
filter_3 = StreamFilter(Gate=null_4.NullFlags, Stream0=heating_global_warming_potential_kgco2e_6, Stream1="0")
multiplication_22 = Multiplication(A=final_heating_energy_demand_kwh_a_6, B=heating_global_warming_potential_kgco2e_6)
cluster_3 = Cluster(ql=ql, na="Heating Global Warming Potential", cna=multiplication_22)
division = Division(A=effective_floor_area_m², B=floor_area_m²)  # disabled
division_2 = Division(A=effective_floor_area_m²_5, B=users_person_5)  # disabled
division_3 = Division(A=construction_cost_2, B=effective_floor_area_m²_2)  # disabled
division_4 = Division(A=construction_cost_3, B=users_person_6)  # disabled
division_5 = Division(A=life_cycle_cost_2, B=effective_floor_area_m²_3)  # disabled
division_6 = Division(A=life_cycle_cost_3, B=users_person_7)  # disabled
division_7 = Division(A=construction_gwp_kgco2e_2, B=effective_floor_area_m²_6)  # disabled
division_8 = Division(A=construction_gwp_kgco2e_3, B=users_person_8)  # disabled
division_9 = Division(A=life_cycle_gwp_kgco2e_2, B=effective_floor_area_m²_4)  # disabled
division_10 = Division(A=life_cycle_gwp_kgco2e_3, B=users_person_9)  # disabled
division_11 = Division(A=primary_energy_demand_kwh_a_2, B=effective_floor_area_m²_7)  # disabled
division_12 = Division(A=primary_energy_demand_kwh_a_3, B=users_person_10)  # disabled
division_13 = Division(A=final_energy_demand_kwh_a_2, B=effective_floor_area_m²_8)  # disabled
division_14 = Division(A=final_energy_demand_kwh_a_3, B=users_person_2)  # disabled
division_15 = Division(A=heating_energy_demand_kwh_a_5, B=users_person_3)  # disabled
division_16 = Division(A=cooling_energy_demand_kwh_a_2, B=effective_floor_area_m²_10)  # disabled
division_17 = Division(A=cooling_energy_demand_kwh_a_3, B=users_person_4)  # disabled
division_18 = Division(A=heating_energy_demand_kwh_a_4, B=effective_floor_area_m²_9)  # disabled
expression_5 = Expression(Start=construction_cost, End=life_cycle_income, Expression="((End-Start)/Start)*100")  # disabled
addition_16 = Addition(A=heating_energy_price_a, B=heating_co2_price_a)
heating_global_warming_potential_kgco2e_7 = Number(cluster_3)  # "Heating Global Warming Potential [kgCO2e/a]"
heating_energy_demand_kwh_a_6 = Number(heating_energy_demand_kwh_a)  # disabled
area_comfort_m²_person = Number(division_2)  # disabled
life_cycle_cost_4 = Number(life_cycle_cost)  # disabled
specific_life_cycle_cost_m² = Number(division_5)  # disabled
construction_global_warming_potential_pe = Number(division_8)  # "Construction Global Warming Potential per User [kgCO2e/Person]"; disabled
specific_life_cycle_global_warming_poten = Number(division_9)  # "Specific Life Cycle Global Warming Potential [kgCO2e/m²]"; disabled
life_cycle_global_warming_potential_per = Number(division_10)  # "Life Cycle Global Warming Potential per User [kgCO2e/Person]"; disabled
primary_energy_demand_kwh_a_4 = Number(primary_energy_demand_kwh_a)  # disabled
primary_energy_demand_per_user_kwh_perso = Number(division_12)  # "Primary Energy Demand per User [kWh/Person a]"; disabled
final_energy_demand_kwh_a_4 = Number(final_energy_demand_kwh_a)  # disabled
specific_final_energy_demand_kwh_m²a = Number(division_13)  # disabled
ventilation_air_flow_volume_m³_s = Number(qal_13.num_2)  # disabled
area_efficiency_eff_m²_m² = Number(division)  # disabled
income_a_2 = Number(qal_5.num_2)  # disabled
expenses_a_2 = Number(addition_12)  # disabled
energy_expenses_a_2 = Number(addition_9)  # disabled
effective_floor_area_m²_11 = Number(qal_2.num_2)  # disabled
floor_area_m²_2 = Number(qal.num_2)  # disabled
users_person_11 = Number(users_person)  # disabled
construction_cost_4 = Number(addition_13)  # disabled
specific_construction_cost_m² = Number(division_3)  # disabled
construction_cost_per_user_person = Number(division_4)  # disabled
life_cycle_cost_per_user_person = Number(division_6)  # disabled
construction_global_warming_potential_kg = Number(construction_gwp_kgco2e)  # "Construction Global Warming Potential [kgCO2e]"; disabled
specific_construction_global_warming_pot = Number(division_7)  # "Specific Construction Global Warming Potential [kgCO2e/m²]"; disabled
life_cycle_global_warming_potential_kgco = Number(life_cycle_gwp_kgco2e)  # "Life Cycle Global Warming Potential [kgCO2e]"; disabled
specific_primary_energy_demand_kwh_m²a = Number(division_11)  # disabled
final_energy_demand_per_user_kwh_person = Number(division_14)  # "Final Energy Demand per User [kWh/Person a]"; disabled
heating_load_kw = Number(qal_11.num_2)  # disabled
specific_heating_energy_demand_kwh_m²a = Number(division_18)  # disabled
heating_energy_demand_per_user_kwh_perso = Number(division_15)  # "Heating Energy Demand per User [kWh/Person a]"; disabled
cooling_load_kw = Number(qal_12.num_2)  # disabled
cooling_energy_demand_kwh_a_4 = Number(cooling_energy_demand_kwh_a)  # disabled
specific_cooling_energy_demand_kwh_m²a = Number(division_16)  # disabled
cooling_energy_demand_per_user_kwh_perso = Number(division_17)  # "Cooling Energy Demand per User [kWh/Person a]"; disabled
interest = Number(expression_5)  # disabled
heating_expenses_a_2 = Number(addition_16)
merge_4 = Merge(
    Data1=interest,
    Data2=area_efficiency_eff_m²_m²,
    Data3=area_comfort_m²_person,
    Data4=income_a_2,
    Data5=expenses_a_2,
    Data6=energy_expenses_a_2,
    Data7=effective_floor_area_m²_11,
    Data8=floor_area_m²_2,
    Data9=users_person_11,
    Data10=construction_cost_4,
    Data11=specific_construction_cost_m²,
    Data12=construction_cost_per_user_person,
    Data13=life_cycle_cost_4,
    Data14=specific_life_cycle_cost_m²,
    Data15=life_cycle_cost_per_user_person,
    Data16=construction_global_warming_potential_kg,
    Data17=specific_construction_global_warming_pot,
    Data18=construction_global_warming_potential_pe,
    Data19=life_cycle_global_warming_potential_kgco,
    Data20=specific_life_cycle_global_warming_poten,
    Data21=life_cycle_global_warming_potential_per,
    Data22=primary_energy_demand_kwh_a_4,
    Data23=specific_primary_energy_demand_kwh_m²a,
    Data24=primary_energy_demand_per_user_kwh_perso,
    Data25=final_energy_demand_kwh_a_4,
    Data26=specific_final_energy_demand_kwh_m²a,
    Data27=final_energy_demand_per_user_kwh_person,
    Data28=heating_load_kw,
    Data29=heating_energy_demand_kwh_a_6,
    Data30=specific_heating_energy_demand_kwh_m²a,
    Data31=heating_energy_demand_per_user_kwh_perso,
    Data32=cooling_load_kw,
    Data33=cooling_energy_demand_kwh_a_4,
    Data34=specific_cooling_energy_demand_kwh_m²a,
    Data35=cooling_energy_demand_per_user_kwh_perso,
    Data36=ventilation_air_flow_volume_m³_s)  # disabled
dsn_2 = ModelDesign(Design=dn_2)  # -> Design, Valid, Name, Description, Icon, Image, Variant, View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; disabled
trim_3 = TrimTree(Tree=dsn_2.Qualities, Depth=1)  # disabled
interest_2 = ClusterOutput(interest)  # disabled
area_efficiency_eff_m²_m²_2 = ClusterOutput(area_efficiency_eff_m²_m²)  # disabled
area_comfort_m²_person_2 = ClusterOutput(area_comfort_m²_person)  # disabled
income_a_3 = ClusterOutput(income_a_2)  # disabled
expenses_a_3 = ClusterOutput(expenses_a_2)  # disabled
energy_expenses_a_3 = ClusterOutput(energy_expenses_a_2)  # disabled
effective_floor_area_m²_12 = ClusterOutput(effective_floor_area_m²_11)  # disabled
floor_area_m²_3 = ClusterOutput(floor_area_m²_2)  # disabled
users_person_12 = ClusterOutput(users_person_11)  # disabled
construction_cost_5 = ClusterOutput(construction_cost_4)  # disabled
specific_construction_cost_m²_2 = ClusterOutput(specific_construction_cost_m²)  # disabled
construction_cost_per_user_person_2 = ClusterOutput(construction_cost_per_user_person)  # disabled
life_cycle_cost_5 = ClusterOutput(life_cycle_cost_4)  # disabled
specific_life_cycle_cost_m²_2 = ClusterOutput(specific_life_cycle_cost_m²)  # disabled
life_cycle_cost_per_user_person_2 = ClusterOutput(life_cycle_cost_per_user_person)  # disabled
construction_global_warming_potential_kg_2 = ClusterOutput(construction_global_warming_potential_kg)  # "Construction Global Warming Potential [kgCO2e]"; disabled
specific_construction_global_warming_pot_2 = ClusterOutput(specific_construction_global_warming_pot)  # "Specific Construction Global Warming Potential [kgCO2e/m²]"; disabled
construction_global_warming_potential_pe_2 = ClusterOutput(construction_global_warming_potential_pe)  # "Construction Global Warming Potential per User [kgCO2e/Person]"; disabled
life_cycle_global_warming_potential_kgco_2 = ClusterOutput(life_cycle_global_warming_potential_kgco)  # "Life Cycle Global Warming Potential [kgCO2e]"; disabled
specific_life_cycle_global_warming_poten_2 = ClusterOutput(specific_life_cycle_global_warming_poten)  # "Specific Life Cycle Global Warming Potential [kgCO2e/m²]"; disabled
life_cycle_global_warming_potential_per_2 = ClusterOutput(life_cycle_global_warming_potential_per)  # "Life Cycle Global Warming Potential per User [kgCO2e/Person]"; disabled
primary_energy_demand_kwh_a_5 = ClusterOutput(primary_energy_demand_kwh_a_4)  # disabled
specific_primary_energy_demand_kwh_m²a_2 = ClusterOutput(specific_primary_energy_demand_kwh_m²a)  # disabled
primary_energy_demand_per_user_kwh_perso_2 = ClusterOutput(primary_energy_demand_per_user_kwh_perso)  # "Primary Energy Demand per User [kWh/Person a]"; disabled
final_energy_demand_kwh_a_5 = ClusterOutput(final_energy_demand_kwh_a_4)  # disabled
specific_final_energy_demand_kwh_m²a_2 = ClusterOutput(specific_final_energy_demand_kwh_m²a)  # disabled
final_energy_demand_per_user_kwh_person_2 = ClusterOutput(final_energy_demand_per_user_kwh_person)  # "Final Energy Demand per User [kWh/Person a]"; disabled
heating_load_kw_2 = ClusterOutput(heating_load_kw)  # disabled
heating_energy_demand_kwh_a_7 = ClusterOutput(heating_energy_demand_kwh_a_6)  # disabled
specific_heating_energy_demand_kwh_m²a_2 = ClusterOutput(specific_heating_energy_demand_kwh_m²a)  # disabled
heating_energy_demand_per_user_kwh_perso_2 = ClusterOutput(heating_energy_demand_per_user_kwh_perso)  # "Heating Energy Demand per User [kWh/Person a]"; disabled
cooling_load_kw_2 = ClusterOutput(cooling_load_kw)  # disabled
cooling_energy_demand_kwh_a_5 = ClusterOutput(cooling_energy_demand_kwh_a_4)  # disabled
specific_cooling_energy_demand_kwh_m²a_2 = ClusterOutput(specific_cooling_energy_demand_kwh_m²a)  # disabled
cooling_energy_demand_per_user_kwh_perso_2 = ClusterOutput(cooling_energy_demand_per_user_kwh_perso)  # "Cooling Energy Demand per User [kWh/Person a]"; disabled
ventilation_air_flow_volume_m³_s_2 = ClusterOutput(ventilation_air_flow_volume_m³_s)  # disabled
panel_9 = Panel("""interest
area efficiency 
area comfort 
income
expenses 
energy expenses 
effective floor area 
floor area 
users 
construction cost 
specific construction cost 
construction cost per user 
life cycle cost 
specific life cycle cost 
life cycle cost per user 
construction global warming potential 
specific construction global warming potential 
construction global warming potential per user 
life cycle global warming potential 
specific life cycle global warming potential 
life cycle global warming potential per user 
primary energy demand 
specific primary energy demand 
primary energy demand per user 
final energy demand 
specific final energy demand 
final energy demand per user 
heating load 
heating energy demand 
specific heating energy demand 
heating energy demand per user 
cooling load 
cooling energy demand 
specific cooling energy demand 
cooling energy demand per user 
ventilation air flow volume  """)
panel_10 = Panel(merge_4)
panel_11 = Panel("""%
eff. m²/m²
m²/Person
€/a
€/a
€/a
m²
m²
Person
€
€/m²
€/Person
€
€/m²
€/Person
kgCO2e
kgCO2e/m²
kgCO2e/Person
kgCO2e
kgCO2e/m²
kgCO2e/Person
kWh/a
kWh/m²a
kWh/Person a
kWh/a
kWh/m²a
kWh/Person a
kW
kWh/a
kWh/m²a
kWh/Person a
kW
kWh/a
kWh/m²a
kWh/Person a
m³/s""")
qal_23 = ModelQuality(Name=panel_9, Value=merge_4, Unit=panel_11)  # -> Quality, Valid, Name, Value, Unit, Definition; disabled
merge_5 = Merge(Data1=trim_3, Data2=qal_23.Quality)  # disabled
dsn_3 = ModelDesign(Design=dsn_2.Design, Qualities=merge_5)  # -> Design, Valid, Name, Description, Icon, Image, Variant, View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; disabled
dn_3 = ClusterOutput(dsn_3.Design)  # disabled
qal_24 = SumQualities(dn=dn_2, ty=ty_2, na="residents")  # -> num_2, ql_2
qal_25 = SumQualities(dn=dn_2, ty=ty_2, na="workspaces")  # -> num_2, ql_2

# ----
# Beispiel
# NullToBranch nur bei unterster Kategorie
panel_12 = Panel("heating energy demand")
panel_13 = Panel(heating_energy_demand_kwh_a_3)
dsn_4 = ModelDesign(Design=dn_2)  # -> Design, Valid, Name, Description, Icon, Image, Variant, View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
trim_4 = TrimTree(Tree=dsn_4.Pieces, Depth=1)
typ_3 = SelectTypeByPiece(ty=ty_2, pc=trim_4)  # -> ty_4, i_2
typ_4 = ModelType(Type=typ_3.ty_4)  # -> Type, Valid, Name, Description, Icon, Image, Variant, Stock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
ventilation_heat_recovery_factor_6 = Number(ventilation_heat_recovery_factor_2)
expression_6 = Expression(x=ventilation_heat_recovery_factor_6, Expression="1-x")
replace = ReplaceItems(Wrap=False)
item_2 = ListItem(Index=0, Wrap=True)

# ----
# explizit definierte Oberkategorie
qal_26 = SumQualities(dn=dn_2, ty=ty_2, na=panel_12)  # -> num_2, ql_2

ql_2 = Quality(typ_4.Qualities)
txt = Text("heating energy demand")

panel_14 = Panel(qal_26.num_2)
null_5 = NullItem(Item=qal_26.num_2)  # -> NullFlags, InvalidFlags, Description
filter_4 = StreamFilter(Gate=null_5.NullFlags, Stream0=qal_26.num_2, Stream1=heating_energy_demand_kwh_a_3)
qal_27 = SelectQuality(ql=ql_2, na="ventilation heat demand")  # -> graft(ql_4)
qal_28 = SelectQuality(ql=ql_2, na="transmission heat demand")  # -> graft(ql_4)
panel_15 = Panel(ql_2)
qal_29 = ModelQuality(Quality=qal_28)  # -> Quality, Valid, Name, Value, Unit, Definition
qal_30 = ModelQuality(Quality=qal_27)  # -> Quality, Valid, Name, Value, Unit, Definition
qal_31 = SelectQuality(ql=ql_2, na=txt)  # -> graft(ql_4)
transmission_heat_loss_kwh_a_4 = Number(qal_29.Value)
ventiation_heat_loss_kwh_a_3 = Number(qal_30.Value)
qal_32 = ModelQuality(Quality=qal_31)  # -> Quality, Valid, Name, Value, Unit, Definition
null_6 = NullItem(Item=qal_31)  # -> NullFlags, InvalidFlags, Description
multiplication_23 = Multiplication(A=ventiation_heat_loss_kwh_a_3, B=expression_6)
addition_17 = Addition(A=transmission_heat_loss_kwh_a_4, B=multiplication_23)
nulltobranch_3 = AddNullToEmptyBranch(D=addition_17)  # -> R; inputs D: tree; same code as nulltobranch
nullrep_3 = ReplaceNulls(Items=nulltobranch_3, Replacements="0")  # -> Items, Count
merge_6 = Merge(Data1=qal_32.Value, Data2=nullrep_3.Items)
panel_16 = Panel(merge_6)
item_3 = ListItem(List=merge_6, Index=null_6.NullFlags, Wrap=invert(True))
panel_17 = Panel(nullrep_3.Items)
panel_18 = Panel(addition_17)

panel_19 = Panel(qal_31)
panel_20 = Panel(null_6.NullFlags)
trim_5 = TrimTree(Tree=item_3, Depth=1)
panel_21 = Panel(item_3)
num_2 = Number(trim_5)

panel_22 = Panel(num_2)

# ==== cluster SumQualities: Sum up the qualities of a type for each piece with this type in a design.
dn = ClusterInput()
ty = ClusterInput()
na = ClusterInput()
dn_2 = Design(dn)
ty_2 = Type(ty)
na_2 = Name(na)
dsn = ModelDesign(Design=dn_2)  # -> Design, Valid, Name, Description, Icon, Image, Variant, View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
typ = ModelType(Type=ty_2)  # -> Type, Valid, Name, Description, Icon, Image, Variant, Stock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
panel = Panel(ty_2)
qal = ModelQuality(Quality=typ.Qualities)  # -> Quality, Valid, Name, Value, Unit, Definition
trim = TrimTree(Tree=dsn.Pieces, Depth=1)
pce = ModelPiece(Piece=trim)  # -> Piece, Valid, Id, Description, TypeName, TypeVariant, Plane, Center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
expression = Expression(x=graft(pce.TypeName), y=typ.Name, Expression="x=y")
expression_2 = Expression(x=na_2, y=qal.Name, Expression="x=y")
expression_3 = Expression(x=graft(pce.TypeVariant), y=typ.Variant, Expression="x=y")
panel_2 = Panel(pce.TypeName)
panel_3 = Panel(typ.Qualities)
cull = CullPattern(List=typ.Qualities, CullPattern=expression_2)
and = GateAnd(A=expression, B=expression_3)
cull_2 = CullPattern(List=ty_2, CullPattern=and)
qal_2 = ModelQuality(Quality=cull)  # -> Quality, Valid, Name, flatten(Value), Unit, Definition
lng = ListLength(List=ty_2)
txt = Text(cull_2)
txt_2 = Text(ty_2)
series = Series(Start=0, Step=1, Count=lng)
expression_4 = Expression(x=txt, y=txt_2, Expression="x=y")
trim_2 = TrimTree(Tree=series, Depth=1)
panel_5 = Panel(qal_2.Quality)
cull_3 = CullPattern(List=trim_2, CullPattern=expression_4)
trim_3 = TrimTree(Tree=cull_3, Depth=1)
item = ListItem(List=qal_2.Value, Index=trim_3, Wrap=True)
clean = CleanTree(RemoveNulls=True, RemoveInvalid=True, RemoveEmpty=False, Tree=item)
ma = MassAddition(Input=clean)  # -> Result, PartialResults
num = Number(ma.Result)
ql = Quality(qal_2.Quality)
num_2 = ClusterOutput(num)
ql_2 = ClusterOutput(ql)

# ==== cluster SelectTypeByPiece: Select the type of a piece.
ty = ClusterInput()
pc = ClusterInput()
pc_2 = Piece(graft(pc))
ty_2 = Type(ty)
pce = ModelPiece(Piece=pc_2)  # -> Piece, Valid, Id, Description, TypeName, TypeVariant, Plane, Center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
typ = SelectType(ty=ty_2, na=pce.TypeName, variant=pce.TypeVariant)  # -> ty_4, i_2
trim = TrimTree(Tree=typ.ty_4, Depth=1)
trim_2 = TrimTree(Tree=typ.i_2, Depth=1)
ty_3 = Type(trim)
i = Integer(trim_2)
ty_4 = ClusterOutput(ty_3)
i_2 = ClusterOutput(i)

# ==== cluster SelectQuality: Select a quality by its name. If no quality matches, null is returned.
ql = ClusterInput()
na = ClusterInput()
ql_2 = Quality(flatten(ql))
tstat = TreeStatistics(Tree=ql_2)  # -> Paths, Length, Count
lng = ListLength(List=tstat.Paths)
na_2 = Name(na)
qal = ModelQuality(Quality=ql_2)  # -> Quality, Valid, Name, Value, Unit, Definition
expression = Expression(x=lng, Expression="x=0")
lng_2 = ListLength(List=na_2)
dup = DuplicateData(Data=graft(ql_2), Number=lng_2, Order=True)
filter = StreamFilter(Gate=expression, Stream0=graft(qal.Name), Stream1=qal.Name)
filter_2 = StreamFilter(Gate=expression, Stream0=na_2, Stream1=graft(na_2))
trim = TrimTree(Tree=dup, Depth=1)
expression_2 = Expression(x=filter, y=filter_2, Expression="x=y")
cull = CullPattern(List=graft(trim), CullPattern=graft(expression_2))
nulltobranch = AddNullToEmptyBranch(D=cull)  # -> R; inputs D: tree
# ---------- nulltobranch: C# ----------
#region Usings
using System;
using System.Linq;
using System.Collections;
using System.Collections.Generic;
using System.Drawing;

using Rhino;
using Rhino.Geometry;

using Grasshopper;
using Grasshopper.Kernel;
using Grasshopper.Kernel.Data;
using Grasshopper.Kernel.Types;
#endregion

public class Script_Instance : GH_ScriptInstance
{

    private void RunScript(DataTree<object> D, ref object R)
    {
        foreach (GH_Path path in D.Paths)
            if (D.Branch(path).Count == 0)
                D.Add(null, path);

        R = D;
    }
}
# ---------- end nulltobranch ----------
trim_2 = TrimTree(Tree=nulltobranch, Depth=1)
ql_3 = Quality(trim_2)
ql_4 = ClusterOutput(ql_3)

# ==== cluster Cluster
na = ClusterInput()
cna = ClusterInput()
ql = ClusterInput()
na_2 = Name(na)
qal = SelectQuality_2(ql=ql, na=na_2)  # -> graft(ql_4)
qal_2 = ModelQuality(Quality=qal)  # -> Quality, Valid, Name, Value, Unit, Definition
null = NullItem(Item=qal)  # -> NullFlags, InvalidFlags, Description
cna_2 = Name(cna)
merge = Merge(Data1=qal_2.Value, Data2=cna_2)
item = ListItem(List=merge, Index=null.NullFlags, Wrap=invert(True))
trim = TrimTree(Tree=item, Depth=1)
num = Number(trim)
num_2 = ClusterOutput(num)

# ==== cluster SumQualitiesByHierachy: Return the numeric quality of the parent hierachy. If not defined return the sum of the child qualities. If not defined return the default value.
ql = ClusterInput()
na = ClusterInput()
cna = ClusterInput()
value = ClusterInput()
cfa = ClusterInput()
cna_2 = Name(cna)
expression = Expression(x=cna_2, Expression="1")
ql_2 = Quality(ql)
na_2 = Name(na)
value_2 = Value(value)
cfa_2 = Number(cfa)
null = NullItem(Item=cfa_2)  # -> NullFlags, InvalidFlags, Description
filter = StreamFilter(Gate=null.NullFlags, Stream0=cfa_2, Stream1=expression)
qal = SelectQuality_3(ql=ql_2, na=cna_2)
qal_2 = SelectQuality_3(ql=ql_2, na=na_2)
trim = TrimTree(Tree=qal, Depth=1)
trim_2 = TrimTree(Tree=qal_2, Depth=1)
clean = CleanTree(RemoveNulls=True, RemoveInvalid=True, RemoveEmpty=False, Tree=trim)
clean_2 = CleanTree(RemoveNulls=True, RemoveInvalid=True, RemoveEmpty=False, Tree=trim_2)
qal_3 = ModelQuality(Quality=clean_2)  # -> Quality, Valid, Name, Value, Unit, Definition
null_2 = NullItem(Item=clean_2)  # -> NullFlags, InvalidFlags, Description
null_3 = NullItem(Item=clean)  # -> NullFlags, InvalidFlags, Description
qal_4 = ModelQuality(Quality=clean)  # -> Quality, Valid, Name, Value, Unit, Definition
expression_2 = Expression(x=value_2, y=clean_2, Expression="x")
not = GateNot(A=null_2.NullFlags)
mm = MassMultiplication(Input=null_3.NullFlags)  # -> Result, PartialResults
null_4 = EmptyStringToNull(T=qal_4.Value)  # -> NT; inputs T: tree
# ---------- null_4: Python ----------
# Component Information
# --------------------------------------------------------------------------------------------
if ghenv.Component.RunCount < 2:
    # General
    # --------------------------------------------------------------------------------------------
    __author__ = "Ueli Saluz"
    __version__ = "2024.08.08"

    ghenv.Component.Name = "EmptyStringToNull"
    ghenv.Component.NickName = "\"\"->Null"
    ghenv.Component.Description = "Replaces empty strings with Null."
    ghenv.Component.Message = "VER 1.1"
    ghenv.Component.Category = "Sets"
    ghenv.Component.SubCategory = "Text"

    # Inputs
    # --------------------------------------------------------------------------------------------
    inputIndex = 0

    ghenv.Component.Params.Input[inputIndex].Name = "String"
    ghenv.Component.Params.Input[inputIndex].NickName = "T"
    ghenv.Component.Params.Input[inputIndex].Description = "Strings that are potentially empty."
    ghenv.Component.Params.Input[inputIndex].Optional = False
    inputIndex += 1

    # Outputs
    # --------------------------------------------------------------------------------------------
    outputIndex = 0

    ghenv.Component.Params.Output[outputIndex].Name = "NullifiedString"
    ghenv.Component.Params.Output[outputIndex].NickName = "NT"
    ghenv.Component.Params.Output[outputIndex].Description = "Original string if not empty, Null otherwise."
    outputIndex += 1

# Imports
# --------------------------------------------------------------------------------------------
from System import Object
from Grasshopper import DataTree

# Solver - Run with trees to enhance performance drastically
# --------------------------------------------------------------------------------------------
if __name__ == "__main__":
    
    # Initialize trees
    # --------------------------------------------------------------------------------------------
    NullifiedStringTree = DataTree[Object]()
    
    # Data matching
    # --------------------------------------------------------------------------------------------
    for path in T.Paths:
        stringBranch = T.Branch(path)
        for i, string in enumerate(stringBranch):
            nullifiedString = string if string != "" else None
            NullifiedStringTree.Add(nullifiedString, path)
    
    # Assign trees to output
    # --------------------------------------------------------------------------------------------
    NT = NullifiedStringTree
# ---------- end null_4 ----------
not_2 = GateNot(A=null_3.NullFlags)
not_3 = GateNot(A=mm.Result)
int = Integer(not)
nullrep = ReplaceNulls(Items=null_4, Replacements="0")  # -> Items, Count
multiplication = Multiplication(A=not_3, B="2")
addition = Addition(A=int, B=multiplication)
multiplication_2 = Multiplication(A=nullrep.Items, B=filter)
panel = Panel(multiplication_2)
ma = MassAddition(Input=multiplication_2)  # -> Result, PartialResults
merge = Merge(Data1=expression_2, Data2=qal_3.Value, Data3=ma.Result, Data4=qal_3.Value)
item = ListItem(List=merge, Index=addition, Wrap=invert(True))
trim_3 = TrimTree(Tree=item, Depth=1)
trim_4 = TrimTree(Tree=not, Depth=1)
trim_5 = TrimTree(Tree=not_3, Depth=1)
value_3 = Value(trim_3)
pa = Boolean(trim_4)
ch = Boolean(trim_5)
value_4 = ClusterOutput(value_3)
pa_2 = ClusterOutput(pa)
ch_2 = ClusterOutput(ch)
panel_2 = Panel(value_3)

# ==== cluster SelectType: Select a type with a name and an optional variant. If no variant is provided it will select all variants. If you want to select the default type then use the empty text.
ty = ClusterInput()
na = ClusterInput()
variant = ClusterInput()
na_2 = Name(na)
variant_2 = Variant(variant)
ty_2 = Type(ty)
typ = ModelType(Type=ty_2)  # -> Type, Valid, Name, Description, Icon, Image, Variant, Stock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
expression = Expression(x=typ.Name, y=na_2, Expression="x=y")
cull = CullPattern(List=typ.Type, CullPattern=expression)
typ_2 = ModelType(Type=cull)  # -> Type, Valid, Name, Description, Icon, Image, Variant, Stock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
expression_2 = Expression(x=typ_2.Variant, y=variant_2, Expression="x=y")
txt = Text(ty_2)
cull_2 = CullPattern(List=typ_2.Type, CullPattern=expression_2)
null = NullItem(Item=variant_2)  # -> NullFlags, InvalidFlags, Description
filter = StreamFilter(Gate=null.NullFlags, Stream0=cull_2, Stream1=cull)
txt_2 = Text(filter)
mindex = MemberIndex(Set=txt, Member=txt_2)  # -> Index, Count
trim = TrimTree(Tree=mindex.Index, Depth=1)
ty_3 = Type(filter)
i = Integer(trim)
ty_4 = ClusterOutput(ty_3)
i_2 = ClusterOutput(i)

# ==== cluster SelectQuality_2: Select a quality by its name. If no quality matches, null is returned.
ql = ClusterInput()
na = ClusterInput()
na_2 = Name(graft(na))
ql_2 = Quality(ql)
qal = ModelQuality(Quality=ql_2)  # -> Quality, Valid, Name, Value, Unit, Definition
expression = Expression(x=qal.Name, y=na_2, Expression="x=y")
cull = CullPattern(List=qal.Quality, CullPattern=expression)
nulltobranch = AddNullToEmptyBranch(D=cull)  # -> R; inputs D: tree; same code as nulltobranch
trim = TrimTree(Tree=nulltobranch, Depth=1)
ql_3 = Quality(trim)
ql_4 = ClusterOutput(ql_3)

# ==== cluster SelectQuality_3: Select a quality by its name. If no quality matches, null is returned.
ql = ClusterInput()
na = ClusterInput()
na_2 = Name(na)
ql_2 = Quality(ql)
flatten = FlattenTree(Tree=ql_2, Path="{0}")
tstat = TreeStatistics(Tree=flatten)  # -> Paths, Length, Count
lng = ListLength(List=tstat.Paths)
qal = ModelQuality(Quality=flatten)  # -> Quality, Valid, Name, Value, Unit, Definition
expression = Expression(x=lng, Expression="x=0")
lng_2 = ListLength(List=na_2)
dup = DuplicateData(Data=graft(flatten), Number=lng_2, Order=True)
filter = StreamFilter(Gate=expression, Stream0=graft(qal.Name), Stream1=qal.Name)
filter_2 = StreamFilter(Gate=expression, Stream0=na_2, Stream1=graft(na_2))
trim = TrimTree(Tree=dup, Depth=1)
expression_2 = Expression(x=filter, y=filter_2, Expression="x=y")
cull = CullPattern(List=graft(trim), CullPattern=graft(expression_2))
dup_2 = DuplicateData(Data=graft(ql_2), Number=lng_2, Order=True)
nulltobranch = AddNullToEmptyBranch(D=cull)  # -> R; inputs D: tree; same code as nulltobranch
trim_2 = TrimTree(Tree=nulltobranch, Depth=1)
trim_3 = TrimTree(Tree=dup_2, Depth=1)
match = MatchTree(Tree=trim_2, Guide=trim_3)
ql_3 = Quality(match)
ql_4 = ClusterOutput(ql_3)
