# Grasshopper definition opionionated-quality.gh (Grasshopper 1.0.8)
# Copyright: GNU Lesser General Public License Version 3
# plug-ins: semio

glc = StandardQuality({"Global Life Cycle Costs": "semio.costs.global life cycle costs", "Life Cycle Costs": "semio.costs.global life cycle costs.life-cycle-costs", "Investment Costs Construction Phase": "semio.costs.global life cycle costs.life-cycle-costs.investment-costs-construction-phase", "Land Costs": "semio.costs.global life cycle costs.life-cycle-costs.investment-costs-construction-phase.land-costs", "Land": "semio.costs.global life cycle costs.life-cycle-costs.investment-costs-construction-phase.land-costs.land", "Land Value": "semio.costs.global life cycle costs.life-cycle-costs.investment-costs-construction-phase.land-costs.land.land-value"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}, selected="Other Site Preparation": "semio.costs.global life cycle costs.life-cycle-costs.investment-costs-construction-phase.development-costs.preparatory-measures.site-preparation.other")
qal = StandardQuality({"Global Life Cycle Costs": "semio.global-life-cycle-costs", "Life Cycle Costs": "semio.global-life-cycle-costs.life-cycle-costs", "Investment Costs Construction Phase": "semio.global-life-cycle-costs.life-cycle-costs.investment-costs-construction-phase", "Land Costs": "semio.global-life-cycle-costs.life-cycle-costs.investment-costs-construction-phase.land-costs", "Land": "semio.global-life-cycle-costs.life-cycle-costs.investment-costs-construction-phase.land-costs.land", "Land Value": "semio.global-life-cycle-costs.life-cycle-costs.investment-costs-construction-phase.land-costs.land.land-value"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}, selected="Land Costs")
ppl = StandardQuality({"People": "semio.people", "Stationary": "semio.people.stationary", "Living": "semio.people.stationary.living", "Residents": "semio.people.stationary.living.residents", "Guests": "semio.people.stationary.living.guests", "Working": "semio.people.stationary.working", "Office Workers": "semio.people.stationary.working.office", "Production Workers": "semio.people.stationary.working.production", "Service Workers": "semio.people.stationary.working.service", "Education Workers": "semio.people.stationary.working.education", "Healthcare Workers": "semio.people.stationary.working.healthcare", "Other Workers": "semio.people.stationary.working.other", "Students": "semio.people.stationary.students", "Pupils": "semio.people.stationary.students.pupils", "Students": "semio.people.stationary.students.students", "Client": "semio.people.stationary.client", "Customers": "semio.people.stationary.client.customers", "Visitors": "semio.people.stationary.client.visitors", "Patients": "semio.people.stationary.client.patients", "Mobile": "semio.people.mobile", "Mobile Visitors": "semio.people.mobile.visitors", "Mobile Customers": "semio.people.mobile.visitors.customers", "Mobile Guests": "semio.people.mobile.visitors.guests", "Tourists": "semio.people.mobile.visitors.tourists", "Mobile Employees": "semio.people.mobile.employees", "Mobile Workers": "semio.people.mobile.employees.mobile-workers", "Delivery Personnel": "semio.people.mobile.employees.delivery-personnel", "Mobile Students": "semio.people.mobile.students", "Commuters": "semio.people.mobile.students.commuters", "Exchange Students": "semio.people.mobile.students.exchange-students"}, selected="People")
fla = StandardQuality({"Floor Area": "semio.area", "Gross Floor Area": "semio.area.gross", "Net Floor Area": "semio.area.gross.net", "Usable Floor Area": "semio.area.gross.net.usable", "Living And Staying Floor Area": "semio.area.gross.net.usable.living-and-staying", "Living Room Floor Area": "semio.area.gross.net.usable.living-and-staying.living-room"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}, selected="Supervision Room Floor Area": "semio.area.gross.net.usable.office-work.supervision-room")
qal_2 = OpinionatedQuality(na=fla, value=Slider(150, range=0..1000), im=False)  # -> ql_2, log_3
qal_3 = OpinionatedQuality(na=ppl, value=Slider(9, range=0..1000), im=False)  # -> ql_2, log_3
qal_4 = OpinionatedQuality_2(na=glc, value=Slider(9, range=0..1000), im=False)  # -> ql_2, log_3
qal_5 = OpinionatedQuality_2(na=qal, value=Slider(93, range=0..1000), im=False)  # -> ql_2, log_3
panel = Panel(qal_5.log_3)
merge = Merge(Data1=qal_2.ql_2, Data2=qal_3.ql_2, Data3=qal_4.ql_2, Data4=qal_5.ql_2)
typ = ModelType(Qualities=merge)  # -> Type, Valid, Name, Description, Icon, Image, Variant, Stock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
qal_6 = ModelQuality(Quality=typ.Qualities)  # -> Quality, Valid, Name, Value, Unit, Definition
panel_2 = Panel(qal_6.Value)
panel_3 = Panel(qal_6.Name)
unt = ConvertUnit(Value=qal_6.Value, FromUnit=qal_6.Unit, ToUnit="ft²")
panel_4 = Panel(qal_6.Unit)
panel_5 = Panel(unt)
merge_2 = Merge(Data1=graft(qal_6.Name), Data2=graft(qal_6.Value), Data3=graft(qal_6.Unit))  # -> simplify(Result)
panel_6 = Panel(merge_2)

# ==== cluster OpinionatedQuality: Construct an opinionated quality with a standard name.
panel = Panel("""semio.energy
semio.energy.primary demand
semio.energy.primary demand.primary heating
semio.energy.primary demand.primary heating.final
semio.energy.primary demand.primary heating.final.heating
semio.energy.primary demand.primary heating.final.heating.transmission
semio.energy.primary demand.primary heating.final.heating.final ventilation
semio.energy.primary demand.primary heating.final.heating.final ventilation.ventialtion
semio.energy.primary demand.primary cooling
semio.energy.primary demand.primary cooling.final
semio.energy.primary demand.primary cooling.final.cooling energy
semio.energy.primary demand.primary electricity
semio.energy.primary demand.primary electricity.electricity
semio.energy.primary demand.primary electricity.electricity.technical equipment""")
panel_2 = Panel("""semio.volume
semio.volume.gross-volume
semio.volume.gross-volume.net-volume
semio.volume.gross-volume.construction-volume""")
panel_3 = Panel("""semio.global-warming-potential
semio.global-warming-potential.embodied
semio.global-warming-potential.embodied.construction
semio.global-warming-potential.embodied.technical-equipment
semio.global-warming-potential.operational
semio.global-warming-potential.operational.heating
semio.global-warming-potential.operational.cooling
semio.global-warming-potential.operational.lighting
semio.global-warming-potential.operational.ventilation
semio.global-warming-potential.operational.hot-water
semio.global-warming-potential.operational.other""")
panel_4 = Panel("""Floor Area                                            
Gross Floor Area                                      
Net Floor Area                                        
Usable Floor Area                                     
Living And Staying Floor Area                         
Living Room Floor Area                                
Living Floor Area                                     
Kitchen Floor Area                                    
Sanitary Floor Area                                   
Circulation Floor Area                                
Outdoor Seating Floor Area                            
Storage Floor Area                                    
Common Room Floor Area                                
Break Room Floor Area                                 
Waiting Room Floor Area                               
Dining Room Floor Area                                
Detention Room Floor Area                             
Office Work Floor Area                                
Office Room Floor Area                                
Open Plan Office Floor Area                           
Meeting Room Floor Area                               
Design Room Floor Area                                
Counter Room Floor Area                               
Control Room Floor Area                               
Supervision Room Floor Area                           
Office Technology Room Floor Area                     
Other Office Work Floor Area                          
Production Experiments Work Floor Area                
Production Hall Floor Area                            
Workshop Floor Area                                   
Technology Lab Floor Area                             
Physics Electrical Lab Floor Area                     
Chemistry Biology Lab Floor Area                      
Animal Husbandry Room Floor Area                      
Plant Cultivation Room Floor Area                     
Kitchen Floor Area                                    
Special Work Room Floor Area                          
Storage Distribution Sales Floor Area                 
Storage Room Floor Area                               
Collection Archive Floor Area                         
Cold Storage Room Floor Area                          
Receiving Dispatch Room Floor Area                    
Sales Room Floor Area                                 
Exhibition Room Floor Area                            
Other Storage Distribution Sales Floor Area           
Education Culture Instruction Floor Area              
Class With Fixed Seating Floor Area                   
Teaching Practice Room Floor Area                     
Special Classroom Floor Area                          
Library Room Floor Area                               
Sports Room Floor Area                                
Assembly Room Floor Area                              
Stage Studio Room Floor Area                          
Display Room Floor Area                               
Sacred Room Floor Area                                
Healing And Care Floor Area                           
General Medical Equipment Room Floor Area             
Special Medical Equipment Room Floor Area             
Surgical Room Floor Area                              
Radiation Diagnostic Room Floor Area                  
Radiation Therapy Room Floor Area                     
Rehabilitation Physiotherapy Floor Area               
General Patient Room Floor Area                       
Special Patient Room Floor Area                       
Other Healing And Care Floor Area                     
Other Usable Floor Area                               
Sanitary Room Floor Area                              
Cloakroom Floor Area                                  
Storage Room Floor Area                               
Vehicle Parking Floor Area                            
Passenger Floor Area                                  
Central Technical Room Floor Area                     
Protective Room Floor Area                            
Laundry Room Floor Area                               
Other Floor Area                                      
Technical Floor Area                                  
Wastewater Gases Water Supply Floor Area              
Heating Hot Water Floor Area                          
Ventilation Air Conditioning Floor Area               
Electrical Power Supply Floor Area                    
Telecommunications Floor Area                         
Elevator Conveyor Systems Floor Area                  
Other Technical Floor Area                            
Circulation Floor Area                                
Corridor Hall Floor Area                              
Stair Floor Area                                      
Shaft For Conveyor System Floor Area                  
Vehicle Traffic Floor Area                            
Other Circulation Floor Area                          
Construction Floor Area                               
Exterior Wall Construction Floor Area                 
Interior Wall Construction Floor Area                 
Partition Wall Floor Area                             
Column Floor Area                                     
Shaft Floor Area                                      
Beam Floor Area                                       
Other Construction Floor Area                         
Property Area                                         
Built Up Area                                         
Unbuilt Area                                          
Outdoor Facility Area                                 
Traffic Area                                          
Sidewalk Area                                         
Driveway Area                                         
Parking Space Area                                    
Bicycle Parking Area                                  
Turning Area                                          
Other Traffic Area                                    
Green Area                                            
Lawn Area                                             
Planted Bed Area                                      
Hedge Area                                            
Tree Area                                             
Roof Greening Area                                    
Facade Greening Area                                  
Other Green Area                                      
Paved Area                                            
Terrace Area                                          
Balcony Area                                          
Courtyard Area                                        
Storage Utility Area                                  
Playground Area                                       
Other Paved Area                                      
Technical Facility Area                               
Waste Collection Point Area                           
Utility Line Area                                     
Stormwater Management Area                            
Lighting System Area                                  
Fence Enclosure Area                                  
Other Technical Facility Area                         
Water Area                                            
Pond Area                                             
Fountain Area                                         
Stormwater Retention Area                             
Other Water Area                                      
Other Outdoor Facility Area   """)
panel_5 = Panel("""semio.area
semio.area.gross
semio.area.gross.net
semio.area.gross.net.usable
semio.area.gross.net.usable.living-and-staying
semio.area.gross.net.usable.living-and-staying.living-room
semio.area.gross.net.usable.living-and-staying.living-room.living
semio.area.gross.net.usable.living-and-staying.living-room.kitchen
semio.area.gross.net.usable.living-and-staying.living-room.sanitary
semio.area.gross.net.usable.living-and-staying.living-room.circulation
semio.area.gross.net.usable.living-and-staying.living-room.outdoor-seating
semio.area.gross.net.usable.living-and-staying.living-room.storage
semio.area.gross.net.usable.living-and-staying.common-room
semio.area.gross.net.usable.living-and-staying.break-room
semio.area.gross.net.usable.living-and-staying.waiting-room
semio.area.gross.net.usable.living-and-staying.dining-room
semio.area.gross.net.usable.living-and-staying.detention-room
semio.area.gross.net.usable.office-work
semio.area.gross.net.usable.office-work.office-room
semio.area.gross.net.usable.office-work.open-plan-office
semio.area.gross.net.usable.office-work.meeting-room
semio.area.gross.net.usable.office-work.design-room
semio.area.gross.net.usable.office-work.counter-room
semio.area.gross.net.usable.office-work.control-room
semio.area.gross.net.usable.office-work.supervision-room
semio.area.gross.net.usable.office-work.office-technology-room
semio.area.gross.net.usable.office-work.other
semio.area.gross.net.usable.production-experiments-work
semio.area.gross.net.usable.production-experiments-work.production-hall
semio.area.gross.net.usable.production-experiments-work.workshop
semio.area.gross.net.usable.production-experiments-work.technology-lab
semio.area.gross.net.usable.production-experiments-work.physics-electrical-lab
semio.area.gross.net.usable.production-experiments-work.chemistry-biology-lab
semio.area.gross.net.usable.production-experiments-work.animal-husbandry-room
semio.area.gross.net.usable.production-experiments-work.plant-cultivation-room
semio.area.gross.net.usable.production-experiments-work.kitchen
semio.area.gross.net.usable.production-experiments-work.special-work-room
semio.area.gross.net.usable.storage-distribution-sales
semio.area.gross.net.usable.storage-distribution-sales.storage-room
semio.area.gross.net.usable.storage-distribution-sales.collection-archive
semio.area.gross.net.usable.storage-distribution-sales.cold-storage-room
semio.area.gross.net.usable.storage-distribution-sales.receiving-dispatch-room
semio.area.gross.net.usable.storage-distribution-sales.sales-room
semio.area.gross.net.usable.storage-distribution-sales.exhibition-room
semio.area.gross.net.usable.storage-distribution-sales.other
semio.area.gross.net.usable.education-culture-instruction
semio.area.gross.net.usable.education-culture-instruction.classwith-fixed-seating
semio.area.gross.net.usable.education-culture-instruction.teaching-practice-room
semio.area.gross.net.usable.education-culture-instruction.special-classroom
semio.area.gross.net.usable.education-culture-instruction.library-room
semio.area.gross.net.usable.education-culture-instruction.sports-room
semio.area.gross.net.usable.education-culture-instruction.assembly-room
semio.area.gross.net.usable.education-culture-instruction.stage-studio-room
semio.area.gross.net.usable.education-culture-instruction.display-room
semio.area.gross.net.usable.education-culture-instruction.sacred-room
semio.area.gross.net.usable.healing-and-care
semio.area.gross.net.usable.healing-and-care.general-medical-equipment-room
semio.area.gross.net.usable.healing-and-care.special-medical-equipment-room
semio.area.gross.net.usable.healing-and-care.surgical-room
semio.area.gross.net.usable.healing-and-care.radiation-diagnostic-room
semio.area.gross.net.usable.healing-and-care.radiation-therapy-room
semio.area.gross.net.usable.healing-and-care.rehabilitation-physiotherapy
semio.area.gross.net.usable.healing-and-care.general-patient-room
semio.area.gross.net.usable.healing-and-care.special-patient-room
semio.area.gross.net.usable.healing-and-care.other
semio.area.gross.net.usable.other
semio.area.gross.net.usable.other.sanitary-room
semio.area.gross.net.usable.other.cloakroom
semio.area.gross.net.usable.other.storage-room
semio.area.gross.net.usable.other.vehicle-parking
semio.area.gross.net.usable.other.passenger
semio.area.gross.net.usable.other.central-technical-room
semio.area.gross.net.usable.other.protective-room
semio.area.gross.net.usable.other.laundry-room
semio.area.gross.net.usable.other.other
semio.area.gross.net.technical
semio.area.gross.net.technical.wastewater-gases-water-supply
semio.area.gross.net.technical.heating-hot-water
semio.area.gross.net.technical.ventilation-air-conditioning
semio.area.gross.net.technical.electrical-power-supply
semio.area.gross.net.technical.telecommunications
semio.area.gross.net.technical.elevator-conveyor-systems
semio.area.gross.net.technical.other
semio.area.gross.net.circulation
semio.area.gross.net.circulation.corridor-hall
semio.area.gross.net.circulation.stair
semio.area.gross.net.circulation.shaft-for-conveyor-system
semio.area.gross.net.circulation.vehicle-traffic
semio.area.gross.net.circulation.other
semio.area.gross.net.construction
semio.area.gross.net.construction.exterior-wall-construction
semio.area.gross.net.construction.interior-wall-construction
semio.area.gross.net.construction.partition-wall
semio.area.gross.net.construction.column
semio.area.gross.net.construction.shaft
semio.area.gross.net.construction.beam
semio.area.gross.net.construction.other
semio.area.property
semio.area.property.built-up
semio.area.property.unbuilt
semio.area.property.outdoor-facility
semio.area.property.outdoor-facility.traffic
semio.area.property.outdoor-facility.traffic.sidewalk
semio.area.property.outdoor-facility.traffic.driveway
semio.area.property.outdoor-facility.traffic.parking-space
semio.area.property.outdoor-facility.traffic.bicycle-parking
semio.area.property.outdoor-facility.traffic.turning
semio.area.property.outdoor-facility.traffic.other
semio.area.property.green
semio.area.property.green.lawn
semio.area.property.green.planted-bed
semio.area.property.green.hedge
semio.area.property.green.tree
semio.area.property.green.roof-greening
semio.area.property.green.facade-greening
semio.area.property.green.other
semio.area.property.paved
semio.area.property.paved.terrace
semio.area.property.paved.balcony
semio.area.property.paved.courtyard
semio.area.property.paved.storage-utility
semio.area.property.paved.playground
semio.area.property.paved.other
semio.area.property.technical-facility
semio.area.property.technical-facility.waste-collection-point
semio.area.property.technical-facility.utility-line
semio.area.property.technical-facility.stormwater-management
semio.area.property.technical-facility.lighting-system
semio.area.property.technical-facility.fence-enclosure
semio.area.property.technical-facility.other
semio.area.property.water
semio.area.property.water.pond
semio.area.property.water.fountain
semio.area.property.water.stormwater-retention
semio.area.property.water.other
semio.area.property.other""")
panel_6 = Panel("https://identifier.buildingsmart.org/uri/buildingsmart/ifc/4.3/prop/NetFloorArea")
# People
# Stationary
# Living
# Residents
# Guests
# Working
# Office Workers
# Production Workers
# Service Workers
# Education Workers
# Healthcare Workers
# Other Workers
# Students
# Pupils
# Students
# Client
# Customers
# Visitors
# Patients
# Mobile
# Mobile Visitors
# Mobile Customers
# Mobile Guests
# Tourists
# Mobile Employees
# Mobile Workers
# Delivery Personnel
# Mobile Students
# Commuters
# Exchange Students
panel_7 = Panel("""semio.people
semio.people.stationary
semio.people.stationary.living
semio.people.stationary.living.residents
semio.people.stationary.living.guests
semio.people.stationary.working
semio.people.stationary.working.office
semio.people.stationary.working.production
semio.people.stationary.working.service
semio.people.stationary.working.education
semio.people.stationary.working.healthcare
semio.people.stationary.working.other
semio.people.stationary.students
semio.people.stationary.students.pupils
semio.people.stationary.students.students
semio.people.stationary.client
semio.people.stationary.client.customers
semio.people.stationary.client.visitors
semio.people.stationary.client.patients
semio.people.mobile
semio.people.mobile.visitors
semio.people.mobile.visitors.customers
semio.people.mobile.visitors.guests
semio.people.mobile.visitors.tourists
semio.people.mobile.employees
semio.people.mobile.employees.mobile-workers
semio.people.mobile.employees.delivery-personnel
semio.people.mobile.students
semio.people.mobile.students.commuters
semio.people.mobile.students.exchange-students""")
im = ClusterInput()
# Raumnutzungsarten nach DIN 277-2: https://search.bsdd.buildingsmart.org/uri/cafmring/din277-2/2024.0.1
na = ClusterInput()
value = ClusterInput()
na_2 = Name(na)
value_2 = Value(value)
im_2 = Boolean(im)
merge = Merge(Data1=panel_5, Data2=panel, Data3=panel_2, Data4=panel_7, Data5=panel_3)
expression = Expression(x="kWh/a", y=panel, Expression="x")
expression_2 = Expression(x="m³", y=panel_2, Expression="x")
expression_3 = Expression(x="kgCO₂e", y=panel_3, Expression="x")
expression_4 = Expression(x="m²", y=panel_5, Expression="x")
merge_2 = Merge(Data1=expression_4, Data2=expression, Data3=expression_2, Data4=expression_3)
itemindex = ItemIndex(L=merge, I=na_2)  # -> i; inputs L: list
# ---------- itemindex: Python ----------
#Component Information
#--------------------------------------------------------------------------------------------
if ghenv.Component.RunCount<2:
    #General
    #--------------------------------------------------------------------------------------------
    __author__ = "Ueli Saluz"
    __version__ = "2022.11.18"
    
    ghenv.Component.Name = "ItemIndex"
    ghenv.Component.NickName = "ItemIndex"
    ghenv.Component.Description = "A better IdemIndex"
    ghenv.Component.Message = "VER 1.0"
    ghenv.Component.Category = "Set"
    ghenv.Component.SubCategory = "List"
    
     #Inputs
    #--------------------------------------------------------------------------------------------
    inputIndex=0
    
    ghenv.Component.Params.Input[inputIndex].Name = "List"
    ghenv.Component.Params.Input[inputIndex].NickName = "L"
    ghenv.Component.Params.Input[inputIndex].Description = "Input1 is..."
    ghenv.Component.Params.Input[inputIndex].Optional = False
    inputIndex+=1
    
    ghenv.Component.Params.Input[inputIndex].Name = "Item"
    ghenv.Component.Params.Input[inputIndex].NickName = "I"
    ghenv.Component.Params.Input[inputIndex].Description = "Input2 is..."
    ghenv.Component.Params.Input[inputIndex].Optional = False
    inputIndex+=1
    
    #Outputs
    #--------------------------------------------------------------------------------------------
    outputIndex=0
    
    ghenv.Component.Params.Output[outputIndex].Name = "Index"
    ghenv.Component.Params.Output[outputIndex].NickName = "i"
    ghenv.Component.Params.Output[outputIndex].Description = "Output1 is..."
    outputIndex+=1

i = L.index(I)
# ---------- end itemindex ----------
panel_8 = Panel("""Global Life Cycle Costs = "semio.global-life-cycle-costs"
Life Cycle Costs = "semio.global-life-cycle-costs.life-cycle-costs"
Investment Costs Construction Phase = "semio.global-life-cycle-costs.life-cycle-costs.investment-costs-construction-phase"
Land Costs = "semio.global-life-cycle-costs.life-cycle-costs.investment-costs-construction-phase.land-costs"
Land = "semio.global-life-cycle-costs.life-cycle-costs.investment-costs-construction-phase.land-costs.land"
Land Value = "semio.global-life-cycle-costs.life-cycle-costs.investment-costs-construction-phase.land-costs.land.land-value"
Ancillary Land Costs = "semio.global-life-cycle-costs.life-cycle-costs.investment-costs-construction-phase.land-costs.land.ancillary-land-costs"
Surveying Fees = "semio.global-life-cycle-costs.life-cycle-costs.investment-costs-construction-phase.land-costs.land.ancillary-land-costs.surveying-fees"
Court Fees = "semio.global-life-cycle-costs.life-cycle-costs.investment-costs-construction-phase.land-costs.land.ancillary-land-costs.court-fees"
Notary Fees = "semio.global-life-cycle-costs.life-cycle-costs.investment-costs-construction-phase.land-costs.land.ancillary-land-costs.notary-fees"
Land Transfer Tax = "semio.global-life-cycle-costs.life-cycle-costs.investment-costs-construction-phase.land-costs.land.ancillary-land-costs.land-transfer-tax"
Investigations = "semio.global-life-cycle-costs.life-cycle-costs.investment-costs-construction-phase.land-costs.land.ancillary-land-costs.investigations"
Valuations = "semio.global-life-cycle-costs.life-cycle-costs.investment-costs-construction-phase.land-costs.land.ancillary-land-costs.valuations"
Permit Fees = "semio.global-life-cycle-costs.life-cycle-costs.investment-costs-construction-phase.land-costs.land.ancillary-land-costs.permit-fees"
Land Reorganization = "semio.global-life-cycle-costs.life-cycle-costs.investment-costs-construction-phase.land-costs.land.ancillary-land-costs.land-reorganization"
Other (Ancillary Land Costs) = "semio.global-life-cycle-costs.life-cycle-costs.investment-costs-construction-phase.land-costs.land.ancillary-land-costs.other"
Third Party Rights = "semio.global-life-cycle-costs.life-cycle-costs.investment-costs-construction-phase.land-costs.land.third-party-rights"
Compensations (Third Party Rights) = "semio.global-life-cycle-costs.life-cycle-costs.investment-costs-construction-phase.land-costs.land.third-party-rights.compensations"
Redemption of Real Rights (Third Party Rights) = "semio.global-life-cycle-costs.life-cycle-costs.investment-costs-construction-phase.land-costs.land.third-party-rights.redemption-of-real-rights"
Other (Third Party Rights) = "semio.global-life-cycle-costs.life-cycle-costs.investment-costs-construction-phase.land-costs.land.third-party-rights.other"
Compensations = "semio.global-life-cycle-costs.life-cycle-costs.investment-costs-construction-phase.land-costs.land.compensations"
Redemption of Real Rights = "semio.global-life-cycle-costs.life-cycle-costs.investment-costs-construction-phase.land-costs.land.redemption-of-real-rights"
Other (Land) = "semio.global-life-cycle-costs.life-cycle-costs.investment-costs-construction-phase.land-costs.land.other"
Other (Land Costs) = "semio.global-life-cycle-costs.life-cycle-costs.investment-costs-construction-phase.land-costs.other"
Development Costs = "semio.global-life-cycle-costs.life-cycle-costs.investment-costs-construction-phase.development-costs"
Preparatory Measures = "semio.global-life-cycle-costs.life-cycle-costs.investment-costs-construction-phase.development-costs.preparatory-measures"
Site Preparation = "semio.global-life-cycle-costs.life-cycle-costs.investment-costs-construction-phase.development-costs.preparatory-measures.site-preparation"
Safety Measures (Site Preparation) = "semio.global-life-cycle-costs.life-cycle-costs.investment-costs-construction-phase.development-costs.preparatory-measures.site-preparation.safety-measures"
Demolition Measures (Site Preparation) = "semio.global-life-cycle-costs.life-cycle-costs.investment-costs-construction-phase.development-costs.preparatory-measures.site-preparation.demolition-measures"
Contaminated Site Remediation = "semio.global-life-cycle-costs.life-cycle-costs.investment-costs-construction-phase.development-costs.preparatory-measures.site-preparation.contaminated-site-remediation"
Surface Preparation = "semio.global-life-cycle-costs.life-cycle-costs.investment-costs-construction-phase.development-costs.preparatory-measures.site-preparation.surface-preparation"
Explosive Ordnance Clearance = "semio.global-life-cycle-costs.life-cycle-costs.investment-costs-construction-phase.development-costs.preparatory-measures.site-preparation.explosive-ordnance-clearance"
Cultural Heritage Finds = "semio.global-life-cycle-costs.life-cycle-costs.investment-costs-construction-phase.development-costs.preparatory-measures.site-preparation.cultural-heritage-finds"
Other (Site Preparation) = "semio.global-life-cycle-costs.life-cycle-costs.investment-costs-construction-phase.development-costs.preparatory-measures.site-preparation.other"
Public Infrastructure Development = "semio.global-life-cycle-costs.life-cycle-costs.investment-costs-construction-phase.development-costs.preparatory-measures.public-infrastructure-development"
Wastewater Disposal = "semio.global-life-cycle-costs.life-cycle-costs.investment-costs-construction-phase.development-costs.preparatory-measures.public-infrastructure-development.wastewater-disposal"
Water Supply = "semio.global-life-cycle-costs.life-cycle-costs.investment-costs-construction-phase.development-costs.preparatory-measures.public-infrastructure-development.water-supply"
Gas Supply = "semio.global-life-cycle-costs.life-cycle-costs.investment-costs-construction-phase.development-costs.preparatory-measures.public-infrastructure-development.gas-supply"
District Heating Supply = "semio.global-life-cycle-costs.life-cycle-costs.investment-costs-construction-phase.development-costs.preparatory-measures.public-infrastructure-development.district-heating-supply"
Power Supply = "semio.global-life-cycle-costs.life-cycle-costs.investment-costs-construction-phase.development-costs.preparatory-measures.public-infrastructure-development.power-supply"
Telecommunications = "semio.global-life-cycle-costs.life-cycle-costs.investment-costs-construction-phase.development-costs.preparatory-measures.public-infrastructure-development.telecommunications"
Traffic Development = "semio.global-life-cycle-costs.life-cycle-costs.investment-costs-construction-phase.development-costs.preparatory-measures.public-infrastructure-development.traffic-development"
Waste Disposal (Public Infrastructure) = "semio.global-life-cycle-costs.life-cycle-costs.investment-costs-construction-phase.development-costs.preparatory-measures.public-infrastructure-development.waste-disposal"
Other (Public Infrastructure) = "semio.global-life-cycle-costs.life-cycle-costs.investment-costs-construction-phase.development-costs.preparatory-measures.public-infrastructure-development.other"
Private Infrastructure Development = "semio.global-life-cycle-costs.life-cycle-costs.investment-costs-construction-phase.development-costs.private-infrastructure-development"
Compensatory Measures and Levies = "semio.global-life-cycle-costs.life-cycle-costs.investment-costs-construction-phase.development-costs.compensatory-measures-and-levies"
Compensatory Measures = "semio.global-life-cycle-costs.life-cycle-costs.investment-costs-construction-phase.development-costs.compensatory-measures-and-levies.compensatory-measures"
Compensatory Levies = "semio.global-life-cycle-costs.life-cycle-costs.investment-costs-construction-phase.development-costs.compensatory-measures-and-levies.compensatory-levies"
Other (Compensatory Measures and Levies) = "semio.global-life-cycle-costs.life-cycle-costs.investment-costs-construction-phase.development-costs.compensatory-measures-and-levies.other"
Transitional Measures = "semio.global-life-cycle-costs.life-cycle-costs.investment-costs-construction-phase.development-costs.transitional-measures"
Structural Measures = "semio.global-life-cycle-costs.life-cycle-costs.investment-costs-construction-phase.development-costs.transitional-measures.structural-measures"
Organizational Measures = "semio.global-life-cycle-costs.life-cycle-costs.investment-costs-construction-phase.development-costs.transitional-measures.organizational-measures"
Other (Transitional Measures) = "semio.global-life-cycle-costs.life-cycle-costs.investment-costs-construction-phase.development-costs.transitional-measures.other"
Other (Development Costs) = "semio.global-life-cycle-costs.life-cycle-costs.investment-costs-construction-phase.development-costs.other"
Building Structural Components = "semio.global-life-cycle-costs.life-cycle-costs.investment-costs-construction-phase.building-structural-components"
Excavation Earthworks = "semio.global-life-cycle-costs.life-cycle-costs.investment-costs-construction-phase.building-structural-components.excavation-earthworks"
Construction (Excavation) = "semio.global-life-cycle-costs.life-cycle-costs.investment-costs-construction-phase.building-structural-components.excavation-earthworks.construction"
Enclosure (Excavation) = "semio.global-life-cycle-costs.life-cycle-costs.investment-costs-construction-phase.building-structural-components.excavation-earthworks.enclosure"
Water Management (Excavation) = "semio.global-life-cycle-costs.life-cycle-costs.investment-costs-construction-phase.building-structural-components.excavation-earthworks.water-management"
Conveyance (Excavation) = "semio.global-life-cycle-costs.life-cycle-costs.investment-costs-construction-phase.building-structural-components.excavation-earthworks.conveyance"
Other (Excavation Earthworks) = "semio.global-life-cycle-costs.life-cycle-costs.investment-costs-construction-phase.building-structural-components.excavation-earthworks.other"
Foundation Substructure = "semio.global-life-cycle-costs.life-cycle-costs.investment-costs-construction-phase.building-structural-components.foundation-substructure"
Soil Improvement = "semio.global-life-cycle-costs.life-cycle-costs.investment-costs-construction-phase.building-structural-components.foundation-substructure.soil-improvement"
Shallow Foundations and Slabs = "semio.global-life-cycle-costs.life-cycle-costs.investment-costs-construction-phase.building-structural-components.foundation-substructure.shallow-foundations-and-slabs"
Deep Foundations = "semio.global-life-cycle-costs.life-cycle-costs.investment-costs-construction-phase.building-structural-components.foundation-substructure.deep-foundations"
Foundation Layers = "semio.global-life-cycle-costs.life-cycle-costs.investment-costs-construction-phase.building-structural-components.foundation-substructure.foundation-layers"
Seals and Linings = "semio.global-life-cycle-costs.life-cycle-costs.investment-costs-construction-phase.building-structural-components.foundation-substructure.seals-and-linings"
Drains = "semio.global-life-cycle-costs.life-cycle-costs.investment-costs-construction-phase.building-structural-components.foundation-substructure.drains"
Other (Foundation Substructure) = "semio.global-life-cycle-costs.life-cycle-costs.investment-costs-construction-phase.building-structural-components.foundation-substructure.other"
External Walls Vertical Structural Components Outside = "semio.global-life-cycle-costs.life-cycle-costs.investment-costs-construction-phase.building-structural-components.external-walls-vertical-structural-components-outside"
Load Bearing External Walls = "semio.global-life-cycle-costs.life-cycle-costs.investment-costs-construction-phase.building-structural-components.external-walls-vertical-structural-components-outside.load-bearing-external-walls"
Non Load Bearing External Walls = "semio.global-life-cycle-costs.life-cycle-costs.investment-costs-construction-phase.building-structural-components.external-walls-vertical-structural-components-outside.non-load-bearing-external-walls"
External Columns = "semio.global-life-cycle-costs.life-cycle-costs.investment-costs-construction-phase.building-structural-components.external-walls-vertical-structural-components-outside.external-columns"
External Wall Openings = "semio.global-life-cycle-costs.life-cycle-costs.investment-costs-construction-phase.building-structural-components.external-walls-vertical-structural-components-outside.external-wall-openings"
External Wall Claddings Outside = "semio.global-life-cycle-costs.life-cycle-costs.investment-costs-construction-phase.building-structural-components.external-walls-vertical-structural-components-outside.external-wall-claddings-outside"
External Wall Claddings Inside = "semio.global-life-cycle-costs.life-cycle-costs.investment-costs-construction-phase.building-structural-components.external-walls-vertical-structural-components-outside.external-wall-claddings-inside"
Prefabricated External Wall Structures = "semio.global-life-cycle-costs.life-cycle-costs.investment-costs-construction-phase.building-structural-components.external-walls-vertical-structural-components-outside.prefabricated-external-wall-structures"
Light Protection KG 330 = "semio.global-life-cycle-costs.life-cycle-costs.investment-costs-construction-phase.building-structural-components.external-walls-vertical-structural-components-outside.light-protection-kg-330"
Other (External Walls Outside) = "semio.global-life-cycle-costs.life-cycle-costs.investment-costs-construction-phase.building-structural-components.external-walls-vertical-structural-components-outside.other"
Internal Walls Vertical Structural Components Inside = "semio.global-life-cycle-costs.life-cycle-costs.investment-costs-construction-phase.building-structural-components.internal-walls-vertical-structural-components-inside"
Load Bearing Internal Walls = "semio.global-life-cycle-costs.life-cycle-costs.investment-costs-construction-phase.building-structural-components.internal-walls-vertical-structural-components-inside.load-bearing-internal-walls"
Non Load Bearing Internal Walls = "semio.global-life-cycle-costs.life-cycle-costs.investment-costs-construction-phase.building-structural-components.internal-walls-vertical-structural-components-inside.non-load-bearing-internal-walls"
Internal Columns = "semio.global-life-cycle-costs.life-cycle-costs.investment-costs-construction-phase.building-structural-components.internal-walls-vertical-structural-components-inside.internal-columns"
Internal Wall Openings = "semio.global-life-cycle-costs.life-cycle-costs.investment-costs-construction-phase.building-structural-components.internal-walls-vertical-structural-components-inside.internal-wall-openings"
Internal Wall Claddings = "semio.global-life-cycle-costs.life-cycle-costs.investment-costs-construction-phase.building-structural-components.internal-walls-vertical-structural-components-inside.internal-wall-claddings"
Prefabricated Internal Wall Structures = "semio.global-life-cycle-costs.life-cycle-costs.investment-costs-construction-phase.building-structural-components.internal-walls-vertical-structural-components-inside.prefabricated-internal-wall-structures"
Light Protection KG 340 = "semio.global-life-cycle-costs.life-cycle-costs.investment-costs-construction-phase.building-structural-components.internal-walls-vertical-structural-components-inside.light-protection-kg-340"
Other (Internal Walls Inside) = "semio.global-life-cycle-costs.life-cycle-costs.investment-costs-construction-phase.building-structural-components.internal-walls-vertical-structural-components-inside.other"
Ceilings Horizontal Structural Components = "semio.global-life-cycle-costs.life-cycle-costs.investment-costs-construction-phase.building-structural-components.ceilings-horizontal-structural-components"
Ceiling Structures = "semio.global-life-cycle-costs.life-cycle-costs.investment-costs-construction-phase.building-structural-components.ceilings-horizontal-structural-components.ceiling-structures"
Ceiling Openings = "semio.global-life-cycle-costs.life-cycle-costs.investment-costs-construction-phase.building-structural-components.ceilings-horizontal-structural-components.ceiling-openings"
Ceiling Finishes = "semio.global-life-cycle-costs.life-cycle-costs.investment-costs-construction-phase.building-structural-components.ceilings-horizontal-structural-components.ceiling-finishes"
Ceiling Linings = "semio.global-life-cycle-costs.life-cycle-costs.investment-costs-construction-phase.building-structural-components.ceilings-horizontal-structural-components.ceiling-linings"
Prefabricated Ceiling Structures = "semio.global-life-cycle-costs.life-cycle-costs.investment-costs-construction-phase.building-structural-components.ceilings-horizontal-structural-components.prefabricated-ceiling-structures"
Other (Ceilings) = "semio.global-life-cycle-costs.life-cycle-costs.investment-costs-construction-phase.building-structural-components.ceilings-horizontal-structural-components.other"
Roofs = "semio.global-life-cycle-costs.life-cycle-costs.investment-costs-construction-phase.building-structural-components.roofs"
Roof Structures = "semio.global-life-cycle-costs.life-cycle-costs.investment-costs-construction-phase.building-structural-components.roofs.roof-structures"
Roof Openings = "semio.global-life-cycle-costs.life-cycle-costs.investment-costs-construction-phase.building-structural-components.roofs.roof-openings"
Roof Finishes = "semio.global-life-cycle-costs.life-cycle-costs.investment-costs-construction-phase.building-structural-components.roofs.roof-finishes"
Roof Linings = "semio.global-life-cycle-costs.life-cycle-costs.investment-costs-construction-phase.building-structural-components.roofs.roof-linings"
Prefabricated Roof Structures = "semio.global-life-cycle-costs.life-cycle-costs.investment-costs-construction-phase.building-structural-components.roofs.prefabricated-roof-structures"
Light Protection KG 360 = "semio.global-life-cycle-costs.life-cycle-costs.investment-costs-construction-phase.building-structural-components.roofs.light-protection-kg-360"
Other (Roofs) = "semio.global-life-cycle-costs.life-cycle-costs.investment-costs-construction-phase.building-structural-components.roofs.other"
Infrastructure Facilities = "semio.global-life-cycle-costs.life-cycle-costs.investment-costs-construction-phase.building-structural-components.infrastructure-facilities"
Road Traffic Facilities = "semio.global-life-cycle-costs.life-cycle-costs.investment-costs-construction-phase.building-structural-components.infrastructure-facilities.road-traffic-facilities"
Rail Traffic Facilities = "semio.global-life-cycle-costs.life-cycle-costs.investment-costs-construction-phase.building-structural-components.infrastructure-facilities.rail-traffic-facilities"
Air Traffic Facilities = "semio.global-life-cycle-costs.life-cycle-costs.investment-costs-construction-phase.building-structural-components.infrastructure-facilities.air-traffic-facilities"
Water Construction Facilities = "semio.global-life-cycle-costs.life-cycle-costs.investment-costs-construction-phase.building-structural-components.infrastructure-facilities.water-construction-facilities"
Wastewater Disposal Facilities = "semio.global-life-cycle-costs.life-cycle-costs.investment-costs-construction-phase.building-structural-components.infrastructure-facilities.wastewater-disposal-facilities"
Water Supply Facilities = "semio.global-life-cycle-costs.life-cycle-costs.investment-costs-construction-phase.building-structural-components.infrastructure-facilities.water-supply-facilities"
Energy and Information Supply Facilities = "semio.global-life-cycle-costs.life-cycle-costs.investment-costs-construction-phase.building-structural-components.infrastructure-facilities.energy-and-information-supply-facilities"
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""")
item = ListItem(List=panel_6, Index=itemindex, Wrap=True)
expression_5 = Expression(x="ft²", y=panel_5, Expression="x")
expression_6 = Expression(x="kBtu/a", y=panel, Expression="x")
expression_7 = Expression(x="ft³", y=panel_2, Expression="x")
expression_8 = Expression(x="MtCO₂e", y=panel_3, Expression="x")
null = NullItem(Item=itemindex)  # -> NullFlags, InvalidFlags, Description
merge_3 = Merge(Data1=expression_5, Data2=expression_6, Data3=expression_7, Data4=expression_8)
filter = StreamFilter(Gate=im_2, Stream0=merge_2, Stream1=merge_3)
item_2 = ListItem(List=filter, Index=itemindex, Wrap=True)
qal = ModelQuality(Name=na_2, Value=value_2, Unit=item_2, Definition=item)  # -> Quality, Valid, Name, Value, Unit, Definition
panel_9 = Panel("Suggestion: Please use a standard name from one of the § lists")
filter_2 = StreamFilter(Gate=null.NullFlags, Stream0=qal.Quality)
ql = Quality(filter_2)
na_3 = Name(na)
ql_2 = ClusterOutput(ql)
concat = Concatenate(
    FragmentF="Error:",
    FragmentE=" QualityNameNotStandard",
    FragmentA="Info: The provided Name (",
    FragmentB=na_3,
    FragmentC=") is not a standard Name",
    FragmentD=panel_9)
log = Text(concat)
filter_3 = StreamFilter(Gate=null.NullFlags, Stream1=log)
log_2 = Text(filter_3)
log_3 = ClusterOutput(log_2)

# ==== cluster OpinionatedQuality_2: Construct an opinionated quality with a standard name.
panel = Panel("""semio.energy
semio.energy.primary demand
semio.energy.primary demand.primary heating
semio.energy.primary demand.primary heating.final
semio.energy.primary demand.primary heating.final.heating
semio.energy.primary demand.primary heating.final.heating.transmission
semio.energy.primary demand.primary heating.final.heating.final ventilation
semio.energy.primary demand.primary heating.final.heating.final ventilation.ventialtion
semio.energy.primary demand.primary cooling
semio.energy.primary demand.primary cooling.final
semio.energy.primary demand.primary cooling.final.cooling energy
semio.energy.primary demand.primary electricity
semio.energy.primary demand.primary electricity.electricity
semio.energy.primary demand.primary electricity.electricity.technical equipment""")
panel_2 = Panel("""semio.volume
semio.volume.gross-volume
semio.volume.gross-volume.net-volume
semio.volume.gross-volume.construction-volume""")
panel_3 = Panel("""semio.global-warming-potential
semio.global-warming-potential.embodied
semio.global-warming-potential.embodied.construction
semio.global-warming-potential.embodied.technical-equipment
semio.global-warming-potential.operational
semio.global-warming-potential.operational.heating
semio.global-warming-potential.operational.cooling
semio.global-warming-potential.operational.lighting
semio.global-warming-potential.operational.ventilation
semio.global-warming-potential.operational.hot-water
semio.global-warming-potential.operational.other""")
panel_4 = Panel("""Floor Area                                            
Gross Floor Area                                      
Net Floor Area                                        
Usable Floor Area                                     
Living And Staying Floor Area                         
Living Room Floor Area                                
Living Floor Area                                     
Kitchen Floor Area                                    
Sanitary Floor Area                                   
Circulation Floor Area                                
Outdoor Seating Floor Area                            
Storage Floor Area                                    
Common Room Floor Area                                
Break Room Floor Area                                 
Waiting Room Floor Area                               
Dining Room Floor Area                                
Detention Room Floor Area                             
Office Work Floor Area                                
Office Room Floor Area                                
Open Plan Office Floor Area                           
Meeting Room Floor Area                               
Design Room Floor Area                                
Counter Room Floor Area                               
Control Room Floor Area                               
Supervision Room Floor Area                           
Office Technology Room Floor Area                     
Other Office Work Floor Area                          
Production Experiments Work Floor Area                
Production Hall Floor Area                            
Workshop Floor Area                                   
Technology Lab Floor Area                             
Physics Electrical Lab Floor Area                     
Chemistry Biology Lab Floor Area                      
Animal Husbandry Room Floor Area                      
Plant Cultivation Room Floor Area                     
Kitchen Floor Area                                    
Special Work Room Floor Area                          
Storage Distribution Sales Floor Area                 
Storage Room Floor Area                               
Collection Archive Floor Area                         
Cold Storage Room Floor Area                          
Receiving Dispatch Room Floor Area                    
Sales Room Floor Area                                 
Exhibition Room Floor Area                            
Other Storage Distribution Sales Floor Area           
Education Culture Instruction Floor Area              
Class With Fixed Seating Floor Area                   
Teaching Practice Room Floor Area                     
Special Classroom Floor Area                          
Library Room Floor Area                               
Sports Room Floor Area                                
Assembly Room Floor Area                              
Stage Studio Room Floor Area                          
Display Room Floor Area                               
Sacred Room Floor Area                                
Healing And Care Floor Area                           
General Medical Equipment Room Floor Area             
Special Medical Equipment Room Floor Area             
Surgical Room Floor Area                              
Radiation Diagnostic Room Floor Area                  
Radiation Therapy Room Floor Area                     
Rehabilitation Physiotherapy Floor Area               
General Patient Room Floor Area                       
Special Patient Room Floor Area                       
Other Healing And Care Floor Area                     
Other Usable Floor Area                               
Sanitary Room Floor Area                              
Cloakroom Floor Area                                  
Storage Room Floor Area                               
Vehicle Parking Floor Area                            
Passenger Floor Area                                  
Central Technical Room Floor Area                     
Protective Room Floor Area                            
Laundry Room Floor Area                               
Other Floor Area                                      
Technical Floor Area                                  
Wastewater Gases Water Supply Floor Area              
Heating Hot Water Floor Area                          
Ventilation Air Conditioning Floor Area               
Electrical Power Supply Floor Area                    
Telecommunications Floor Area                         
Elevator Conveyor Systems Floor Area                  
Other Technical Floor Area                            
Circulation Floor Area                                
Corridor Hall Floor Area                              
Stair Floor Area                                      
Shaft For Conveyor System Floor Area                  
Vehicle Traffic Floor Area                            
Other Circulation Floor Area                          
Construction Floor Area                               
Exterior Wall Construction Floor Area                 
Interior Wall Construction Floor Area                 
Partition Wall Floor Area                             
Column Floor Area                                     
Shaft Floor Area                                      
Beam Floor Area                                       
Other Construction Floor Area                         
Property Area                                         
Built Up Area                                         
Unbuilt Area                                          
Outdoor Facility Area                                 
Traffic Area                                          
Sidewalk Area                                         
Driveway Area                                         
Parking Space Area                                    
Bicycle Parking Area                                  
Turning Area                                          
Other Traffic Area                                    
Green Area                                            
Lawn Area                                             
Planted Bed Area                                      
Hedge Area                                            
Tree Area                                             
Roof Greening Area                                    
Facade Greening Area                                  
Other Green Area                                      
Paved Area                                            
Terrace Area                                          
Balcony Area                                          
Courtyard Area                                        
Storage Utility Area                                  
Playground Area                                       
Other Paved Area                                      
Technical Facility Area                               
Waste Collection Point Area                           
Utility Line Area                                     
Stormwater Management Area                            
Lighting System Area                                  
Fence Enclosure Area                                  
Other Technical Facility Area                         
Water Area                                            
Pond Area                                             
Fountain Area                                         
Stormwater Retention Area                             
Other Water Area                                      
Other Outdoor Facility Area   """)
panel_5 = Panel("""semio.area
semio.area.gross
semio.area.gross.net
semio.area.gross.net.usable
semio.area.gross.net.usable.living-and-staying
semio.area.gross.net.usable.living-and-staying.living-room
semio.area.gross.net.usable.living-and-staying.living-room.living
semio.area.gross.net.usable.living-and-staying.living-room.kitchen
semio.area.gross.net.usable.living-and-staying.living-room.sanitary
semio.area.gross.net.usable.living-and-staying.living-room.circulation
semio.area.gross.net.usable.living-and-staying.living-room.outdoor-seating
semio.area.gross.net.usable.living-and-staying.living-room.storage
semio.area.gross.net.usable.living-and-staying.common-room
semio.area.gross.net.usable.living-and-staying.break-room
semio.area.gross.net.usable.living-and-staying.waiting-room
semio.area.gross.net.usable.living-and-staying.dining-room
semio.area.gross.net.usable.living-and-staying.detention-room
semio.area.gross.net.usable.office-work
semio.area.gross.net.usable.office-work.office-room
semio.area.gross.net.usable.office-work.open-plan-office
semio.area.gross.net.usable.office-work.meeting-room
semio.area.gross.net.usable.office-work.design-room
semio.area.gross.net.usable.office-work.counter-room
semio.area.gross.net.usable.office-work.control-room
semio.area.gross.net.usable.office-work.supervision-room
semio.area.gross.net.usable.office-work.office-technology-room
semio.area.gross.net.usable.office-work.other
semio.area.gross.net.usable.production-experiments-work
semio.area.gross.net.usable.production-experiments-work.production-hall
semio.area.gross.net.usable.production-experiments-work.workshop
semio.area.gross.net.usable.production-experiments-work.technology-lab
semio.area.gross.net.usable.production-experiments-work.physics-electrical-lab
semio.area.gross.net.usable.production-experiments-work.chemistry-biology-lab
semio.area.gross.net.usable.production-experiments-work.animal-husbandry-room
semio.area.gross.net.usable.production-experiments-work.plant-cultivation-room
semio.area.gross.net.usable.production-experiments-work.kitchen
semio.area.gross.net.usable.production-experiments-work.special-work-room
semio.area.gross.net.usable.storage-distribution-sales
semio.area.gross.net.usable.storage-distribution-sales.storage-room
semio.area.gross.net.usable.storage-distribution-sales.collection-archive
semio.area.gross.net.usable.storage-distribution-sales.cold-storage-room
semio.area.gross.net.usable.storage-distribution-sales.receiving-dispatch-room
semio.area.gross.net.usable.storage-distribution-sales.sales-room
semio.area.gross.net.usable.storage-distribution-sales.exhibition-room
semio.area.gross.net.usable.storage-distribution-sales.other
semio.area.gross.net.usable.education-culture-instruction
semio.area.gross.net.usable.education-culture-instruction.classwith-fixed-seating
semio.area.gross.net.usable.education-culture-instruction.teaching-practice-room
semio.area.gross.net.usable.education-culture-instruction.special-classroom
semio.area.gross.net.usable.education-culture-instruction.library-room
semio.area.gross.net.usable.education-culture-instruction.sports-room
semio.area.gross.net.usable.education-culture-instruction.assembly-room
semio.area.gross.net.usable.education-culture-instruction.stage-studio-room
semio.area.gross.net.usable.education-culture-instruction.display-room
semio.area.gross.net.usable.education-culture-instruction.sacred-room
semio.area.gross.net.usable.healing-and-care
semio.area.gross.net.usable.healing-and-care.general-medical-equipment-room
semio.area.gross.net.usable.healing-and-care.special-medical-equipment-room
semio.area.gross.net.usable.healing-and-care.surgical-room
semio.area.gross.net.usable.healing-and-care.radiation-diagnostic-room
semio.area.gross.net.usable.healing-and-care.radiation-therapy-room
semio.area.gross.net.usable.healing-and-care.rehabilitation-physiotherapy
semio.area.gross.net.usable.healing-and-care.general-patient-room
semio.area.gross.net.usable.healing-and-care.special-patient-room
semio.area.gross.net.usable.healing-and-care.other
semio.area.gross.net.usable.other
semio.area.gross.net.usable.other.sanitary-room
semio.area.gross.net.usable.other.cloakroom
semio.area.gross.net.usable.other.storage-room
semio.area.gross.net.usable.other.vehicle-parking
semio.area.gross.net.usable.other.passenger
semio.area.gross.net.usable.other.central-technical-room
semio.area.gross.net.usable.other.protective-room
semio.area.gross.net.usable.other.laundry-room
semio.area.gross.net.usable.other.other
semio.area.gross.net.technical
semio.area.gross.net.technical.wastewater-gases-water-supply
semio.area.gross.net.technical.heating-hot-water
semio.area.gross.net.technical.ventilation-air-conditioning
semio.area.gross.net.technical.electrical-power-supply
semio.area.gross.net.technical.telecommunications
semio.area.gross.net.technical.elevator-conveyor-systems
semio.area.gross.net.technical.other
semio.area.gross.net.circulation
semio.area.gross.net.circulation.corridor-hall
semio.area.gross.net.circulation.stair
semio.area.gross.net.circulation.shaft-for-conveyor-system
semio.area.gross.net.circulation.vehicle-traffic
semio.area.gross.net.circulation.other
semio.area.gross.net.construction
semio.area.gross.net.construction.exterior-wall-construction
semio.area.gross.net.construction.interior-wall-construction
semio.area.gross.net.construction.partition-wall
semio.area.gross.net.construction.column
semio.area.gross.net.construction.shaft
semio.area.gross.net.construction.beam
semio.area.gross.net.construction.other
semio.area.property
semio.area.property.built-up
semio.area.property.unbuilt
semio.area.property.outdoor-facility
semio.area.property.outdoor-facility.traffic
semio.area.property.outdoor-facility.traffic.sidewalk
semio.area.property.outdoor-facility.traffic.driveway
semio.area.property.outdoor-facility.traffic.parking-space
semio.area.property.outdoor-facility.traffic.bicycle-parking
semio.area.property.outdoor-facility.traffic.turning
semio.area.property.outdoor-facility.traffic.other
semio.area.property.green
semio.area.property.green.lawn
semio.area.property.green.planted-bed
semio.area.property.green.hedge
semio.area.property.green.tree
semio.area.property.green.roof-greening
semio.area.property.green.facade-greening
semio.area.property.green.other
semio.area.property.paved
semio.area.property.paved.terrace
semio.area.property.paved.balcony
semio.area.property.paved.courtyard
semio.area.property.paved.storage-utility
semio.area.property.paved.playground
semio.area.property.paved.other
semio.area.property.technical-facility
semio.area.property.technical-facility.waste-collection-point
semio.area.property.technical-facility.utility-line
semio.area.property.technical-facility.stormwater-management
semio.area.property.technical-facility.lighting-system
semio.area.property.technical-facility.fence-enclosure
semio.area.property.technical-facility.other
semio.area.property.water
semio.area.property.water.pond
semio.area.property.water.fountain
semio.area.property.water.stormwater-retention
semio.area.property.water.other
semio.area.property.other""")
panel_6 = Panel("https://identifier.buildingsmart.org/uri/buildingsmart/ifc/4.3/prop/NetFloorArea")
panel_7 = Panel("""semio.people
semio.people.stationary
semio.people.stationary.living
semio.people.stationary.living.residents
semio.people.stationary.living.guests
semio.people.stationary.working
semio.people.stationary.working.office
semio.people.stationary.working.production
semio.people.stationary.working.service
semio.people.stationary.working.education
semio.people.stationary.working.healthcare
semio.people.stationary.working.other
semio.people.stationary.students
semio.people.stationary.students.pupils
semio.people.stationary.students.students
semio.people.stationary.client
semio.people.stationary.client.customers
semio.people.stationary.client.visitors
semio.people.stationary.client.patients
semio.people.mobile
semio.people.mobile.visitors
semio.people.mobile.visitors.customers
semio.people.mobile.visitors.guests
semio.people.mobile.visitors.tourists
semio.people.mobile.employees
semio.people.mobile.employees.mobile-workers
semio.people.mobile.employees.delivery-personnel
semio.people.mobile.students
semio.people.mobile.students.commuters
semio.people.mobile.students.exchange-students""")
im = ClusterInput()
# Raumnutzungsarten nach DIN 277-2: https://search.bsdd.buildingsmart.org/uri/cafmring/din277-2/2024.0.1
na = ClusterInput()
value = ClusterInput()
na_2 = Name(na)
value_2 = Value(value)
im_2 = Boolean(im)
merge = Merge(Data1=panel_5, Data2=panel, Data3=panel_2, Data4=panel_7, Data5=panel_3)
expression = Expression(x="kWh/a", y=panel, Expression="x")
expression_2 = Expression(x="m³", y=panel_2, Expression="x")
expression_3 = Expression(x="kgCO₂e", y=panel_3, Expression="x")
expression_4 = Expression(x="m²", y=panel_5, Expression="x")
merge_2 = Merge(Data1=expression_4, Data2=expression, Data3=expression_2, Data4=expression_3)
itemindex = ItemIndex(L=merge, I=na_2)  # -> i; inputs L: list; same code as itemindex
panel_8 = Panel("""Global Life Cycle Costs = "semio.global-life-cycle-costs"
Life Cycle Costs = "semio.global-life-cycle-costs.life-cycle-costs"
Investment Costs Construction Phase = "semio.global-life-cycle-costs.life-cycle-costs.investment-costs-construction-phase"
Land Costs = "semio.global-life-cycle-costs.life-cycle-costs.investment-costs-construction-phase.land-costs"
Land = "semio.global-life-cycle-costs.life-cycle-costs.investment-costs-construction-phase.land-costs.land"
Land Value = "semio.global-life-cycle-costs.life-cycle-costs.investment-costs-construction-phase.land-costs.land.land-value"
Ancillary Land Costs = "semio.global-life-cycle-costs.life-cycle-costs.investment-costs-construction-phase.land-costs.land.ancillary-land-costs"
Surveying Fees = "semio.global-life-cycle-costs.life-cycle-costs.investment-costs-construction-phase.land-costs.land.ancillary-land-costs.surveying-fees"
Court Fees = "semio.global-life-cycle-costs.life-cycle-costs.investment-costs-construction-phase.land-costs.land.ancillary-land-costs.court-fees"
Notary Fees = "semio.global-life-cycle-costs.life-cycle-costs.investment-costs-construction-phase.land-costs.land.ancillary-land-costs.notary-fees"
Land Transfer Tax = "semio.global-life-cycle-costs.life-cycle-costs.investment-costs-construction-phase.land-costs.land.ancillary-land-costs.land-transfer-tax"
Investigations = "semio.global-life-cycle-costs.life-cycle-costs.investment-costs-construction-phase.land-costs.land.ancillary-land-costs.investigations"
Valuations = "semio.global-life-cycle-costs.life-cycle-costs.investment-costs-construction-phase.land-costs.land.ancillary-land-costs.valuations"
Permit Fees = "semio.global-life-cycle-costs.life-cycle-costs.investment-costs-construction-phase.land-costs.land.ancillary-land-costs.permit-fees"
Land Reorganization = "semio.global-life-cycle-costs.life-cycle-costs.investment-costs-construction-phase.land-costs.land.ancillary-land-costs.land-reorganization"
Other (Ancillary Land Costs) = "semio.global-life-cycle-costs.life-cycle-costs.investment-costs-construction-phase.land-costs.land.ancillary-land-costs.other"
Third Party Rights = "semio.global-life-cycle-costs.life-cycle-costs.investment-costs-construction-phase.land-costs.land.third-party-rights"
Compensations (Third Party Rights) = "semio.global-life-cycle-costs.life-cycle-costs.investment-costs-construction-phase.land-costs.land.third-party-rights.compensations"
Redemption of Real Rights (Third Party Rights) = "semio.global-life-cycle-costs.life-cycle-costs.investment-costs-construction-phase.land-costs.land.third-party-rights.redemption-of-real-rights"
Other (Third Party Rights) = "semio.global-life-cycle-costs.life-cycle-costs.investment-costs-construction-phase.land-costs.land.third-party-rights.other"
Compensations = "semio.global-life-cycle-costs.life-cycle-costs.investment-costs-construction-phase.land-costs.land.compensations"
Redemption of Real Rights = "semio.global-life-cycle-costs.life-cycle-costs.investment-costs-construction-phase.land-costs.land.redemption-of-real-rights"
Other (Land) = "semio.global-life-cycle-costs.life-cycle-costs.investment-costs-construction-phase.land-costs.land.other"
Other (Land Costs) = "semio.global-life-cycle-costs.life-cycle-costs.investment-costs-construction-phase.land-costs.other"
Development Costs = "semio.global-life-cycle-costs.life-cycle-costs.investment-costs-construction-phase.development-costs"
Preparatory Measures = "semio.global-life-cycle-costs.life-cycle-costs.investment-costs-construction-phase.development-costs.preparatory-measures"
Site Preparation = "semio.global-life-cycle-costs.life-cycle-costs.investment-costs-construction-phase.development-costs.preparatory-measures.site-preparation"
Safety Measures (Site Preparation) = "semio.global-life-cycle-costs.life-cycle-costs.investment-costs-construction-phase.development-costs.preparatory-measures.site-preparation.safety-measures"
Demolition Measures (Site Preparation) = "semio.global-life-cycle-costs.life-cycle-costs.investment-costs-construction-phase.development-costs.preparatory-measures.site-preparation.demolition-measures"
Contaminated Site Remediation = "semio.global-life-cycle-costs.life-cycle-costs.investment-costs-construction-phase.development-costs.preparatory-measures.site-preparation.contaminated-site-remediation"
Surface Preparation = "semio.global-life-cycle-costs.life-cycle-costs.investment-costs-construction-phase.development-costs.preparatory-measures.site-preparation.surface-preparation"
Explosive Ordnance Clearance = "semio.global-life-cycle-costs.life-cycle-costs.investment-costs-construction-phase.development-costs.preparatory-measures.site-preparation.explosive-ordnance-clearance"
Cultural Heritage Finds = "semio.global-life-cycle-costs.life-cycle-costs.investment-costs-construction-phase.development-costs.preparatory-measures.site-preparation.cultural-heritage-finds"
Other (Site Preparation) = "semio.global-life-cycle-costs.life-cycle-costs.investment-costs-construction-phase.development-costs.preparatory-measures.site-preparation.other"
Public Infrastructure Development = "semio.global-life-cycle-costs.life-cycle-costs.investment-costs-construction-phase.development-costs.preparatory-measures.public-infrastructure-development"
Wastewater Disposal = "semio.global-life-cycle-costs.life-cycle-costs.investment-costs-construction-phase.development-costs.preparatory-measures.public-infrastructure-development.wastewater-disposal"
Water Supply = "semio.global-life-cycle-costs.life-cycle-costs.investment-costs-construction-phase.development-costs.preparatory-measures.public-infrastructure-development.water-supply"
Gas Supply = "semio.global-life-cycle-costs.life-cycle-costs.investment-costs-construction-phase.development-costs.preparatory-measures.public-infrastructure-development.gas-supply"
District Heating Supply = "semio.global-life-cycle-costs.life-cycle-costs.investment-costs-construction-phase.development-costs.preparatory-measures.public-infrastructure-development.district-heating-supply"
Power Supply = "semio.global-life-cycle-costs.life-cycle-costs.investment-costs-construction-phase.development-costs.preparatory-measures.public-infrastructure-development.power-supply"
Telecommunications = "semio.global-life-cycle-costs.life-cycle-costs.investment-costs-construction-phase.development-costs.preparatory-measures.public-infrastructure-development.telecommunications"
Traffic Development = "semio.global-life-cycle-costs.life-cycle-costs.investment-costs-construction-phase.development-costs.preparatory-measures.public-infrastructure-development.traffic-development"
Waste Disposal (Public Infrastructure) = "semio.global-life-cycle-costs.life-cycle-costs.investment-costs-construction-phase.development-costs.preparatory-measures.public-infrastructure-development.waste-disposal"
Other (Public Infrastructure) = "semio.global-life-cycle-costs.life-cycle-costs.investment-costs-construction-phase.development-costs.preparatory-measures.public-infrastructure-development.other"
Private Infrastructure Development = "semio.global-life-cycle-costs.life-cycle-costs.investment-costs-construction-phase.development-costs.private-infrastructure-development"
Compensatory Measures and Levies = "semio.global-life-cycle-costs.life-cycle-costs.investment-costs-construction-phase.development-costs.compensatory-measures-and-levies"
Compensatory Measures = "semio.global-life-cycle-costs.life-cycle-costs.investment-costs-construction-phase.development-costs.compensatory-measures-and-levies.compensatory-measures"
Compensatory Levies = "semio.global-life-cycle-costs.life-cycle-costs.investment-costs-construction-phase.development-costs.compensatory-measures-and-levies.compensatory-levies"
Other (Compensatory Measures and Levies) = "semio.global-life-cycle-costs.life-cycle-costs.investment-costs-construction-phase.development-costs.compensatory-measures-and-levies.other"
Transitional Measures = "semio.global-life-cycle-costs.life-cycle-costs.investment-costs-construction-phase.development-costs.transitional-measures"
Structural Measures = "semio.global-life-cycle-costs.life-cycle-costs.investment-costs-construction-phase.development-costs.transitional-measures.structural-measures"
Organizational Measures = "semio.global-life-cycle-costs.life-cycle-costs.investment-costs-construction-phase.development-costs.transitional-measures.organizational-measures"
Other (Transitional Measures) = "semio.global-life-cycle-costs.life-cycle-costs.investment-costs-construction-phase.development-costs.transitional-measures.other"
Other (Development Costs) = "semio.global-life-cycle-costs.life-cycle-costs.investment-costs-construction-phase.development-costs.other"
Building Structural Components = "semio.global-life-cycle-costs.life-cycle-costs.investment-costs-construction-phase.building-structural-components"
Excavation Earthworks = "semio.global-life-cycle-costs.life-cycle-costs.investment-costs-construction-phase.building-structural-components.excavation-earthworks"
Construction (Excavation) = "semio.global-life-cycle-costs.life-cycle-costs.investment-costs-construction-phase.building-structural-components.excavation-earthworks.construction"
Enclosure (Excavation) = "semio.global-life-cycle-costs.life-cycle-costs.investment-costs-construction-phase.building-structural-components.excavation-earthworks.enclosure"
Water Management (Excavation) = "semio.global-life-cycle-costs.life-cycle-costs.investment-costs-construction-phase.building-structural-components.excavation-earthworks.water-management"
Conveyance (Excavation) = "semio.global-life-cycle-costs.life-cycle-costs.investment-costs-construction-phase.building-structural-components.excavation-earthworks.conveyance"
Other (Excavation Earthworks) = "semio.global-life-cycle-costs.life-cycle-costs.investment-costs-construction-phase.building-structural-components.excavation-earthworks.other"
Foundation Substructure = "semio.global-life-cycle-costs.life-cycle-costs.investment-costs-construction-phase.building-structural-components.foundation-substructure"
Soil Improvement = "semio.global-life-cycle-costs.life-cycle-costs.investment-costs-construction-phase.building-structural-components.foundation-substructure.soil-improvement"
Shallow Foundations and Slabs = "semio.global-life-cycle-costs.life-cycle-costs.investment-costs-construction-phase.building-structural-components.foundation-substructure.shallow-foundations-and-slabs"
Deep Foundations = "semio.global-life-cycle-costs.life-cycle-costs.investment-costs-construction-phase.building-structural-components.foundation-substructure.deep-foundations"
Foundation Layers = "semio.global-life-cycle-costs.life-cycle-costs.investment-costs-construction-phase.building-structural-components.foundation-substructure.foundation-layers"
Seals and Linings = "semio.global-life-cycle-costs.life-cycle-costs.investment-costs-construction-phase.building-structural-components.foundation-substructure.seals-and-linings"
Drains = "semio.global-life-cycle-costs.life-cycle-costs.investment-costs-construction-phase.building-structural-components.foundation-substructure.drains"
Other (Foundation Substructure) = "semio.global-life-cycle-costs.life-cycle-costs.investment-costs-construction-phase.building-structural-components.foundation-substructure.other"
External Walls Vertical Structural Components Outside = "semio.global-life-cycle-costs.life-cycle-costs.investment-costs-construction-phase.building-structural-components.external-walls-vertical-structural-components-outside"
Load Bearing External Walls = "semio.global-life-cycle-costs.life-cycle-costs.investment-costs-construction-phase.building-structural-components.external-walls-vertical-structural-components-outside.load-bearing-external-walls"
Non Load Bearing External Walls = "semio.global-life-cycle-costs.life-cycle-costs.investment-costs-construction-phase.building-structural-components.external-walls-vertical-structural-components-outside.non-load-bearing-external-walls"
External Columns = "semio.global-life-cycle-costs.life-cycle-costs.investment-costs-construction-phase.building-structural-components.external-walls-vertical-structural-components-outside.external-columns"
External Wall Openings = "semio.global-life-cycle-costs.life-cycle-costs.investment-costs-construction-phase.building-structural-components.external-walls-vertical-structural-components-outside.external-wall-openings"
External Wall Claddings Outside = "semio.global-life-cycle-costs.life-cycle-costs.investment-costs-construction-phase.building-structural-components.external-walls-vertical-structural-components-outside.external-wall-claddings-outside"
External Wall Claddings Inside = "semio.global-life-cycle-costs.life-cycle-costs.investment-costs-construction-phase.building-structural-components.external-walls-vertical-structural-components-outside.external-wall-claddings-inside"
Prefabricated External Wall Structures = "semio.global-life-cycle-costs.life-cycle-costs.investment-costs-construction-phase.building-structural-components.external-walls-vertical-structural-components-outside.prefabricated-external-wall-structures"
Light Protection KG 330 = "semio.global-life-cycle-costs.life-cycle-costs.investment-costs-construction-phase.building-structural-components.external-walls-vertical-structural-components-outside.light-protection-kg-330"
Other (External Walls Outside) = "semio.global-life-cycle-costs.life-cycle-costs.investment-costs-construction-phase.building-structural-components.external-walls-vertical-structural-components-outside.other"
Internal Walls Vertical Structural Components Inside = "semio.global-life-cycle-costs.life-cycle-costs.investment-costs-construction-phase.building-structural-components.internal-walls-vertical-structural-components-inside"
Load Bearing Internal Walls = "semio.global-life-cycle-costs.life-cycle-costs.investment-costs-construction-phase.building-structural-components.internal-walls-vertical-structural-components-inside.load-bearing-internal-walls"
Non Load Bearing Internal Walls = "semio.global-life-cycle-costs.life-cycle-costs.investment-costs-construction-phase.building-structural-components.internal-walls-vertical-structural-components-inside.non-load-bearing-internal-walls"
Internal Columns = "semio.global-life-cycle-costs.life-cycle-costs.investment-costs-construction-phase.building-structural-components.internal-walls-vertical-structural-components-inside.internal-columns"
Internal Wall Openings = "semio.global-life-cycle-costs.life-cycle-costs.investment-costs-construction-phase.building-structural-components.internal-walls-vertical-structural-components-inside.internal-wall-openings"
Internal Wall Claddings = "semio.global-life-cycle-costs.life-cycle-costs.investment-costs-construction-phase.building-structural-components.internal-walls-vertical-structural-components-inside.internal-wall-claddings"
Prefabricated Internal Wall Structures = "semio.global-life-cycle-costs.life-cycle-costs.investment-costs-construction-phase.building-structural-components.internal-walls-vertical-structural-components-inside.prefabricated-internal-wall-structures"
Light Protection KG 340 = "semio.global-life-cycle-costs.life-cycle-costs.investment-costs-construction-phase.building-structural-components.internal-walls-vertical-structural-components-inside.light-protection-kg-340"
Other (Internal Walls Inside) = "semio.global-life-cycle-costs.life-cycle-costs.investment-costs-construction-phase.building-structural-components.internal-walls-vertical-structural-components-inside.other"
Ceilings Horizontal Structural Components = "semio.global-life-cycle-costs.life-cycle-costs.investment-costs-construction-phase.building-structural-components.ceilings-horizontal-structural-components"
Ceiling Structures = "semio.global-life-cycle-costs.life-cycle-costs.investment-costs-construction-phase.building-structural-components.ceilings-horizontal-structural-components.ceiling-structures"
Ceiling Openings = "semio.global-life-cycle-costs.life-cycle-costs.investment-costs-construction-phase.building-structural-components.ceilings-horizontal-structural-components.ceiling-openings"
Ceiling Finishes = "semio.global-life-cycle-costs.life-cycle-costs.investment-costs-construction-phase.building-structural-components.ceilings-horizontal-structural-components.ceiling-finishes"
Ceiling Linings = "semio.global-life-cycle-costs.life-cycle-costs.investment-costs-construction-phase.building-structural-components.ceilings-horizontal-structural-components.ceiling-linings"
Prefabricated Ceiling Structures = "semio.global-life-cycle-costs.life-cycle-costs.investment-costs-construction-phase.building-structural-components.ceilings-horizontal-structural-components.prefabricated-ceiling-structures"
Other (Ceilings) = "semio.global-life-cycle-costs.life-cycle-costs.investment-costs-construction-phase.building-structural-components.ceilings-horizontal-structural-components.other"
Roofs = "semio.global-life-cycle-costs.life-cycle-costs.investment-costs-construction-phase.building-structural-components.roofs"
Roof Structures = "semio.global-life-cycle-costs.life-cycle-costs.investment-costs-construction-phase.building-structural-components.roofs.roof-structures"
Roof Openings = "semio.global-life-cycle-costs.life-cycle-costs.investment-costs-construction-phase.building-structural-components.roofs.roof-openings"
Roof Finishes = "semio.global-life-cycle-costs.life-cycle-costs.investment-costs-construction-phase.building-structural-components.roofs.roof-finishes"
Roof Linings = "semio.global-life-cycle-costs.life-cycle-costs.investment-costs-construction-phase.building-structural-components.roofs.roof-linings"
Prefabricated Roof Structures = "semio.global-life-cycle-costs.life-cycle-costs.investment-costs-construction-phase.building-structural-components.roofs.prefabricated-roof-structures"
Light Protection KG 360 = "semio.global-life-cycle-costs.life-cycle-costs.investment-costs-construction-phase.building-structural-components.roofs.light-protection-kg-360"
Other (Roofs) = "semio.global-life-cycle-costs.life-cycle-costs.investment-costs-construction-phase.building-structural-components.roofs.other"
Infrastructure Facilities = "semio.global-life-cycle-costs.life-cycle-costs.investment-costs-construction-phase.building-structural-components.infrastructure-facilities"
Road Traffic Facilities = "semio.global-life-cycle-costs.life-cycle-costs.investment-costs-construction-phase.building-structural-components.infrastructure-facilities.road-traffic-facilities"
Rail Traffic Facilities = "semio.global-life-cycle-costs.life-cycle-costs.investment-costs-construction-phase.building-structural-components.infrastructure-facilities.rail-traffic-facilities"
Air Traffic Facilities = "semio.global-life-cycle-costs.life-cycle-costs.investment-costs-construction-phase.building-structural-components.infrastructure-facilities.air-traffic-facilities"
Water Construction Facilities = "semio.global-life-cycle-costs.life-cycle-costs.investment-costs-construction-phase.building-structural-components.infrastructure-facilities.water-construction-facilities"
Wastewater Disposal Facilities = "semio.global-life-cycle-costs.life-cycle-costs.investment-costs-construction-phase.building-structural-components.infrastructure-facilities.wastewater-disposal-facilities"
Water Supply Facilities = "semio.global-life-cycle-costs.life-cycle-costs.investment-costs-construction-phase.building-structural-components.infrastructure-facilities.water-supply-facilities"
Energy and Information Supply Facilities = "semio.global-life-cycle-costs.life-cycle-costs.investment-costs-construction-phase.building-structural-components.infrastructure-facilities.energy-and-information-supply-facilities"
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""")
item = ListItem(List=panel_6, Index=itemindex, Wrap=True)
expression_5 = Expression(x="ft²", y=panel_5, Expression="x")
expression_6 = Expression(x="kBtu/a", y=panel, Expression="x")
expression_7 = Expression(x="ft³", y=panel_2, Expression="x")
expression_8 = Expression(x="MtCO₂e", y=panel_3, Expression="x")
null = NullItem(Item=itemindex)  # -> NullFlags, InvalidFlags, Description
merge_3 = Merge(Data1=expression_5, Data2=expression_6, Data3=expression_7, Data4=expression_8)
filter = StreamFilter(Gate=im_2, Stream0=merge_2, Stream1=merge_3)
item_2 = ListItem(List=filter, Index=itemindex, Wrap=True)
qal = ModelQuality(Name=na_2, Value=value_2, Unit=item_2, Definition=item)  # -> Quality, Valid, Name, Value, Unit, Definition
panel_9 = Panel("Suggestion: Please use a standard name from one of the § lists")
filter_2 = StreamFilter(Gate=null.NullFlags, Stream0=qal.Quality)
ql = Quality(filter_2)
na_3 = Name(na)
ql_2 = ClusterOutput(ql)
concat = Concatenate(
    FragmentF="Error:",
    FragmentE=" QualityNameNotStandard",
    FragmentA="Info: The provided Name (",
    FragmentB=na_3,
    FragmentC=") is not a standard Name",
    FragmentD=panel_9)
log = Text(concat)
filter_3 = StreamFilter(Gate=null.NullFlags, Stream1=log)
log_2 = Text(filter_3)
log_3 = ClusterOutput(log_2)
