# Grasshopper definition tests.gh (Grasshopper 1.0.8)
# Copyright: GNU Lesser General Public License Version 3
# plug-ins: semio

file = ReadFile(File="C:\git\semio\semio\assets\semio\kit_metabolism.json", PerLineParse=False)
kit = DeserializeKit(Text=file)
kit_2 = PassthroughKit(Kit=kit)  # -> Kit, Valid, Guid, Name, Version, Description, Icon, Image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
item = ListItem(List=kit_2.Design, Index=0, Wrap=True)
fil = PassthroughFile(File=kit_2.File)  # -> File, Valid, Guid, Name, Mime, Remote, FolderId, Size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
dsn = PassthroughDesign(Design=item)  # -> Design, Valid, Guid, Name, DesignId, IsAbstract, Folder, Description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
flat = FlattenDesign(Kit=kit, DesignId=dsn.Guid)
passthrough_designdiff = PassthroughDesignDiff(DesignDiff=flat)  # -> DesignDiff, Valid, Guid, Name, DesignId, IsAbstract, Folder, Description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
apply_design_diff = ApplyDesignDiff(Design=dsn.Design, DesignDiff=flat)
pds = PassthroughPiecesDiff(PiecesDiff=passthrough_designdiff.PiecesDiff)  # -> PiecesDiff, Valid, PieceId, PieceDiff, Piece
passthrough_piecediff = PassthroughPieceDiff(PieceDiff=pds.PieceDiff)  # -> PieceDiff, Valid, Guid, Name, Description, TypeId, DesignId, Plane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
dsn_2 = PassthroughDesign(Design=apply_design_diff)  # -> Design, Valid, Guid, Name, DesignId, IsAbstract, Folder, Description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
pds_2 = PassthroughPiecesDiff()  # -> PiecesDiff, Valid, PieceId, PieceDiff, Piece
kit_3 = UpdateKit(Run=False)  # -> Success, Kit, LocalDirectory
pln = Plane(passthrough_piecediff.Plane)
passthrough_filediff = PassthroughFileDiff(FileDiff=pds.PieceDiff)  # -> FileDiff, Valid, Guid, Name, Remote, FolderId, Size, Hash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
passthrough_filediff_2 = PassthroughFileDiff()  # -> FileDiff, Valid, Guid, Name, Remote, FolderId, Size, Hash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
pce = PassthroughPiece(Piece=dsn_2.Piece)  # -> Piece, Valid, Guid, Name, Description, TypeId, DesignId, Plane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
passthrough_piecediff_2 = PassthroughPieceDiff()  # -> PieceDiff, Valid, Guid, Name, Description, TypeId, DesignId, Plane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
pln_2 = Plane(pce.Plane)
