# Grasshopper definition CapsuleTest.gh (Grasshopper 1.0.7)
# plug-ins: Semio, Swiftlet

panel = Panel("C:\Git\Studium\PhD\semio\tests\elements\Capsule_Simple.gh")
list = ValueList({"Back", "Side"}, selected="Back")
parameter = ConstructParameter(Name="Entrance", Value=list)
parameter_2 = ConstructParameter(Name="Gap", Value=Slider(0, range=0..50))
cluster = Cluster(
    X=Slider(0, range=-1000..1000),
    Y=Slider(-300, range=-1000..1000),
    Z=Slider(0, range=-1000..1000),
    yaw=Slider(165, range=-360..360),
    pitch=Slider(-17, range=-360..360),
    roll=Slider(150, range=-360..360))
cluster_2 = Cluster(
    X=Slider(-91, range=-1000..1000),
    Y=Slider(-319, range=-1000..1000),
    Z=Slider(50, range=-1000..1000),
    yaw=Slider(16, range=-360..360),
    pitch=Slider(-102, range=-360..360),
    roll=Slider(-43, range=-360..360))
plan = ConstructPlan(Url=panel, Parameters=parameter)  # -> Plan, Hash
sobject = ConstructSobject(Plan=panel)
panel_2 = Panel("Door")
layout = ConstructLayout(Sobjects=sobject)
sobject_2 = ConstructSobject(Pose=cluster, Plan=plan.Plan)
sobject_3 = ConstructSobject(Pose=cluster_2)
link = ConstructLink()
fjs = FormatJsonString(JSONString=layout)
panel_3 = Panel(fjs)
connection = ConstructConnection(Connecting=sobject, Connected=sobject_2)
connectable = ConstructConnectable(Sobject=sobject_3, Link=link)
layout_2 = ConstructLayout(Sobjects=[sobject, sobject_2], Connections=connection)
connection_2 = ConstructConnection()
cluster_3 = Cluster(
    X=Slider(-91, range=-1000..1000),
    Y=Slider(-319, range=-1000..1000),
    Z=Slider(50, range=-1000..1000),
    yaw=Slider(16, range=-360..360),
    pitch=Slider(-102, range=-360..360),
    roll=Slider(-43, range=-360..360))
plan_2 = ConstructPlan(Url=panel)  # -> Plan, Hash
layout_design = LayoutDesign(Url="http://localhost:2999", Layout=layout, Run=Toggle(False))
layout_design_2 = LayoutDesign(Url="http://localhost:2999", Layout=layout_2, Run=Toggle(False))
sobject_4 = ConstructSobject(Pose=cluster_3, Plan=plan_2.Plan)
link_2 = ConstructLink()
connectable_2 = ConstructConnectable(Sobject=sobject_4, Link=link_2)
assembly = ConstructAssembly(Sobject=sobject)
assembly_2 = ConstructAssembly(Sobject=sobject_2, Parts=assembly)

# ==== cluster Cluster
X = ClusterInput()
Y = ClusterInput()
Z = ClusterInput()
yaw = ClusterInput()
pitch = ClusterInput()
roll = ClusterInput()
yawpitchroll = NAME(yaw=yaw, pitch=pitch, roll=roll)  # -> t
# ---------- yawpitchroll: Python ----------
from Rhino.Geometry import Transform
from math import radians

t = Transform.RotationZYX(radians(yaw),radians(pitch),radians(roll))
# ---------- end yawpitchroll ----------
pt = ConstructPoint(XCoordinate=X, YCoordinate=Y, ZCoordinate=Z)
xy = XYPlane(Origin=Point(0, 0, 0))
transform = Transform(Geometry=xy, Transform=yawpitchroll)
pl_origin = PlaneOrigin(Base=transform, Origin=pt)
pln = Plane(pl_origin)
pln_2 = ClusterOutput(pln)
